# Grasshopper definition FacadeEmbed.gh (Grasshopper 1.0.7)
# plug-ins: EleFront, Wombat

# ---- group: 钢结构预埋
crv = Curve([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])

# ---- group: 板槽
inblock = InsertBlock(BlockName="xxx", SourcePlane=PlaneXY(0, 0, 0))

# ----
# 单体选型
list = ValueList({"板埋": 0, "槽埋": 1, "板槽埋": 2}, selected="板埋")
list_2 = ValueList({"顶埋": 0, "侧埋": 1}, selected="顶埋")

# ---- group: 结构线
crv_2 = Curve(<curve referenced from the Rhino model>)

# ----
# 平面定位INPUT
crv_3 = Curve([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])

# ---- group: 玻璃线
玻璃线 = Curve(<curve referenced from the Rhino model>)
玻璃线_2 = Curve(<curve referenced from the Rhino model>)
玻璃线_3 = Curve(<curve referenced from the Rhino model>)

# ---- group: 定位竖料
crv_4 = Curve([<curve referenced from the Rhino model> x300])
crv_5 = Curve([<curve referenced from the Rhino model> x180])
crv_6 = Curve([<curve referenced from the Rhino model> x383])

# ----
panel = Panel(list)
panel_2 = Panel(list_2)

# ---- group: 混凝土
# 板埋几何INPUT
list_3 = ValueList({"C15": 0, "C20": 1, "C25": 2, "C30": 3, "C35": 4, "C40": 5}, selected="C35")

# ---- group: 钢筋牌号
list_4 = ValueList({"HPB300": 0, "HRB400": 1}, selected="HPB300")

# ---- group: 直径
list_5 = ValueList({"10": 0, "12": 1, "16": 2, "18": 3, "20": 4, "25": 5}, selected="12")

# ---- group: 列
list_6 = ValueList({"2X": 0, "3X": 1, "4X": 2}, selected="3X")

# ---- group: 行
list_7 = ValueList({"2Y": 0, "3Y": 1, "4Y": 2}, selected="2Y")

# ---- group: 锚筋间距
s_x = Slider(22, range=14..60, expression="X*5")
s_y = Slider(22, range=14..60, expression="X*5")

# ----
join = JoinCurves(Curves=crv_6, Preserve=False)
flip = FlipCurve(Curve=玻璃线_3)  # -> Curve, Flag
boundary = BoundarySurfaces(Edges=join)
filter = StreamFilter(Gate=Toggle(True), Stream0=玻璃线_3, Stream1=flip.Curve)
sunion = SolidUnion(Breps=boundary)
offset = OffsetCurve(Curve=filter, Distance=expr("-x", Slider(375, range=0..1000)), Corners=1)
area = Area(Geometry=sunion)  # -> Area, Centroid
pt = Point(area.Centroid)
explode = Explode(Curve=offset, Recursive=True)  # -> Segments, Vertices

# ---- group: 钢结构预埋
# 随文件数据请勿覆盖
crv_7 = Curve([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])

# ---- group: 槽埋3D
brep = Brep(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)

# ----
pt_2 = Point(explode.Vertices)
entwine = Entwine(Branch00=sunion, Branch01=pt, FlattenInputs=True)
max = Maximum(A=s_x, B=s_y)
flip_2 = FlipMatrix(Data=entwine)
filter_2 = StreamFilter(Gate=list_3, Stream0=7.2, Stream1=9.6, Stream2=11.9, Stream3=14.3, Stream4=16.7, Stream5=19.1)
filter_3 = StreamFilter(Gate=list_4, Stream0=270, Stream1=360)
filter_4 = StreamFilter(Gate=list_5, Stream0=10, Stream1=12, Stream2=16, Stream3=18, Stream4=20, Stream5=25)
filter_5 = StreamFilter(Gate=list_3, Stream0=0.91, Stream1=1.1, Stream2=1.27, Stream3=1.43, Stream4=1.57, Stream5=1.71)
filter_6 = StreamFilter(Gate=list_4, Stream0=0.16, Stream1=0.14)
addition = Addition(A=list_6, B=1)
addition_2 = Addition(A=list_7, B=1)
division = Division(A=max, B=8)

# ---- group: 建筑定位轮廓
item = ListItem(List=flip_2, Index="0", Wrap=True)  # -> flatten(Item)

# ---- group: 埋件定位点
item_2 = ListItem(List=flip_2, Index="-1", Wrap=True)  # -> flatten(Item)

# ----
t = Integer(division)
panel_3 = Panel(filter_5)
panel_4 = Panel(filter_2)
panel_5 = Panel(filter_6)
min = Minimum(A=filter_3, B=300)
brep_2 = Brep(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)
panel_6 = Panel(min)
expression = Expression(A=filter_6, fy=filter_3, ft=filter_5, d=filter_4, Expression="(int((0.6*1.1*A*fy/ft*d)/5)+1)*5")

# ---- group: 槽埋
# 槽埋Modeling
brep_3 = Brep(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)
brep_4 = Brep(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)
bbox = BoundingBox(Content=brep_3, Plane=PlaneXY(0, 0, 0))  # -> Box, Box_2
debox = DeconstructBox(Box=bbox.Box)  # -> Plane, X, Y, Z
area_2 = Area(Geometry=brep_3)  # -> Area, Centroid
pdecon = Deconstruct(Point=area_2.Centroid)  # -> XComponent, YComponent, ZComponent
dedomain = DeconstructDomain(Domain=debox.Z)  # -> Start, End
xy = XYPlane(Origin=Point(0, 0, 0))
pt_3 = ConstructPoint(XCoordinate=pdecon.XComponent, YCoordinate=pdecon.YComponent, ZCoordinate=dedomain.End)
pl_origin = PlaneOrigin(Base=xy, Origin=pt_3)
xy_2 = XYPlane(Origin=Point(0, 0, 0))
orient = Orient(Geometry=brep_3, Source=pl_origin, Target=xy_2)  # -> Geometry, Transform

# ----
edges = BrepEdges(Brep=bbox.Box)  # -> Naked, Interior, NonManifold
item_3 = ListItem(List=edges.Interior, Index="5", Wrap=True)
item_4 = ListItem(List=edges.Interior, Index="4", Wrap=True)
clx = CurveLine(Curve=item_4, Line=item_3)  # -> Points, Params, Count
Y = UnitY(Factor=item_3)
rotate = Rotate(Geometry=brep_3, Angle=1.570796327, Plane=clx.Points)  # -> Geometry, Transform
move = Move(Geometry=rotate.Geometry, Motion=Y)  # -> Geometry, Transform
merge = Merge(Data1=brep_3, Data2=move.Geometry)  # -> flatten(Result)
sunion_2 = SolidUnion(Breps=merge)
bbox_2 = BoundingBox(Content=sunion_2, Plane=PlaneXY(0, 0, 0))  # -> Box, Box_2
area_3 = Area(Geometry=sunion_2)  # -> Area, Centroid
debox_2 = DeconstructBox(Box=bbox_2.Box)  # -> Plane, X, Y, Z
pdecon_2 = Deconstruct(Point=area_3.Centroid)  # -> XComponent, YComponent, ZComponent
dedomain_2 = DeconstructDomain(Domain=debox_2.Z)  # -> Start, End
pt_4 = ConstructPoint(XCoordinate=pdecon_2.XComponent, YCoordinate=pdecon_2.YComponent, ZCoordinate=dedomain_2.End)
xy_3 = XYPlane(Origin=Point(0, 0, 0))
pl_origin_2 = PlaneOrigin(Base=xy_3, Origin=pt_4)
xy_4 = XYPlane(Origin=Point(0, 0, 0))
orient_2 = Orient(Geometry=sunion_2, Source=pl_origin_2, Target=xy_4)  # -> Geometry, Transform

list_8 = ValueList({"槽埋角部-L形": 0, "槽埋角部-I形": 1}, selected="槽埋角部-L形")
panel_7 = Panel(list_8)
filter_7 = StreamFilter(Gate=list_8, Stream0=orient_2.Geometry, Stream1=orient.Geometry)
entwine_2 = Entwine(Branch00=orient.Geometry, Branch01=filter_7, FlattenInputs=True)
crv_8 = Curve(offset)

# ---- group: 阴阳角区分
cp = ClosestPoint(Point=pt_2, Cloud=item_2)  # -> ClosestPoint, CPIndex, Distance
item_5 = ListItem(List=item_2, Index=cp.CPIndex, Wrap=True)
crv_cp = CurveClosestPoint(Point=item_5, Curve=offset)  # -> Point, Parameter, Distance
eval = EvaluateCurve(Curve=offset, Parameter=crv_cp.Parameter)  # -> Point, Tangent, Angle

# ----
# 板埋Modeling
multiplication = Multiplication(A=s_x, B=addition)
multiplication_2 = Multiplication(A=s_y, B=addition_2)
recgrid = Rectangular(Plane=PlaneXY(0, 0, 0), SizeX=s_x, SizeY=s_y, ExtentX=addition, ExtentY=addition_2)  # -> Cells, Points
直径 = Text(filter_4)
division_2 = Division(A=multiplication, B=2)
division_3 = Division(A=multiplication_2, B=2)
vec = VectorXYZ(XComponent=expr("-x", division_2), YComponent=expr("-x", division_3), ZComponent=0)  # -> Vector, Length
move_2 = Move(Geometry=recgrid.Points, Motion=vec.Vector)  # -> Geometry, Transform
division_4 = Division(A=直径, B=2)
cyl = Cylinder(Base=move_2.Geometry, Radius=division_4, Length=expr("-x", expression))
X = UnitX(Factor=直径)
multiplication_3 = Multiplication(A=直径, B=6)
edges_2 = BrepEdges(Brep=cyl)  # -> Naked, Interior, NonManifold
item_6 = ListItem(List=edges_2.Naked, Index=0, Wrap=True)
max_2 = Maximum(A=multiplication_3, B=70)
move_3 = Move(Geometry=item_6, Motion=X)  # -> Geometry, Transform
multiplication_4 = Multiplication(A=max_2, B=2)
addition_3 = Addition(A=multiplication, B=multiplication_4)
addition_4 = Addition(A=multiplication_2, B=multiplication_4)
division_5 = Division(A=t, B=2)
expression_2 = Expression(x=addition_4, Expression="Ceiling(x/10)*10/2")
expression_3 = Expression(x=addition_3, Expression="Ceiling(x/10)*10/2")
round = Round(Number=division_5)  # -> Nearest, Floor, Ceiling
multiplication_5 = Multiplication(A=round.Ceiling, B=2)
dom = ConstructDomain(DomainStart=expr("-x", expression_2), DomainEnd=expression_2)
dom_2 = ConstructDomain(DomainStart=expr("-x", expression_3), DomainEnd=expression_3)
box = DomainBox(Base=PlaneXY(0, 0, 0), X=dom_2, Y=dom, Z=multiplication_5)
Z = UnitZ(Factor=expr("-x", multiplication_5))
move_4 = Move(Geometry=box, Motion=Z)  # -> Geometry, Transform
Z_2 = UnitZ(Factor=expr("-x", multiplication_5))

multiplication_6 = Multiplication(A=直径, B=5)

Z_3 = UnitZ(Factor=multiplication_6)
extr = Extrude(Base=move_3.Geometry, Direction=Z_3)
cap = CapHoles(Brep=[extr, cyl])
merge_2 = Merge(Data1=cap, Data2=box)
flatten = FlattenTree(Tree=merge_2, Path="{0}")
move_5 = Move(Geometry=flatten, Motion=Z_2)  # -> Geometry, Transform

box_2 = DomainBox(Base=PlaneXY(0, 0, 0), X=dom_2, Y=dom_2, Z=multiplication_5)
merge_3 = Merge(Data1=cap, Data2=box_2)
flatten_2 = FlattenTree(Tree=merge_3, Path="{0}")
move_6 = Move(Geometry=flatten_2, Motion=Z_2)  # -> Geometry, Transform
entwine_3 = Entwine(Branch00=move_5.Geometry, Branch01=move_6.Geometry, FlattenInputs=True)

# ---- group: 选单体
板埋or槽埋or板槽埋 = StreamFilter(Gate=list, Stream0=entwine_3, Stream1=entwine_2)

# ----
# 三视图
# hidden lines of top+pers view
# move to center
# 如果无法完整的生成埋件的三视图，
# 建议选择埋件的3D在Rhino中将
# Top/Perspective/Front/Right 试图缩放至合适大小后重新运行
panel_8 = Panel("""Top
Perspective
Front
Right""")
m2d_rhino = Make2DRhinoView(Name=panel_8, Clip=True)
make2d = Make2D(Geometry=板埋or槽埋or板槽埋, View=m2d_rhino, TangentEdges=False, TangentSeams=False, AutoComputeMake2D=False)  # -> VisibleCurves, VisibleIndex, VisibleType, HiddenCurves, HiddenIndex, HiddenType
bang = ExplodeTree(Data=make2d.VisibleCurves)  # -> Branch0, Branch1, Branch2, Branch3, Branch4, Branch5, Branch6, Branch7
bang_2 = ExplodeTree(Data=make2d.VisibleCurves)  # -> Branch0, Branch1, Branch2, Branch3, Branch4, Branch5, Branch6, Branch7
divdist = DivideDistance(Curve=make2d.HiddenCurves, Distance=Slider(1, range=0..10))  # -> Points, Tangents, Parameters
graft = GraftTree(Tree=make2d.HiddenCurves, IncludeEmptyLists=True, IncludeNullItems=True)
shatter = Shatter(Curve=graft, Parameters=divdist.Parameters)
dispatch = Dispatch(List=shatter, DispatchPattern=[True, False])  # -> ListA, ListB
crv_9 = Curve(dispatch.ListA)
pshift = ShiftPaths(Data=crv_9, Offset=-1)
pshift_2 = ShiftPaths(Data=pshift, Offset=-1)
bang_3 = ExplodeTree(Data=pshift_2)  # -> Branch0, Branch1, Branch2, Branch3, Branch4, Branch5, Branch6, Branch7
bang_4 = ExplodeTree(Data=pshift_2)  # -> Branch0, Branch1, Branch2, Branch3, Branch4, Branch5, Branch6, Branch7
entwine_4 = Entwine(Branch00=bang_4.Branch4, Branch01=bang_2.Branch4, FlattenInputs=True)  # -> flatten(Result)
entwine_5 = Entwine(Branch00=bang_4.Branch5, Branch01=bang_2.Branch5, FlattenInputs=True)  # -> flatten(Result)
entwine_6 = Entwine(Branch00=bang_3.Branch0, Branch01=bang.Branch0, FlattenInputs=True)  # -> flatten(Result)
entwine_7 = Entwine(Branch00=bang_3.Branch1, Branch01=bang.Branch1, FlattenInputs=True)  # -> flatten(Result)
entwine_8 = Entwine(Branch00=entwine_6, Branch01=entwine_7, Branch02=bang.Branch2, Branch03=bang.Branch3, FlattenInputs=True)
entwine_9 = Entwine(Branch00=entwine_4, Branch01=entwine_5, Branch02=bang_2.Branch6, Branch03=bang_2.Branch7, FlattenInputs=True)
group = Group(Objects=entwine_8)
group_2 = Group(Objects=entwine_9)
entwine_10 = Entwine(Branch00=group, Branch01=group_2, FlattenInputs=True)
pshift_3 = ShiftPaths(Data=entwine_10, Offset=-1)
pshift_4 = ShiftPaths(Data=entwine_10, Offset=-1)
number_slider = Slider(2, range=0..10)
# Rhino 文件中导入的块名
boxprop = BoxProperties(Box=pshift_3)  # -> Center, Diagonal, Area, Volume, Degeneracy
pt_5 = Point(Point(957.9296072, 367.7685097, 0))
pt_6 = Point("0,0,0")
recgrid_2 = Rectangular(
    Plane=pt_5,
    SizeX=Slider(12, range=1..20, expression="X*50"),
    SizeY=Slider(10, range=1..20, expression="X*50"),
    ExtentX=number_slider,
    ExtentY=number_slider)  # -> Cells, Points
vec2pt = Vector2Pt(PointA=boxprop.Center, PointB=pt_6, Unitize=False)  # -> Vector, Length
flatten_3 = FlattenTree(Tree=recgrid_2.Points, Path="{0}")
move_7 = Move(Geometry=pshift_4, Motion=vec2pt.Vector)  # -> flatten(Geometry), Transform
orient_3 = Orient(Geometry=flatten(move_7.Geometry), Source=PlaneXY(0, 0, 0), Target=flatten_3)  # -> Geometry, Transform
cull_i = CullIndex(List=orient_3.Geometry, Indices="-1", Wrap=True)
split = SplitList(List=cull_i, Index="4")  # -> ListA, ListB
data = Data(split.ListA)
data_2 = Data(split.ListB)
entwine_11 = Entwine(Branch00=data, Branch01=data_2, FlattenInputs=True)
geo = Geometry(entwine_11)

# ---- group: 单体定Top/Side
item_7 = ListItem(List=geo, Index=2, Wrap=True)
item_8 = ListItem(List=geo, Index=Slider(0, range=0..10), Wrap=True)
cluster = Cluster(G=item_8)
cluster_2 = Cluster(G=item_7)

# ---- group: 单体定Top/Side / Top/Side
filter_8 = StreamFilter(Gate=list_2, Stream0=cluster, Stream1=cluster_2)

# ---- group: 单体定Top/Side / Monomer + Top/Side
filter_9 = StreamFilter(Gate=list, Stream0=filter_8, Stream1=filter_8)  # -> flatten(Stream)

# ---- group: Block
# 自定义块所在图层
# 自定义块所在图层颜色
# 自定义块名称
panel_9 = Panel("Embeded::Embeded")
layer = DefineLayer(Name=panel_9, Color=ColourSwatch(SwatchColor=RGB(255, 0, 0)))
attributes = DefineObjectAttributes(Layer=layer)
block = DefineBlock(Geometry=filter_8, Attributes=attributes, BlockName="Steel Plate", BasePlane=PlaneXY(0, 0, 0))

# ---- group: 正常+阳角+阴角区分
cull_i_2 = CullIndex(List=item_2, Indices=cp.CPIndex, Wrap=True)
crv_10 = Curve(offset)
crv_11 = Curve(flip.Curve)
explode_2 = Explode(Curve=crv_10, Recursive=True)  # -> Segments, Vertices
explode_3 = Explode(Curve=crv_11, Recursive=True)  # -> Segments, Vertices

# ---- group: 阴角定位-细化
item_9 = ListItem(List=item, Index=cp.CPIndex, Wrap=True)

# ---- group: 阴角
# 阴角埋件布置
explode_4 = Explode(Curve=crv_8, Recursive=True)  # -> Segments, Vertices

# ----
# 阳角埋件布置
number_slider_2 = Slider(150, range=0..1000)
explode_5 = Explode(Curve=crv_8, Recursive=True)  # -> Segments, Vertices
item_10 = ListItem(List=filter_9, Index="1", Wrap=True)
bbox_3 = BoundingBox(Content=graft(item_10), Plane=PlaneXY(0, 0, 0))  # -> Box, Box_2
srf = Surface(bbox_3.Box)
explode_6 = Explode(Curve=srf, Recursive=True)  # -> Segments, Vertices
item_11 = ListItem(List=explode_6.Vertices, Index=0, Wrap=True)  # -> Item, Item1, Item2
ln = Line(StartPoint=graft(item_11.Item1), EndPoint=graft(item_11.Item2))
ln_2 = Line(StartPoint=graft(item_11.Item1), EndPoint=graft(item_11.Item))
ln_3 = Line(StartPoint=graft(item_11.Item1), EndPoint=graft(item_11.Item))
ln_4 = Line(StartPoint=graft(item_11.Item1), EndPoint=graft(item_11.Item2))
pl = ConstructPlane(Origin=item_11.Item1, XAxis=ln_4, YAxis=ln_3)
pl_2 = ConstructPlane(Origin=item_11.Item1, XAxis=ln_2, YAxis=ln)

# ---- group: 大面
# 大面埋件布置
number_slider_3 = Slider(0.002, range=0..0.01)
filter_10 = StreamFilter(Gate=list_2, Stream0=expression_2, Stream1=number_slider_3)
filter_11 = StreamFilter(Gate=list, Stream0=filter_10, Stream1=expression_2)
offset_2 = OffsetCurve(Curve=offset, Distance=expr("-x", filter_11), Plane=PlaneXY(0, 0, 0), Corners=1)

# ---- group: 阴阳角区分 (continued)
crv_cp_2 = CurveClosestPoint(Point=item_5, Curve=offset_2)  # -> Point, Parameter, Distance
vec2pt_2 = Vector2Pt(PointA=crv_cp_2.Point, PointB=crv_cp.Point, Unitize=False)  # -> expr("-x", Vector), Length
angle = Angle(VectorA=eval.Tangent, VectorB=vec2pt_2.Vector)  # -> Angle, Reflex
deg = Degrees(Radians=angle.Angle)
smaller = SmallerThan(FirstNumber=deg, SecondNumber=89)  # -> SmallerThan, OrEqualTo
dispatch_2 = Dispatch(List=item_5, DispatchPattern=smaller.SmallerThan)  # -> ListA, ListB

# ---- group: 正常+阳角+阴角区分 (continued)
data_3 = Data(dispatch_2.ListA)
data_4 = Data(dispatch_2.ListB)
pull = PullPoint(Point=data_3, Geometry=crv_10, ClosestOnly=True)  # -> ClosestPoint, Distance
pull_2 = PullPoint(Point=data_4, Geometry=crv_11, ClosestOnly=True)  # -> ClosestPoint, Distance
c_script = CSharpScript(archPoint=pull.ClosestPoint, crvPoint=explode_2.Vertices)  # -> out, specialPt; inputs archPoint: list of Point3d, crvPoint: list of Point3d
# ---------- c_script: C# ----------
    List<int> passIndex = new List<int>();

    for(int i = 0; i < archPoint.Count; i++){
      foreach(Point3d t in crvPoint){
        if(archPoint[i].X == t.X && archPoint[i].Y == t.Y && archPoint[i].Z == t.Z){
          Print("pass");
          passIndex.Add(i);}
      }
    }

    specialPt = passIndex;
# ---------- end c_script ----------
c_script_2 = CSharpScript(archPoint=pull_2.ClosestPoint, crvPoint=explode_3.Vertices)  # -> out, specialPt; inputs archPoint: list of Point3d, crvPoint: list of Point3d; same code as c_script
cull_i_3 = CullIndex(List=data_3, Indices=c_script.specialPt, Wrap=True)

# ---- group: 阴角定位-细化 (continued)
dispatch_3 = Dispatch(List=item_9, DispatchPattern=smaller.SmallerThan)  # -> ListA, ListB
item_12 = ListItem(List=dispatch_3.ListB, Index=c_script_2.specialPt, Wrap=True)
join_2 = JoinCurves(Curves=item_12, Preserve=False)
explode_7 = Explode(Curve=join_2, Recursive=True)  # -> Segments, Vertices
crv_12 = Curve(simplify(explode_7.Segments))
len = Length(Curve=crv_12)
sort = SortList(Keys=len, ValuesA=crv_12)  # -> Keys, ValuesA
item_13 = ListItem(List=sort.ValuesA, Index=0, Wrap=True)  # -> Item2, Item1, Item
crv_13 = Curve([item_13.Item2, item_13.Item1])
disc = Discontinuity(Curve=crv_13, Level=1)  # -> Points, Parameters
item_14 = ListItem(List=disc.Points, Index=0, Wrap=True)
pull_3 = PullPoint(Point=disc.Points, Geometry=pt_2, ClosestOnly=True)  # -> ClosestPoint, Distance
crv_cp_3 = CurveClosestPoint(Point=disc.Points, Curve=offset)  # -> Point, Parameter, Distance
sort_2 = SortList(Keys=pull_3.Distance, ValuesA=crv_cp_3.Point)  # -> Keys, ValuesA

# ---- group: 正常+阳角+阴角区分 / 正常-遗漏
cull_i_4 = CullIndex(List=data_4, Indices=c_script_2.specialPt, Wrap=True)

# ---- group: 正常+阳角+阴角区分 / 阴角定位点
item_15 = ListItem(List=data_4, Index=c_script_2.specialPt, Wrap=True)

# ---- group: 正常+阳角+阴角区分 / 正常定位点
merge_4 = Merge(Data1=cull_i_2, Data2=cull_i_4, Data3=cull_i_3)

# ---- group: 正常+阳角+阴角区分 / 阳角定位点
item_16 = ListItem(List=data_3, Index=c_script.specialPt, Wrap=True)

# ---- group: 阴角定位-细化 / 阴角-2点定位
item_17 = ListItem(List=sort_2.ValuesA, Index=0, Wrap=True)

# ----
pt_7 = Point(item_16)
cp_2 = ClosestPoint(Point=pt_7, Cloud=explode_5.Vertices)  # -> ClosestPoint, CPIndex, Distance
cir = Circle(Plane=cp_2.ClosestPoint, Radius=number_slider_2)
pt_8 = Point(cp_2.ClosestPoint)
ccx = CurveCurve(CurveA=cir, CurveB=offset)  # -> Points, ParamsA, ParamsB
item_18 = ListItem(List=ccx.Points, Index=0, Wrap=True)  # -> Item, Item1
ln_5 = Line(StartPoint=graft(pt_8), EndPoint=graft(item_18.Item))  # -> flatten(Line)
ln_6 = Line(StartPoint=graft(pt_8), EndPoint=graft(item_18.Item1))  # -> flatten(Line)
pl_3 = ConstructPlane(Origin=pt_8, XAxis=ln_5, YAxis=ln_6)
orient_4 = Orient(Geometry=item_10, Source=pl_2, Target=pl_3)  # -> Geometry, Transform
orient_5 = Orient(Geometry=item_10, Source=pl, Target=pl_3)  # -> Geometry, Transform
merge_5 = Merge(Data1=orient_4.Geometry, Data2=orient_5.Geometry)
filter_12 = StreamFilter(Gate=list_2, Stream0=orient_4.Geometry, Stream1=merge_5)
bbox_4 = BoundingBox(Content=filter_12, Plane=PlaneXY(0, 0, 0))  # -> Box, Box_2
entwine_12 = Entwine(Branch00=filter_12, Branch01=bbox_4.Box, FlattenInputs=True)
flip_3 = FlipMatrix(Data=entwine_12)
item_19 = ListItem(List=flip_3, Index=-1, Wrap=True)  # -> flatten(Item)
item_20 = ListItem(List=flip_3, Index="0", Wrap=True)  # -> flatten(Item)

# ---- group: 阴角 (continued)
cp_3 = ClosestPoint(Point=item_15, Cloud=explode_4.Vertices)  # -> ClosestPoint, CPIndex, Distance
pshift_5 = ShiftPaths(Data=item_17, Offset=-1)
crv_cp_4 = CurveClosestPoint(Point=pshift_5, Curve=offset_2)  # -> Point, Parameter, Distance
crv_cp_5 = CurveClosestPoint(Point=pshift_5, Curve=offset)  # -> Point, Parameter, Distance
vec2pt_3 = Vector2Pt(PointA=crv_cp_4.Point, PointB=crv_cp_5.Point, Unitize=False)  # -> expr("-x", Vector), Length
eval_2 = EvaluateCurve(Curve=offset, Parameter=crv_cp_5.Parameter)  # -> Point, Tangent, Angle
pl_4 = ConstructPlane(Origin=crv_cp_5.Point, XAxis=eval_2.Tangent, YAxis=vec2pt_3.Vector)
orient_6 = Orient(Geometry=block, Source=PlaneXY(0, 0, 0), Target=pl_4)  # -> Geometry, Transform

# ---- group: 大面 (continued)
crv_cp_6 = CurveClosestPoint(Point=merge_4, Curve=offset_2)  # -> Point, Parameter, Distance
crv_cp_7 = CurveClosestPoint(Point=merge_4, Curve=offset)  # -> Point, Parameter, Distance
vec2pt_4 = Vector2Pt(PointA=crv_cp_6.Point, PointB=crv_cp_7.Point, Unitize=False)  # -> expr("-x", Vector), Length
eval_3 = EvaluateCurve(Curve=offset, Parameter=crv_cp_7.Parameter)  # -> Point, Tangent, Angle
pl_5 = ConstructPlane(Origin=crv_cp_7.Point, XAxis=eval_3.Tangent, YAxis=vec2pt_4.Vector)
orient_7 = Orient(Geometry=block, Source=PlaneXY(0, 0, 0), Target=pl_5)  # -> flatten(Geometry), Transform

# ---- group: Datea / 2
lng = ListLength(List=orient_7.Geometry)
division_6 = Division(A=lng, B=2)
split_2 = SplitList(List=orient_7.Geometry, Index=division_6)  # -> ListA, ListB
data_5 = Data(split_2.ListA)

# ----
bbox_5 = BoundingBox(Content=data_5, Plane=PlaneXY(0, 0, 0))  # -> Box, Box_2
entwine_13 = Entwine(Branch00=data_5, Branch01=bbox_5.Box, FlattenInputs=True)
flip_4 = FlipMatrix(Data=entwine_13)
item_21 = ListItem(List=flip_4, Index=-1, Wrap=True)  # -> flatten(Item)
item_22 = ListItem(List=flip_4, Index="0", Wrap=True)  # -> flatten(Item)

# ---- group: Monomer + Side/Top / Monomer Type
filter_13 = StreamFilter(Gate=list, Stream0=item_19, Stream1=item_19)
filter_14 = StreamFilter(Gate=list, Stream0=item_19, Stream1=item_19)

# ---- group: Monomer + Side/Top / Top/Side
filter_15 = StreamFilter(Gate=list_2, Stream0=filter_13, Stream1=filter_14)

# ----
number_slider_4 = Slider(1, range=1..4)  # disabled
number_slider_5 = Slider(0, range=0..1)  # disabled
debrep = DeconstructBrep(Brep=item_19)  # -> Faces, Edges, Vertices; disabled
ln_7 = Line(StartPoint=pt_8, EndPoint=pt_7)  # disabled
item_23 = ListItem(List=debrep.Edges, Index=number_slider_4, Wrap=True)  # -> flatten(Item); disabled
pframe = PerpFrame(Curve=ln_7, Parameter=number_slider_5)  # disabled
len_2 = Length(Curve=item_23)  # disabled
deplane = DeconstructPlane(Plane=pframe)  # -> Origin, XAxis, YAxis, ZAxis; disabled
toggle = BooleanToggle(True)  # disabled
toggle_2 = BooleanToggle(False)  # disabled
item_24 = ListItem(List=len_2, Index=0, Wrap=True)  # disabled
trigger = Trigger(Interval=20, TimerInterval=20, Target=c_script_3)  # disabled
number_slider_6 = Slider(170, range=170..200)  # disabled
amp = Amplitude(Vector=deplane.YAxis, Amplitude=item_24)  # disabled
c_script_3 = CSharpScript(iReset=toggle_2, Start=toggle)  # -> out, A; inputs iReset: Boolean, Start: Boolean; disabled
# ---------- c_script_3: C# ----------
    if(iReset){
      num = 174;
    }
    if(!iReset){
      if(Start && num < 176){
        num += 0.02;
        B = num;
      }
    }

    A = B;
# ---------- c_script_3: C# additional code ----------
  double num = 174;
  double B = 0;
# ---------- end c_script_3 ----------
move_8 = Move(Geometry=deplane.Origin, Motion=expr("-x", amp))  # -> Geometry, Transform; disabled
move_9 = Move(Geometry=deplane.Origin, Motion=amp)  # -> Geometry, Transform; disabled
panel_10 = Panel(c_script_3.A)  # disabled
amp_2 = Amplitude(Vector=ln_7, Amplitude=c_script_3.A)  # disabled
ln_8 = Line(StartPoint=move_9.Geometry, EndPoint=move_8.Geometry)  # disabled
rev = Reverse(Vector=amp_2)  # disabled
move_10 = Move(Geometry=ln_8, Motion=rev)  # -> Geometry, Transform; disabled
clx_2 = CurveLine(Curve=crv_8, Line=move_10.Geometry)  # -> Points, Params, Count; disabled
mp = Midpoint(Curve=move_10.Geometry)  # disabled
toggle_3 = BooleanToggle(True)  # disabled
pull_4 = PullPoint(Point=clx_2.Points, Geometry=mp, ClosestOnly=True)  # -> ClosestPoint, Distance; disabled
sort_3 = SortList(Keys=pull_4.Distance, ValuesA=clx_2.Points)  # -> Keys, ValuesA; disabled
panel_11 = Panel("{0}")  # disabled
item_25 = ListItem(List=sort_3.ValuesA, Index=0, Wrap=True)  # -> Item, Item1; disabled
ln_9 = Line(StartPoint=item_25.Item, EndPoint=item_25.Item1)  # disabled
len_3 = Length(Curve=flatten(ln_9))  # disabled
end = EndPoints(Curve=ln_9)  # -> flatten(Start), flatten(End); disabled
item_26 = ListItem(List=len_3, Index=0, Wrap=True)  # disabled
num = Number(item_24)  # disabled
c_script_4 = CSharpScript(targetNum=num, checkNum=item_26, lines=ln_9, ptS=end.Start, ptE=end.End, reset=toggle_3)  # -> out, A, simplify(S), simplify(E); inputs targetNum: Double, checkNum: Double, lines: list of Line, ptS: list of Point3d, ptE: list of Point3d, reset: Boolean; disabled
# ---------- c_script_4: C# ----------
    if(reset){
      List<Line> l = new List<Line>();
      List<Point3d> pointS = new List<Point3d>();
      List<Point3d> pointE = new List<Point3d>();
    }
    else{
      if (targetNum <= checkNum && !runOnce){
        l = lines;
        pointS = ptS;
        pointE = ptE;
        runOnce = true;
      }
      A = l;
      S = pointS;
      E = pointE;
    }
# ---------- c_script_4: C# additional code ----------
  List<Line> l = new List<Line>();
  List<Point3d> pointS = new List<Point3d>();
  List<Point3d> pointE = new List<Point3d>();
  bool runOnce = false;
# ---------- end c_script_4 ----------
panel_12 = Panel(c_script_4.S)  # disabled
branch = TreeBranch(Tree=c_script_4.E, Path=panel_11, MaintainPaths=True)  # disabled
branch_2 = TreeBranch(Tree=c_script_4.S, Path=panel_11, MaintainPaths=True)  # disabled
ln_10 = Line(StartPoint=graft(branch_2), EndPoint=graft(branch))  # disabled
number_slider_7 = Slider(3, range=0..3)  # disabled
line = Line(ln_10)  # disabled
len_4 = Length(Curve=line)  # disabled
panel_13 = Panel(len_4)  # disabled
mp_2 = Midpoint(Curve=line)  # disabled
item_27 = ListItem(List=debrep.Edges, Index=number_slider_7, Wrap=True)  # disabled
item_28 = ListItem(List=c_script_4.S, Index=0, Wrap=True)  # disabled
end_2 = EndPoints(Curve=line)  # -> Start, End; disabled
ln_11 = Line(StartPoint=mp_2, EndPoint=end_2.Start)  # disabled
mp_3 = Midpoint(Curve=item_27)
number_slider_8 = Slider(2, range=0..10)  # disabled
end_3 = EndPoints(Curve=item_27)  # -> Start, End; disabled
pull_5 = PullPoint(Point=end_2.Start, Geometry=explode_4.Vertices, ClosestOnly=True)  # -> ClosestPoint, Distance; disabled
ln_12 = Line(StartPoint=mp_3, EndPoint=end_3.Start)
ln_13 = Line(StartPoint=mp_2, EndPoint=pull_5.ClosestPoint)  # disabled
item_29 = ListItem(List=debrep.Edges, Index=number_slider_8, Wrap=True)  # -> flatten(Item); disabled
line_2 = Line(item_29)  # disabled
move_11 = Move(Geometry=flatten(mp_3), Motion=line_2)  # -> Geometry, Transform; disabled
ln_14 = Line(StartPoint=flatten(mp_3), EndPoint=move_11.Geometry)  # -> graft(Line); disabled
pl_6 = ConstructPlane(Origin=mp_2, XAxis=ln_11, YAxis=ln_13)  # disabled
pl_7 = ConstructPlane(Origin=graft(mp_3), XAxis=graft(ln_12), YAxis=graft(ln_14))
orient_8 = Orient(Geometry=graft(item_19), Source=pl_7, Target=pl_6)  # -> Geometry, Transform; disabled
orient_9 = Orient(Geometry=graft(item_19), Source=pl_7, Target=pl_6)  # -> Geometry, Transform; disabled

# ---- group: 正常和阳角 - BoundingBox — 测Intersection
c_script_5 = CSharpScript(BrepMain=item_21, BrepStay=filter_15)  # -> out, BrepInters, BrepRemain, IndexM, IndexS; inputs BrepMain: list of Brep, BrepStay: list of Brep
# ---------- c_script_5: C# ----------
    List<Brep> BrepI = new List<Brep>();
    List<Brep> BrepR = new List<Brep>();
    List<int> num = new List<int>();
    List<int> numS = new List<int>();


    double tolr = Rhino.RhinoDoc.ActiveDoc.ModelAbsoluteTolerance;

    for(int j = 0; j < BrepMain.Count;j++){
      for(int i = 0; i < BrepStay.Count;i++){
        bool test = Rhino.Geometry.Intersect.Intersection.BrepBrep(BrepMain[j], BrepStay[i], tolr, out crv, out pts);
        if(test && crv.Length != 0){
          tryThis = true;
          numS.Add(i);
          break;}
        else{
          tryThis = false;}
      }
      if(tryThis){
        BrepI.Add(BrepMain[j]);
        num.Add(j);
      }
      else{
        BrepR.Add(BrepMain[j]);
      }
    }



    BrepInters = BrepI;
    BrepRemain = BrepR;
    IndexM = num;
    IndexS = numS;
# ---------- c_script_5: C# additional code ----------
  Rhino.Geometry.Curve[] crv;
  Rhino.Geometry.Point3d[] pts;
  bool tryThis;
# ---------- end c_script_5 ----------
item_30 = ListItem(List=item_21, Index=c_script_5.IndexM, Wrap=True)  # -> graft(Item)
item_31 = ListItem(List=filter_15, Index=c_script_5.IndexS, Wrap=True)  # -> graft(Item)
cull_i_5 = CullIndex(List=item_22, Indices=c_script_5.IndexM, Wrap=True)
item_32 = ListItem(List=item_22, Index=c_script_5.IndexM, Wrap=True)  # -> graft(Item)
area_4 = Area(Geometry=item_30)  # -> Area, Centroid
bbx = BrepBrep(BrepA=item_30, BrepB=item_31)  # -> simplify(Curves), Points
area_5 = Area(Geometry=bbx.Curves)  # -> Area, Centroid
ln_15 = Line(StartPoint=area_4.Centroid, EndPoint=area_5.Centroid)
mp_4 = Midpoint(Curve=ln_15)
scale = Scale(Geometry=ln_15, Center=mp_4, Factor=Slider(1000000, range=0..1000000))  # -> Geometry, Transform
ccx_2 = CurveCurve(CurveA=scale.Geometry, CurveB=bbx.Curves)  # -> Points, ParamsA, ParamsB
item_33 = ListItem(List=ccx_2.Points, Index=0, Wrap=True)  # -> Item, Item1
ln_16 = Line(StartPoint=item_33.Item1, EndPoint=item_33.Item)
move_12 = Move(Geometry=item_32, Motion=ln_16)  # -> simplify(Geometry), Transform
entwine_14 = Entwine(Branch00=flip.Curve, Branch01=offset, FlattenInputs=True)
bbox_6 = BoundingBox(Content=move_12.Geometry, Plane=PlaneXY(0, 0, 0))  # -> Box, Box_2
flip_5 = FlipMatrix(Data=entwine_14)
area_6 = Area(Geometry=bbox_6.Box)  # -> Area, Centroid
entwine_15 = Entwine(Branch00=move_12.Geometry, Branch01=area_6.Centroid, FlattenInputs=True)
item_34 = ListItem(List=flip_5, Index=0, Wrap=True)  # -> Item, Item1
flip_6 = FlipMatrix(Data=entwine_15)
item_35 = ListItem(List=flip_6, Index="0", Wrap=True)  # -> flatten(Item)
item_36 = ListItem(List=flip_6, Index="-1", Wrap=True)  # -> flatten(Item)
pull_6 = PullPoint(Point=item_36, Geometry=item_34.Item, ClosestOnly=True)  # -> flatten(ClosestPoint), Distance
pull_7 = PullPoint(Point=item_36, Geometry=item_34.Item1, ClosestOnly=True)  # -> flatten(ClosestPoint), Distance
vec2pt_5 = Vector2Pt(PointA=item_36, PointB=pull_6.ClosestPoint, Unitize=False)  # -> Vector, Length
vec2pt_6 = Vector2Pt(PointA=item_36, PointB=pull_7.ClosestPoint, Unitize=False)  # -> Vector, Length
multiplication_7 = Multiplication(A=vec2pt_5.Vector, B=vec2pt_6.Vector)
larger = LargerThan(FirstNumber=multiplication_7, SecondNumber=0)  # -> LargerThan, OrEqualTo
dispatch_4 = Dispatch(List=item_35, DispatchPattern=larger.LargerThan)  # -> ListA, ListB

# ---- group: 阳角分类
filter_16 = StreamFilter(Gate=list, Stream0=item_20, Stream1=item_20)
filter_17 = StreamFilter(Gate=list, Stream0=item_20, Stream1=item_20)
filter_18 = StreamFilter(Gate=list_2, Stream0=filter_16, Stream1=filter_17)

# ---- group: Normal
geo_2 = Geometry(cull_i_5)

# ----
阳角 = Geometry(filter_18)

# ---- group: Normal-Move
移动 = Geometry(dispatch_4.ListA)

# ----
阴角 = Geometry(orient_6.Geometry)
merge_6 = Merge(Data1=geo_2, Data2=阳角, Data3=移动, Data4=阴角)

# ==== cluster Cluster
G = ClusterInput()
rotate = Rotate(Geometry=G, Angle=3.141592654, Plane=PlaneXY(0, 0, 0))  # -> Geometry, Transform
boxprop = BoxProperties(Box=rotate.Geometry)  # -> Center, Diagonal, Area, Volume, Degeneracy
bbox = BoundingBox(Content=rotate.Geometry, Plane=PlaneXY(0, 0, 0))  # -> Box, Box_2
debox = DeconstructBox(Box=bbox.Box)  # -> Plane, X, Y, Z
pdecon = Deconstruct(Point=boxprop.Center)  # -> XComponent, YComponent, ZComponent
dedomain = DeconstructDomain(Domain=debox.Y)  # -> Start, End
pt = ConstructPoint(XCoordinate=pdecon.XComponent, YCoordinate=dedomain.Start, ZCoordinate=pdecon.ZComponent)
xy = XYPlane(Origin=Point(0, 0, 0))
pl_origin = PlaneOrigin(Base=xy, Origin=pt)
orient = Orient(Geometry=rotate.Geometry, Source=pl_origin, Target=xy)  # -> Geometry, Transform
G_2 = ClusterOutput(orient.Geometry)
