# Grasshopper definition FacadeEmbed_JinQiao_Podium1123.gh (Grasshopper 1.0.7)
# plug-ins: EleFront, treesloth01, Pufferfish, Hare, TT Toolbox

# ---- group: 下层定位点颜色
# (1)  根据颜色自动导入所以埋件定位点的circle
# 下层、上层、檐口处定位点用不同颜色表示
panel = Panel("Magenta")

# ---- group: 上层定位点颜色
panel_2 = Panel("Yellow")

# ---- group: 檐口定位点颜色
panel_3 = Panel("Cyan")

# ---- group: 檐口线-外侧
crv = Curve(<curve referenced from the Rhino model>)

# ---- group: 檐口线-内侧：没有则清空
crv_2 = Curve([<curve referenced from the Rhino model> x2])

# ---- group: 上层-内部幕墙线: 没有则清空
# 导入下层幕墙线
crv_3 = Curve(<curve referenced from the Rhino model>)

# ---- group: 楼板线
# 导入上层楼板线
# 导入上层幕墙线
crv_4 = Curve(<curve referenced from the Rhino model>)

# ---- group: 导入上层单体幕墙线
crv_5 = Curve(<curve referenced from the Rhino model>)

# ---- group: 导入下层单体幕墙线
crv_6 = Curve(<curve referenced from the Rhino model>)

# ---- group: 导入上层All-外部幕墙线
crv_7 = Curve([<curve referenced from the Rhino model> x3])

# ---- group: 下层All幕墙线
crv_8 = Curve([<curve referenced from the Rhino model> x3])

# ----
# 钢埋板长度（按需设定）
number_slider = Slider(350, range=0..1000)

# ----
# 肋板倒角距离（按需设定）
number_slider_2 = Slider(30, range=0..100)

# ----
# 钢埋板厚度（按需设定）
number_slider_3 = Slider(16, range=0..100)

# ----
# Dimension Style
panel_4 = Panel("图例2-地上$0$XD100$0")

# ---- group: 输入梁编号Texts所在图层
panel_5 = Panel("text-def")

# ----
# 埋件编号tag的Offset - 所有钢埋件
number_slider_4 = Slider(190, range=0..1000)

# ----
# 钢结构截面列表
txt = Text(["GKL4-1\tH 400x250x16x20", "GKL4-2\tH 400x350x12x30", "GKL4-3\tH 400x350x16x35", "GKL5-1\tH 500x200x14x25", "GKL5-2\tH 500x300x14x20", "GKL5a-1\tH 550x250x12x25", "GKL6-1\tH 600x200x12x18", "GKL6-2\tH 600x300x14x20", "GKL6-3\tH 600x350x12x25", "GKL6-4\tH 600x350x16x35", "GKL7-1\tH 700x300x16x25", "GKL7-2\tH 700x350x14x25", "GKL7-3\tH 700x350x14x30", "GKL7-4\tH 700x350x14x35", "GKL8-1\tH 800x300x20x25", "GKL8-2\tH 800x300x20x40", "GKL8-3\tH 800x400x25x30", "GKL8-4\tH 800x400x25x35", "GKL9-1\tH 900x300x20x30", "GKL9-2\tH 900x400x20x40", "GKL9-3\tH 900x500x20x40", "GKL9-4\tH 900x300x20x40", "GKL10-1\tH 1000x500x20x30", "GKL10-2\tH 1000x500x20x40", "GKL10-3\tH 1000x500x20x35", "GKL10-4\tH 1000x600x20x40", "GKL12-1\tH 1200x400x20x50", "GKL12-2\tH 1200x600x25x50", "GL2A-1\tHN 250x125x6x9", "GL3-1\tHN 300x150x6.5x9", "GL3-2\tH 300x100x8x10", "GL3-3\tH 300x200x8x16", "GL3-4\tHW 300x300x10x15", "GL4-1\tHN 400x200x8x13", "GL4-2\tH 400x200x10x16", "GL4-3\tH 400x250x10x20", "GL4-4\tH 400x350x16x35", "GL4a-1\tH 450x200x9x14", "GL5-1\tHN 500x200x10x16", "GL5-2\tH 500x200x10x20", "GL5-3\tH 500x300x14x20", "GL5a-1\tH 550x250x10x25", "GL5a-2\tH 550x300x14x25", "GL6-1\tHN 600x200x11x17", "GL6-2\tH 600x300x12x20", "GL6-3\tH 600x350x12x25", "GL6-4\tH 600x350x16x35", "GL7-1\tHN 700x300x13x24", "GL7-2\tH 700x350x14x30", "GL7-3\tH 700x350x14x35", "GL8-1\tHN 800x300x14x26", "GL8-2\tH 800x300x20x40", "GL9-1\tH 900x300x20x30", "GL9-2\tH 900x400x20x40", "GL10-1\tH 1000x400x20x30", "GL10-2\tH 1000x500x20x30", "GL10-3\tH 1000x500x20x35", "GL10-4\tH 1000x400x20x40", "GL10-5\tH 1000x500x20x40", "GL12-1\tH 1200x400x25x50"])

# ---- group: 导入一条梁中线
# （4）导入梁中线+结构编号，生成对应的钢板焊埋件
crv_9 = Curve(<curve referenced from the Rhino model>)

# ----
# 手动输入埋件Tag
panel_6 = Panel("""1-1
2-2""")

refcol = ReferenceByColor(Color=panel)
area = Area(Geometry=refcol)  # -> Area, Centroid
null = NullItem(Item=area.Area)  # -> NullFlags, InvalidFlags, Description
dispatch = Dispatch(List=refcol, DispatchPattern=null.NullFlags)  # -> ListA, ListB
crv_10 = Curve(dispatch.ListB)

refcol_2 = ReferenceByColor(Color=panel_2)
area_2 = Area(Geometry=refcol_2)  # -> Area, Centroid
null_2 = NullItem(Item=area_2.Area)  # -> NullFlags, InvalidFlags, Description
dispatch_2 = Dispatch(List=refcol_2, DispatchPattern=null_2.NullFlags)  # -> ListA, ListB
crv_11 = Curve(dispatch_2.ListB)

refcol_3 = ReferenceByColor(Color=panel_3)
area_3 = Area(Geometry=refcol_3)  # -> Area, Centroid
null_3 = NullItem(Item=area_3.Area)  # -> NullFlags, InvalidFlags, Description
dispatch_3 = Dispatch(List=refcol_3, DispatchPattern=null_3.NullFlags)  # -> ListA, ListB
crv_12 = Curve(dispatch_3.ListB)

# ----
# （2）导入单体建筑的参考线
clscrv = CloseCurve(Curve=crv, CloseType=0, Bulge=0.5, Tolerance=0)  # -> Closed, R
clscrv_2 = CloseCurve(Curve=crv_6, CloseType=0, Bulge=0.5, Tolerance=0)  # -> Closed, R
clscrv_3 = CloseCurve(Curve=crv_8, CloseType=0, Bulge=0.5, Tolerance=0)  # -> Closed, R
clscrv_4 = CloseCurve(Curve=crv_4, CloseType=0, Bulge=0.5, Tolerance=0)  # -> Closed, R
clscrv_5 = CloseCurve(Curve=crv_5, CloseType=0, Bulge=0.5, Tolerance=0)  # -> Closed, R
clscrv_6 = CloseCurve(Curve=crv_7, CloseType=0, Bulge=0.5, Tolerance=0)  # -> Closed, R
xy = XYPlane(Origin=Point(0, 0, 0))
xy_2 = XYPlane(Origin=Point(0, 0, 0))
xy_3 = XYPlane(Origin=Point(0, 0, 0))
xy_4 = XYPlane(Origin=Point(0, 0, 0))
xy_5 = XYPlane(Origin=Point(0, 0, 0))
project = Project(Geometry=clscrv_2.Closed, Plane=xy_2)  # -> Geometry, Transform
project_2 = Project(Geometry=clscrv_3.Closed, Plane=xy)  # -> Geometry, Transform
project_3 = Project(Geometry=clscrv_4.Closed, Plane=xy_4)  # -> Geometry, Transform
project_4 = Project(Geometry=clscrv_5.Closed, Plane=xy_3)  # -> Geometry, Transform
project_5 = Project(Geometry=clscrv_6.Closed, Plane=xy_5)  # -> Geometry, Transform

# ----
# Embed Layer Color
swatch = ColourSwatch(SwatchColor=RGB(136, 235, 148))

# ----
# （5）导入Default Embed
# 输入
# 
# 1.Embed的结构编号
# 2.Embed的Tag命名
# 需要出图的钢结构编号
panel_7 = Panel("GL3-3H")

# ----
# 导入梁中线+结构编号
# 注意：
# 导入完之后可能要点一下Update确保导入成功
layer = ObjectLayer(Guid=crv_9)  # -> LayerIndex, LayerPathName
reflay = ReferenceByLayer(LayerName=layer.LayerPathName)
reflay_2 = ReferenceByLayer(LayerName=panel_5)

# ----
# 埋件编号tag
panel_8 = Panel("0-0")

# ---- group: 下-阴阳角
data = Data()

# ----
# 导入檐口线
# 注意：如果没有檐口线或没有内测檐口线，一定要确保对应需要导入檐口线curve的区域为空data
xy_6 = XYPlane(Origin=Point(0, 0, 0))
project_6 = Project(Geometry=clscrv.Closed, Plane=xy_6)  # -> Geometry, Transform

clscrv_7 = CloseCurve(Curve=crv_3, CloseType=0, Bulge=0.5, Tolerance=0)  # -> Closed, R

# ---- group: 混凝土
list = ValueList({"C15": 0, "C20": 1, "C25": 2, "C30": 3, "C35": 4, "C40": 5}, selected="C35")

# ---- group: 钢筋牌号
list_2 = ValueList({"HPB300": 0, "HRB400": 1}, selected="HPB300")

# ---- group: 直径
list_3 = ValueList({"10": 0, "12": 1, "16": 2, "18": 3, "20": 4, "25": 5}, selected="12")

# ---- group: 列
list_4 = ValueList({"2X": 0, "3X": 1, "4X": 2}, selected="3X")

# ---- group: 行
# 第二层-阴阳角
# 第二层
# 
# Curves(location point)+ Smooth Curves(architecture line)
list_5 = ValueList({"2Y": 0, "3Y": 1, "4Y": 2}, selected="2Y")

# ---- group: 锚筋间距
s_y = Slider(22, range=14..60, expression="X*5")
s_x = Slider(22, range=14..60, expression="X*5")

# ----
# 第二层-区分阴阳角
# 长
# InsideCurve-阳角
# remove duplicate curves
# 第二层-大面定位
panel_9 = Panel("-175 To 175")

# ----
# 埋件编号tag的Offset
number_slider_5 = Slider(353, range=0..1000)

# ----
# 宽
# InsideCurve-阴角
panel_10 = Panel("-125 To 125")

# ----
# 埋件编号tag
# 板埋几何INPUT
panel_11 = Panel("6-6")

# ----
# (8) 撞到梁交点-Offset
# InsideCurve-大面
# 求内部曲线转折点
# 显示"False"时要选择线段延长
# SmoothCurve-阴角&阳角
# 阳角
# 线段延长长度
# 阴角
# 调换阴阳角设定
number_slider_6 = Slider(450, range=0..1000)

# ----
# （7）生成底埋钢埋件
# 输入
# 
# Embed的Tag命名
# 埋件编号
panel_12 = Panel("5-5")

# ---- group: 参考线起点
number_slider_7 = Slider(0.806, range=0..1)

# ---- group: Dimension Offset Input 2
number_slider_8 = Slider(1000, range=0..1000)

# ---- group: 移除重复位置点-容差
number_slider_9 = Slider(200, range=0..1000)

# ---- group: Dimension Offset Input 1
number_slider_10 = Slider(2000, range=0..10000)

# ---- group: 标注区域-单一轴网
标准范围_符合单一轴网方向 = Curve(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)

# ---- group: 轴网XY2个方向的线
crv_13 = Curve(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)
crv_14 = Curve(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)

# ---- group: 移除重复位置点-容差
number_slider_11 = Slider(200, range=0..1000)

# ---- group: 参考线起点
number_slider_12 = Slider(0.548, range=0..1)

# ---- group: Dimension Offset Input 2
number_slider_13 = Slider(1000, range=0..1000)

# ---- group: Dimension Offset Input 1
number_slider_14 = Slider(2000, range=0..10000)

# ---- group: 标注区域-单一轴网
标准范围_符合单一轴网方向_2 = Curve(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)

# ---- group: 轴网XY2个方向的线
crv_15 = Curve(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)
crv_16 = Curve(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)

# ---- group: 参考线: 符合轴网方向+囊括整个建筑
# (9)Bake Me!!
# 上层图纸-单一区域
crv_17 = Curve(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)

# (9)Bake Me!!
# 下层图纸-单一区域
crv_18 = Curve(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)

# ----
panel_13 = Panel(txt)

xy_7 = XYPlane(Origin=Point(0, 0, 0))
project_7 = Project(Geometry=clscrv_7.Closed, Plane=xy_7)  # -> Geometry, Transform

# ---- group: the Dimension Reference Curve
seam = Seam(Curve=reparameterize(crv_18), Seam=number_slider_7)

# ---- group: The Start Point of the Dimension Reference Curve
eval = EvaluateCurve(Curve=reparameterize(crv_18), Parameter=number_slider_7)  # -> Point, Tangent, Angle

# ---- group: Dimension Style
panel_14 = Panel("图例2-地上$0$XD100$0")

# ---- group: The Start Point of the Dimension Reference Curve
eval_2 = EvaluateCurve(Curve=reparameterize(crv_17), Parameter=number_slider_12)  # -> Point, Tangent, Angle

# ---- group: the Dimension Reference Curve
seam_2 = Seam(Curve=reparameterize(crv_17), Seam=number_slider_12)

# ---- group: Dimension Style
panel_15 = Panel("图例2-地上$0$XD100$0")

# ---- group: Plan B - 根据图层导入 / 定位点的circle
circle = Curve(<curve referenced from the Rhino model>)

# ---- group: Plan B - 根据图层导入
layer_2 = ObjectLayer(Guid=circle)  # -> LayerIndex, LayerPathName

# ---- group: Plan B - 根据图层导入 / Click Me after Input
reflay_3 = ReferenceByLayer(LayerName=layer_2.LayerPathName)

# ----
# 生成Default Embed
cluster = Cluster_3(
    structure_number=panel_7,
    tag_text=panel_8,
    text_offset=number_slider_4,
    embed_color=swatch,
    T=txt,
    A=number_slider,
    A_2=number_slider_3,
    B=number_slider_2,
    dimension_style=panel_4)  # -> R, G_2, R_2
data_2 = Data(flatten(cluster.R_2))
item = ListItem(List=data_2, Index=0, Wrap=True)  # -> Item, Item1
ungroup = Ungroup(Group=item.Item)
item_2 = ListItem(List=ungroup, Index=0, Wrap=True)
bbox = BoundingBox(Content=item_2, Plane=PlaneXY(0, 0, 0))  # -> Box, Box_2
debrep = DeconstructBrep(Brep=bbox.Box)  # -> Faces, Edges, Vertices
len = Length(Curve=debrep.Edges)
sort = SortList(Keys=len, ValuesA=debrep.Edges)  # -> Keys, ValuesA
pln = Plane(item.Item1)
item_3 = ListItem(List=sort.ValuesA, Index=0, Wrap=True)
deplane = DeconstructPlane(Plane=pln)  # -> Origin, XAxis, YAxis, ZAxis
amp = Amplitude(Vector=deplane.YAxis, Amplitude=item_3)
move = Move(Geometry=deplane.Origin, Motion=amp)  # -> Geometry, Transform
move2pt = MoveToPoint(Geometry=pln, PointA=deplane.Origin, PointB=move.Geometry)  # -> Moved, Vector, Transform

# ---- group: All-下-幕墙线
# 生成下层定位平面
crv_19 = Curve(project_2.Geometry)

# ---- group: 上-幕墙线 - 有内部线
merge = Merge(Data1=project_5.Geometry, Data2=project_7.Geometry)

# ---- group: 上-幕墙线 - 无内部线
# 生成上层定位平面
crv_20 = Curve(project_5.Geometry)

# ---- group: 上层局部幕墙线
crv_21 = Curve(project_4.Geometry)

# ---- group: All-檐口线
# 生成檐口定位平面
merge_2 = Merge(Data1=project_6.Geometry, Data2=crv_2)

# ---- group: 筛选阴阳角的点
crv_22 = Curve(merge_2)
disc = Discontinuity(Curve=graft(crv_22), Level=1)  # -> Points, Parameters
crv_cp = CurveClosestPoint(Point=disc.Points, Curve=graft(crv_22))  # -> Point, Parameter, Distance
eval_3 = EvaluateCurve(Curve=graft(crv_22), Parameter=crv_cp.Parameter)  # -> flatten(Point), Tangent, flatten(Angle)
offset = OffsetCurve(Curve=crv_22, Distance=expr("-X", Slider(300, range=0..1000)), Corners=1)
deg = Degrees(Radians=eval_3.Angle)
larger = LargerThan(FirstNumber=deg, SecondNumber=Slider(70, range=0..100))  # -> LargerThan, OrEqualTo
disc_2 = Discontinuity(Curve=offset, Level=1)  # -> flatten(Points), Parameters
dispatch_4 = Dispatch(List=eval_3.Point, DispatchPattern=larger.LargerThan)  # -> ListA, ListB
dispatch_5 = Dispatch(List=deg, DispatchPattern=larger.LargerThan)  # -> ListA, ListB
data_3 = Data(dispatch_4.ListA)
smaller = SmallerThan(FirstNumber=dispatch_5.ListA, SecondNumber=Slider(100, range=0..100))  # -> SmallerThan, OrEqualTo
dispatch_6 = Dispatch(List=data_3, DispatchPattern=smaller.SmallerThan)  # -> ListA, ListB
data_4 = Data(dispatch_6.ListA)
pull = PullPoint(Point=data_4, Geometry=flatten(offset), ClosestOnly=True)  # -> ClosestPoint, Distance
testpoint = TestPoint(archPoint=pull.ClosestPoint, crvPoint=disc_2.Points)  # -> out, specialPt; inputs archPoint: list of Point3d, crvPoint: list of Point3d
# ---------- testpoint: C# ----------
    List<int> passIndex = new List<int>();

    for(int i = 0; i < archPoint.Count; i++){
      foreach(Point3d t in crvPoint){
        if(archPoint[i].X == t.X && archPoint[i].Y == t.Y && archPoint[i].Z == t.Z){
          Print("pass");
          passIndex.Add(i);}
      }
    }

    specialPt = passIndex;
# ---------- end testpoint ----------

crv_23 = Curve(crv_20)
disc_3 = Discontinuity(Curve=graft(crv_23), Level=1)  # -> Points, Parameters
crv_cp_2 = CurveClosestPoint(Point=disc_3.Points, Curve=graft(crv_23))  # -> Point, Parameter, Distance
eval_4 = EvaluateCurve(Curve=graft(crv_23), Parameter=crv_cp_2.Parameter)  # -> flatten(Point), Tangent, flatten(Angle)
deg_2 = Degrees(Radians=eval_4.Angle)
offset_2 = OffsetCurve(Curve=merge, Distance=expr("-X", Slider(300, range=0..1000)), Corners=1)
larger_2 = LargerThan(FirstNumber=deg_2, SecondNumber=Slider(70, range=0..100))  # -> LargerThan, OrEqualTo
dispatch_7 = Dispatch(List=deg_2, DispatchPattern=larger_2.LargerThan)  # -> ListA, ListB
dispatch_8 = Dispatch(List=eval_4.Point, DispatchPattern=larger_2.LargerThan)  # -> ListA, ListB
disc_4 = Discontinuity(Curve=offset_2, Level=1)  # -> flatten(Points), Parameters
data_5 = Data(dispatch_8.ListA)
smaller_2 = SmallerThan(FirstNumber=dispatch_7.ListA, SecondNumber=Slider(100, range=0..100))  # -> SmallerThan, OrEqualTo
dispatch_9 = Dispatch(List=data_5, DispatchPattern=smaller_2.SmallerThan)  # -> ListA, ListB
data_6 = Data(dispatch_9.ListA)
pull_2 = PullPoint(Point=data_6, Geometry=flatten(offset_2), ClosestOnly=True)  # -> ClosestPoint, Distance
testpoint_2 = TestPoint(archPoint=pull_2.ClosestPoint, crvPoint=disc_4.Points)  # -> out, specialPt; inputs archPoint: list of Point3d, crvPoint: list of Point3d; same code as testpoint

disc_5 = Discontinuity(Curve=graft(crv_19), Level=1)  # -> Points, Parameters
crv_cp_3 = CurveClosestPoint(Point=disc_5.Points, Curve=graft(crv_19))  # -> Point, Parameter, Distance
eval_5 = EvaluateCurve(Curve=graft(crv_19), Parameter=crv_cp_3.Parameter)  # -> flatten(Point), Tangent, flatten(Angle)
offset_3 = OffsetCurve(Curve=crv_19, Distance=expr("-X", Slider(300, range=0..1000)), Corners=1)
deg_3 = Degrees(Radians=eval_5.Angle)
disc_6 = Discontinuity(Curve=offset_3, Level=1)  # -> flatten(Points), Parameters
larger_3 = LargerThan(FirstNumber=deg_3, SecondNumber=Slider(70, range=0..100))  # -> LargerThan, OrEqualTo
dispatch_10 = Dispatch(List=eval_5.Point, DispatchPattern=larger_3.LargerThan)  # -> ListA, ListB
dispatch_11 = Dispatch(List=deg_3, DispatchPattern=larger_3.LargerThan)  # -> ListA, ListB
data_7 = Data(dispatch_10.ListA)
smaller_3 = SmallerThan(FirstNumber=dispatch_11.ListA, SecondNumber=Slider(100, range=0..100))  # -> SmallerThan, OrEqualTo
dispatch_12 = Dispatch(List=data_7, DispatchPattern=smaller_3.SmallerThan)  # -> ListA, ListB

# ---- group: default 钢埋件单体
merge_3 = Merge(Data1=item.Item, Data2=move2pt.Moved)

# ---- group: 阴阳角的点
# 阳角
# 阴角
data_8 = Data(dispatch_12.ListA)

# ----
钢埋板长度_2 = Division(A=number_slider, B=2)
neg = Negative(Value=钢埋板长度_2)
dom = ConstructDomain(DomainStart=neg, DomainEnd=钢埋板长度_2)
panel_16 = Panel(dom)

钢埋板厚度_2 = Division(A=number_slider_3, B=2)
neg_2 = Negative(Value=钢埋板厚度_2)
dom_2 = ConstructDomain(DomainStart=neg_2, DomainEnd=钢埋板厚度_2)
panel_17 = Panel(dom_2)

# ----
# 列表文字以空格进行分割
panel_18 = Panel(" ")
split = TextSplit(Text=txt, Separators=panel_18)

# ----
# 钢埋板肋板位置 1/4处
panel_19 = Panel("4")
division = Division(A=number_slider, B=panel_19)

# ---- group: 下层定位点
movetoplane = MoveToPlane(Geometry=crv_10, Plane=PlaneXY(0, 0, 0), Above=True, Below=True)  # -> Geometry, Transform
area_4 = Area(Geometry=movetoplane.Geometry)  # -> Area, Centroid
pt = Point(area_4.Centroid)

# ----
# 编号和截面尺寸分区
panel_20 = Panel("1")
split_2 = SplitList(List=split, Index=panel_20)  # -> flatten(ListA), flatten(ListB)

# ---- group: 筛选阴阳角的点
# 阳角
item_4 = ListItem(List=data_6, Index=testpoint_2.specialPt, Wrap=True)

# 阴角
cull_i = CullIndex(List=data_6, Indices=testpoint_2.specialPt, Wrap=True)

# 阴角
cull_i_2 = CullIndex(List=data_4, Indices=testpoint.specialPt, Wrap=True)

# 阳角
item_5 = ListItem(List=data_4, Index=testpoint.specialPt, Wrap=True)

# ----
movetoplane_2 = MoveToPlane(Geometry=crv_12, Plane=PlaneXY(0, 0, 0), Above=True, Below=True)  # -> Geometry, Transform
area_5 = Area(Geometry=movetoplane_2.Geometry)  # -> Area, Centroid
pt_2 = Point(area_5.Centroid)

# ---- group: 上层定位点
movetoplane_3 = MoveToPlane(Geometry=crv_11, Plane=PlaneXY(0, 0, 0), Above=True, Below=True)  # -> Geometry, Transform
area_6 = Area(Geometry=movetoplane_3.Geometry)  # -> Area, Centroid
pt_3 = Point(area_6.Centroid)

# ---- group: 阴阳角的点
merge_4 = Merge(Data1=item_4, Data2=cull_i)  # -> flatten(Result)

merge_5 = Merge(Data1=item_5, Data2=cull_i_2)  # -> flatten(Result)

# ----
xy_8 = XYPlane(Origin=Point(0, 0, 0))
xy_9 = XYPlane(Origin=Point(0, 0, 0))
xy_10 = XYPlane(Origin=Point(0, 0, 0))

# ----
# 单体选型
list_6 = ValueList({"顶埋": 0, "侧埋": 1}, selected="顶埋")

# ---- group: F2 Arch Outline
crv_24 = Curve(crv_21)

# ---- group: 檐口线Input
crv_25 = Curve(project_6.Geometry)

crv_26 = Curve(project_6.Geometry)

crv_27 = Curve(project_6.Geometry)

# ----
# 选要重塑的线段长度
number_slider_15 = Slider(1200, range=0..10000)

# ----
# 调整重塑线段的平滑度
number_slider_16 = Slider(11, range=0..11)

# ----
# 区分内外梁边线
# 1.根据F2建筑线制作轮廓线
explode = Explode(Curve=crv_24, Recursive=True)  # -> Segments, Vertices
len_2 = Length(Curve=explode.Segments)
sort_2 = SortList(Keys=len_2)  # -> Keys, ValuesA
larger_4 = LargerThan(FirstNumber=len_2, SecondNumber=number_slider_15)  # -> LargerThan, OrEqualTo
panel_21 = Panel(sort_2.Keys)
dispatch_13 = Dispatch(List=explode.Segments, DispatchPattern=larger_4.LargerThan)  # -> ListA, ListB
data_9 = Data(dispatch_13.ListB)
data_10 = Data(dispatch_13.ListA)
join = JoinCurves(Curves=data_9, Preserve=False)
disc_7 = Discontinuity(Curve=join, Level=1)  # -> Points, Parameters
nurbs = NurbsCurve(Vertices=disc_7.Points, Degree=number_slider_16, Periodic=False)  # -> flatten(Curve), Length, Domain
join_2 = JoinCurves(Curves=flatten([data_10, nurbs.Curve]), Preserve=False)
offset_4 = OffsetCurve(Curve=join_2, Distance=Slider(10000, range=0..10000), Corners=1)

# ---- group: F2 Archline - Smoothed
reb = RebuildCurve(Curve=offset_4, Count=Slider(17, range=0..100), Tangents=invert(False))

# ----
# InputCurve
crv_28 = Curve()

# ----
# Curve-框住要分析的建筑单体
# 如果要用自己导入Curve作为分析线，
# 请在InputCurve那里导入curve,
# 然后在上方的选型列表选择Input Curve。
# 
# 如果要用Grasshopper自动生成的Curve,
# 请在上方的选型列表选择Default Curve。
list_7 = ValueList({"Default Curve": 0, "Input Curve": 1}, selected="Default Curve")
filter = StreamFilter(Gate=list_7, Stream0=reb, Stream1=crv_28)

crv_29 = Curve(filter)

# ---- group: 楼板线
crv_30 = Curve(project_3.Geometry)

# ---- group: 檐口线外侧
crv_31 = Curve(project_6.Geometry)

# ---- group: 檐口线内测
crv_32 = Curve(crv_2)

# ----
# 埋件向内探索最远出的梁的距离
number_slider_17 = Slider(500, range=0..10000)

# ----
# 埋件向外探索最远出的梁的距离
number_slider_18 = Slider(0, range=0..10000)

# ---- group: 下层幕墙线
crv_33 = Curve(project.Geometry)

crv_34 = Curve(crv_33)

# ---- group: 下层Arch Line
crv_35 = Curve(crv_34)

# ----
crv_36 = Curve(crv_35)
offset_5 = OffsetCurve(Curve=crv_36, Distance=Slider(350, range=0..1000), Corners=1)
offset_6 = OffsetCurve(Curve=crv_36, Distance=Slider(50, range=0..100), Corners=1)

# ---- group: 下层建筑线
# 4.0下层建筑内侧到300到外侧50内
# 无钢结构
# 要求主体结构提供钢结构梁，默认位置为建筑边线向内300mm
crv_37 = Curve(crv_35)

# ----
# 4.0 -初筛： 下层建筑边线内侧600mm到外侧350内没有钢梁
number_slider_19 = Slider(600, range=0..1000)
offset_7 = OffsetCurve(Curve=crv_37, Distance=expr("-x", number_slider_19), Corners=1)
offset_8 = OffsetCurve(Curve=crv_37, Distance=Slider(300, range=0..1000), Corners=1)

crv_38 = Curve(crv_35)
offset_9 = OffsetCurve(Curve=crv_38, Distance=expr("-x", Slider(300, range=0..1000)), Corners=1)
offset_10 = OffsetCurve(Curve=crv_38, Distance=expr("-x", Slider(600, range=0..1000)), Corners=1)

# ---- group: 上层幕墙线
crv_39 = Curve(crv_21)

# ---- group: 檐口线外侧
crv_40 = Curve(crv_27)

# ----
# 是否有吊顶：
# 下层幕墙边线在结构边梁以内>350
# 
# （最外层结构线）
number_slider_20 = Slider(350, range=0..1000)

# ---- group: 上下幕墙有效点 / 容差
number_slider_21 = Slider(150, range=0..1000)

# ---- group: 檐口线
crv_41 = Curve(crv_27)

# ---- group: 上层幕墙线
crv_42 = Curve(crv_39)

crv_43 = Curve(crv_39)

# ----
crv_44 = Curve(crv_35)
offset_11 = OffsetCurve(Curve=crv_44, Distance=expr("-x", Slider(300, range=0..1000)), Corners=1)
offset_12 = OffsetCurve(Curve=crv_44, Distance=Slider(50, range=0..1000), Corners=1)

# ---- group: 上层幕墙线
crv_45 = Curve(crv_21)

# ---- group: 建筑线
crv_46 = Curve(filter)

crv_47 = Curve(filter)

# ----
crv_48 = Curve(crv_45)

# ----
# 生成埋件编号
# 注意：
# 可以选择机动生成or手动输入埋件Tag可以参考下方右侧的”涉及到的梁编号“来手动输入对应的埋件编号
list_8 = ValueList({"机动生成埋件Tags": 0, "手动输入埋件Tags": 1}, selected="机动生成埋件Tags")

swatch_2 = ColourSwatch(SwatchColor=RGB(140, 140, 140))
# (9)Bake Me!!
# 埋件和阴阳角定位
panel_22 = Panel("阴阳角定位-F1+F2")

layer_3 = DefineLayer(Name=panel_22, Color=swatch_2)
attributes = DefineObjectAttributes(Layer=layer_3, Color=swatch_2)

# ---- group: 檐口埋件
panel_23 = Panel("Embed::1-1-02钢板焊埋件")
panel_24 = Panel("Tag::1-1-02钢板焊埋件")
swatch_3 = ColourSwatch(SwatchColor=RGB(255, 212, 0))

# ---- group: 上下幕墙连续
panel_25 = Panel("Tag::1-0-01钢板焊埋件")
swatch_4 = ColourSwatch(SwatchColor=RGB(255, 242, 66))
panel_26 = Panel("Embed::1-0-01钢板焊埋件")

# ---- group: 有吊顶的范围，檐口处内侧埋件
panel_27 = Panel("Embed::2-1-03钢板焊埋件")
panel_28 = Panel("Tag::2-1-03钢板焊埋件")
swatch_5 = ColourSwatch(SwatchColor=RGB(255, 242, 66))

# ---- group: 框架顶部，埋件在幕墙线外侧
panel_29 = Panel("Embed::3-1-03钢板焊埋件")
panel_30 = Panel("Tag::3-1-03钢板焊埋件")
swatch_6 = ColourSwatch(SwatchColor=RGB(180, 255, 66))

# ---- group: 框架顶部，埋件在幕墙线内侧
panel_31 = Panel("Embed::3-2-03钢板焊埋件")
panel_32 = Panel("Tag::3-2-03钢板焊埋件")
swatch_7 = ColourSwatch(SwatchColor=RGB(66, 255, 69))

# ---- group: 钢结构下底埋
panel_33 = Panel("Embed::4-1钢板焊底埋")
panel_34 = Panel("Tag::4-1钢板焊底埋")
swatch_8 = ColourSwatch(SwatchColor=RGB(66, 255, 236))

# ---- group: 范围内没有钢梁，默认幕墙线向内300有一个埋件
panel_35 = Panel("Embed::4-0-03默认钢板焊")
panel_36 = Panel("Tag::4-0-03默认钢板焊")
swatch_9 = ColourSwatch(SwatchColor=RGB(66, 167, 255))

# ---- group: 幕墙底部接地埋件
panel_37 = Panel("Embed::5-04板埋")
panel_38 = Panel("Tag::5-04板埋")
swatch_10 = ColourSwatch(SwatchColor=RGB(66, 98, 255))

# ----
# 1.1-掩口出侧埋遗漏
panel_39 = Panel("1.1-掩口出侧埋遗漏")
layer_4 = DefineLayer(Name=panel_39)
attributes_2 = DefineObjectAttributes(Layer=layer_4)

layer_5 = DefineLayer(Name=panel_24, Color=swatch_3)
layer_6 = DefineLayer(Name=panel_23, Color=swatch_3)
entwine = Entwine(Branch00=layer_6, Branch01=layer_5, FlattenInputs=True)
attributes_3 = DefineObjectAttributes(Layer=entwine, Color=swatch_3)

layer_7 = DefineLayer(Name=panel_28, Color=swatch_5)
layer_8 = DefineLayer(Name=panel_27, Color=swatch_5)
entwine_2 = Entwine(Branch00=layer_8, Branch01=layer_7, FlattenInputs=True)
attributes_4 = DefineObjectAttributes(Layer=entwine_2, Color=swatch_5)

layer_9 = DefineLayer(Name=panel_25, Color=swatch_4)
layer_10 = DefineLayer(Name=panel_26, Color=swatch_4)
entwine_3 = Entwine(Branch00=layer_10, Branch01=layer_9, FlattenInputs=True)
attributes_5 = DefineObjectAttributes(Layer=entwine_3, Color=swatch_4)

layer_11 = DefineLayer(Name=panel_30, Color=swatch_6)
layer_12 = DefineLayer(Name=panel_29, Color=swatch_6)
entwine_4 = Entwine(Branch00=layer_12, Branch01=layer_11, FlattenInputs=True)
attributes_6 = DefineObjectAttributes(Layer=entwine_4, Color=swatch_6)

layer_13 = DefineLayer(Name=panel_32, Color=swatch_7)
layer_14 = DefineLayer(Name=panel_31, Color=swatch_7)
entwine_5 = Entwine(Branch00=layer_14, Branch01=layer_13, FlattenInputs=True)
attributes_7 = DefineObjectAttributes(Layer=entwine_5, Color=swatch_7)

layer_15 = DefineLayer(Name=panel_34, Color=swatch_8)
layer_16 = DefineLayer(Name=panel_33, Color=swatch_8)
entwine_6 = Entwine(Branch00=layer_16, Branch01=layer_15, FlattenInputs=True)
attributes_8 = DefineObjectAttributes(Layer=entwine_6, Color=swatch_8)

layer_17 = DefineLayer(Name=panel_38, Color=swatch_10)
layer_18 = DefineLayer(Name=panel_37, Color=swatch_10)
entwine_7 = Entwine(Branch00=layer_18, Branch01=layer_17, FlattenInputs=True)
attributes_9 = DefineObjectAttributes(Layer=entwine_7, Color=swatch_10)

layer_19 = DefineLayer(Name=panel_36, Color=swatch_9)
layer_20 = DefineLayer(Name=panel_35, Color=swatch_9)
entwine_8 = Entwine(Branch00=layer_20, Branch01=layer_19, FlattenInputs=True)
attributes_10 = DefineObjectAttributes(Layer=entwine_8, Color=swatch_9)

# ----
# 板埋：制作板埋三视图
max = Maximum(A=s_x, B=s_y)
filter_2 = StreamFilter(Gate=list, Stream0=7.2, Stream1=9.6, Stream2=11.9, Stream3=14.3, Stream4=16.7, Stream5=19.1)
filter_3 = StreamFilter(Gate=list_2, Stream0=270, Stream1=360)
filter_4 = StreamFilter(Gate=list_3, Stream0=10, Stream1=12, Stream2=16, Stream3=18, Stream4=20, Stream5=25)
filter_5 = StreamFilter(Gate=list, Stream0=0.91, Stream1=1.1, Stream2=1.27, Stream3=1.43, Stream4=1.57, Stream5=1.71)
filter_6 = StreamFilter(Gate=list_2, Stream0=0.16, Stream1=0.14)
addition = Addition(A=list_4, B=1)
addition_2 = Addition(A=list_5, B=1)
division_2 = Division(A=max, B=8)
t = Integer(division_2)
panel_40 = Panel(filter_5)
panel_41 = Panel(filter_2)
panel_42 = Panel(filter_6)
min = Minimum(A=filter_3, B=300)
panel_43 = Panel(min)
expression = Expression(A=filter_6, fy=filter_3, ft=filter_5, d=filter_4, Expression="(int((0.6*1.1*A*fy/ft*d)/5)+1)*5")

# ----
# 生成底埋钢埋件
rectangle = Rectangle(Plane=PlaneXY(0, 0, 0), XSize=panel_9, YSize=panel_10, Radius=0)  # -> Rectangle, Length
pln_2 = Plane(rectangle.Rectangle)
rec = Rectangle(rectangle.Rectangle)

deplane_2 = DeconstructPlane(Plane=pln_2)  # -> Origin, XAxis, YAxis, ZAxis
dedomain = DeconstructDomain(Domain=panel_10)  # -> Start, End
amp_2 = Amplitude(Vector=deplane_2.YAxis, Amplitude=dedomain.End)
move_2 = Move(Geometry=deplane_2.Origin, Motion=amp_2)  # -> Geometry, Transform
ln = Line(StartPoint=deplane_2.Origin, EndPoint=move_2.Geometry)
amp_3 = Amplitude(Vector=ln, Amplitude=Slider(190, range=0..1000))
move_3 = Move(Geometry=deplane_2.Origin, Motion=amp_3)  # -> Geometry, Transform

text = DefineTextObject(Text=panel_12, Plane=move_3.Geometry, DimensionStyle=panel_4, OutputType="Text")
group = Group(Objects=[rec, text])

# ---- group: 底埋埋件单体
merge_6 = Merge(Data1=group, Data2=pln_2)

# ----
crv_49 = Curve(project_4.Geometry)
panel_44 = Panel("""Dimension::Dim1
Dimension::Dim2
Dimension::Dim3
Dimension::Dim4""")
layer_21 = DefineLayer(Name=panel_44)  # -> graft(Layer)
attributes_11 = DefineObjectAttributes(Layer=layer_21)

crv_50 = Curve(project_4.Geometry)
panel_45 = Panel("""Dimension::Dim1
Dimension::Dim2
Dimension::Dim3
Dimension::Dim4""")
layer_22 = DefineLayer(Name=panel_45)  # -> graft(Layer)
attributes_12 = DefineObjectAttributes(Layer=layer_22)

# ---- group: 根据color分类梁和tags
rhatt = GetRhinoAttributes(Geometry=reflay)  # -> Name, Layer, Color
C = CreateSet(Data=rhatt.Color)  # -> Data, Map, Number
panel_46 = Panel(C.Data)
filtercolor = FilterByColor(Geometry=reflay_2, Color=C.Data)  # -> simplify(Geometry)
detext = DeconstructText(TextObject=filtercolor)  # -> Text, Plane, Height, Justification

# ---- group: 根据color分类梁和tags / Beam
filtercolor_2 = FilterByColor(Geometry=reflay, Color=C.Data)  # -> simplify(Geometry)

# ---- group: 根据color分类梁和tags (continued)
crv_51 = Curve(filtercolor_2)

# ---- group: Text
item_6 = ListItem(List=detext.Text, Index=0, Wrap=True)

# ----
# 涉及到的梁编号
panel_47 = Panel(item_6)

# ---- group: Create Tags
tstat = TreeStatistics(Tree=detext.Text)  # -> Paths, Length, Count
series = Series(Start="1", Step=1, Count=tstat.Count)
concat = Concatenate(FragmentA=series, FragmentB="-")
concat_2 = Concatenate(FragmentA=concat, FragmentB=series)  # -> simplify(graft(Result))

# ----
filter_7 = StreamFilter(Gate=list_8, Stream0=concat_2, Stream1=simplify(graft(panel_6)))

# ----
# 埋件Tag预览
panel_48 = Panel(filter_7)

# ----
# 生成All Embed - Steel
flatten = FlattenTree(Tree=item_6, Path="{0}")
addition_3 = Addition(A=钢埋板厚度_2, B=division)
addition_4 = Addition(A=neg_2, B=division)
dom_3 = ConstructDomain(DomainStart=addition_4, DomainEnd=addition_3)
panel_49 = Panel(split_2.ListB)
钢埋板_侧视图 = Rectangle(Plane=PlaneXY(0, 0, 0), XSize=dom_2, YSize=dom, Radius=0)  # -> Rectangle, Length
xz = XZPlane(Origin=Point(0, 0, 0))
txt_2 = Text(item_6)
col = Colour(simplify(graft(C.Data)))
concat_3 = Concatenate(FragmentA="Embed", FragmentB=txt_2)
attributes_13 = DefineObjectAttributes(Color=col)
xy_11 = XYPlane(Origin=Point(0, 0, 0))
dedomain_2 = DeconstructDomain(Domain=dom)  # -> Start, End
multiplication = Multiplication(A=dedomain_2.Start, B=dedomain_2.Start)
txt_3 = Text(filter_7)
project_8 = Project(Geometry=crv_51, Plane=xy_11)  # -> Geometry, Transform

# ----
# 求出对应输入编号的钢结构截面尺寸
fsim = FindSimilarMember(Data=flatten, Set=split_2.ListA)  # -> Hit, Index
item_7 = ListItem(List=split_2.ListB, Index=fsim.Index, Wrap=True)

# ----
# 要连接的梁中线curve
crv_52 = Curve(project_8.Geometry)

# ---- group: 梁中线
crv_53 = Curve(crv_52)

# ---- group: 梁中线-中点
midpt = CurveMiddle(Curve=crv_53)

# ---- group: 梁中线
crv_54 = Curve(crv_53)

crv_55 = Curve(crv_53)

crv_56 = Curve(crv_55)

# ---- group: 筛选定位点里的阴阳角
pull_3 = PullPoint(Point=flatten(pt), Geometry=graft(data_8), ClosestOnly=True)  # -> ClosestPoint, Distance
sort_3 = SortList(Keys=pull_3.Distance, ValuesA=flatten(pt))  # -> Keys, ValuesA
item_8 = ListItem(List=sort_3.Keys, Index=0, Wrap=True)  # -> Item, Item1
item_9 = ListItem(List=sort_3.ValuesA, Index=0, Wrap=True)  # -> Item, Item1
merge_7 = Merge(Data1=item_8.Item, Data2=item_8.Item1)
merge_8 = Merge(Data1=item_9.Item, Data2=item_9.Item1)
panel_50 = Panel(merge_7)
smaller_4 = SmallerThan(FirstNumber=merge_7, SecondNumber="100")  # -> SmallerThan, OrEqualTo
dispatch_14 = Dispatch(List=merge_8, DispatchPattern=smaller_4.SmallerThan)  # -> ListA, ListB
crv_57 = Curve(flatten(offset_3))

# ---- group: 筛选定位点里的阴阳角 / F1-阴阳角-点
data_11 = Data(dispatch_14.ListA)

# ---- group: 筛选定位点里的阴阳角 (continued)
check_same_points = CheckSamePoints(archPoint=flatten(pt), crvPoint=flatten(data_11))  # -> out, specialPt; inputs archPoint: list of Point3d, crvPoint: list of Point3d; same code as testpoint
cull_i_3 = CullIndex(List=flatten(pt), Indices=check_same_points.specialPt, Wrap=True)
pull_4 = PullPoint(Point=cull_i_3, Geometry=crv_57, ClosestOnly=True)  # -> ClosestPoint, Distance
ln_2 = Line(StartPoint=pull_4.ClosestPoint, EndPoint=cull_i_3)
rotate = Rotate(Geometry=ln_2, Angle=1.570796327, Plane=cull_i_3)  # -> Geometry, Transform
pl = ConstructPlane(Origin=cull_i_3, XAxis=rotate.Geometry, YAxis=ln_2)

# ----
project_9 = Project(Geometry=pl, Plane=xy_8)  # -> Geometry, Transform

# ---- group: 下层定位点Plane-去阴阳角
pln_3 = Plane(project_9.Geometry)

# ---- group: 下层定位平面-All
pln_4 = Plane(pln_3)

# ----
# 1.是否有檐口线-下层定位点
toggle = BooleanToggle(True)
clean = CleanTree(RemoveNulls=True, RemoveInvalid=True, RemoveEmpty=toggle, Tree=pln_4)
deplane_3 = DeconstructPlane(Plane=clean)  # -> Origin, XAxis, YAxis, ZAxis
incurve = PointInCurve(Point=deplane_3.Origin, Curve=crv_26)  # -> Relationship, Point
equals = Equality(FirstNumber=incurve.Relationship, SecondNumber="2")  # -> Equality, Inequality
dispatch_15 = Dispatch(List=clean, DispatchPattern=equals.Equality)  # -> ListA, ListB

# ----
# Site - 有檐口线的定位点
pln_5 = Plane(dispatch_15.ListA)

# ----
# Site - 无檐口线的定位点
pln_6 = Plane(dispatch_15.ListB)

# ---- group: 檐口线-Site
pln_7 = Plane(pln_5)

# ----
incurve_2 = PointInCurve(Point=pln_6, Curve=crv_29)  # -> Relationship, Point
equals_2 = Equality(FirstNumber=incurve_2.Relationship, SecondNumber="2")  # -> Equality, Inequality
dispatch_16 = Dispatch(List=pln_6, DispatchPattern=equals_2.Equality)  # -> ListA, ListB

incurve_3 = PointInCurve(Point=pln_7, Curve=crv_29)  # -> Relationship, Point
equals_3 = Equality(FirstNumber=incurve_3.Relationship, SecondNumber="2")  # -> Equality, Inequality
dispatch_17 = Dispatch(List=pln_7, DispatchPattern=equals_3.Equality)  # -> ListA, ListB

# ---- group: 建筑单体-下层-有檐口线定位点
pln_8 = Plane(dispatch_17.ListA)

# ---- group: 建筑单体-下层-无檐口线定位点
pln_9 = Plane(dispatch_16.ListA)

# ---- group: All-下层定位点
# 1.1有檐口线
pln_10 = Plane(pln_8)

# ----
# 1.0无檐口线初筛-下层定位点
pln_11 = Plane(pln_9)

# ----
# 板埋Modeling
multiplication_2 = Multiplication(A=s_x, B=addition)
multiplication_3 = Multiplication(A=s_y, B=addition_2)
recgrid = Rectangular(Plane=PlaneXY(0, 0, 0), SizeX=s_x, SizeY=s_y, ExtentX=addition, ExtentY=addition_2)  # -> Cells, Points
直径 = Text(filter_4)
division_3 = Division(A=multiplication_2, B=2)
division_4 = Division(A=multiplication_3, B=2)
vec = VectorXYZ(XComponent=expr("-x", division_3), YComponent=expr("-x", division_4), ZComponent=0)  # -> Vector, Length
move_4 = Move(Geometry=recgrid.Points, Motion=vec.Vector)  # -> Geometry, Transform
division_5 = Division(A=直径, B=2)
cyl = Cylinder(Base=move_4.Geometry, Radius=division_5, Length=expr("-x", expression))
X = UnitX(Factor=直径)
multiplication_4 = Multiplication(A=直径, B=6)
edges = BrepEdges(Brep=cyl)  # -> Naked, Interior, NonManifold
item_10 = ListItem(List=edges.Naked, Index=0, Wrap=True)
max_2 = Maximum(A=multiplication_4, B=70)
move_5 = Move(Geometry=item_10, Motion=X)  # -> Geometry, Transform
multiplication_5 = Multiplication(A=max_2, B=2)
addition_5 = Addition(A=multiplication_2, B=multiplication_5)
addition_6 = Addition(A=multiplication_3, B=multiplication_5)
division_6 = Division(A=t, B=2)
expression_2 = Expression(x=addition_6, Expression="Ceiling(x/10)*10/2")
expression_3 = Expression(x=addition_5, Expression="Ceiling(x/10)*10/2")
round = Round(Number=division_6)  # -> Nearest, Floor, Ceiling
multiplication_6 = Multiplication(A=round.Ceiling, B=2)
dom_4 = ConstructDomain(DomainStart=expr("-x", expression_2), DomainEnd=expression_2)
dom_5 = ConstructDomain(DomainStart=expr("-x", expression_3), DomainEnd=expression_3)
box = DomainBox(Base=PlaneXY(0, 0, 0), X=dom_5, Y=dom_4, Z=multiplication_6)
Z = UnitZ(Factor=expr("-x", multiplication_6))

multiplication_7 = Multiplication(A=直径, B=5)

Z_2 = UnitZ(Factor=multiplication_7)
extr = Extrude(Base=move_5.Geometry, Direction=Z_2)
cap = CapHoles(Brep=[extr, cyl])
merge_9 = Merge(Data1=cap, Data2=box)
flatten_2 = FlattenTree(Tree=merge_9, Path="{0}")
move_6 = Move(Geometry=flatten_2, Motion=Z)  # -> Geometry, Transform

# ---- group: 筛选阴阳角
pull_5 = PullPoint(Point=flatten(pt_2), Geometry=graft(merge_5), ClosestOnly=True)  # -> ClosestPoint, Distance
sort_4 = SortList(Keys=pull_5.Distance, ValuesA=flatten(pt_2))  # -> Keys, ValuesA
item_11 = ListItem(List=sort_4.Keys, Index=0, Wrap=True)  # -> Item, Item1
item_12 = ListItem(List=sort_4.ValuesA, Index=0, Wrap=True)  # -> Item, Item1
merge_10 = Merge(Data1=item_11.Item, Data2=item_11.Item1)
merge_11 = Merge(Data1=item_12.Item, Data2=item_12.Item1)
panel_51 = Panel(merge_10)
smaller_5 = SmallerThan(FirstNumber=merge_10, SecondNumber="100")  # -> SmallerThan, OrEqualTo
dispatch_18 = Dispatch(List=merge_11, DispatchPattern=smaller_5.SmallerThan)  # -> ListA, ListB
crv_58 = Curve(flatten(offset))

# ---- group: 筛选阴阳角 / F1-阴阳角-点
data_12 = Data(dispatch_18.ListA)

# ---- group: 筛选阴阳角 (continued)
check_same_points_2 = CheckSamePoints(archPoint=flatten(pt_2), crvPoint=flatten(data_12))  # -> out, specialPt; inputs archPoint: list of Point3d, crvPoint: list of Point3d; same code as testpoint
cull_i_4 = CullIndex(List=flatten(pt_2), Indices=check_same_points_2.specialPt, Wrap=True)
pull_6 = PullPoint(Point=cull_i_4, Geometry=crv_58, ClosestOnly=True)  # -> ClosestPoint, Distance
ln_3 = Line(StartPoint=pull_6.ClosestPoint, EndPoint=cull_i_4)
rotate_2 = Rotate(Geometry=ln_3, Angle=1.570796327, Plane=cull_i_4)  # -> Geometry, Transform
pl_2 = ConstructPlane(Origin=cull_i_4, XAxis=rotate_2.Geometry, YAxis=ln_3)

# ----
project_10 = Project(Geometry=pl_2, Plane=xy_9)  # -> Geometry, Transform

# ---- group: 檐口定位点Plane-去阴阳角
pln_12 = Plane(project_10.Geometry)

# ---- group: 檐口定位平面-All
pln_13 = Plane(pln_12)

# ---- group: 筛选定位点里的阴阳角
pull_7 = PullPoint(Point=flatten(pt_3), Geometry=graft(merge_4), ClosestOnly=True)  # -> ClosestPoint, Distance
sort_5 = SortList(Keys=pull_7.Distance, ValuesA=flatten(pt_3))  # -> Keys, ValuesA
item_13 = ListItem(List=sort_5.Keys, Index=0, Wrap=True)  # -> Item, Item1
item_14 = ListItem(List=sort_5.ValuesA, Index=0, Wrap=True)  # -> Item, Item1
merge_12 = Merge(Data1=item_13.Item, Data2=item_13.Item1)
merge_13 = Merge(Data1=item_14.Item, Data2=item_14.Item1)
panel_52 = Panel(merge_12)
smaller_6 = SmallerThan(FirstNumber=merge_12, SecondNumber="100")  # -> SmallerThan, OrEqualTo
dispatch_19 = Dispatch(List=merge_13, DispatchPattern=smaller_6.SmallerThan)  # -> ListA, ListB
crv_59 = Curve(flatten(offset_2))

# ---- group: 筛选定位点里的阴阳角 / F1-阴阳角-点
data_13 = Data(dispatch_19.ListA)

# ---- group: 上-阴阳角
pt_4 = Point(data_13)

# ----
merge_14 = Merge(Data1=data, Data2=pt_4)

bake = BakeObjects(Geometry=merge_14, Attributes=attributes, BakeName=panel_22, Bake=False)

# ---- group: 筛选定位点里的阴阳角 (continued)
check_same_points_3 = CheckSamePoints(archPoint=flatten(pt_3), crvPoint=flatten(data_13))  # -> out, specialPt; inputs archPoint: list of Point3d, crvPoint: list of Point3d; same code as testpoint
cull_i_5 = CullIndex(List=flatten(pt_3), Indices=check_same_points_3.specialPt, Wrap=True)
pull_8 = PullPoint(Point=cull_i_5, Geometry=crv_59, ClosestOnly=True)  # -> ClosestPoint, Distance
ln_4 = Line(StartPoint=pull_8.ClosestPoint, EndPoint=cull_i_5)
rotate_3 = Rotate(Geometry=ln_4, Angle=1.570796327, Plane=cull_i_5)  # -> Geometry, Transform
pl_3 = ConstructPlane(Origin=cull_i_5, XAxis=rotate_3.Geometry, YAxis=ln_4)

# ----
project_11 = Project(Geometry=pl_3, Plane=xy_10)  # -> Geometry, Transform

# ---- group: 上层定位点Plane-去阴阳角
pln_14 = Plane(project_11.Geometry)

# ---- group: 上层定位平面-All
pln_15 = Plane(pln_14)

# ----
split_3 = TextSplit(Text=item_7, Separators="x")
split_4 = TextSplit(Text=split_3, Separators="Q")
item_15 = ListItem(List=split_4, Index="0", Wrap=True)

shift = ShiftPaths(Data=item_15, Offset=-1)
subtraction = Subtraction(A=division, B=钢埋板厚度_2)
subtraction_2 = Subtraction(A=division, B=钢埋板厚度_2)
subtraction_3 = Subtraction(A=division, B=钢埋板厚度_2)
neg_3 = Negative(Value=钢埋板厚度_2)
neg_4 = Negative(Value=钢埋板厚度_2)
neg_5 = Negative(Value=钢埋板厚度_2)
subtraction_4 = Subtraction(A=division, B=钢埋板厚度_2)
addition_7 = Addition(A=subtraction, B=number_slider_3)
addition_8 = Addition(A=subtraction_2, B=number_slider_3)
subtraction_5 = Subtraction(A=neg_3, B=number_slider_3)
subtraction_6 = Subtraction(A=neg_4, B="2")
subtraction_7 = Subtraction(A=division, B=钢埋板厚度_2)
addition_9 = Addition(A=subtraction_3, B="2")
subtraction_8 = Subtraction(A=neg_5, B="2")
neg_6 = Negative(Value=钢埋板厚度_2)
neg_7 = Negative(Value=钢埋板厚度_2)
工字钢_h = ListItem(List=shift, Index=0, Wrap=True)
工字钢_b = ListItem(List=shift, Index=1, Wrap=True)
工字钢_tf = ListItem(List=shift, Index=3, Wrap=True)
工字钢_tw = ListItem(List=shift, Index=2, Wrap=True)
pt_5 = ConstructPoint(XCoordinate=neg_6, YCoordinate=subtraction_4, ZCoordinate=0)
pt_6 = ConstructPoint(XCoordinate=neg_7, YCoordinate=addition_7, ZCoordinate=0)
pt_7 = ConstructPoint(XCoordinate=subtraction_5, YCoordinate=addition_8, ZCoordinate=0)
pt_8 = ConstructPoint(XCoordinate=subtraction_6, YCoordinate=subtraction_7, ZCoordinate=0)
pt_9 = ConstructPoint(XCoordinate=subtraction_8, YCoordinate=addition_9, ZCoordinate=0)
subtraction_9 = Subtraction(A=工字钢_b, B=工字钢_tw)
merge_15 = Merge(Data1=pt_5, Data2=pt_6, Data3=pt_7, Data4=pt_9, Data5=pt_8)
division_7 = Division(A=subtraction_9, B="2")
pline = PolyLine(Vertices=merge_15, Closed=True)
division_8 = Division(A=division_7, B="2")
subtraction_10 = Subtraction(A=division_8, B=number_slider_3)
subtraction_11 = Subtraction(A=division_8, B=钢埋板厚度_2)
neg_8 = Negative(Value=division_8)
subtraction_12 = Subtraction(A=neg_8, B=subtraction_11)
addition_10 = Addition(A=subtraction_12, B=number_slider_2)
dom_6 = ConstructDomain(DomainStart=addition_10, DomainEnd=subtraction_12)
dom_7 = ConstructDomain(DomainStart=addition_4, DomainEnd=addition_3)
subtraction_13 = Subtraction(A=subtraction_10, B=subtraction_11)
subtraction_14 = Subtraction(A=neg_8, B=subtraction_11)
dom_8 = ConstructDomain(DomainStart=subtraction_13, DomainEnd=subtraction_14)

panel_53 = Panel(工字钢_b)
tstat_2 = TreeStatistics(Tree=工字钢_h)  # -> Paths, Length, Count
钢肋板倒角_侧视图 = Rectangle(Plane=PlaneXY(0, 0, 0), XSize=dom_6, YSize=dom_7, Radius=0)  # -> Rectangle, Length
钢肋板_侧视图 = Rectangle(Plane=PlaneXY(0, 0, 0), XSize=dom_8, YSize=dom_3, Radius=0)  # -> Rectangle, Length
repeat = RepeatData(Data=pline, Length=tstat_2.Length)  # -> simplify(Data)
merge_16 = Merge(Data1=simplify(钢肋板_侧视图.Rectangle), Data2=simplify(repeat), Data3=simplify(钢肋板倒角_侧视图.Rectangle))
division_9 = Division(A=工字钢_h, B="2")
subtraction_15 = Subtraction(A=division_9, B=工字钢_tf)
division_10 = Division(A=工字钢_b, B=2)
repeat_2 = RepeatData(Data=钢埋板_侧视图.Rectangle, Length=tstat_2.Length)  # -> simplify(Data)
mirror = Mirror(Geometry=merge_16, Plane=xz)  # -> Geometry, Transform
addition_11 = Addition(A=subtraction_15, B=Slider(200, range=0..1000))
addition_12 = Addition(A=addition_11, B=division_7)
merge_17 = Merge(Data1=repeat_2, Data2=merge_16, Data3=mirror.Geometry)
X_2 = UnitX(Factor=addition_12)

# ---- group: 所以钢埋件geo
move_7 = Move(Geometry=merge_17, Motion=X_2)  # -> Geometry, Transform

# ---- group: 对齐geo
group_2 = Group(Objects=move_7.Geometry)
rotate_4 = Rotate(Geometry=group_2, Angle=3.141592654, Plane=PlaneXY(0, 0, 0))  # -> Geometry, Transform
boxprop = BoxProperties(Box=rotate_4.Geometry)  # -> Center, Diagonal, Area, Volume, Degeneracy
bbox_2 = BoundingBox(Content=rotate_4.Geometry, Plane=PlaneXY(0, 0, 0))  # -> Box, Box_2
debox = DeconstructBox(Box=bbox_2.Box)  # -> Plane, X, Y, Z
pdecon = Deconstruct(Point=boxprop.Center)  # -> XComponent, YComponent, ZComponent
dedomain_3 = DeconstructDomain(Domain=debox.Y)  # -> Start, End
pt_10 = ConstructPoint(XCoordinate=pdecon.XComponent, YCoordinate=dedomain_3.Start, ZCoordinate=pdecon.ZComponent)
xy_12 = XYPlane(Origin=Point(0, 0, 0))
pl_origin = PlaneOrigin(Base=xy_12, Origin=pt_10)
orient = Orient(Geometry=rotate_4.Geometry, Source=pl_origin, Target=xy_12)  # -> Geometry, Transform
ungroup_2 = Ungroup(Group=orient.Geometry)  # -> simplify(Objects)

# ----
# 要连接的梁中线Offest值
num = Number(simplify(division_10))

# ---- group: 梁Offset
num_2 = Number(num)

# ----
# 三视图
# hidden lines of top+pers view
# move to center
# 如果无法完整的生成埋件的三视图，
# 建议选择埋件的3D在Rhino中将
# Top/Perspective/Front/Right 试图缩放至合适大小后重新运行
panel_54 = Panel("""Top
Perspective
Front
Right""")
m2d_rhino = Make2DRhinoView(Name=panel_54, Clip=True)
number_slider_22 = Slider(1, range=0..10)
pt_11 = Point(Point(957.9296072, 367.7685097, 0))
pt_12 = Point("0,0,0")
recgrid_2 = Rectangular(
    Plane=pt_11,
    SizeX=Slider(12, range=1..20, expression="X*50"),
    SizeY=Slider(10, range=1..20, expression="X*50"),
    ExtentX=number_slider_22,
    ExtentY=number_slider_22)  # -> Cells, Points
flatten_3 = FlattenTree(Tree=recgrid_2.Points, Path="{0}")

# ----
# （6）生成板埋埋件
# 注意：
# 1.记得点一下Compute按钮
# 2.如果无法完整的生成埋件的三视图，
# 建议选择埋件的3D在Rhino中将
# Top/Perspective/Front/Right 试图缩放至合适大小后重新运行
make2d = Make2D(Geometry=move_6.Geometry, View=m2d_rhino, TangentEdges=False, TangentSeams=False, AutoComputeMake2D=False)  # -> VisibleCurves, VisibleIndex, VisibleType, HiddenCurves, HiddenIndex, HiddenType

bang = ExplodeTree(Data=make2d.VisibleCurves)  # -> Branch0, Branch1, Branch2, Branch3, Branch4, Branch5, Branch6, Branch7
divdist = DivideDistance(Curve=make2d.HiddenCurves, Distance=Slider(1, range=0..10))  # -> Points, Tangents, Parameters
graft = GraftTree(Tree=make2d.HiddenCurves, IncludeEmptyLists=True, IncludeNullItems=True)
shatter = Shatter(Curve=graft, Parameters=divdist.Parameters)
dispatch_20 = Dispatch(List=shatter, DispatchPattern=[True, False])  # -> ListA, ListB
crv_60 = Curve(dispatch_20.ListA)
pshift = ShiftPaths(Data=crv_60, Offset=-1)
pshift_2 = ShiftPaths(Data=pshift, Offset=-1)
bang_2 = ExplodeTree(Data=pshift_2)  # -> Branch0, Branch1, Branch2, Branch3, Branch4, Branch5, Branch6, Branch7
entwine_9 = Entwine(Branch00=bang_2.Branch0, Branch01=bang.Branch0, FlattenInputs=True)  # -> flatten(Result)
entwine_10 = Entwine(Branch00=bang_2.Branch1, Branch01=bang.Branch1, FlattenInputs=True)  # -> flatten(Result)
entwine_11 = Entwine(Branch00=entwine_9, Branch01=entwine_10, Branch02=bang.Branch2, Branch03=bang.Branch3, FlattenInputs=True)
group_3 = Group(Objects=entwine_11)
pshift_3 = ShiftPaths(Data=group_3, Offset=-1)
pshift_4 = ShiftPaths(Data=group_3, Offset=-1)
boxprop_2 = BoxProperties(Box=pshift_3)  # -> Center, Diagonal, Area, Volume, Degeneracy
vec2pt = Vector2Pt(PointA=boxprop_2.Center, PointB=pt_12, Unitize=False)  # -> Vector, Length
move_8 = Move(Geometry=pshift_4, Motion=vec2pt.Vector)  # -> flatten(Geometry), Transform
orient_2 = Orient(Geometry=flatten(move_8.Geometry), Source=PlaneXY(0, 0, 0), Target=flatten_3)  # -> Geometry, Transform
cull_i_6 = CullIndex(List=orient_2.Geometry, Indices="-1", Wrap=True)
split_5 = SplitList(List=cull_i_6, Index="4")  # -> ListA, ListB
geo = Geometry(split_5.ListA)

# ---- group: 单体定Top/Side
item_16 = ListItem(List=geo, Index=Slider(0, range=0..10), Wrap=True)
item_17 = ListItem(List=geo, Index=2, Wrap=True)
cluster_2 = Cluster(G=item_16)
cluster_3 = Cluster(G=item_17)

# ----
block = DefineBlock(Geometry=ungroup_2, Attributes=attributes_13, BlockName=concat_3, BasePlane=PlaneXY(0, 0, 0))
deblock = DeconstructBlock(Block=block)  # -> Name, Plane, Geometry
group_4 = Group(Objects=deblock.Geometry)
bbox_3 = BoundingBox(Content=group_4, Plane=PlaneXY(0, 0, 0))  # -> Box, Box_2
deplane_4 = DeconstructPlane(Plane=deblock.Plane)  # -> Origin, XAxis, YAxis, ZAxis
area_7 = Area(Geometry=bbox_3.Box)  # -> Area, Centroid
move2pt_2 = MoveToPoint(Geometry=deplane_4.Origin, PointA=deplane_4.Origin, PointB=area_7.Centroid)  # -> Moved, Vector, Transform
pl_4 = ConstructPlane(Origin=move2pt_2.Moved, XAxis=deplane_4.YAxis, YAxis=deplane_4.XAxis)
deplane_5 = DeconstructPlane(Plane=pl_4)  # -> Origin, XAxis, YAxis, ZAxis
rotate_5 = Rotate(Geometry=pl_4, Angle="Pi", Plane=pl_4)  # -> Geometry, Transform
amp_4 = Amplitude(Vector=deplane_5.YAxis, Amplitude=multiplication)
move_9 = Move(Geometry=deplane_5.Origin, Motion=amp_4)  # -> Geometry, Transform
srf = Surface(bbox_3.Box)
crv_61 = Curve(srf)
ln_5 = Line(StartPoint=move_9.Geometry, EndPoint=deplane_5.Origin)
ccx = CurveCurve(CurveA=ln_5, CurveB=crv_61)  # -> Points, ParamsA, ParamsB
ln_6 = Line(StartPoint=deplane_5.Origin, EndPoint=ccx.Points)
move_10 = Move(Geometry=rotate_5.Geometry, Motion=ln_6)  # -> simplify(Geometry), Transform
amp_5 = Amplitude(Vector=ln_6, Amplitude=expr("-x", number_slider_4))
move_11 = Move(Geometry=move_10.Geometry, Motion=amp_5)  # -> Geometry, Transform

# ---- group: 生成埋件定位plane
neg_9 = Negative(Value=multiplication)
amp_6 = Amplitude(Vector=deplane_5.YAxis, Amplitude=neg_9)
move_12 = Move(Geometry=deplane_5.Origin, Motion=amp_6)  # -> Geometry, Transform
ln_7 = Line(StartPoint=move_12.Geometry, EndPoint=deplane_5.Origin)
ccx_2 = CurveCurve(CurveA=ln_7, CurveB=crv_61)  # -> Points, ParamsA, ParamsB
ln_8 = Line(StartPoint=deplane_5.Origin, EndPoint=ccx_2.Points)
move_13 = Move(Geometry=rotate_5.Geometry, Motion=ln_8)  # -> simplify(Geometry), Transform

# ---- group: tag
text_2 = DefineTextObject(Text=txt_3, Plane=simplify(move_11.Geometry), DimensionStyle=panel_4, OutputType="Text")
group_5 = Group(Objects=[block, text_2])

# ----
merge_18 = Merge(Data1=group_5, Data2=move_13.Geometry)

# ----
# 要连接的embed
data_14 = Data(merge_18)

# ----
# 测试Smooth Curve是否与每个Block相切
# remove duplicate blocks
# 测试Smooth Curve是否与每个Block相切
# remove duplicate blocks
data_15 = Data(data_14)
# blocks + smooth curves
# blocks + special curves
# blocks + smooth curves
# blocks + special curves
item_18 = ListItem(List=data_15, Index=0, Wrap=True)
item_19 = ListItem(List=data_15, Index="-1", Wrap=True)
# 第一层
# 
# Curves(location point)+ Smooth Curves(architecture line)
# 第一层
# 
# Angular Curves(architecture line)
# 第一层
# 
# Special Curves(architecture line)
# 第一层
# 
# Angular Curves(architecture line)
data_16 = Data(data_14)
item_20 = ListItem(List=data_16, Index="-1", Wrap=True)
item_21 = ListItem(List=data_16, Index=0, Wrap=True)
data_17 = Data(data_14)
# 阳角
# 阴角
# 转角点
item_22 = ListItem(List=data_17, Index=0, Wrap=True)
item_23 = ListItem(List=data_17, Index="-1", Wrap=True)
rotate_6 = Rotate(Geometry=item_23, Angle="Pi", Plane=item_23)  # -> Geometry, Transform
data_18 = Data(data_14)
data_19 = Data(data_14)
item_24 = ListItem(List=data_18, Index=0, Wrap=True)
item_25 = ListItem(List=data_18, Index="-1", Wrap=True)
item_26 = ListItem(List=data_19, Index=0, Wrap=True)
item_27 = ListItem(List=data_19, Index="-1", Wrap=True)
rotate_7 = Rotate(Geometry=item_25, Angle="Pi", Plane=item_25)  # -> Geometry, Transform

ungroup_3 = Ungroup(Group=cluster_3)
ungroup_4 = Ungroup(Group=cluster_2)

# ---- group: Top/Side
filter_8 = StreamFilter(Gate=list_6, Stream0=ungroup_4, Stream1=ungroup_3)

# ---- group: Block
attributes_14 = DefineObjectAttributes(Color=ColourSwatch(SwatchColor=RGB(255, 0, 0)))
block_2 = DefineBlock(Geometry=ungroup_4, Attributes=attributes_14, BlockName="Board Plate", BasePlane=PlaneXY(0, 0, 0))

# ----
deblock_2 = DeconstructBlock(Block=block_2)  # -> Name, flatten(Plane), flatten(Geometry)
boundary = BoundarySurfaces(Edges=deblock_2.Geometry)
deplane_6 = DeconstructPlane(Plane=deblock_2.Plane)  # -> Origin, XAxis, YAxis, ZAxis
area_8 = Area(Geometry=boundary)  # -> Area, Centroid
move2pt_3 = MoveToPoint(Geometry=flatten(deplane_6.Origin), PointA=flatten(deplane_6.Origin), PointB=flatten(area_8.Centroid))  # -> Moved, Vector, Transform
pl_5 = ConstructPlane(Origin=move2pt_3.Moved, XAxis=deplane_6.XAxis, YAxis=deplane_6.YAxis)  # -> graft(Plane)

deplane_7 = DeconstructPlane(Plane=deblock_2.Plane)  # -> Origin, XAxis, YAxis, ZAxis
amp_7 = Amplitude(Vector=deplane_7.YAxis, Amplitude=number_slider_5)
move_14 = Move(Geometry=deplane_7.Origin, Motion=amp_7)  # -> Geometry, Transform

text_3 = DefineTextObject(Text=panel_11, Plane=move_14.Geometry, DimensionStyle=panel_4, OutputType="Text")
group_6 = Group(Objects=flatten([block_2, text_3]))

# ---- group: 板埋埋件单体
entwine_12 = Entwine(Branch00=group_6, Branch01=pl_5, FlattenInputs=True)

# ----
data_20 = Data(flatten(entwine_12))
item_28 = ListItem(List=data_20, Index=0, Wrap=True)
item_29 = ListItem(List=data_20, Index="-1", Wrap=True)

ungroup_5 = Ungroup(Group=item_28)
item_30 = ListItem(List=ungroup_5, Index="-1", Wrap=True)
# （3.1）导入轴线
deblock_3 = DeconstructBlock(Block=item_30)  # -> Name, Plane, Geometry
boundary_2 = BoundarySurfaces(Edges=deblock_3.Geometry)
debrep_2 = DeconstructBrep(Brep=boundary_2)  # -> Faces, Edges, Vertices
len_3 = Length(Curve=debrep_2.Edges)
sort_6 = SortList(Keys=len_3, ValuesA=debrep_2.Edges)  # -> Keys, ValuesA
item_31 = ListItem(List=sort_6.ValuesA, Index=0, Wrap=True)
# curve
len_4 = Length(Curve=item_31)  # -> expr("x/2", Length)

# ----
# 1.是否有檐口线-上层定位点
toggle_2 = BooleanToggle(True)
clean_2 = CleanTree(RemoveNulls=True, RemoveInvalid=True, RemoveEmpty=toggle_2, Tree=pln_15)

# ---- group: Input ???
deplane_8 = DeconstructPlane(Plane=clean_2)  # -> Origin, XAxis, YAxis, ZAxis

# ----
incurve_4 = PointInCurve(Point=deplane_8.Origin, Curve=crv_25)  # -> Relationship, Point
equals_4 = Equality(FirstNumber=incurve_4.Relationship, SecondNumber="2")  # -> Equality, Inequality
dispatch_21 = Dispatch(List=clean_2, DispatchPattern=equals_4.Equality)  # -> ListA, ListB

# ----
# Site - 无檐口线的定位点
pln_16 = Plane(dispatch_21.ListB)

incurve_5 = PointInCurve(Point=pln_16, Curve=crv_29)  # -> Relationship, Point
equals_5 = Equality(FirstNumber=incurve_5.Relationship, SecondNumber="2")  # -> Equality, Inequality
dispatch_22 = Dispatch(List=pln_16, DispatchPattern=equals_5.Equality)  # -> ListA, ListB
pln_17 = Plane(dispatch_22.ListB)

# ---- group: 建筑单体-上层-无檐口线定位点
pln_18 = Plane(dispatch_22.ListA)

# ----
# 1.0无檐口线初筛-上层定位点
pln_19 = Plane(pln_18)

# ----
# 1.是否有檐口线-檐口线定位点
toggle_3 = BooleanToggle(True)
clean_3 = CleanTree(RemoveNulls=True, RemoveInvalid=True, RemoveEmpty=toggle_3, Tree=pln_13)

# ---- group: Input ???
deplane_9 = DeconstructPlane(Plane=clean_3)  # -> Origin, XAxis, YAxis, ZAxis

# ----
incurve_6 = PointInCurve(Point=deplane_9.Origin, Curve=crv_27)  # -> Relationship, Point
equals_6 = Equality(FirstNumber=incurve_6.Relationship, SecondNumber="2")  # -> Equality, Inequality
dispatch_23 = Dispatch(List=clean_3, DispatchPattern=equals_6.Equality)  # -> ListA, ListB

# ----
# Site - 檐口线的定位点
pln_20 = Plane(dispatch_23.ListB)

incurve_7 = PointInCurve(Point=pln_20, Curve=crv_29)  # -> Relationship, Point
equals_7 = Equality(FirstNumber=incurve_7.Relationship, SecondNumber="2")  # -> Equality, Inequality
dispatch_24 = Dispatch(List=pln_20, DispatchPattern=equals_7.Equality)  # -> ListA, ListB
pln_21 = Plane(dispatch_24.ListB)

# ---- group: 建筑单体-檐口定位点
pln_22 = Plane(dispatch_24.ListA)

# ---- group: 檐口处定位点
pln_23 = Plane(pln_22)

# ----
# 区分内外梁边线
# 2.根据是否相交判定内外梁(平行于建筑边线方向）
crv_62 = Curve(filter)
offcrv = OffsetCurve(Curve=crv_53, Plane=PlaneXY(0, 0, 0), Distance=num_2, BothSides=expr("-x", num_2), Kinks=0, CapType="0")
midpt_2 = CurveMiddle(Curve=offcrv)
offcrv_2 = OffsetCurve(Curve=crv_53, Plane=PlaneXY(0, 0, 0), Distance=num_2, BothSides=expr("-x", num_2), Kinks=0, CapType="1")
crv_63 = Curve(offcrv)
item_32 = ListItem(List=midpt_2, Index=0, Wrap=True)
item_33 = ListItem(List=crv_63, Index=0, Wrap=True)
item_34 = ListItem(List=crv_63, Index="-1", Wrap=True)
graft_2 = GraftTree(Tree=crv_53, IncludeEmptyLists=True, IncludeNullItems=True)
panel_55 = Panel(num_2)

# ---- group: Pull到轮廓线
pull_9 = PullPoint(Point=midpt, Geometry=flatten(crv_62), ClosestOnly=True)  # -> ClosestPoint, Distance

# ----
# 梁线闭合
shift_2 = ShiftPaths(Data=offcrv_2, Offset=-1)

# ---- group: 和某组梁边线相连
ln_9 = Line(StartPoint=item_32, EndPoint=graft(pull_9.ClosestPoint))

# ---- group: 有交点为内
ccx_3 = CurveCurve(CurveA=ln_9, CurveB=graft_2)  # -> Points, ParamsA, ParamsB

# ----
null_4 = NullItem(Item=ccx_3.Points)  # -> NullFlags, InvalidFlags, Description
dispatch_25 = Dispatch(List=item_33, DispatchPattern=null_4.InvalidFlags)  # -> ListA, ListB
dispatch_26 = Dispatch(List=item_34, DispatchPattern=null_4.InvalidFlags)  # -> ListA, ListB

# ----
# 要连接的梁中线Offest值
# 要连接的梁中线curve
# 要连接的embed
# 梁边线-内
merge_19 = Merge(Data1=dispatch_25.ListB, Data2=dispatch_26.ListA)

# ----
# 梁边线-外
merge_20 = Merge(Data1=dispatch_25.ListA, Data2=dispatch_26.ListB)

# ---- group: 梁外侧
crv_64 = Curve(merge_20)

crv_65 = Curve(merge_20)

# ---- group: 内侧梁线
crv_66 = Curve(merge_19)

crv_67 = Curve(merge_19)

# ---- group: 梁外侧
crv_68 = Curve(merge_20)

# ----
crv_69 = Curve([crv_68, crv_66])
flatten_4 = FlattenTree(Tree=crv_69, Path="{0}")
boundary_3 = BoundarySurfaces(Edges=[offset_7, offset_8])
scx = SurfaceCurve(Surface=boundary_3, Curve=flatten_4)  # -> simplify(Curves), Points, UVPoints, Normals, Parameters, Tangents

# ---- group: 梁内测
crv_70 = Curve(merge_19)

# ---- group: 梁中线
crv_71 = Curve(shift_2)

# ---- group: 梁-外侧
crv_72 = Curve(merge_20)

# ---- group: 梁外侧
crv_73 = Curve(merge_20)

# ---- group: All BEAMS
crv_74 = Curve(scx.Curves)

# ---- group: 梁内测
crv_75 = Curve(merge_19)

# ---- group: 梁外侧
crv_76 = Curve(merge_20)

crv_77 = Curve(merge_20)

# ---- group: 梁内侧
crv_78 = Curve(crv_67)

# ---- group: 梁闭合offset
crv_79 = Curve(shift_2)

# ---- group: 梁外侧
crv_80 = Curve(merge_20)

crv_81 = Curve(crv_80)

# ----
crv_82 = Curve(shift_2)

# ---- group: 梁内测线
crv_83 = Curve(crv_70)

# ---- group: 梁内侧
crv_84 = Curve(merge_19)

# ---- group: 梁外侧
crv_85 = Curve(merge_20)

crv_86 = Curve(merge_20)

# ---- group: 梁offset
crv_87 = Curve(shift_2)

# ---- group: 梁外侧
crv_88 = Curve(merge_20)

crv_89 = Curve(crv_80)

# ---- group: 梁内侧
crv_90 = Curve(merge_19)

crv_91 = Curve(crv_67)

crv_92 = Curve(crv_67)

crv_93 = Curve(crv_67)

# ----
# 初筛： 最近的梁到定位点距离在300-600间保留
number_slider_23 = Slider(2000, range=0..10000)

number_slider_24 = Slider(3584, range=0..10000)
boundary_4 = BoundarySurfaces(Edges=[offset_6, offset_5])

# ---- group: 50-350建筑结构交点
scx_2 = SurfaceCurve(Surface=boundary_4, Curve=crv_67)  # -> flatten(Curves), Points, UVPoints, Normals, Parameters, Tangents

# ----
project_12 = Project(Geometry=crv_30, Plane=PlaneXY(0, 0, 0))  # -> Geometry, Transform
project_13 = Project(Geometry=pln_11, Plane=PlaneXY(0, 0, 0))  # -> Geometry, Transform
reb_2 = RebuildCurve(Curve=project_12.Geometry, Count=Slider(5000, range=0..10000), Tangents=False)

# ---- group: 楼板线以外的定位点
deplane_10 = DeconstructPlane(Plane=pln_19)  # -> Origin, XAxis, YAxis, ZAxis
incurves = PointInCurves(Point=deplane_10.Origin, Curves=flatten(reb_2))  # -> Relationship, Index, Point
equals_8 = Equality(FirstNumber=incurves.Relationship, SecondNumber="2")  # -> Equality, Inequality
dispatch_27 = Dispatch(List=pln_19, DispatchPattern=equals_8.Equality)  # -> ListA, ListB
pln_24 = Plane(dispatch_27.ListA)
data_21 = Data(dispatch_27.ListB)

# ----
# 1.0无檐口线-上层定位点
pln_25 = Plane(data_21)

pln_26 = Plane(pln_10)
number_slider_25 = Slider(5000, range=0..10000)
deplane_11 = DeconstructPlane(Plane=pln_26)  # -> Origin, XAxis, YAxis, ZAxis
amp_8 = Amplitude(Vector=deplane_11.YAxis, Amplitude=expr("-x", number_slider_25))
amp_9 = Amplitude(Vector=deplane_11.YAxis, Amplitude=number_slider_25)
move_15 = Move(Geometry=deplane_11.Origin, Motion=amp_9)  # -> Geometry, Transform
move_16 = Move(Geometry=deplane_11.Origin, Motion=amp_8)  # -> Geometry, Transform
ln_10 = Line(StartPoint=move_15.Geometry, EndPoint=move_16.Geometry)

# ---- group: 起始Plane
pln_27 = Plane(pln_26)

# ----
pln_28 = Plane(pln_27)
deplane_12 = DeconstructPlane(Plane=pln_28)  # -> Origin, XAxis, YAxis, ZAxis
amp_10 = Amplitude(Vector=deplane_12.YAxis, Amplitude=expr("-x", number_slider_23))
move_17 = Move(Geometry=deplane_12.Origin, Motion=amp_10)  # -> Geometry, Transform
ln_11 = Line(StartPoint=deplane_12.Origin, EndPoint=move_17.Geometry)
ccx_4 = CurveCurve(CurveA=flatten(crv_64), CurveB=simplify(graft(ln_11)))  # -> Points, ParamsA, ParamsB
shift_3 = ShiftPaths(Data=ccx_4.Points, Offset=-1)
graft_3 = GraftTree(Tree=deplane_12.Origin, IncludeEmptyLists=True, IncludeNullItems=True)  # -> simplify(Tree)
pull_10 = PullPoint(Point=shift_3, Geometry=graft_3, ClosestOnly=True)  # -> ClosestPoint, Distance
sort_7 = SortList(Keys=pull_10.Distance, ValuesA=shift_3)  # -> Keys, ValuesA
graft_4 = GraftTree(Tree=pln_28, IncludeEmptyLists=True, IncludeNullItems=True)  # -> flatten(Tree)
item_35 = ListItem(List=sort_7.Keys, Index=0, Wrap=True)  # -> flatten(Item)
c_script = CSharpScript(num=item_35, Max="600", Min="300")  # -> out, A, Distance; inputs num: list of Double, Max: Double
# ---------- c_script: C# ----------
    for(int i = 0; i < num.Count; i++){
      if(num[i] > 300 && num[i] < 600){
        Print(i.ToString());
        index.Add(i);
        dist.Add(num[i]);

      }
    }

    A = index;
    Distance = dist;
# ---------- c_script: C# additional code ----------
  List<double> index = new List<double>();
  List<double> dist = new List<double>();
# ---------- end c_script ----------
item_36 = ListItem(List=graft_4, Index=c_script.A, Wrap=True)

# ---- group: 和下层建筑的交点
ccx_5 = CurveCurve(CurveA=ln_10, CurveB=crv_34)  # -> Points, ParamsA, ParamsB

# ----
deplane_13 = DeconstructPlane(Plane=pln_27)  # -> Origin, XAxis, YAxis, ZAxis
amp_11 = Amplitude(Vector=deplane_13.YAxis, Amplitude=number_slider_24)
amp_12 = Amplitude(Vector=deplane_13.YAxis, Amplitude=expr("-x", number_slider_24))
move_18 = Move(Geometry=deplane_13.Origin, Motion=amp_12)  # -> Geometry, Transform
move_19 = Move(Geometry=deplane_13.Origin, Motion=amp_11)  # -> Geometry, Transform
ln_12 = Line(StartPoint=move_18.Geometry, EndPoint=move_19.Geometry)

# ---- group: 该区间的定位点
ccx_6 = CurveCurve(CurveA=graft(ln_12), CurveB=scx_2.Curves)  # -> Points, ParamsA, ParamsB

# ----
shift_4 = ShiftPaths(Data=ccx_6.Points, Offset=-1)
pull_11 = PullPoint(Point=graft(pln_27), Geometry=shift_4, ClosestOnly=True)  # -> ClosestPoint, Distance
sort_8 = SortList(Keys=pull_11.Distance, ValuesA=pull_11.ClosestPoint)  # -> Keys, ValuesA
null_5 = NullItem(Item=sort_8.ValuesA)  # -> NullFlags, simplify(InvalidFlags), Description
item_37 = ListItem(List=sort_8.ValuesA, Index=0, Wrap=True)
dispatch_28 = Dispatch(List=simplify(graft(pln_27)), DispatchPattern=null_5.InvalidFlags)  # -> ListA, ListB
dispatch_29 = Dispatch(List=simplify(graft(item_37)), DispatchPattern=null_5.InvalidFlags)  # -> ListA, ListB
pln_29 = Plane(dispatch_28.ListB)
pln_30 = Plane(dispatch_28.ListA)
pt_13 = Point(dispatch_29.ListB)

# ----
# 按照梁分类定位点
crv_94 = Curve(shift_2)
pt_14 = Point(pt_13)
incurves_2 = PointInCurves(Point=flatten(pt_14), Curves=crv_94)  # -> Relationship, Index, Point
equals_9 = Equality(FirstNumber=incurves_2.Relationship, SecondNumber="0")  # -> Equality, Inequality
dispatch_30 = Dispatch(List=flatten(pt_14), DispatchPattern=equals_9.Inequality)  # -> ListA, ListB

# ---- group: 交点-属于哪个梁
data_22 = Data(dispatch_30.ListA)

# ----
# 可能的结构交点-大量
pln_31 = Plane(pln_30)

# ----
# 0 檐口出定位点
# 与结构无交点
pln_32 = Plane(flatten(pln_31))

deplane_14 = DeconstructPlane(Plane=pln_23)  # -> Origin, XAxis, YAxis, ZAxis
amp_13 = Amplitude(Vector=deplane_14.YAxis, Amplitude=number_slider_18)
amp_14 = Amplitude(Vector=deplane_14.YAxis, Amplitude=number_slider_17)
move_20 = Move(Geometry=deplane_14.Origin, Motion=expr("-x", amp_14))  # -> Geometry, Transform
move_21 = Move(Geometry=deplane_14.Origin, Motion=amp_13)  # -> Geometry, Transform
merge_21 = Merge(Data1=crv_31, Data2=crv_32)
ln_13 = Line(StartPoint=move_20.Geometry, EndPoint=move_21.Geometry)
project_14 = Project(Geometry=ln_13, Plane=PlaneXY(0, 0, 0))  # -> Geometry, Transform
project_15 = Project(Geometry=crv_72, Plane=PlaneXY(0, 0, 0))  # -> Geometry, Transform
project_16 = Project(Geometry=merge_21, Plane=PlaneXY(0, 0, 0))  # -> Geometry, Transform
ccx_7 = CurveCurve(CurveA=graft(project_14.Geometry), CurveB=flatten(project_15.Geometry))  # -> Points, ParamsA, ParamsB
shift_5 = ShiftPaths(Data=ccx_7.Points, Offset=-1)
pull_12 = PullPoint(Point=shift_5, Geometry=flatten(project_16.Geometry), ClosestOnly=True)  # -> ClosestPoint, Distance
sort_9 = SortList(Keys=pull_12.Distance, ValuesA=shift_5)  # -> Keys, ValuesA
item_38 = ListItem(List=sort_9.ValuesA, Index=0, Wrap=True)
null_6 = NullItem(Item=flatten(item_38))  # -> NullFlags, InvalidFlags, Description
dispatch_31 = Dispatch(List=flatten(item_38), DispatchPattern=null_6.InvalidFlags)  # -> ListA, ListB
dispatch_32 = Dispatch(List=pln_23, DispatchPattern=null_6.InvalidFlags)  # -> ListA, ListB

# ---- group: 交点对应的初始Plane
data_23 = Data(dispatch_32.ListB)

# ---- group: 交点Point
data_24 = Data(dispatch_31.ListB)

# ----
# 按照梁分类定位点
pt_15 = Point(data_24)
incurves_3 = PointInCurves(Point=flatten(pt_15), Curves=crv_71)  # -> Relationship, Index, Point
equals_10 = Equality(FirstNumber=incurves_3.Relationship, SecondNumber="0")  # -> Equality, Inequality
dispatch_33 = Dispatch(List=flatten(pt_15), DispatchPattern=equals_10.Inequality)  # -> ListA, ListB

check_same_points_4 = CheckSamePoints(archPoint=pln_23, crvPoint=data_23)  # -> out, specialPt; inputs archPoint: list of Point3d, crvPoint: list of Point3d; same code as testpoint

# ----
# 0无檐口线 与梁不相交
cull_i_7 = CullIndex(List=pln_23, Indices=check_same_points_4.specialPt, Wrap=True)

# ---- group: 交点-属于哪个梁
data_25 = Data(dispatch_33.ListA)

# ----
# 0 檐口出定位点
# 与结构无交点
pln_33 = Plane(cull_i_7)

# ----
# 二次筛选檐口处
# 埋件定位点Offset，没有找到和梁的交点
deplane_15 = DeconstructPlane(Plane=pln_33)  # -> Origin, XAxis, YAxis, ZAxis
amp_15 = Amplitude(Vector=deplane_15.YAxis, Amplitude=expr("-X", number_slider_17))
move_22 = Move(Geometry=deplane_15.Origin, Motion=amp_15)  # -> Geometry, Transform
ln_14 = Line(StartPoint=move_22.Geometry, EndPoint=deplane_15.Origin)
amp_16 = Amplitude(Vector=deplane_15.XAxis, Amplitude=expr("-x", number_slider_6))
amp_17 = Amplitude(Vector=deplane_15.XAxis, Amplitude=number_slider_6)

# ---- group: 2条Offset的探针找交点
move_23 = Move(Geometry=ln_14, Motion=amp_17)  # -> Geometry, Transform
move_24 = Move(Geometry=ln_14, Motion=amp_16)  # -> Geometry, Transform

# ---- group: 楼板线以外的定位点
deplane_16 = DeconstructPlane(Plane=project_13.Geometry)  # -> Origin, XAxis, YAxis, ZAxis

# ----
pt_16 = Point(deplane_16.Origin)

# ---- group: 楼板线以外的定位点 (continued)
incurves_4 = PointInCurves(Point=pt_16, Curves=flatten(reb_2))  # -> Relationship, Index, Point
equals_11 = Equality(FirstNumber=incurves_4.Relationship, SecondNumber="2")  # -> Equality, Inequality
dispatch_34 = Dispatch(List=project_13.Geometry, DispatchPattern=equals_11.Equality)  # -> ListA, ListB
data_26 = Data(dispatch_34.ListB)

# ----
# 1.0无檐口线-下层定位点
pln_34 = Plane(data_26)

# ----
# 3.2下层建筑边线内侧300-600mm范围内
item_39 = ListItem(List=sort_7.ValuesA, Index=0, Wrap=True)  # -> flatten(Item)
item_40 = ListItem(List=item_39, Index=c_script.A, Wrap=True)

pln_35 = Plane(item_36)
boundary_5 = BoundarySurfaces(Edges=[offset_10, offset_9])
number_slider_26 = Slider(3584, range=0..10000)
deplane_17 = DeconstructPlane(Plane=pln_35)  # -> Origin, XAxis, YAxis, ZAxis
scx_3 = SurfaceCurve(Surface=boundary_5, Curve=crv_65)  # -> flatten(Curves), Points, UVPoints, Normals, Parameters, Tangents
amp_18 = Amplitude(Vector=deplane_17.YAxis, Amplitude=number_slider_26)
amp_19 = Amplitude(Vector=deplane_17.YAxis, Amplitude=expr("-x", number_slider_26))
move_25 = Move(Geometry=deplane_17.Origin, Motion=amp_19)  # -> Geometry, Transform
move_26 = Move(Geometry=deplane_17.Origin, Motion=amp_18)  # -> Geometry, Transform
ln_15 = Line(StartPoint=move_25.Geometry, EndPoint=move_26.Geometry)
ccx_8 = CurveCurve(CurveA=graft(ln_15), CurveB=scx_3.Curves)  # -> Points, ParamsA, ParamsB
shift_6 = ShiftPaths(Data=ccx_8.Points, Offset=-1)
pull_13 = PullPoint(Point=graft(pln_35), Geometry=shift_6, ClosestOnly=True)  # -> ClosestPoint, Distance
sort_10 = SortList(Keys=pull_13.Distance, ValuesA=pull_13.ClosestPoint)  # -> Keys, ValuesA
item_41 = ListItem(List=sort_10.ValuesA, Index=0, Wrap=True)
null_7 = NullItem(Item=item_41)  # -> NullFlags, simplify(InvalidFlags), Description
null_8 = NullItem(Item=sort_10.ValuesA)  # -> NullFlags, simplify(InvalidFlags), Description
dispatch_35 = Dispatch(List=simplify(graft(pln_35)), DispatchPattern=null_8.InvalidFlags)  # -> ListA, ListB
dispatch_36 = Dispatch(List=simplify(graft(item_41)), DispatchPattern=null_7.InvalidFlags)  # -> ListA, ListB
pt_17 = Point(item_40)
pln_36 = Plane(dispatch_35.ListB)
pln_37 = Plane(dispatch_35.ListA)

# ----
# 按照梁分类定位点
crv_95 = Curve(shift_2)
pt_18 = Point(pt_17)
incurves_5 = PointInCurves(Point=flatten(pt_18), Curves=crv_95)  # -> Relationship, Index, Point
equals_12 = Equality(FirstNumber=incurves_5.Relationship, SecondNumber="0")  # -> Equality, Inequality
dispatch_37 = Dispatch(List=flatten(pt_18), DispatchPattern=equals_12.Inequality)  # -> ListA, ListB

# ---- group: 交点-属于哪个梁
data_27 = Data(dispatch_37.ListA)

# ----
# 可能的结构交点-大量
null_9 = NullItem(Item=item_39)  # -> NullFlags, InvalidFlags, Description
dispatch_38 = Dispatch(List=pln_28, DispatchPattern=null_9.NullFlags)  # -> ListA, ListB
pln_38 = Plane(dispatch_38.ListA)

# ----
# 0 檐口出定位点
# 与结构无交点
pln_39 = Plane(flatten(pln_38))

pln_40 = Plane(pln_10)
deplane_18 = DeconstructPlane(Plane=pln_40)  # -> Origin, XAxis, YAxis, ZAxis
amp_20 = Amplitude(Vector=deplane_18.YAxis, Amplitude=expr("-x", Slider(5000, range=0..10000)))
move_27 = Move(Geometry=deplane_18.Origin, Motion=amp_20)  # -> Geometry, Transform
ln_16 = Line(StartPoint=move_27.Geometry, EndPoint=deplane_18.Origin)
amp_21 = Amplitude(Vector=deplane_18.XAxis, Amplitude=number_slider_6)
amp_22 = Amplitude(Vector=deplane_18.XAxis, Amplitude=expr("-x", number_slider_6))
move_28 = Move(Geometry=ln_16, Motion=amp_22)  # -> Geometry, Transform
move_29 = Move(Geometry=ln_16, Motion=amp_21)  # -> Geometry, Transform
move_30 = Move(Geometry=pln_40, Motion=amp_22)  # -> Geometry, Transform
move_31 = Move(Geometry=pln_40, Motion=amp_21)  # -> Geometry, Transform

pln_41 = Plane(move_31.Geometry)
deplane_19 = DeconstructPlane(Plane=pln_41)  # -> Origin, XAxis, YAxis, ZAxis
amp_23 = Amplitude(Vector=deplane_19.YAxis, Amplitude=expr("-x", Slider(2000, range=0..10000)))
move_32 = Move(Geometry=deplane_19.Origin, Motion=amp_23)  # -> Geometry, Transform
ln_17 = Line(StartPoint=deplane_19.Origin, EndPoint=move_32.Geometry)
ccx_9 = CurveCurve(CurveA=flatten(crv_74), CurveB=simplify(graft(move_29.Geometry)))  # -> Points, ParamsA, ParamsB

pln_42 = Plane(pln_40)
deplane_20 = DeconstructPlane(Plane=pln_42)  # -> Origin, XAxis, YAxis, ZAxis
amp_24 = Amplitude(Vector=deplane_20.YAxis, Amplitude=expr("-x", Slider(2000, range=0..10000)))
move_33 = Move(Geometry=deplane_20.Origin, Motion=amp_24)  # -> Geometry, Transform
ln_18 = Line(StartPoint=deplane_20.Origin, EndPoint=move_33.Geometry)
ccx_10 = CurveCurve(CurveA=flatten(crv_74), CurveB=simplify(graft(move_28.Geometry)))  # -> Points, ParamsA, ParamsB

pln_43 = Plane(move_30.Geometry)
deplane_21 = DeconstructPlane(Plane=pln_43)  # -> Origin, XAxis, YAxis, ZAxis
amp_25 = Amplitude(Vector=deplane_21.YAxis, Amplitude=expr("-x", Slider(2000, range=0..10000)))
move_34 = Move(Geometry=deplane_21.Origin, Motion=amp_25)  # -> Geometry, Transform
ln_19 = Line(StartPoint=deplane_21.Origin, EndPoint=move_34.Geometry)
ccx_11 = CurveCurve(CurveA=flatten(crv_74), CurveB=simplify(graft(move_28.Geometry)))  # -> Points, ParamsA, ParamsB

shift_7 = ShiftPaths(Data=ccx_9.Points, Offset=-1)
shift_8 = ShiftPaths(Data=ccx_10.Points, Offset=-1)
shift_9 = ShiftPaths(Data=ccx_11.Points, Offset=-1)
merge_22 = Merge(Data1=shift_7, Data2=shift_9, Data3=shift_8)
item_42 = ListItem(List=merge_22, Index=0, Wrap=True)
null_10 = NullItem(Item=item_42)  # -> flatten(NullFlags), InvalidFlags, Description
pln_44 = Plane(pln_42)
dispatch_39 = Dispatch(List=pln_44, DispatchPattern=null_10.NullFlags)  # -> ListA, ListB
panel_56 = Panel(null_10.NullFlags)
pln_45 = Plane(dispatch_39.ListA)
deplane_22 = DeconstructPlane(Plane=pln_45)  # -> Origin, XAxis, YAxis, ZAxis
amp_26 = Amplitude(Vector=deplane_22.YAxis, Amplitude="-300")
move_35 = Move(Geometry=deplane_22.Origin, Motion=amp_26)  # -> Geometry, Transform
move2pt_4 = MoveToPoint(Geometry=pln_45, PointA=deplane_22.Origin, PointB=move_35.Geometry)  # -> Moved, Vector, Transform

# ----
# 4.0 默认位置为建筑边线向内300mm
# 侧埋，钢板焊
# 03：钢板焊埋件[钢梁外侧]@钢边梁宽@钢边梁高
data_28 = Data(flatten(merge_3))
pln_46 = Plane(move2pt_4.Moved)
item_43 = ListItem(List=data_28, Index=0, Wrap=True)
item_44 = ListItem(List=data_28, Index="-1", Wrap=True)
orient_3 = Orient(Geometry=item_43, Source=item_44, Target=pln_46)  # -> Geometry, Transform

data_29 = Data(orient_3.Geometry)
ungroup_6 = Ungroup(Group=data_29)
item_45 = ListItem(List=ungroup_6, Index=0, Wrap=True)  # -> flatten(Item)
item_46 = ListItem(List=ungroup_6, Index="-1", Wrap=True)  # -> flatten(Item)

# ---- group: 范围内没有钢梁，默认幕墙线向内300有一个埋件 (continued)
entwine_13 = Entwine(Branch00=item_45, Branch01=item_46, FlattenInputs=True)
bake_2 = BakeObjects(Geometry=entwine_13, Attributes=attributes_10, BakeName=panel_35, Bake=False)

# ----
null_11 = NullItem(Item=ccx_5.Points)  # -> NullFlags, InvalidFlags, Description
dispatch_40 = Dispatch(List=simplify(ccx_5.Points), DispatchPattern=simplify(null_11.NullFlags))  # -> ListA, ListB
dispatch_41 = Dispatch(List=simplify(graft(pln_26)), DispatchPattern=simplify(null_11.NullFlags))  # -> ListA, ListB
pln_47 = Plane(flatten(dispatch_41.ListB))
pt_19 = Point(dispatch_40.ListB)
pt_20 = Point(pln_47)
pull_14 = PullPoint(Point=flatten(pt_20), Geometry=flatten(pt_19), ClosestOnly=True)  # -> ClosestPoint, Distance
ln_20 = Line(StartPoint=pln_47, EndPoint=pull_14.ClosestPoint)

# ----
# 定位点Project到下层建筑线
move2pt_5 = MoveToPoint(Geometry=pln_47, PointA=pln_47, PointB=pull_14.ClosestPoint)  # -> Moved, Vector, Transform

# ----
# 可能的点-离结构很远
pln_48 = Plane(dispatch_41.ListA)

# ---- group: 上下幕墙有效点
pln_49 = Plane(pln_25)
pln_50 = Plane(pln_34)
number_slider_27 = Slider(3584, range=0..10000)
deplane_23 = DeconstructPlane(Plane=pln_50)  # -> Origin, XAxis, YAxis, ZAxis
deplane_24 = DeconstructPlane(Plane=pln_49)  # -> Origin, XAxis, YAxis, ZAxis
number_slider_28 = Slider(3584, range=0..10000)
amp_27 = Amplitude(Vector=deplane_23.YAxis, Amplitude=expr("-x", number_slider_28))
amp_28 = Amplitude(Vector=deplane_23.YAxis, Amplitude=number_slider_28)
amp_29 = Amplitude(Vector=deplane_24.YAxis, Amplitude=expr("-x", number_slider_27))
amp_30 = Amplitude(Vector=deplane_24.YAxis, Amplitude=number_slider_27)
move_36 = Move(Geometry=deplane_23.Origin, Motion=amp_27)  # -> Geometry, Transform
move_37 = Move(Geometry=deplane_23.Origin, Motion=amp_28)  # -> Geometry, Transform
move_38 = Move(Geometry=deplane_24.Origin, Motion=amp_29)  # -> Geometry, Transform
move_39 = Move(Geometry=deplane_24.Origin, Motion=amp_30)  # -> Geometry, Transform
ln_21 = Line(StartPoint=move_38.Geometry, EndPoint=move_39.Geometry)
ln_22 = Line(StartPoint=move_36.Geometry, EndPoint=move_37.Geometry)
number_slider_29 = Slider(20, range=0..100)

# ---- group: 上下幕墙有效点 / 下层点+上层线
ccx_12 = CurveCurve(CurveA=graft(ln_22), CurveB=crv_39)  # -> Points, ParamsA, ParamsB

# ---- group: 上下幕墙有效点 / 下层点+下层线
ccx_13 = CurveCurve(CurveA=graft(ln_22), CurveB=crv_33)  # -> Points, ParamsA, ParamsB

# ---- group: 上下幕墙有效点 / 上层点+上层线
ccx_14 = CurveCurve(CurveA=graft(ln_21), CurveB=crv_39)  # -> Points, ParamsA, ParamsB

# ---- group: 上下幕墙有效点 / 上层点+下层线
ccx_15 = CurveCurve(CurveA=graft(ln_21), CurveB=crv_33)  # -> Points, ParamsA, ParamsB

# ----
deplane_25 = DeconstructPlane(Plane=move2pt_5.Moved)  # -> Origin, XAxis, YAxis, ZAxis
amp_31 = Amplitude(Vector=deplane_25.YAxis, Amplitude=Slider(5000, range=0..10000))
move_40 = Move(Geometry=deplane_25.Origin, Motion=amp_31)  # -> Geometry, Transform
ln_23 = Line(StartPoint=move_40.Geometry, EndPoint=deplane_25.Origin)

# ---- group: 和内测梁交点
ccx_16 = CurveCurve(CurveA=graft(ln_23), CurveB=flatten(crv_70))  # -> simplify(Points), ParamsA, ParamsB

# ----
# 按照梁分类定位PLANE
shift_10 = ShiftPaths(Data=crv_81, Offset=-1)
shift_11 = ShiftPaths(Data=shift_10, Offset=-1)
pull_15 = PullPoint(Point=data_22, Geometry=simplify(shift_11), ClosestOnly=True)  # -> ClosestPoint, Distance
ln_24 = Line(StartPoint=pull_15.ClosestPoint, EndPoint=data_22)

# ---- group: Y Axis Line-All
crv_96 = Curve(ln_24)

# ----
shift_12 = ShiftPaths(Data=ccx_16.Points, Offset=-1)
null_12 = NullItem(Item=shift_12)  # -> NullFlags, InvalidFlags, Description
dispatch_42 = Dispatch(List=simplify(graft(move2pt_5.Moved)), DispatchPattern=null_12.NullFlags)  # -> ListA, ListB
dispatch_43 = Dispatch(List=simplify(graft(ln_23)), DispatchPattern=null_12.NullFlags)  # -> ListA, ListB
pln_51 = Plane(dispatch_42.ListA)
crv_97 = Curve(dispatch_43.ListB)
pln_52 = Plane(dispatch_42.ListB)
ccx_17 = CurveCurve(CurveA=graft(crv_97), CurveB=flatten(crv_70))  # -> Points, ParamsA, ParamsB
shift_13 = ShiftPaths(Data=simplify(ccx_17.Points), Offset=-1)
pull_16 = PullPoint(Point=pln_52, Geometry=shift_13, ClosestOnly=True)  # -> ClosestPoint, Distance
sort_11 = SortList(Keys=pull_16.Distance, ValuesA=pull_16.ClosestPoint)  # -> Keys, ValuesA

# ---- group: 交点对应的起始定位点
item_47 = ListItem(List=sort_11.ValuesA, Index=0, Wrap=True)

# ----
ln_25 = Line(StartPoint=pln_52, EndPoint=item_47)
len_5 = Length(Curve=ln_25)
larger_5 = LargerThan(FirstNumber=len_5, SecondNumber=number_slider_20)  # -> LargerThan, OrEqualTo
panel_57 = Panel(len_5)
dispatch_44 = Dispatch(List=pln_52, DispatchPattern=larger_5.LargerThan)  # -> ListA, ListB
dispatch_45 = Dispatch(List=item_47, DispatchPattern=larger_5.LargerThan)  # -> ListA, ListB
pln_53 = Plane(dispatch_44.ListB)

# ---- group: 起始点
pt_21 = Point(dispatch_45.ListA)

# ----
# 按照梁分类定位点
pt_22 = Point(pt_21)
incurves_6 = PointInCurves(Point=flatten(pt_22), Curves=crv_79)  # -> Relationship, Index, Point
equals_13 = Equality(FirstNumber=incurves_6.Relationship, SecondNumber="0")  # -> Equality, Inequality
dispatch_46 = Dispatch(List=flatten(pt_22), DispatchPattern=equals_13.Inequality)  # -> ListA, ListB

# ---- group: 交点-属于哪个梁
data_30 = Data(dispatch_46.ListA)

# ----
# 可能的结构交点-大量
pln_54 = Plane(pln_51)

# ----
# 可能的结构交点
pln_55 = Plane(pln_53)

# ----
# 按照梁分类定位PLANE
cullduppoints = RemoveDuplicatePoints(InputPoints=data_25, Tolerance=0.001)  # -> OutputPoints, FirstPointIndexes
shift_14 = ShiftPaths(Data=crv_75, Offset=-1)
shift_15 = ShiftPaths(Data=shift_14, Offset=-1)
pull_17 = PullPoint(Point=cullduppoints.OutputPoints, Geometry=simplify(shift_15), ClosestOnly=True)  # -> ClosestPoint, Distance
ln_26 = Line(StartPoint=pull_17.ClosestPoint, EndPoint=cullduppoints.OutputPoints)
movetoplane_4 = MoveToPlane(Geometry=crv_40, Plane=PlaneXY(0, 0, 0), Above=True, Below=True)  # -> Geometry, Transform

# ---- group: Y Axis Line-All
crv_98 = Curve(ln_26)

# ----
end = EndPoints(Curve=graft(crv_98))  # -> Start, End
merge_23 = Merge(Data1=end.Start, Data2=end.End)
pull_18 = PullPoint(Point=merge_23, Geometry=movetoplane_4.Geometry, ClosestOnly=True)  # -> ClosestPoint, Distance
sort_12 = SortList(Keys=pull_18.Distance, ValuesA=merge_23)  # -> Keys, ValuesA
item_48 = ListItem(List=sort_12.ValuesA, Index="-1", Wrap=True)
item_49 = ListItem(List=sort_12.ValuesA, Index=0, Wrap=True)
null_13 = NullItem(Item=item_48)  # -> NullFlags, InvalidFlags, Description
null_14 = NullItem(Item=item_49)  # -> NullFlags, InvalidFlags, Description
dispatch_47 = Dispatch(List=item_49, DispatchPattern=null_14.NullFlags)  # -> ListA, ListB
dispatch_48 = Dispatch(List=item_48, DispatchPattern=null_13.NullFlags)  # -> ListA, ListB
pt_23 = Point(dispatch_47.ListB)
pt_24 = Point(dispatch_48.ListB)
ln_27 = Line(StartPoint=pt_24, EndPoint=pt_23)
end_2 = EndPoints(Curve=graft(ln_27))  # -> Start, End
rotate_8 = Rotate(Geometry=ln_27, Angle=1.570796327, Plane=pt_23)  # -> Geometry, Transform
pt_25 = Point(end_2.End)
pl_6 = ConstructPlane(Origin=pt_25, XAxis=rotate_8.Geometry, YAxis=ln_27)
null_15 = NullItem(Item=pl_6)  # -> NullFlags, InvalidFlags, Description
dispatch_49 = Dispatch(List=pl_6, DispatchPattern=null_15.NullFlags)  # -> ListA, ListB
pln_56 = Plane(dispatch_49.ListB)

# ---- group: 上下幕墙有效点 (continued)
pull_19 = PullPoint(Point=ccx_14.Points, Geometry=ccx_15.Points, ClosestOnly=True)  # -> ClosestPoint, Distance
pull_20 = PullPoint(Point=ccx_13.Points, Geometry=ccx_12.Points, ClosestOnly=True)  # -> ClosestPoint, Distance
panel_58 = Panel(pull_20.Distance)
smaller_7 = SmallerThan(FirstNumber=pull_20.Distance, SecondNumber=number_slider_29)  # -> SmallerThan, OrEqualTo
smaller_8 = SmallerThan(FirstNumber=pull_19.Distance, SecondNumber=number_slider_29)  # -> SmallerThan, OrEqualTo
dispatch_50 = Dispatch(List=pln_50, DispatchPattern=flatten(smaller_7.SmallerThan))  # -> ListA, ListB
dispatch_51 = Dispatch(List=pln_49, DispatchPattern=flatten(smaller_8.SmallerThan))  # -> ListA, ListB

# ---- group: 上下幕墙有效点 / 上层有效点
pln_57 = Plane(dispatch_51.ListA)

# ---- group: 上下幕墙有效点 / 下层有效点
pln_58 = Plane(dispatch_50.ListA)

# ---- group: 上下幕墙有效点 (continued)
pt_26 = Point(pln_57)
pt_27 = Point(pln_58)
pull_21 = PullPoint(Point=pt_26, Geometry=pt_27, ClosestOnly=True)  # -> ClosestPoint, Distance
larger_6 = LargerThan(FirstNumber=pull_21.Distance, SecondNumber=number_slider_21)  # -> LargerThan, OrEqualTo
dispatch_52 = Dispatch(List=pln_57, DispatchPattern=larger_6.LargerThan)  # -> ListA, ListB
pln_59 = Plane(dispatch_52.ListA)

# ---- group: 上下层共同有效点
merge_24 = Merge(Data1=pln_58, Data2=pln_59)

# ----
end_3 = EndPoints(Curve=graft(crv_96))  # -> Start, End
merge_25 = Merge(Data1=end_3.Start, Data2=end_3.End)

# ----
# 按照梁分类定位PLANE
shift_16 = ShiftPaths(Data=crv_78, Offset=-1)
shift_17 = ShiftPaths(Data=shift_16, Offset=-1)
pull_22 = PullPoint(Point=data_27, Geometry=simplify(shift_17), ClosestOnly=True)  # -> ClosestPoint, Distance
ln_28 = Line(StartPoint=pull_22.ClosestPoint, EndPoint=data_27)

# ---- group: Y Axis Line-All
crv_99 = Curve(ln_28)

# ----
ccx_18 = CurveCurve(CurveA=graft(move_24.Geometry), CurveB=flatten(crv_76))  # -> Points, ParamsA, ParamsB
shift_18 = ShiftPaths(Data=ccx_18.Points, Offset=-1)
pull_23 = PullPoint(Point=shift_18, Geometry=graft(pln_33), ClosestOnly=True)  # -> ClosestPoint, Distance
sort_13 = SortList(Keys=pull_23.Distance, ValuesA=pull_23.ClosestPoint)  # -> Keys, ValuesA

# ---- group: 最远交点
item_50 = ListItem(List=sort_13.ValuesA, Index="-1", Wrap=True)

# ----
null_16 = NullItem(Item=flatten(item_50))  # -> NullFlags, InvalidFlags, Description
dispatch_53 = Dispatch(List=simplify(item_50), DispatchPattern=simplify(graft(null_16.InvalidFlags)))  # -> ListA, ListB
dispatch_54 = Dispatch(List=pln_33, DispatchPattern=null_16.InvalidFlags)  # -> ListA, ListB
pt_28 = Point(dispatch_53.ListB)
pln_60 = Plane(dispatch_54.ListB)

# ----
# 按照梁分类定位点
pt_29 = Point(pt_28)
incurves_7 = PointInCurves(Point=flatten(pt_29), Curves=crv_82)  # -> Relationship, Index, Point
equals_14 = Equality(FirstNumber=incurves_7.Relationship, SecondNumber="0")  # -> Equality, Inequality
dispatch_55 = Dispatch(List=flatten(pt_29), DispatchPattern=equals_14.Inequality)  # -> ListA, ListB

# ---- group: 交点-属于哪个梁
data_31 = Data(dispatch_55.ListA)

# ----
ccx_19 = CurveCurve(CurveA=graft(move_23.Geometry), CurveB=flatten(crv_77))  # -> Points, ParamsA, ParamsB
shift_19 = ShiftPaths(Data=ccx_19.Points, Offset=-1)
pull_24 = PullPoint(Point=shift_19, Geometry=graft(pln_33), ClosestOnly=True)  # -> ClosestPoint, Distance
sort_14 = SortList(Keys=pull_24.Distance, ValuesA=pull_24.ClosestPoint)  # -> Keys, ValuesA

# ---- group: 最远交点
item_51 = ListItem(List=sort_14.ValuesA, Index="-1", Wrap=True)

# ----
null_17 = NullItem(Item=flatten(item_51))  # -> NullFlags, InvalidFlags, Description
dispatch_56 = Dispatch(List=simplify(item_51), DispatchPattern=simplify(graft(null_17.InvalidFlags)))  # -> ListA, ListB
dispatch_57 = Dispatch(List=pln_33, DispatchPattern=null_17.InvalidFlags)  # -> ListA, ListB
pt_30 = Point(dispatch_56.ListB)
pln_61 = Plane(dispatch_57.ListB)

# ----
# 按照梁分类定位点
pt_31 = Point(pt_30)
incurves_8 = PointInCurves(Point=flatten(pt_31), Curves=crv_82)  # -> Relationship, Index, Point
equals_15 = Equality(FirstNumber=incurves_8.Relationship, SecondNumber="0")  # -> Equality, Inequality
dispatch_58 = Dispatch(List=flatten(pt_31), DispatchPattern=equals_15.Inequality)  # -> ListA, ListB

# ---- group: 交点-属于哪个梁
data_32 = Data(dispatch_58.ListA)

# ----
# 3.1下层建筑边线外侧50-350mm范围内
pt_32 = Point(end_3.End)
pln_62 = Plane(pln_29)
crv_100 = Curve(shift_2)

end_4 = EndPoints(Curve=graft(crv_99))  # -> Start, End
merge_26 = Merge(Data1=end_4.Start, Data2=end_4.End)

deplane_26 = DeconstructPlane(Plane=merge_24)  # -> Origin, XAxis, YAxis, ZAxis
amp_32 = Amplitude(Vector=deplane_26.YAxis, Amplitude=expr("-x", Slider(2756, range=0..10000)))
move_41 = Move(Geometry=deplane_26.Origin, Motion=amp_32)  # -> Geometry, Transform

# ---- group: 相内探索
ln_29 = Line(StartPoint=deplane_26.Origin, EndPoint=move_41.Geometry)

# ----
# 2是否有吊顶
# 梁以内>350
merge_27 = Merge(Data1=project_6.Geometry, Data2=crv_2)
merge_28 = Merge(Data1=project_6.Geometry, Data2=crv_2)

# ---- group: All檐口线
crv_101 = Curve(merge_27)

crv_102 = Curve(merge_28)

crv_103 = Curve(crv_102)

# ----
movetoplane_5 = MoveToPlane(Geometry=crv_103, Plane=PlaneXY(0, 0, 0), Above=True, Below=True)  # -> Geometry, Transform
pull_25 = PullPoint(Point=merge_25, Geometry=movetoplane_5.Geometry, ClosestOnly=True)  # -> ClosestPoint, Distance
sort_15 = SortList(Keys=pull_25.Distance, ValuesA=merge_25)  # -> Keys, ValuesA
item_52 = ListItem(List=sort_15.ValuesA, Index="-1", Wrap=True)
item_53 = ListItem(List=sort_15.ValuesA, Index=0, Wrap=True)
pt_33 = Point(item_53)
pt_34 = Point(item_52)
ln_30 = Line(StartPoint=pt_34, EndPoint=pt_33)
rotate_9 = Rotate(Geometry=ln_30, Angle=1.570796327, Plane=pt_33)  # -> Geometry, Transform
pl_7 = ConstructPlane(Origin=pt_32, XAxis=rotate_9.Geometry, YAxis=ln_30)
null_18 = NullItem(Item=pl_7)  # -> NullFlags, InvalidFlags, Description
dispatch_59 = Dispatch(List=pl_7, DispatchPattern=null_18.NullFlags)  # -> ListA, ListB
pln_63 = Plane(dispatch_59.ListB)

# ---- group: All檐口线
crv_104 = Curve(crv_102)

crv_105 = Curve(crv_102)

crv_106 = Curve(crv_102)

# ----
movetoplane_6 = MoveToPlane(Geometry=crv_104, Plane=PlaneXY(0, 0, 0), Above=True, Below=True)  # -> Geometry, Transform
pull_26 = PullPoint(Point=merge_26, Geometry=movetoplane_6.Geometry, ClosestOnly=True)  # -> ClosestPoint, Distance
sort_16 = SortList(Keys=pull_26.Distance, ValuesA=merge_26)  # -> Keys, ValuesA
item_54 = ListItem(List=sort_16.ValuesA, Index="-1", Wrap=True)
item_55 = ListItem(List=sort_16.ValuesA, Index=0, Wrap=True)
pt_35 = Point(item_55)
pt_36 = Point(item_54)
ln_31 = Line(StartPoint=pt_36, EndPoint=pt_35)
rotate_10 = Rotate(Geometry=ln_31, Angle=1.570796327, Plane=pt_35)  # -> Geometry, Transform

shift_20 = ShiftPaths(Data=pln_63, Offset=-1)

# ---- group: 檐口-首次筛选的有效起始Plane
data_33 = Data(shift_20)

# ----
# 3.1
# 下层建筑边线外侧50-350mm
# 03：钢板焊埋件[钢梁内侧]
# @钢边梁宽@钢边梁高
pln_64 = Plane(data_33)

ccx_20 = CurveCurve(CurveA=graft(ln_29), CurveB=flatten(crv_73))  # -> Points, ParamsA, ParamsB
shift_21 = ShiftPaths(Data=ccx_20.Points, Offset=-1)
pull_27 = PullPoint(Point=deplane_26.Origin, Geometry=shift_21, ClosestOnly=True)  # -> ClosestPoint, Distance
sort_17 = SortList(Keys=pull_27.Distance, ValuesA=pull_27.ClosestPoint)  # -> Keys, ValuesA

# ---- group: 与梁最近交点
item_56 = ListItem(List=sort_17.ValuesA, Index=0, Wrap=True)

# ----
null_19 = NullItem(Item=flatten(item_56))  # -> NullFlags, InvalidFlags, Description
dispatch_60 = Dispatch(List=flatten(item_56), DispatchPattern=null_19.InvalidFlags)  # -> ListA, ListB
dispatch_61 = Dispatch(List=merge_24, DispatchPattern=null_19.InvalidFlags)  # -> ListA, ListB

# ---- group: 去除Null的交点
data_34 = Data(dispatch_60.ListB)

# ----
# 1.0
crv_107 = Curve(shift_2)
data_35 = Data(data_34)

# ----
# 1.0无檐口线
# 与梁不相交
pln_65 = Plane(dispatch_61.ListA)

pt_37 = Point(data_35)
incurves_9 = PointInCurves(Point=flatten(pt_37), Curves=crv_107)  # -> Relationship, Index, Point
equals_16 = Equality(FirstNumber=incurves_9.Relationship, SecondNumber="0")  # -> Equality, Inequality
dispatch_62 = Dispatch(List=flatten(pt_37), DispatchPattern=equals_16.Inequality)  # -> ListA, ListB

# ----
# 0 檐口出定位点
# 与结构无交点
pln_66 = Plane(flatten(pln_65))

# ---- group: 交点-属于哪个梁
data_36 = Data(dispatch_62.ListA)

# ----
pt_38 = Point(end_4.End)

pl_8 = ConstructPlane(Origin=pt_38, XAxis=rotate_10.Geometry, YAxis=ln_31)
null_20 = NullItem(Item=pl_8)  # -> NullFlags, InvalidFlags, Description
dispatch_63 = Dispatch(List=pl_8, DispatchPattern=null_20.NullFlags)  # -> ListA, ListB
pln_67 = Plane(dispatch_63.ListB)

# ----
# 1.1 有檐口
pln_68 = Plane(dispatch_54.ListA)
pln_69 = Plane(dispatch_57.ListA)
check_same_points_5 = CheckSamePoints(archPoint=pln_69, crvPoint=pln_68)  # -> out, specialPt; inputs archPoint: list of Point3d, crvPoint: list of Point3d; same code as testpoint
shift_22 = ShiftPaths(Data=pln_56, Offset=-1)
shift_23 = ShiftPaths(Data=shift_22, Offset=-1)  # -> simplify(Data)
cset = CreateSet(List=check_same_points_5.specialPt)  # -> Set, Map

# ---- group: 檐口-首次筛选的有效起始Plane
data_37 = Data(shift_23)

# ---- group: 未生成檐口埋件
item_57 = ListItem(List=pln_69, Index=cset.Set, Wrap=True)

# ----
# 1.1 檐口处侧埋，钢板焊
# 02：钢板焊埋件[钢梁外侧]
# @钢边梁宽@钢边梁高
pln_70 = Plane(data_37)

# ----
# 未生成檐口线
pt_39 = Point(item_57)

# ----
# （10）需人工排布
pt_40 = Point(pt_39)
bake_3 = BakeObjects(Geometry=pt_40, Attributes=attributes_2, BakeName=panel_39, Bake=False)

# ----
# 按照梁分类定位PLANE
shift_24 = ShiftPaths(Data=crv_80, Offset=-1)
shift_25 = ShiftPaths(Data=shift_24, Offset=-1)
pull_28 = PullPoint(Point=data_30, Geometry=simplify(shift_25), ClosestOnly=True)  # -> ClosestPoint, Distance
ln_32 = Line(StartPoint=pull_28.ClosestPoint, EndPoint=data_30)
movetoplane_7 = MoveToPlane(Geometry=crv_101, Plane=PlaneXY(0, 0, 0), Above=True, Below=True)  # -> Geometry, Transform

# ---- group: Y Axis Line-All
crv_108 = Curve(ln_32)

# ----
# 2.1 Missing Point
# 埋件定位点Offset，没有找到和梁的交点
number_slider_30 = Slider(5000, range=0..10000)
merge_29 = Merge(Data1=pln_48, Data2=pln_55, Data3=pln_54)

# ----
# 0 檐口出定位点
# 与结构无交点
pln_71 = Plane(flatten(merge_29))

deplane_27 = DeconstructPlane(Plane=pln_71)  # -> Origin, XAxis, YAxis, ZAxis
amp_33 = Amplitude(Vector=deplane_27.YAxis, Amplitude=number_slider_30)
move_42 = Move(Geometry=deplane_27.Origin, Motion=amp_33)  # -> Geometry, Transform
ln_33 = Line(StartPoint=move_42.Geometry, EndPoint=deplane_27.Origin)
amp_34 = Amplitude(Vector=deplane_27.XAxis, Amplitude=number_slider_6)
amp_35 = Amplitude(Vector=deplane_27.XAxis, Amplitude=expr("-x", number_slider_6))
move_43 = Move(Geometry=ln_33, Motion=amp_34)  # -> Geometry, Transform
move_44 = Move(Geometry=ln_33, Motion=amp_35)  # -> Geometry, Transform

ccx_21 = CurveCurve(CurveA=graft(move_44.Geometry), CurveB=flatten(crv_83))  # -> Points, ParamsA, ParamsB
shift_26 = ShiftPaths(Data=ccx_21.Points, Offset=-1)
pull_29 = PullPoint(Point=shift_26, Geometry=graft(pln_71), ClosestOnly=True)  # -> ClosestPoint, Distance
sort_18 = SortList(Keys=pull_29.Distance, ValuesA=shift_26)  # -> Keys, ValuesA
item_58 = ListItem(List=sort_18.ValuesA, Index="-1", Wrap=True)
null_21 = NullItem(Item=flatten(item_58))  # -> NullFlags, InvalidFlags, Description
end_5 = EndPoints(Curve=move_44.Geometry)  # -> Start, End
dispatch_64 = Dispatch(List=simplify(item_58), DispatchPattern=simplify(graft(null_21.InvalidFlags)))  # -> ListA, ListB
dispatch_65 = Dispatch(List=graft(pln_71), DispatchPattern=flatten(null_21.InvalidFlags))  # -> ListA, ListB
dispatch_66 = Dispatch(List=simplify(graft(end_5.End)), DispatchPattern=simplify(graft(null_21.InvalidFlags)))  # -> ListA, ListB
pln_72 = Plane(dispatch_65.ListB)
pt_41 = Point(dispatch_64.ListB)
pt_42 = Point(dispatch_66.ListB)
ln_34 = Line(StartPoint=pt_42, EndPoint=pt_41)
len_6 = Length(Curve=ln_34)
larger_7 = LargerThan(FirstNumber=len_6, SecondNumber=Slider(350, range=0..1000))  # -> LargerThan, OrEqualTo
dispatch_67 = Dispatch(List=pln_72, DispatchPattern=larger_7.LargerThan)  # -> ListA, ListB
dispatch_68 = Dispatch(List=pt_41, DispatchPattern=larger_7.LargerThan)  # -> ListA, ListB
pln_73 = Plane(dispatch_67.ListA)
pt_43 = Point(dispatch_68.ListA)
move2pt_6 = MoveToPoint(Geometry=pln_73, PointA=pln_73, PointB=pt_43)  # -> Moved, Vector, Transform

ccx_22 = CurveCurve(CurveA=graft(move_43.Geometry), CurveB=flatten(crv_83))  # -> Points, ParamsA, ParamsB
shift_27 = ShiftPaths(Data=ccx_22.Points, Offset=-1)
pull_30 = PullPoint(Point=shift_27, Geometry=graft(pln_71), ClosestOnly=True)  # -> ClosestPoint, Distance
sort_19 = SortList(Keys=pull_30.Distance, ValuesA=shift_27)  # -> Keys, ValuesA
item_59 = ListItem(List=sort_19.ValuesA, Index="-1", Wrap=True)
null_22 = NullItem(Item=flatten(item_59))  # -> NullFlags, InvalidFlags, Description
dispatch_69 = Dispatch(List=graft(pln_71), DispatchPattern=graft(null_22.InvalidFlags))  # -> ListA, ListB
dispatch_70 = Dispatch(List=simplify(item_59), DispatchPattern=simplify(graft(null_22.InvalidFlags)))  # -> ListA, ListB
end_6 = EndPoints(Curve=move_43.Geometry)  # -> Start, End
pt_44 = Point(dispatch_70.ListB)
pln_74 = Plane(dispatch_69.ListB)
dispatch_71 = Dispatch(List=simplify(graft(end_6.End)), DispatchPattern=simplify(graft(null_22.InvalidFlags)))  # -> ListA, ListB
pt_45 = Point(dispatch_71.ListB)
ln_35 = Line(StartPoint=pt_45, EndPoint=pt_44)
len_7 = Length(Curve=ln_35)
larger_8 = LargerThan(FirstNumber=len_7, SecondNumber=Slider(350, range=0..1000))  # -> LargerThan, OrEqualTo
dispatch_72 = Dispatch(List=pln_74, DispatchPattern=larger_8.LargerThan)  # -> ListA, ListB
dispatch_73 = Dispatch(List=pt_44, DispatchPattern=larger_8.LargerThan)  # -> ListA, ListB
pln_75 = Plane(dispatch_72.ListA)
pt_46 = Point(dispatch_73.ListA)
move2pt_7 = MoveToPoint(Geometry=pln_75, PointA=pln_75, PointB=pt_46)  # -> Moved, Vector, Transform

# ---- group: 有效plane-2次
merge_30 = Merge(Data1=move2pt_7.Moved, Data2=move2pt_6.Moved)

# ----
# 按照梁分类定位点
incurves_10 = PointInCurves(Point=flatten(merge_30), Curves=crv_87)  # -> Relationship, Index, Point
equals_17 = Equality(FirstNumber=incurves_10.Relationship, SecondNumber="0")  # -> Equality, Inequality
dispatch_74 = Dispatch(List=flatten(merge_30), DispatchPattern=equals_17.Inequality)  # -> ListA, ListB

# ---- group: 交点-属于哪个梁
data_38 = Data(dispatch_74.ListA)

# ----
end_7 = EndPoints(Curve=graft(crv_108))  # -> Start, End
merge_31 = Merge(Data1=end_7.Start, Data2=end_7.End)
pull_31 = PullPoint(Point=merge_31, Geometry=movetoplane_7.Geometry, ClosestOnly=True)  # -> ClosestPoint, Distance
sort_20 = SortList(Keys=pull_31.Distance, ValuesA=merge_31)  # -> Keys, ValuesA
item_60 = ListItem(List=sort_20.ValuesA, Index="-1", Wrap=True)
item_61 = ListItem(List=sort_20.ValuesA, Index=0, Wrap=True)
pt_47 = Point(item_61)
pt_48 = Point(item_60)
ln_36 = Line(StartPoint=pt_48, EndPoint=pt_47)
rotate_11 = Rotate(Geometry=ln_36, Angle=1.570796327, Plane=pt_47)  # -> Geometry, Transform

shift_28 = ShiftPaths(Data=pln_67, Offset=-1)

# ---- group: 檐口-首次筛选的有效起始Plane
data_39 = Data(shift_28)

# ----
# 3.2
# 下层建筑边线内侧300-600mm范围
# 03：钢板焊埋件[钢梁外侧]
# @钢边梁宽@钢边梁高
pln_76 = Plane(data_39)

# ----
# 3.1 Missing Point
# 埋件定位点Offset，没有找到和梁的交点
number_slider_31 = Slider(5000, range=0..10000)
deplane_28 = DeconstructPlane(Plane=pln_32)  # -> Origin, XAxis, YAxis, ZAxis
amp_36 = Amplitude(Vector=deplane_28.YAxis, Amplitude=number_slider_31)
crv_109 = Curve(scx_2.Curves)
move_45 = Move(Geometry=deplane_28.Origin, Motion=amp_36)  # -> Geometry, Transform
ln_37 = Line(StartPoint=move_45.Geometry, EndPoint=deplane_28.Origin)
amp_37 = Amplitude(Vector=deplane_28.XAxis, Amplitude=expr("-x", number_slider_6))
amp_38 = Amplitude(Vector=deplane_28.XAxis, Amplitude=number_slider_6)
move_46 = Move(Geometry=ln_37, Motion=amp_38)  # -> Geometry, Transform
move_47 = Move(Geometry=ln_37, Motion=amp_37)  # -> Geometry, Transform
move_48 = Move(Geometry=pln_32, Motion=amp_37)  # -> Geometry, Transform
move_49 = Move(Geometry=pln_32, Motion=amp_38)  # -> Geometry, Transform

ccx_23 = CurveCurve(CurveA=graft(move_47.Geometry), CurveB=flatten(crv_109))  # -> Points, ParamsA, ParamsB
shift_29 = ShiftPaths(Data=ccx_23.Points, Offset=-1)
sort_21 = SortList(Keys=shift_29, ValuesA=shift_29)  # -> Keys, ValuesA
pull_32 = PullPoint(Point=sort_21.ValuesA, Geometry=graft(pln_32), ClosestOnly=True)  # -> ClosestPoint, Distance
sort_22 = SortList(Keys=pull_32.Distance, ValuesA=sort_21.ValuesA)  # -> Keys, ValuesA
item_62 = ListItem(List=sort_22.ValuesA, Index="-1", Wrap=True)
null_23 = NullItem(Item=flatten(item_62))  # -> NullFlags, InvalidFlags, Description
dispatch_75 = Dispatch(List=flatten(item_62), DispatchPattern=null_23.InvalidFlags)  # -> ListA, ListB
dispatch_76 = Dispatch(List=pln_32, DispatchPattern=null_23.InvalidFlags)  # -> ListA, ListB
pt_49 = Point(dispatch_75.ListB)
pln_77 = Plane(dispatch_76.ListB)

ccx_24 = CurveCurve(CurveA=graft(move_46.Geometry), CurveB=flatten(crv_109))  # -> Points, ParamsA, ParamsB
shift_30 = ShiftPaths(Data=ccx_24.Points, Offset=-1)
sort_23 = SortList(Keys=shift_30, ValuesA=shift_30)  # -> Keys, ValuesA
pull_33 = PullPoint(Point=sort_23.ValuesA, Geometry=graft(pln_32), ClosestOnly=True)  # -> ClosestPoint, Distance
sort_24 = SortList(Keys=pull_33.Distance, ValuesA=sort_23.ValuesA)  # -> Keys, ValuesA
item_63 = ListItem(List=sort_24.ValuesA, Index="-1", Wrap=True)
null_24 = NullItem(Item=flatten(item_63))  # -> NullFlags, InvalidFlags, Description
dispatch_77 = Dispatch(List=flatten(item_63), DispatchPattern=null_24.InvalidFlags)  # -> ListA, ListB
dispatch_78 = Dispatch(List=pln_32, DispatchPattern=null_24.InvalidFlags)  # -> ListA, ListB
pln_78 = Plane(dispatch_78.ListB)
pt_50 = Point(dispatch_77.ListB)

merge_32 = Merge(Data1=pln_78, Data2=pln_77)  # -> flatten(Result)

# ----
# 使用过的点
merge_33 = Merge(Data1=merge_32, Data2=pln_62)

# ----
# 按照梁分类定位PLANE
crv_110 = Curve(merge_19)
shift_31 = ShiftPaths(Data=crv_110, Offset=-1)
shift_32 = ShiftPaths(Data=shift_31, Offset=-1)
pull_34 = PullPoint(Point=data_32, Geometry=simplify(shift_32), ClosestOnly=True)  # -> ClosestPoint, Distance
ln_38 = Line(StartPoint=pull_34.ClosestPoint, EndPoint=data_32)
movetoplane_8 = MoveToPlane(Geometry=crv_41, Plane=PlaneXY(0, 0, 0), Above=True, Below=True)  # -> Geometry, Transform

# ---- group: Y Axis Line-All
crv_111 = Curve(ln_38)

# ----
# 按照梁分类定位PLANE
crv_112 = Curve(merge_19)
crv_113 = Curve(crv_27)
shift_33 = ShiftPaths(Data=crv_112, Offset=-1)
shift_34 = ShiftPaths(Data=shift_33, Offset=-1)
pull_35 = PullPoint(Point=data_31, Geometry=simplify(shift_34), ClosestOnly=True)  # -> ClosestPoint, Distance
ln_39 = Line(StartPoint=pull_35.ClosestPoint, EndPoint=data_31)
movetoplane_9 = MoveToPlane(Geometry=crv_113, Plane=PlaneXY(0, 0, 0), Above=True, Below=True)  # -> Geometry, Transform

# ---- group: Y Axis Line-All
crv_114 = Curve(ln_39)

# ----
pt_51 = Point(end_7.End)

pl_9 = ConstructPlane(Origin=pt_51, XAxis=rotate_11.Geometry, YAxis=ln_36)
null_25 = NullItem(Item=pl_9)  # -> NullFlags, InvalidFlags, Description
dispatch_79 = Dispatch(List=pl_9, DispatchPattern=null_25.NullFlags)  # -> ListA, ListB
pln_79 = Plane(dispatch_79.ListB)

end_8 = EndPoints(Curve=graft(crv_114))  # -> Start, End
merge_34 = Merge(Data1=end_8.Start, Data2=end_8.End)
pull_36 = PullPoint(Point=merge_34, Geometry=movetoplane_9.Geometry, ClosestOnly=True)  # -> ClosestPoint, Distance
sort_25 = SortList(Keys=pull_36.Distance, ValuesA=merge_34)  # -> Keys, ValuesA
item_64 = ListItem(List=sort_25.ValuesA, Index="-1", Wrap=True)
item_65 = ListItem(List=sort_25.ValuesA, Index=0, Wrap=True)
pt_52 = Point(item_65)
pt_53 = Point(item_64)
ln_40 = Line(StartPoint=pt_53, EndPoint=pt_52)
rotate_12 = Rotate(Geometry=ln_40, Angle=1.570796327, Plane=pt_52)  # -> Geometry, Transform

end_9 = EndPoints(Curve=graft(crv_111))  # -> Start, End
merge_35 = Merge(Data1=end_9.Start, Data2=end_9.End)
pull_37 = PullPoint(Point=merge_35, Geometry=movetoplane_8.Geometry, ClosestOnly=True)  # -> ClosestPoint, Distance
sort_26 = SortList(Keys=pull_37.Distance, ValuesA=merge_35)  # -> Keys, ValuesA
item_66 = ListItem(List=sort_26.ValuesA, Index="-1", Wrap=True)
item_67 = ListItem(List=sort_26.ValuesA, Index=0, Wrap=True)
pt_54 = Point(item_67)
pt_55 = Point(item_66)
ln_41 = Line(StartPoint=pt_55, EndPoint=pt_54)
rotate_13 = Rotate(Geometry=ln_41, Angle=1.570796327, Plane=pt_54)  # -> Geometry, Transform

# ----
# 1.0.Missing Point
# 埋件定位点Offset，没有找到和梁的交点
crv_115 = Curve(crv_73)
deplane_29 = DeconstructPlane(Plane=pln_66)  # -> Origin, XAxis, YAxis, ZAxis
amp_39 = Amplitude(Vector=deplane_29.YAxis, Amplitude=expr("-x", Slider(5000, range=0..10000)))
move_50 = Move(Geometry=deplane_29.Origin, Motion=amp_39)  # -> Geometry, Transform
ln_42 = Line(StartPoint=move_50.Geometry, EndPoint=deplane_29.Origin)
amp_40 = Amplitude(Vector=deplane_29.XAxis, Amplitude=number_slider_6)
amp_41 = Amplitude(Vector=deplane_29.XAxis, Amplitude=expr("-x", number_slider_6))

# ---- group: 2组探索针
move_51 = Move(Geometry=ln_42, Motion=amp_40)  # -> Geometry, Transform
move_52 = Move(Geometry=ln_42, Motion=amp_41)  # -> Geometry, Transform

# ----
ccx_25 = CurveCurve(CurveA=graft(move_52.Geometry), CurveB=flatten(crv_115))  # -> Points, ParamsA, ParamsB
shift_35 = ShiftPaths(Data=ccx_25.Points, Offset=-1)
sort_27 = SortList(Keys=shift_35, ValuesA=shift_35)  # -> Keys, ValuesA
pull_38 = PullPoint(Point=sort_27.ValuesA, Geometry=graft(pln_66), ClosestOnly=True)  # -> ClosestPoint, Distance
sort_28 = SortList(Keys=pull_38.Distance, ValuesA=sort_27.ValuesA)  # -> Keys, ValuesA
item_68 = ListItem(List=sort_28.ValuesA, Index="0", Wrap=True)
null_26 = NullItem(Item=flatten(item_68))  # -> NullFlags, InvalidFlags, Description
dispatch_80 = Dispatch(List=simplify(item_68), DispatchPattern=simplify(graft(null_26.InvalidFlags)))  # -> ListA, ListB
dispatch_81 = Dispatch(List=pln_66, DispatchPattern=null_26.InvalidFlags)  # -> ListA, ListB
pln_80 = Plane(dispatch_81.ListB)
pt_56 = Point(dispatch_80.ListB)
move2pt_8 = MoveToPoint(Geometry=pln_80, PointA=pln_80, PointB=pt_56)  # -> Moved, Vector, Transform

ccx_26 = CurveCurve(CurveA=graft(move_51.Geometry), CurveB=flatten(crv_115))  # -> Points, ParamsA, ParamsB
shift_36 = ShiftPaths(Data=ccx_26.Points, Offset=-1)
sort_29 = SortList(Keys=shift_36, ValuesA=shift_36)  # -> Keys, ValuesA
pull_39 = PullPoint(Point=sort_29.ValuesA, Geometry=graft(pln_66), ClosestOnly=True)  # -> ClosestPoint, Distance
sort_30 = SortList(Keys=pull_39.Distance, ValuesA=sort_29.ValuesA)  # -> Keys, ValuesA
item_69 = ListItem(List=sort_30.ValuesA, Index="0", Wrap=True)
null_27 = NullItem(Item=flatten(item_69))  # -> NullFlags, InvalidFlags, Description
dispatch_82 = Dispatch(List=simplify(item_69), DispatchPattern=simplify(graft(null_27.InvalidFlags)))  # -> ListA, ListB
dispatch_83 = Dispatch(List=pln_66, DispatchPattern=null_27.InvalidFlags)  # -> ListA, ListB
pt_57 = Point(dispatch_82.ListB)
pln_81 = Plane(dispatch_83.ListB)
move2pt_9 = MoveToPoint(Geometry=pln_81, PointA=pln_81, PointB=pt_57)  # -> Moved, Vector, Transform

pln_82 = Plane([dispatch_83.ListA, dispatch_81.ListA])

# ----
# 按照梁分类定位点
merge_36 = Merge(Data1=move2pt_9.Moved, Data2=move2pt_8.Moved)
crv_116 = Curve(crv_107)
pt_58 = Point(merge_36)
incurves_11 = PointInCurves(Point=flatten(pt_58), Curves=crv_116)  # -> Relationship, Index, Point
equals_18 = Equality(FirstNumber=incurves_11.Relationship, SecondNumber="0")  # -> Equality, Inequality
dispatch_84 = Dispatch(List=flatten(pt_58), DispatchPattern=equals_18.Inequality)  # -> ListA, ListB

# ---- group: 交点-属于哪个梁
data_40 = Data(dispatch_84.ListA)

# ----
# 3.2  Missing Point
# 埋件定位点Offset，没有找到和梁的交点
number_slider_32 = Slider(5000, range=0..10000)
deplane_30 = DeconstructPlane(Plane=pln_39)  # -> Origin, XAxis, YAxis, ZAxis
amp_42 = Amplitude(Vector=deplane_30.YAxis, Amplitude=expr("-x", number_slider_32))
move_53 = Move(Geometry=deplane_30.Origin, Motion=amp_42)  # -> Geometry, Transform
ln_43 = Line(StartPoint=move_53.Geometry, EndPoint=deplane_30.Origin)
amp_43 = Amplitude(Vector=deplane_30.XAxis, Amplitude=number_slider_6)
amp_44 = Amplitude(Vector=deplane_30.XAxis, Amplitude=expr("-x", number_slider_6))
move_54 = Move(Geometry=ln_43, Motion=amp_44)  # -> Geometry, Transform
move_55 = Move(Geometry=ln_43, Motion=amp_43)  # -> Geometry, Transform
move_56 = Move(Geometry=pln_39, Motion=amp_44)  # -> Geometry, Transform
move_57 = Move(Geometry=pln_39, Motion=amp_43)  # -> Geometry, Transform

pln_83 = Plane(move_57.Geometry)
deplane_31 = DeconstructPlane(Plane=pln_83)  # -> Origin, XAxis, YAxis, ZAxis
amp_45 = Amplitude(Vector=deplane_31.YAxis, Amplitude=expr("-x", Slider(2000, range=0..10000)))
move_58 = Move(Geometry=deplane_31.Origin, Motion=amp_45)  # -> Geometry, Transform
ln_44 = Line(StartPoint=deplane_31.Origin, EndPoint=move_58.Geometry)
ccx_27 = CurveCurve(CurveA=flatten(crv_85), CurveB=simplify(graft(move_55.Geometry)))  # -> Points, ParamsA, ParamsB
shift_37 = ShiftPaths(Data=ccx_27.Points, Offset=-1)
graft_5 = GraftTree(Tree=deplane_31.Origin, IncludeEmptyLists=True, IncludeNullItems=True)  # -> simplify(Tree)
pull_40 = PullPoint(Point=shift_37, Geometry=graft_5, ClosestOnly=True)  # -> ClosestPoint, Distance
sort_31 = SortList(Keys=pull_40.Distance, ValuesA=shift_37)  # -> Keys, ValuesA
graft_6 = GraftTree(Tree=pln_83, IncludeEmptyLists=True, IncludeNullItems=True)  # -> flatten(Tree)
item_70 = ListItem(List=sort_31.Keys, Index=0, Wrap=True)  # -> flatten(Item)
c_script_2 = CSharpScript(num=item_70, Max="600", Min="300")  # -> out, A, Distance; inputs num: list of Double, Max: Double; same code as c_script
item_71 = ListItem(List=graft_6, Index=c_script_2.out, Wrap=True)

pln_84 = Plane(move_56.Geometry)
deplane_32 = DeconstructPlane(Plane=pln_84)  # -> Origin, XAxis, YAxis, ZAxis
amp_46 = Amplitude(Vector=deplane_32.YAxis, Amplitude=expr("-x", Slider(2000, range=0..10000)))
move_59 = Move(Geometry=deplane_32.Origin, Motion=amp_46)  # -> Geometry, Transform
ln_45 = Line(StartPoint=deplane_32.Origin, EndPoint=move_59.Geometry)
ccx_28 = CurveCurve(CurveA=flatten(crv_86), CurveB=simplify(graft(move_54.Geometry)))  # -> Points, ParamsA, ParamsB
shift_38 = ShiftPaths(Data=ccx_28.Points, Offset=-1)
graft_7 = GraftTree(Tree=deplane_32.Origin, IncludeEmptyLists=True, IncludeNullItems=True)  # -> simplify(Tree)
pull_41 = PullPoint(Point=shift_38, Geometry=graft_7, ClosestOnly=True)  # -> ClosestPoint, Distance
sort_32 = SortList(Keys=pull_41.Distance, ValuesA=shift_38)  # -> Keys, ValuesA
graft_8 = GraftTree(Tree=pln_84, IncludeEmptyLists=True, IncludeNullItems=True)  # -> flatten(Tree)
item_72 = ListItem(List=sort_32.Keys, Index=0, Wrap=True)  # -> flatten(Item)
c_script_3 = CSharpScript(num=item_72, Max="600", Min="300")  # -> out, A, Distance; inputs num: list of Double, Max: Double; same code as c_script
item_73 = ListItem(List=graft_8, Index=c_script_3.out, Wrap=True)

item_74 = ListItem(List=sort_31.ValuesA, Index=0, Wrap=True)  # -> flatten(Item)
item_75 = ListItem(List=sort_32.ValuesA, Index=0, Wrap=True)  # -> flatten(Item)
item_76 = ListItem(List=item_74, Index=c_script_2.out, Wrap=True)
item_77 = ListItem(List=item_75, Index=c_script_3.out, Wrap=True)

# ----
# 使用过的点
item_78 = ListItem(List=pln_39, Index=c_script_2.out, Wrap=True)
item_79 = ListItem(List=pln_39, Index=c_script_3.out, Wrap=True)
item_80 = ListItem(List=pln_28, Index=c_script.A, Wrap=True)
merge_37 = Merge(Data1=item_78, Data2=item_79, Data3=item_80)

# ----
# 3.1下层建筑内侧到300到外侧50内是否有钢结构
merge_38 = Merge(Data1=flatten(merge_33), Data2=flatten(merge_37), Data3=flatten(pln_45))
pln_85 = Plane(pln_40)
deplane_33 = DeconstructPlane(Plane=merge_38)  # -> Origin, XAxis, YAxis, ZAxis
deplane_34 = DeconstructPlane(Plane=pln_85)  # -> Origin, XAxis, YAxis, ZAxis
check_same_points_6 = CheckSamePoints(archPoint=deplane_34.Origin, crvPoint=deplane_33.Origin)  # -> out, specialPt; inputs archPoint: list of Point3d, crvPoint: list of Point3d; same code as testpoint

# ---- group: 有效筛选点
cull_i_8 = CullIndex(List=pln_85, Indices=check_same_points_6.specialPt, Wrap=True)

# ----
# 1.0 无檐口线+上下层幕墙边线连续
panel_59 = Panel(dispatch_62.ListA)

pt_59 = Point(end_8.End)
pt_60 = Point(end_9.End)

pl_10 = ConstructPlane(Origin=pt_59, XAxis=rotate_12.Geometry, YAxis=ln_40)
null_28 = NullItem(Item=pl_10)  # -> NullFlags, InvalidFlags, Description
dispatch_85 = Dispatch(List=pl_10, DispatchPattern=null_28.NullFlags)  # -> ListA, ListB

pl_11 = ConstructPlane(Origin=pt_60, XAxis=rotate_13.Geometry, YAxis=ln_41)
null_29 = NullItem(Item=pl_11)  # -> NullFlags, InvalidFlags, Description
dispatch_86 = Dispatch(List=pl_11, DispatchPattern=null_29.NullFlags)  # -> ListA, ListB

pln_86 = Plane(dispatch_85.ListB)
pln_87 = Plane(dispatch_86.ListB)

# ---- group: 檐口处-二次筛选-plane
shift_39 = ShiftPaths(Data=pln_86, Offset=-1)  # -> simplify(Data)

shift_40 = ShiftPaths(Data=pln_87, Offset=-1)  # -> simplify(Data)

# ----
# 撞到梁交点
pln_88 = Plane(shift_39)
pln_89 = Plane(shift_40)

merge_39 = Merge(Data1=pln_70, Data2=pln_89, Data3=pln_88)
orient_4 = Orient(Geometry=item_18, Source=item_19, Target=merge_39)  # -> Geometry, Transform

data_41 = Data(orient_4.Geometry)
ungroup_7 = Ungroup(Group=data_41)
item_81 = ListItem(List=ungroup_7, Index=0, Wrap=True)  # -> flatten(Item)
item_82 = ListItem(List=ungroup_7, Index="-1", Wrap=True)  # -> flatten(Item)

# ---- group: 檐口埋件 (continued)
entwine_14 = Entwine(Branch00=item_81, Branch01=item_82, FlattenInputs=True)
bake_4 = BakeObjects(Geometry=entwine_14, Attributes=attributes_3, BakeName=panel_23, Bake=False)

# ----
shift_41 = ShiftPaths(Data=pln_79, Offset=-1)

# ---- group: 檐口-首次筛选的有效起始Plane
data_42 = Data(simplify(shift_41))

# ----
# 2.1 梁以内>350
# 
# 侧埋，钢板焊
# 03：钢板焊埋件[钢梁内侧]
# @钢边梁宽@钢边梁高
pln_90 = Plane(data_42)

# ----
# 按照梁分类定位PLANE
shift_42 = ShiftPaths(Data=crv_84, Offset=-1)
shift_43 = ShiftPaths(Data=shift_42, Offset=-1)
movetoplane_10 = MoveToPlane(Geometry=crv_42, Plane=PlaneXY(0, 0, 0), Above=True, Below=True)  # -> Geometry, Transform
pull_42 = PullPoint(Point=data_36, Geometry=simplify(shift_43), ClosestOnly=True)  # -> ClosestPoint, Distance
ln_46 = Line(StartPoint=pull_42.ClosestPoint, EndPoint=data_36)

# ---- group: Y Axis Line-All
crv_117 = Curve(ln_46)

# ----
end_10 = EndPoints(Curve=graft(crv_117))  # -> Start, End
merge_40 = Merge(Data1=end_10.Start, Data2=end_10.End)
pull_43 = PullPoint(Point=merge_40, Geometry=movetoplane_10.Geometry, ClosestOnly=True)  # -> ClosestPoint, Distance
sort_33 = SortList(Keys=pull_43.Distance, ValuesA=merge_40)  # -> Keys, ValuesA
item_83 = ListItem(List=sort_33.ValuesA, Index="-1", Wrap=True)
item_84 = ListItem(List=sort_33.ValuesA, Index=0, Wrap=True)
pt_61 = Point(item_84)
pt_62 = Point(item_83)
ln_47 = Line(StartPoint=pt_62, EndPoint=pt_61)
rotate_14 = Rotate(Geometry=ln_47, Angle=1.570796327, Plane=pt_61)  # -> Geometry, Transform

merge_41 = Merge(Data1=pt_50, Data2=pt_49)

# ----
# 按照梁分类定位点
incurves_12 = PointInCurves(Point=flatten(merge_41), Curves=crv_100)  # -> Relationship, Index, Point
equals_19 = Equality(FirstNumber=incurves_12.Relationship, SecondNumber="0")  # -> Equality, Inequality
dispatch_87 = Dispatch(List=flatten(merge_41), DispatchPattern=equals_19.Inequality)  # -> ListA, ListB

# ---- group: 交点-属于哪个梁
data_43 = Data(dispatch_87.ListA)

# ----
pt_63 = Point(end_10.End)

pl_12 = ConstructPlane(Origin=pt_63, XAxis=rotate_14.Geometry, YAxis=ln_47)
null_30 = NullItem(Item=pl_12)  # -> NullFlags, InvalidFlags, Description
dispatch_88 = Dispatch(List=pl_12, DispatchPattern=null_30.NullFlags)  # -> ListA, ListB
pln_91 = Plane(dispatch_88.ListB)

# ---- group: 檐口-首次筛选的有效起始Plane
data_44 = Data(pln_91)

# ----
shift_44 = ShiftPaths(Data=data_44, Offset=-1)

# ----
# 1.0无檐口线+上下层幕墙边线连续
# 01：钢板焊埋件[钢梁外侧]
# @钢边梁宽@钢边梁高
pln_92 = Plane(shift_44)

# ----
# 按照梁分类定位PLANE
shift_45 = ShiftPaths(Data=crv_89, Offset=-1)
shift_46 = ShiftPaths(Data=shift_45, Offset=-1)
pull_44 = PullPoint(Point=data_43, Geometry=simplify(shift_46), ClosestOnly=True)  # -> ClosestPoint, Distance
ln_48 = Line(StartPoint=pull_44.ClosestPoint, EndPoint=data_43)
movetoplane_11 = MoveToPlane(Geometry=crv_105, Plane=PlaneXY(0, 0, 0), Above=True, Below=True)  # -> Geometry, Transform

# ---- group: Y Axis Line-All
crv_118 = Curve(ln_48)

# ----
# 按照梁分类定位PLANE
shift_47 = ShiftPaths(Data=crv_88, Offset=-1)
shift_48 = ShiftPaths(Data=shift_47, Offset=-1)
pull_45 = PullPoint(Point=data_38, Geometry=simplify(shift_48), ClosestOnly=True)  # -> ClosestPoint, Distance
ln_49 = Line(StartPoint=pull_45.ClosestPoint, EndPoint=data_38)
movetoplane_12 = MoveToPlane(Geometry=crv_102, Plane=PlaneXY(0, 0, 0), Above=True, Below=True)  # -> Geometry, Transform

# ---- group: Y Axis Line-All
crv_119 = Curve(ln_49)

# ----
# 按照梁分类定位PLANE
shift_49 = ShiftPaths(Data=crv_90, Offset=-1)
shift_50 = ShiftPaths(Data=shift_49, Offset=-1)
pull_46 = PullPoint(Point=data_40, Geometry=simplify(shift_50), ClosestOnly=True)  # -> ClosestPoint, Distance
ln_50 = Line(StartPoint=pull_46.ClosestPoint, EndPoint=data_40)
movetoplane_13 = MoveToPlane(Geometry=crv_43, Plane=PlaneXY(0, 0, 0), Above=True, Below=True)  # -> Geometry, Transform

# ---- group: Y Axis Line-All
crv_120 = Curve(ln_50)

# ----
merge_42 = Merge(Data1=item_76, Data2=item_77)

# ----
# 按照梁分类定位点
crv_121 = Curve(shift_2)
incurves_13 = PointInCurves(Point=flatten(merge_42), Curves=crv_121)  # -> Relationship, Index, Point
equals_20 = Equality(FirstNumber=incurves_13.Relationship, SecondNumber="0")  # -> Equality, Inequality
dispatch_89 = Dispatch(List=flatten(merge_42), DispatchPattern=equals_20.Inequality)  # -> ListA, ListB
data_45 = Data(dispatch_89.ListA)

# ---- group: 交点-属于哪个梁
data_46 = Data(data_45)

# ----
end_11 = EndPoints(Curve=graft(crv_118))  # -> Start, End
merge_43 = Merge(Data1=end_11.Start, Data2=end_11.End)
pull_47 = PullPoint(Point=merge_43, Geometry=movetoplane_11.Geometry, ClosestOnly=True)  # -> ClosestPoint, Distance
sort_34 = SortList(Keys=pull_47.Distance, ValuesA=merge_43)  # -> Keys, ValuesA
item_85 = ListItem(List=sort_34.ValuesA, Index="-1", Wrap=True)
item_86 = ListItem(List=sort_34.ValuesA, Index=0, Wrap=True)
pt_64 = Point(item_86)
pt_65 = Point(item_85)
ln_51 = Line(StartPoint=pt_65, EndPoint=pt_64)
rotate_15 = Rotate(Geometry=ln_51, Angle=1.570796327, Plane=pt_64)  # -> Geometry, Transform

end_12 = EndPoints(Curve=graft(crv_119))  # -> Start, End
merge_44 = Merge(Data1=end_12.Start, Data2=end_12.End)
pull_48 = PullPoint(Point=merge_44, Geometry=movetoplane_12.Geometry, ClosestOnly=True)  # -> ClosestPoint, Distance
sort_35 = SortList(Keys=pull_48.Distance, ValuesA=merge_44)  # -> Keys, ValuesA
item_87 = ListItem(List=sort_35.ValuesA, Index="-1", Wrap=True)
item_88 = ListItem(List=sort_35.ValuesA, Index=0, Wrap=True)
pt_66 = Point(item_88)
pt_67 = Point(item_87)
ln_52 = Line(StartPoint=pt_67, EndPoint=pt_66)
rotate_16 = Rotate(Geometry=ln_52, Angle=1.570796327, Plane=pt_66)  # -> Geometry, Transform

end_13 = EndPoints(Curve=graft(crv_120))  # -> Start, End
merge_45 = Merge(Data1=end_13.Start, Data2=end_13.End)
pull_49 = PullPoint(Point=merge_45, Geometry=movetoplane_13.Geometry, ClosestOnly=True)  # -> ClosestPoint, Distance
sort_36 = SortList(Keys=pull_49.Distance, ValuesA=merge_45)  # -> Keys, ValuesA
item_89 = ListItem(List=sort_36.ValuesA, Index="-1", Wrap=True)
item_90 = ListItem(List=sort_36.ValuesA, Index=0, Wrap=True)
pt_68 = Point(item_90)
pt_69 = Point(item_89)
ln_53 = Line(StartPoint=pt_69, EndPoint=pt_68)
rotate_17 = Rotate(Geometry=ln_53, Angle=1.570796327, Plane=pt_68)  # -> Geometry, Transform

pt_70 = Point(end_11.End)

pl_13 = ConstructPlane(Origin=pt_70, XAxis=rotate_15.Geometry, YAxis=ln_51)
null_31 = NullItem(Item=pl_13)  # -> NullFlags, InvalidFlags, Description
dispatch_90 = Dispatch(List=pl_13, DispatchPattern=null_31.NullFlags)  # -> ListA, ListB
pln_93 = Plane(dispatch_90.ListB)

shift_51 = ShiftPaths(Data=pln_93, Offset=-1)
data_47 = Data(shift_51)

# ----
# 撞到梁交点
merge_46 = Merge(Data1=data_47)

merge_47 = Merge(Data1=pln_64, Data2=merge_46)
orient_5 = Orient(Geometry=item_24, Source=rotate_7.Geometry, Target=merge_47)  # -> Geometry, Transform

data_48 = Data(orient_5.Geometry)
ungroup_8 = Ungroup(Group=data_48)
item_91 = ListItem(List=ungroup_8, Index=0, Wrap=True)  # -> flatten(Item)
item_92 = ListItem(List=ungroup_8, Index="-1", Wrap=True)  # -> flatten(Item)

# ---- group: 框架顶部，埋件在幕墙线外侧 (continued)
entwine_15 = Entwine(Branch00=item_91, Branch01=item_92, FlattenInputs=True)
bake_5 = BakeObjects(Geometry=entwine_15, Attributes=attributes_6, BakeName=panel_29, Bake=False)

# ----
pt_71 = Point(end_12.End)

pl_14 = ConstructPlane(Origin=pt_71, XAxis=rotate_16.Geometry, YAxis=ln_52)
null_32 = NullItem(Item=pl_14)  # -> NullFlags, InvalidFlags, Description
dispatch_91 = Dispatch(List=pl_14, DispatchPattern=null_32.NullFlags)  # -> ListA, ListB
pln_94 = Plane(dispatch_91.ListB)

shift_52 = ShiftPaths(Data=pln_94, Offset=-1)

# ---- group: 檐口-首次筛选的有效起始Plane
data_49 = Data(shift_52)

# ----
# 撞到梁交点
merge_48 = Merge(Data1=data_49)

merge_49 = Merge(Data1=pln_90, Data2=merge_48)
orient_6 = Orient(Geometry=item_22, Source=rotate_6.Geometry, Target=merge_49)  # -> Geometry, Transform

data_50 = Data(orient_6.Geometry)
ungroup_9 = Ungroup(Group=data_50)
item_93 = ListItem(List=ungroup_9, Index=0, Wrap=True)  # -> flatten(Item)
item_94 = ListItem(List=ungroup_9, Index="-1", Wrap=True)  # -> flatten(Item)

# ---- group: 有吊顶的范围，檐口处内侧埋件 (continued)
entwine_16 = Entwine(Branch00=item_93, Branch01=item_94, FlattenInputs=True)
bake_6 = BakeObjects(Geometry=entwine_16, Attributes=attributes_4, BakeName=panel_27, Bake=False)

# ----
pt_72 = Point(end_13.End)

pl_15 = ConstructPlane(Origin=pt_72, XAxis=rotate_17.Geometry, YAxis=ln_53)
null_33 = NullItem(Item=pl_15)  # -> NullFlags, InvalidFlags, Description
dispatch_92 = Dispatch(List=pl_15, DispatchPattern=null_33.NullFlags)  # -> ListA, ListB
pln_95 = Plane(dispatch_92.ListB)

shift_53 = ShiftPaths(Data=pln_95, Offset=-1)

# ---- group: 檐口-2次筛选的有效起始Plane
data_51 = Data(shift_53)

# ----
# 撞到梁交点
data_52 = Data(data_51)

merge_50 = Merge(Data1=pln_92, Data2=data_52)
orient_7 = Orient(Geometry=item_21, Source=item_20, Target=merge_50)  # -> Geometry, Transform

data_53 = Data(orient_7.Geometry)
ungroup_10 = Ungroup(Group=data_53)
item_95 = ListItem(List=ungroup_10, Index=0, Wrap=True)  # -> flatten(Item)
item_96 = ListItem(List=ungroup_10, Index="-1", Wrap=True)  # -> flatten(Item)

# ---- group: 上下幕墙连续 (continued)
entwine_17 = Entwine(Branch00=item_95, Branch01=item_96, FlattenInputs=True)
bake_7 = BakeObjects(Geometry=entwine_17, Attributes=attributes_5, BakeName=panel_26, Bake=False)

# ----
# 按照梁分类定位PLANE
shift_54 = ShiftPaths(Data=crv_91, Offset=-1)
shift_55 = ShiftPaths(Data=shift_54, Offset=-1)
pull_50 = PullPoint(Point=data_46, Geometry=simplify(shift_55), ClosestOnly=True)  # -> ClosestPoint, Distance
ln_54 = Line(StartPoint=pull_50.ClosestPoint, EndPoint=data_46)
movetoplane_14 = MoveToPlane(Geometry=crv_106, Plane=PlaneXY(0, 0, 0), Above=True, Below=True)  # -> Geometry, Transform

# ---- group: Y Axis Line-All
crv_122 = Curve(ln_54)

# ----
end_14 = EndPoints(Curve=graft(crv_122))  # -> Start, End
merge_51 = Merge(Data1=end_14.Start, Data2=end_14.End)
pull_51 = PullPoint(Point=merge_51, Geometry=movetoplane_14.Geometry, ClosestOnly=True)  # -> ClosestPoint, Distance
sort_37 = SortList(Keys=pull_51.Distance, ValuesA=merge_51)  # -> Keys, ValuesA
item_97 = ListItem(List=sort_37.ValuesA, Index="-1", Wrap=True)
item_98 = ListItem(List=sort_37.ValuesA, Index=0, Wrap=True)
pt_73 = Point(item_98)
pt_74 = Point(item_97)
ln_55 = Line(StartPoint=pt_74, EndPoint=pt_73)
rotate_18 = Rotate(Geometry=ln_55, Angle=1.570796327, Plane=pt_73)  # -> Geometry, Transform

pt_75 = Point(end_14.End)

pl_16 = ConstructPlane(Origin=pt_75, XAxis=rotate_18.Geometry, YAxis=ln_55)
null_34 = NullItem(Item=pl_16)  # -> NullFlags, InvalidFlags, Description
dispatch_93 = Dispatch(List=pl_16, DispatchPattern=null_34.NullFlags)  # -> ListA, ListB
pln_96 = Plane(dispatch_93.ListB)

shift_56 = ShiftPaths(Data=pln_96, Offset=-1)

# ---- group: 檐口-首次筛选的有效起始Plane
data_54 = Data(shift_56)

# ----
# 撞到梁交点
merge_52 = Merge(Data1=data_54)

merge_53 = Merge(Data1=pln_76, Data2=merge_52)
orient_8 = Orient(Geometry=item_26, Source=item_27, Target=merge_53)  # -> Geometry, Transform

data_55 = Data(orient_8.Geometry)
ungroup_11 = Ungroup(Group=data_55)
item_99 = ListItem(List=ungroup_11, Index=0, Wrap=True)  # -> flatten(Item)
item_100 = ListItem(List=ungroup_11, Index="-1", Wrap=True)  # -> flatten(Item)

# ---- group: 框架顶部，埋件在幕墙线内侧 (continued)
entwine_18 = Entwine(Branch00=item_99, Branch01=item_100, FlattenInputs=True)
bake_8 = BakeObjects(Geometry=entwine_18, Attributes=attributes_7, BakeName=panel_31, Bake=False)

# ----
# 1.0无檐口线初筛-上层定位点
crv_123 = Curve(reb_2)
pln_97 = Plane(pln_15)
project_17 = Project(Geometry=crv_123, Plane=PlaneXY(0, 0, 0))  # -> Geometry, Transform
clscrv_8 = CloseCurve(Curve=project_17.Geometry, CloseType=0, Bulge=0.5, Tolerance=0)  # -> Closed, R

deplane_35 = DeconstructPlane(Plane=pln_97)  # -> Origin, XAxis, YAxis, ZAxis

pt_76 = Point(deplane_35.Origin)
incurve_8 = PointInCurve(Point=pt_76, Curve=clscrv_8.Closed)  # -> Relationship, Point

equals_21 = Equality(FirstNumber=incurve_8.Relationship, SecondNumber="2")  # -> Equality, Inequality
dispatch_94 = Dispatch(List=pln_97, DispatchPattern=equals_21.Equality)  # -> ListA, ListB
data_56 = Data(dispatch_94.ListB)

# ----
# 5 上层建筑边线,
# 默认建筑提供上翻，如主结构提供示意则使用结构定位【该项目无】，
# 如无则使用建筑边线向内50mm作为埋件定位
panel_60 = Panel(incurve_8.Relationship)

pln_98 = Plane(dispatch_94.ListA)

# ---- group: 1.0N的情况的Plane
pln_99 = Plane(pln_98)

# ----
deplane_36 = DeconstructPlane(Plane=pln_99)  # -> Origin, XAxis, YAxis, ZAxis
number_slider_33 = Slider(3584, range=0..10000)
amp_47 = Amplitude(Vector=deplane_36.YAxis, Amplitude=number_slider_33)
amp_48 = Amplitude(Vector=deplane_36.YAxis, Amplitude=expr("-x", number_slider_33))
move_60 = Move(Geometry=deplane_36.Origin, Motion=amp_48)  # -> Geometry, Transform
move_61 = Move(Geometry=deplane_36.Origin, Motion=amp_47)  # -> Geometry, Transform
ln_56 = Line(StartPoint=move_60.Geometry, EndPoint=move_61.Geometry)
ccx_29 = CurveCurve(CurveA=ln_56, CurveB=crv_45)  # -> simplify(Points), ParamsA, ParamsB
ln_57 = Line(StartPoint=ccx_29.Points, EndPoint=simplify(graft(pln_99)))
len_8 = Length(Curve=ln_57)
null_35 = NullItem(Item=ccx_29.Points)  # -> NullFlags, InvalidFlags, Description
sort_38 = SortList(Keys=len_8, ValuesA=simplify(ccx_29.Points))  # -> Keys, ValuesA
dispatch_95 = Dispatch(List=simplify(graft(pln_99)), DispatchPattern=null_35.NullFlags)  # -> ListA, ListB
item_101 = ListItem(List=sort_38.ValuesA, Index=0, Wrap=True)

# ----
# 可能的双点
pln_100 = Plane(dispatch_95.ListA)

# ----
# 0 檐口出定位点
# 与结构无交点
pln_101 = Plane(flatten(pln_100))

# ----
# 5 上层建筑边线,
# 默认建筑提供上翻
# 04：板埋埋件[混凝土楼板上侧]
# @板埋参数xn
move2pt_10 = MoveToPoint(Geometry=simplify(graft(pln_99)), PointA=simplify(graft(pln_99)), PointB=item_101)  # -> flatten(Moved), Vector, Transform

pln_102 = Plane(cull_i_8)
flatten_5 = FlattenTree(Tree=crv_54, Path="{0}")
number_slider_34 = Slider(3584, range=0..10000)
deplane_37 = DeconstructPlane(Plane=pln_102)  # -> Origin, XAxis, YAxis, ZAxis
boundary_6 = BoundarySurfaces(Edges=[offset_12, offset_11])
amp_49 = Amplitude(Vector=deplane_37.YAxis, Amplitude=number_slider_34)
amp_50 = Amplitude(Vector=deplane_37.YAxis, Amplitude=expr("-x", number_slider_34))
scx_4 = SurfaceCurve(Surface=boundary_6, Curve=flatten_5)  # -> flatten(Curves), Points, UVPoints, Normals, Parameters, Tangents
move_62 = Move(Geometry=deplane_37.Origin, Motion=amp_50)  # -> Geometry, Transform
move_63 = Move(Geometry=deplane_37.Origin, Motion=amp_49)  # -> Geometry, Transform
ln_58 = Line(StartPoint=move_62.Geometry, EndPoint=move_63.Geometry)
ccx_30 = CurveCurve(CurveA=graft(ln_58), CurveB=crv_55)  # -> Points, ParamsA, ParamsB

# ----
# 4下层建筑内侧到300到外侧50内
# 有钢结构
ccx_31 = CurveCurve(CurveA=graft(ln_58), CurveB=flatten(crv_55))  # -> Points, ParamsA, ParamsB

shift_57 = ShiftPaths(Data=ccx_31.Points, Offset=-1)
pull_52 = PullPoint(Point=graft(pln_102), Geometry=shift_57, ClosestOnly=True)  # -> ClosestPoint, Distance
sort_39 = SortList(Keys=pull_52.Distance, ValuesA=pull_52.ClosestPoint)  # -> Keys, ValuesA
item_102 = ListItem(List=sort_39.ValuesA, Index=0, Wrap=True)
null_36 = NullItem(Item=sort_39.ValuesA)  # -> NullFlags, simplify(InvalidFlags), Description
dispatch_96 = Dispatch(List=simplify(graft(pln_102)), DispatchPattern=null_36.InvalidFlags)  # -> ListA, ListB
pln_103 = Plane(dispatch_96.ListA)
pln_104 = Plane(dispatch_96.ListB)
move2pt_11 = MoveToPoint(Geometry=pln_104, PointA=pln_104, PointB=simplify(item_102))  # -> flatten(Moved), Vector, Transform

# ---- group: 交点-属于哪个梁
data_57 = Data(move2pt_11.Moved)

# ----
# 按照梁分类定位点
crv_124 = Curve(shift_2)
incurves_14 = PointInCurves(Point=flatten(data_57), Curves=crv_124)  # -> Relationship, Index, Point
equals_22 = Equality(FirstNumber=incurves_14.Relationship, SecondNumber="0")  # -> Equality, Inequality
dispatch_97 = Dispatch(List=flatten(data_57), DispatchPattern=equals_22.Inequality)  # -> ListA, ListB

# ----
# 可能的结构交点-大量
pln_105 = Plane(pln_103)

# ----
# 0 檐口出定位点
# 与结构无交点
pln_106 = Plane(flatten(pln_105))

# ----
# 4 Missing Point
# 埋件定位点Offset，没有找到和梁的交点
number_slider_35 = Slider(5000, range=0..10000)
deplane_38 = DeconstructPlane(Plane=pln_106)  # -> Origin, XAxis, YAxis, ZAxis
amp_51 = Amplitude(Vector=deplane_38.YAxis, Amplitude=expr("-x", number_slider_35))
move_64 = Move(Geometry=deplane_38.Origin, Motion=amp_51)  # -> Geometry, Transform
ln_59 = Line(StartPoint=move_64.Geometry, EndPoint=deplane_38.Origin)
amp_52 = Amplitude(Vector=deplane_38.XAxis, Amplitude=number_slider_6)
amp_53 = Amplitude(Vector=deplane_38.XAxis, Amplitude=expr("-x", number_slider_6))
move_65 = Move(Geometry=ln_59, Motion=amp_52)  # -> Geometry, Transform
move_66 = Move(Geometry=ln_59, Motion=amp_53)  # -> Geometry, Transform

ccx_32 = CurveCurve(CurveA=graft(move_66.Geometry), CurveB=flatten(crv_56))  # -> Points, ParamsA, ParamsB
shift_58 = ShiftPaths(Data=ccx_32.Points, Offset=-1)
sort_40 = SortList(Keys=shift_58, ValuesA=shift_58)  # -> Keys, ValuesA
pull_53 = PullPoint(Point=sort_40.ValuesA, Geometry=graft(pln_106), ClosestOnly=True)  # -> ClosestPoint, Distance
sort_41 = SortList(Keys=pull_53.Distance, ValuesA=sort_40.ValuesA)  # -> Keys, ValuesA
item_103 = ListItem(List=sort_41.ValuesA, Index="-1", Wrap=True)
null_37 = NullItem(Item=flatten(item_103))  # -> NullFlags, InvalidFlags, Description
dispatch_98 = Dispatch(List=flatten(item_103), DispatchPattern=null_37.InvalidFlags)  # -> ListA, ListB
dispatch_99 = Dispatch(List=pln_106, DispatchPattern=null_37.InvalidFlags)  # -> ListA, ListB
pt_77 = Point(dispatch_98.ListB)
pln_107 = Plane(dispatch_99.ListB)
move2pt_12 = MoveToPoint(Geometry=pln_107, PointA=pln_107, PointB=pt_77)  # -> Moved, Vector, Transform

ccx_33 = CurveCurve(CurveA=graft(move_65.Geometry), CurveB=flatten(crv_56))  # -> Points, ParamsA, ParamsB
shift_59 = ShiftPaths(Data=ccx_33.Points, Offset=-1)
sort_42 = SortList(Keys=shift_59, ValuesA=shift_59)  # -> Keys, ValuesA
pull_54 = PullPoint(Point=sort_42.ValuesA, Geometry=graft(pln_106), ClosestOnly=True)  # -> ClosestPoint, Distance
sort_43 = SortList(Keys=pull_54.Distance, ValuesA=sort_42.ValuesA)  # -> Keys, ValuesA
item_104 = ListItem(List=sort_43.ValuesA, Index="-1", Wrap=True)
null_38 = NullItem(Item=flatten(item_104))  # -> NullFlags, InvalidFlags, Description
dispatch_100 = Dispatch(List=pln_106, DispatchPattern=null_38.InvalidFlags)  # -> ListA, ListB
dispatch_101 = Dispatch(List=flatten(item_104), DispatchPattern=null_38.InvalidFlags)  # -> ListA, ListB
pln_108 = Plane(dispatch_100.ListB)
pt_78 = Point(dispatch_101.ListB)
move2pt_13 = MoveToPoint(Geometry=pln_108, PointA=pln_108, PointB=pt_78)  # -> Moved, Vector, Transform

# ----
# 5  Missing Point
# 埋件定位点Offset，没有找到和梁的交点
number_slider_36 = Slider(5000, range=0..10000)
deplane_39 = DeconstructPlane(Plane=pln_101)  # -> Origin, XAxis, YAxis, ZAxis
crv_125 = Curve(crv_45)
amp_54 = Amplitude(Vector=deplane_39.YAxis, Amplitude=number_slider_36)
move_67 = Move(Geometry=deplane_39.Origin, Motion=amp_54)  # -> Geometry, Transform
ln_60 = Line(StartPoint=move_67.Geometry, EndPoint=deplane_39.Origin)
amp_55 = Amplitude(Vector=deplane_39.XAxis, Amplitude=number_slider_6)
amp_56 = Amplitude(Vector=deplane_39.XAxis, Amplitude=expr("-x", number_slider_6))
move_68 = Move(Geometry=ln_60, Motion=amp_55)  # -> Geometry, Transform
move_69 = Move(Geometry=ln_60, Motion=amp_56)  # -> Geometry, Transform
pln_109 = Plane(pln_101)

ccx_34 = CurveCurve(CurveA=graft(move_69.Geometry), CurveB=flatten(crv_125))  # -> Points, ParamsA, ParamsB
shift_60 = ShiftPaths(Data=ccx_34.Points, Offset=-1)
sort_44 = SortList(Keys=shift_60, ValuesA=shift_60)  # -> Keys, ValuesA
pull_55 = PullPoint(Point=sort_44.ValuesA, Geometry=graft(pln_101), ClosestOnly=True)  # -> ClosestPoint, Distance
sort_45 = SortList(Keys=pull_55.Distance, ValuesA=sort_44.ValuesA)  # -> Keys, ValuesA
item_105 = ListItem(List=sort_45.ValuesA, Index="-1", Wrap=True)
null_39 = NullItem(Item=flatten(item_105))  # -> NullFlags, InvalidFlags, Description
dispatch_102 = Dispatch(List=simplify(item_105), DispatchPattern=simplify(graft(null_39.InvalidFlags)))  # -> ListA, ListB
dispatch_103 = Dispatch(List=pln_101, DispatchPattern=null_39.InvalidFlags)  # -> ListA, ListB
pln_110 = Plane(dispatch_103.ListB)
pt_79 = Point(dispatch_102.ListB)

ccx_35 = CurveCurve(CurveA=graft(move_68.Geometry), CurveB=flatten(crv_125))  # -> Points, ParamsA, ParamsB
shift_61 = ShiftPaths(Data=ccx_35.Points, Offset=-1)
sort_46 = SortList(Keys=shift_61, ValuesA=shift_61)  # -> Keys, ValuesA
pull_56 = PullPoint(Point=sort_46.ValuesA, Geometry=graft(pln_101), ClosestOnly=True)  # -> ClosestPoint, Distance
sort_47 = SortList(Keys=pull_56.Distance, ValuesA=sort_46.ValuesA)  # -> Keys, ValuesA
item_106 = ListItem(List=sort_47.ValuesA, Index="-1", Wrap=True)
null_40 = NullItem(Item=flatten(item_106))  # -> NullFlags, InvalidFlags, Description
dispatch_104 = Dispatch(List=simplify(item_106), DispatchPattern=simplify(graft(null_40.InvalidFlags)))  # -> ListA, ListB
dispatch_105 = Dispatch(List=pln_101, DispatchPattern=null_40.InvalidFlags)  # -> ListA, ListB
pln_111 = Plane(dispatch_105.ListB)
pt_80 = Point(dispatch_104.ListB)

merge_54 = Merge(Data1=pln_111, Data2=pln_110)  # -> flatten(Result)
check_same_points_7 = CheckSamePoints(archPoint=flatten(pln_109), crvPoint=merge_54)  # -> out, specialPt; inputs archPoint: list of Point3d, crvPoint: list of Point3d; same code as testpoint

# ----
# 撞到结构
move2pt_14 = MoveToPoint(Geometry=flatten(pln_111), PointA=flatten(pln_111), PointB=flatten(pt_80))  # -> Moved, Vector, Transform
move2pt_15 = MoveToPoint(Geometry=flatten(pln_110), PointA=flatten(pln_110), PointB=flatten(pt_79))  # -> Moved, Vector, Transform

# ----
# pass
cull_i_9 = CullIndex(List=flatten(pln_109), Indices=check_same_points_7.specialPt, Wrap=True)  # -> simplify(graft(List))

# ----
# 撞到梁交点
merge_55 = Merge(Data1=flatten(move2pt_14.Moved), Data2=flatten(move2pt_15.Moved))

merge_56 = Merge(Data1=flatten(move2pt_10.Moved), Data2=flatten(merge_55))

# ---- group: All Location Point
merge_57 = Merge(Data1=merge_39, Data2=merge_50, Data3=merge_56)

# ----
deplane_40 = DeconstructPlane(Plane=merge_56)  # -> Origin, XAxis, YAxis, ZAxis
amp_57 = Amplitude(Vector=deplane_40.YAxis, Amplitude=len_4)
move_70 = Move(Geometry=merge_56, Motion=amp_57)  # -> Geometry, Transform
incurve_9 = PointInCurve(Point=move_70.Geometry, Curve=crv_48)  # -> Relationship, Point
panel_61 = Panel(incurve_9.Relationship)
equals_23 = Equality(FirstNumber=incurve_9.Relationship, SecondNumber="0")  # -> Equality, Inequality
dispatch_106 = Dispatch(List=move_70.Geometry, DispatchPattern=equals_23.Equality)  # -> ListA, ListB
data_58 = Data(dispatch_106.ListA)
data_59 = Data(dispatch_106.ListB)
amp_58 = Amplitude(Vector=deplane_40.YAxis, Amplitude=len_4)
move_71 = Move(Geometry=data_58, Motion=expr("-X", amp_58))  # -> Geometry, Transform
move_72 = Move(Geometry=move_71.Geometry, Motion=expr("-X", amp_58))  # -> Geometry, Transform
# 阳角
# 阴角
# 阳角
# 阴角
# SmoothCurve-阴角
# SmoothCurve-阳角
# SmoothCurve-阴角
# SmoothCurve-正常
# Angular Curve - All
# Special Curve(with location)- All
# Curve for this project only - All
merge_58 = Merge(Data1=move_72.Geometry, Data2=data_59)
# 这里如果跑红也不要紧，
# 说明单体没有出现相撞的情况
# Sort Text
# Rhino 文件中导入的块名
orient_9 = Orient(Geometry=item_28, Source=item_29, Target=merge_58)  # -> Geometry, Transform

data_60 = Data(orient_9.Geometry)
ungroup_12 = Ungroup(Group=data_60)
item_107 = ListItem(List=ungroup_12, Index=0, Wrap=True)  # -> flatten(Item)
item_108 = ListItem(List=ungroup_12, Index="-1", Wrap=True)  # -> flatten(Item)

# ---- group: 幕墙底部接地埋件 (continued)
entwine_19 = Entwine(Branch00=item_107, Branch01=item_108, FlattenInputs=True)
bake_9 = BakeObjects(Geometry=entwine_19, Attributes=attributes_9, BakeName=panel_37, Bake=False)

# ----
null_41 = NullItem(Item=merge_57)  # -> NullFlags, InvalidFlags, Description
dispatch_107 = Dispatch(List=merge_57, DispatchPattern=null_41.InvalidFlags)  # -> ListA, ListB

# ---- group: 下层图纸-标注定位点
pt_81 = Point(dispatch_107.ListB)

# ----
cluster_4 = Cluster_2(
    outline_curve=标准范围_符合单一轴网方向_2,
    dim_offset_1=number_slider_14,
    dim_offset_2=number_slider_13,
    axis_direction_crv1=crv_15,
    axis_direction_crv2=crv_16,
    f2_arch_outline=crv_50,
    location_point=pt_81,
    dim_style=panel_15,
    directed_outline=seam_2,
    移除重复位置点_容差=number_slider_11)  # -> D_3, D_4, D, D_2
dimension1 = Data(cluster_4.D_3)

# ---- group: Dimension2
data_61 = Data(cluster_4.D_4)

# ---- group: Dimension4
data_62 = Data(cluster_4.D_2)

# ---- group: Dimension3
data_63 = Data(cluster_4.D)

# ----
entwine_20 = Entwine(Branch00=dimension1, Branch01=data_61, Branch02=data_63, Branch03=data_62, FlattenInputs=True)

# ---- group: Refrash Data
# 将所有Input都输入完后要Refresh data
dam = DataDam(DataA=entwine_20, BufferDelay=10000000, BufferMode=0)

# ----
dedim = DeconstructDimension(DimensionObject=dam)  # -> Value, Text, Plane, Points, Style
shift_62 = ShiftPaths(Data=dedim.Text, Offset=-1)
smaller_9 = SmallerThan(FirstNumber=shift_62, SecondNumber=Slider(1, range=0..10))  # -> SmallerThan, OrEqualTo
dispatch_108 = Dispatch(List=dam, DispatchPattern=smaller_9.SmallerThan)  # -> ListA, ListB

# ---- group: Bake Me
bake_10 = BakeObjects(Geometry=dispatch_108.ListB, Attributes=attributes_12, Bake=False)

# ----
data_64 = Data(dispatch_108.ListB)

pt_82 = Point(dispatch_97.ListA)
merge_59 = Merge(Data1=move2pt_13.Moved, Data2=move2pt_12.Moved)

# ---- group: 交点-属于哪个梁
data_65 = Data(merge_59)

# ----
# 按照梁分类定位点
crv_126 = Curve(shift_2)
incurves_15 = PointInCurves(Point=flatten(data_65), Curves=crv_126)  # -> Relationship, Index, Point
equals_24 = Equality(FirstNumber=incurves_15.Relationship, SecondNumber="0")  # -> Equality, Inequality
dispatch_109 = Dispatch(List=flatten(data_65), DispatchPattern=equals_24.Inequality)  # -> ListA, ListB

# ----
# 按照梁分类定位PLANE
shift_63 = ShiftPaths(Data=crv_92, Offset=-1)
shift_64 = ShiftPaths(Data=shift_63, Offset=-1)
pull_57 = PullPoint(Point=pt_82, Geometry=simplify(shift_64), ClosestOnly=True)  # -> ClosestPoint, Distance
ln_61 = Line(StartPoint=pull_57.ClosestPoint, EndPoint=pt_82)
movetoplane_15 = MoveToPlane(Geometry=crv_46, Plane=PlaneXY(0, 0, 0), Above=True, Below=True)  # -> Geometry, Transform

# ---- group: Y Axis Line-All
crv_127 = Curve(ln_61)

# ----
end_15 = EndPoints(Curve=graft(crv_127))  # -> Start, End
merge_60 = Merge(Data1=end_15.Start, Data2=end_15.End)
pull_58 = PullPoint(Point=merge_60, Geometry=movetoplane_15.Geometry, ClosestOnly=True)  # -> ClosestPoint, Distance
sort_48 = SortList(Keys=pull_58.Distance, ValuesA=merge_60)  # -> Keys, ValuesA
item_109 = ListItem(List=sort_48.ValuesA, Index="-1", Wrap=True)
item_110 = ListItem(List=sort_48.ValuesA, Index=0, Wrap=True)
pt_83 = Point(item_110)
pt_84 = Point(item_109)
ln_62 = Line(StartPoint=pt_84, EndPoint=pt_83)
rotate_19 = Rotate(Geometry=ln_62, Angle=1.570796327, Plane=pt_83)  # -> Geometry, Transform

pt_85 = Point(end_15.End)
pt_86 = Point(dispatch_109.ListA)

pl_17 = ConstructPlane(Origin=pt_85, XAxis=rotate_19.Geometry, YAxis=ln_62)
null_42 = NullItem(Item=pl_17)  # -> NullFlags, InvalidFlags, Description
dispatch_110 = Dispatch(List=pl_17, DispatchPattern=null_42.NullFlags)  # -> ListA, ListB
pln_112 = Plane(dispatch_110.ListB)

shift_65 = ShiftPaths(Data=pln_112, Offset=-1)

# ---- group: 檐口-首次筛选的有效起始Plane
data_66 = Data(shift_65)

# ----
# 4.1下层建筑内侧300到外侧50内
# 03底埋，钢板焊
data_67 = Data(merge_6)
pln_113 = Plane(data_66)
# 阴阳角
item_111 = ListItem(List=data_67, Index=0, Wrap=True)  # -> Item, Item1

# ----
# 按照梁分类定位PLANE
shift_66 = ShiftPaths(Data=crv_93, Offset=-1)
shift_67 = ShiftPaths(Data=shift_66, Offset=-1)
pull_59 = PullPoint(Point=pt_86, Geometry=simplify(shift_67), ClosestOnly=True)  # -> ClosestPoint, Distance
ln_63 = Line(StartPoint=pull_59.ClosestPoint, EndPoint=pt_86)
movetoplane_16 = MoveToPlane(Geometry=crv_47, Plane=PlaneXY(0, 0, 0), Above=True, Below=True)  # -> Geometry, Transform

# ---- group: Y Axis Line-All
crv_128 = Curve(ln_63)

# ----
end_16 = EndPoints(Curve=graft(crv_128))  # -> Start, End
merge_61 = Merge(Data1=end_16.Start, Data2=end_16.End)
pull_60 = PullPoint(Point=merge_61, Geometry=movetoplane_16.Geometry, ClosestOnly=True)  # -> ClosestPoint, Distance
sort_49 = SortList(Keys=pull_60.Distance, ValuesA=merge_61)  # -> Keys, ValuesA
item_112 = ListItem(List=sort_49.ValuesA, Index="-1", Wrap=True)
item_113 = ListItem(List=sort_49.ValuesA, Index=0, Wrap=True)
pt_87 = Point(item_113)
pt_88 = Point(item_112)
ln_64 = Line(StartPoint=pt_88, EndPoint=pt_87)
rotate_20 = Rotate(Geometry=ln_64, Angle=1.570796327, Plane=pt_87)  # -> Geometry, Transform

pt_89 = Point(end_16.End)

pl_18 = ConstructPlane(Origin=pt_89, XAxis=rotate_20.Geometry, YAxis=ln_64)
null_43 = NullItem(Item=pl_18)  # -> NullFlags, InvalidFlags, Description
dispatch_111 = Dispatch(List=pl_18, DispatchPattern=null_43.NullFlags)  # -> ListA, ListB
pln_114 = Plane(dispatch_111.ListB)

shift_68 = ShiftPaths(Data=pln_114, Offset=-1)

# ---- group: 檐口-首次筛选的有效起始Plane
data_68 = Data(shift_68)

# ----
# 撞到梁交点
pln_115 = Plane(data_68)

merge_62 = Merge(Data1=pln_113, Data2=pln_115)

# ---- group: All Location Point
merge_63 = Merge(Data1=merge_49, Data2=merge_47, Data3=merge_53, Data4=merge_62)

# ----
orient_10 = Orient(Geometry=item_111.Item, Source=item_111.Item1, Target=merge_62)  # -> Geometry, Transform

data_69 = Data(orient_10.Geometry)
ungroup_13 = Ungroup(Group=data_69)
item_114 = ListItem(List=ungroup_13, Index=0, Wrap=True)  # -> flatten(Item)
item_115 = ListItem(List=ungroup_13, Index="-1", Wrap=True)  # -> flatten(Item)

# ---- group: 钢结构下底埋 (continued)
entwine_21 = Entwine(Branch00=item_114, Branch01=item_115, FlattenInputs=True)
bake_11 = BakeObjects(Geometry=entwine_21, Attributes=attributes_8, BakeName=panel_33, Bake=False)

# ----
null_44 = NullItem(Item=merge_63)  # -> NullFlags, InvalidFlags, Description
dispatch_112 = Dispatch(List=merge_63, DispatchPattern=null_44.InvalidFlags)  # -> ListA, ListB

# ---- group: 下层图纸-标注定位点
pt_90 = Point(dispatch_112.ListB)

# ----
cluster_5 = Cluster_2(
    outline_curve=标准范围_符合单一轴网方向,
    dim_offset_1=number_slider_10,
    dim_offset_2=number_slider_8,
    axis_direction_crv1=crv_13,
    axis_direction_crv2=crv_14,
    f2_arch_outline=crv_49,
    location_point=pt_90,
    dim_style=panel_14,
    directed_outline=seam,
    移除重复位置点_容差=number_slider_9)  # -> D_3, D_4, D, D_2
dimension1_2 = Data(cluster_5.D_3)

# ---- group: Dimension4
data_70 = Data(cluster_5.D_2)

# ---- group: Dimension2
data_71 = Data(cluster_5.D_4)

# ---- group: Dimension3
data_72 = Data(cluster_5.D)

# ----
entwine_22 = Entwine(Branch00=dimension1_2, Branch01=data_71, Branch02=data_72, Branch03=data_70, FlattenInputs=True)

# ---- group: Refrash Data
# 将所有Input都输入完后要Refresh data
dam_2 = DataDam(DataA=entwine_22, BufferDelay=10000000, BufferMode=0)

# ----
dedim_2 = DeconstructDimension(DimensionObject=dam_2)  # -> Value, Text, Plane, Points, Style
shift_69 = ShiftPaths(Data=dedim_2.Text, Offset=-1)
smaller_10 = SmallerThan(FirstNumber=shift_69, SecondNumber=Slider(1, range=0..10))  # -> SmallerThan, OrEqualTo
dispatch_113 = Dispatch(List=dam_2, DispatchPattern=smaller_10.SmallerThan)  # -> ListA, ListB

# ---- group: Bake Me
bake_12 = BakeObjects(Geometry=dispatch_113.ListB, Attributes=attributes_11, Bake=False)

# ----
data_73 = Data(dispatch_113.ListB)

# ==== cluster Cluster
G = ClusterInput()
rotate = Rotate(Geometry=G, Angle=3.141592654, Plane=PlaneXY(0, 0, 0))  # -> Geometry, Transform
boxprop = BoxProperties(Box=rotate.Geometry)  # -> Center, Diagonal, Area, Volume, Degeneracy
bbox = BoundingBox(Content=rotate.Geometry, Plane=PlaneXY(0, 0, 0))  # -> Box, Box_2
debox = DeconstructBox(Box=bbox.Box)  # -> Plane, X, Y, Z
pdecon = Deconstruct(Point=boxprop.Center)  # -> XComponent, YComponent, ZComponent
dedomain = DeconstructDomain(Domain=debox.Y)  # -> Start, End
pt = ConstructPoint(XCoordinate=pdecon.XComponent, YCoordinate=dedomain.Start, ZCoordinate=pdecon.ZComponent)
xy = XYPlane(Origin=Point(0, 0, 0))
pl_origin = PlaneOrigin(Base=xy, Origin=pt)
orient = Orient(Geometry=rotate.Geometry, Source=pl_origin, Target=xy)  # -> Geometry, Transform
G_2 = ClusterOutput(orient.Geometry)

# ==== cluster Cluster_2
f2_arch_outline = ClusterInput()
directed_outline = ClusterInput()
location_point = ClusterInput()
移除重复位置点_容差 = ClusterInput()
dim_offset_1 = ClusterInput()
dim_offset_2 = ClusterInput()
axis_direction_crv1 = ClusterInput()
axis_direction_crv2 = ClusterInput()
dim_style = ClusterInput()
outline_curve = ClusterInput()
pt = Point(location_point)
merge = Merge(Data1=axis_direction_crv1, Data2=axis_direction_crv2)
crv = Curve(f2_arch_outline)
number_slider = Slider(61, range=0..100)

incurve = PointInCurve(Point=flatten(pt), Curve=outline_curve)  # -> Relationship, Point
equals = Equality(FirstNumber=incurve.Relationship, SecondNumber="0")  # -> Equality, Inequality
dispatch = Dispatch(List=flatten(pt), DispatchPattern=equals.Inequality)  # -> ListA, ListB
pt_2 = Point(dispatch.ListA)
crv_cp = CurveClosestPoint(Point=pt_2, Curve=directed_outline)  # -> Point, Parameter, Distance
sort = SortList(Keys=crv_cp.Parameter, ValuesA=pt_2)  # -> Keys, ValuesA
pt_3 = Point(sort.ValuesA)
item = ListItem(List=merge, Index=0, Wrap=True)  # -> Item, Item1

# ----
# remove重复定位点生成的2个点
pt_4 = Point(pt_3)
shift = ShiftList(List=pt_4, Shift=1, Wrap=invert(True))
pt_5 = Point(pt_3)
pt_6 = Point(shift)
dist = Distance(PointA=pt_5, PointB=pt_6)
larger = LargerThan(FirstNumber=dist, SecondNumber=移除重复位置点_容差)  # -> LargerThan, OrEqualTo
dispatch_2 = Dispatch(List=pt_5, DispatchPattern=larger.LargerThan)  # -> ListA, ListB
pt_7 = Point(dispatch_2.ListA)
pt_8 = Point(dispatch_2.ListB)

dispatch_3 = Dispatch(List=pt_7, DispatchPattern=[True, False])  # -> ListA, ListB
pt_9 = Point(dispatch_3.ListB)
pt_10 = Point(dispatch_3.ListA)
pl = ConstructPlane(Origin=pt_10, XAxis=item.Item1, YAxis=item.Item)
pl_2 = ConstructPlane(Origin=pt_10, XAxis=item.Item, YAxis=item.Item1)

item_2 = ListItem(List=pt_7, Index=number_slider, Wrap=True)
shift_2 = ShiftList(List=pt_7, Shift=1, Wrap=invert(True))
item_3 = ListItem(List=shift_2, Index=number_slider, Wrap=True)

dispatch_4 = Dispatch(List=shift_2, DispatchPattern=[True, False])  # -> ListA, ListB
item_4 = ListItem(List=merge, Index=0, Wrap=True)  # -> Item, Item1
pt_11 = Point(dispatch_4.ListB)
pt_12 = Point(dispatch_4.ListA)
pl_3 = ConstructPlane(Origin=pt_12, XAxis=item_4.Item1, YAxis=item_4.Item)
pl_4 = ConstructPlane(Origin=pt_12, XAxis=item_4.Item, YAxis=item_4.Item1)

ln = Line(StartPoint=pt_10, EndPoint=pt_9)
ln_2 = Line(StartPoint=pt_12, EndPoint=pt_11)

crv_2 = Curve(crv)
deplane = DeconstructPlane(Plane=pl_3)  # -> Origin, XAxis, YAxis, ZAxis
amp = Amplitude(Vector=deplane.YAxis, Amplitude=Slider(3000, range=0..10000))
move = Move(Geometry=deplane.Origin, Motion=amp)  # -> Geometry, Transform
clscrv = CloseCurve(Curve=crv_2, CloseType=0, Bulge=0.5, Tolerance=0)  # -> Closed, R
pt_13 = Point(move.Geometry)
incurve_2 = PointInCurve(Point=pt_13, Curve=clscrv.Closed)  # -> Relationship, Point
equals_2 = Equality(FirstNumber=incurve_2.Relationship, SecondNumber="2")  # -> Equality, Inequality
lng = ListLength(List=equals_2.Equality)
lng_2 = ListLength(List=equals_2.Equality)
neg = Negative(Value=dim_offset_1)
repeat = RepeatData(Data=graft(neg), Length=lng)
repeat_2 = RepeatData(Data=graft(dim_offset_1), Length=lng_2)
panel = Panel(equals_2.Equality)
dispatch_5 = Dispatch(List=graft(repeat_2), DispatchPattern=graft(equals_2.Equality))  # -> ListA, ListB
dispatch_6 = Dispatch(List=graft(repeat), DispatchPattern=graft(equals_2.Equality))  # -> ListA, ListB
merge_2 = Merge(Data1=dispatch_5.ListA, Data2=dispatch_6.ListB)  # -> flatten(Result)

crv_3 = Curve(crv)
deplane_2 = DeconstructPlane(Plane=pl_4)  # -> Origin, XAxis, YAxis, ZAxis
amp_2 = Amplitude(Vector=deplane_2.YAxis, Amplitude=Slider(3000, range=0..10000))
move_2 = Move(Geometry=deplane_2.Origin, Motion=amp_2)  # -> Geometry, Transform
clscrv_2 = CloseCurve(Curve=crv_3, CloseType=0, Bulge=0.5, Tolerance=0)  # -> Closed, R
pt_14 = Point(move_2.Geometry)
incurve_3 = PointInCurve(Point=pt_14, Curve=clscrv_2.Closed)  # -> Relationship, Point
equals_3 = Equality(FirstNumber=incurve_3.Relationship, SecondNumber="2")  # -> Equality, Inequality
lng_3 = ListLength(List=equals_3.Equality)
neg_2 = Negative(Value=dim_offset_1)
lng_4 = ListLength(List=equals_3.Equality)
repeat_3 = RepeatData(Data=graft(neg_2), Length=lng_4)
repeat_4 = RepeatData(Data=graft(dim_offset_1), Length=lng_3)
panel_2 = Panel(equals_3.Equality)
dispatch_7 = Dispatch(List=graft(repeat_4), DispatchPattern=graft(equals_3.Equality))  # -> ListA, ListB
dispatch_8 = Dispatch(List=graft(repeat_3), DispatchPattern=graft(equals_3.Equality))  # -> ListA, ListB
merge_3 = Merge(Data1=dispatch_7.ListA, Data2=dispatch_8.ListB)  # -> flatten(Result)

crv_4 = Curve(crv)
deplane_3 = DeconstructPlane(Plane=pl)  # -> Origin, XAxis, YAxis, ZAxis
amp_3 = Amplitude(Vector=deplane_3.YAxis, Amplitude=Slider(3000, range=0..10000))
move_3 = Move(Geometry=deplane_3.Origin, Motion=amp_3)  # -> Geometry, Transform
clscrv_3 = CloseCurve(Curve=crv_4, CloseType=0, Bulge=0.5, Tolerance=0)  # -> Closed, R
pt_15 = Point(move_3.Geometry)
incurve_4 = PointInCurve(Point=pt_15, Curve=clscrv_3.Closed)  # -> Relationship, Point
equals_4 = Equality(FirstNumber=incurve_4.Relationship, SecondNumber="2")  # -> Equality, Inequality
lng_5 = ListLength(List=equals_4.Equality)
neg_3 = Negative(Value=dim_offset_2)
lng_6 = ListLength(List=equals_4.Equality)
repeat_5 = RepeatData(Data=graft(neg_3), Length=lng_6)
repeat_6 = RepeatData(Data=graft(dim_offset_2), Length=lng_5)
panel_3 = Panel(equals_4.Equality)
dispatch_9 = Dispatch(List=graft(repeat_6), DispatchPattern=graft(equals_4.Equality))  # -> ListA, ListB
dispatch_10 = Dispatch(List=graft(repeat_5), DispatchPattern=graft(equals_4.Equality))  # -> ListA, ListB
merge_4 = Merge(Data1=dispatch_9.ListA, Data2=dispatch_10.ListB)  # -> flatten(Result)

crv_5 = Curve(crv)
deplane_4 = DeconstructPlane(Plane=pl_2)  # -> Origin, XAxis, YAxis, ZAxis
amp_4 = Amplitude(Vector=deplane_4.YAxis, Amplitude=Slider(3000, range=0..10000))
move_4 = Move(Geometry=deplane_4.Origin, Motion=amp_4)  # -> Geometry, Transform
clscrv_4 = CloseCurve(Curve=crv_5, CloseType=0, Bulge=0.5, Tolerance=0)  # -> Closed, R
pt_16 = Point(move_4.Geometry)
incurve_5 = PointInCurve(Point=pt_16, Curve=clscrv_4.Closed)  # -> Relationship, Point
equals_5 = Equality(FirstNumber=incurve_5.Relationship, SecondNumber="2")  # -> Equality, Inequality
lng_7 = ListLength(List=equals_5.Equality)
neg_4 = Negative(Value=dim_offset_2)
lng_8 = ListLength(List=equals_5.Equality)
repeat_7 = RepeatData(Data=graft(neg_4), Length=lng_8)
repeat_8 = RepeatData(Data=graft(dim_offset_2), Length=lng_7)
panel_4 = Panel(equals_5.Equality)
dispatch_11 = Dispatch(List=graft(repeat_8), DispatchPattern=graft(equals_5.Equality))  # -> ListA, ListB
dispatch_12 = Dispatch(List=graft(repeat_7), DispatchPattern=graft(equals_5.Equality))  # -> ListA, ListB
merge_5 = Merge(Data1=dispatch_11.ListA, Data2=dispatch_12.ListB)  # -> flatten(Result)

lineardim = DefineLinearDimension(
    Point1=simplify(pt_12),
    Point2=simplify(pt_11),
    DimensionPlane=simplify(pl_3),
    Offset=expr("-x", merge_2),
    DimensionStyle=dim_style)
lineardim_2 = DefineLinearDimension(
    Point1=simplify(pt_12),
    Point2=simplify(pt_11),
    DimensionPlane=simplify(pl_4),
    Offset=expr("-x", merge_3),
    DimensionStyle=dim_style)
lineardim_3 = DefineLinearDimension(
    Point1=simplify(pt_10),
    Point2=simplify(pt_9),
    DimensionPlane=simplify(pl),
    Offset=expr("-x", merge_4),
    DimensionStyle=dim_style)
lineardim_4 = DefineLinearDimension(
    Point1=simplify(pt_10),
    Point2=simplify(pt_9),
    DimensionPlane=simplify(pl_2),
    Offset=expr("-x", merge_5),
    DimensionStyle=dim_style)
D = ClusterOutput(lineardim)
D_2 = ClusterOutput(lineardim_2)
D_3 = ClusterOutput(lineardim_3)
D_4 = ClusterOutput(lineardim_4)

# ==== cluster Cluster_3
structure_number = ClusterInput()
tag_text = ClusterInput()
text_offset = ClusterInput()
embed_color = ClusterInput()
T = ClusterInput()
G = ClusterInput()
A = ClusterInput()
A_2 = ClusterInput()
B = ClusterInput()
dimension_style = ClusterInput()

# ----
# 列表文字以空格进行分割
panel = Panel(" ")
split = TextSplit(Text=T, Separators=panel)

钢埋板长度_2 = Division(A=A, B=2)
neg = Negative(Value=钢埋板长度_2)
dom = ConstructDomain(DomainStart=neg, DomainEnd=钢埋板长度_2)
panel_2 = Panel(dom)

钢埋板厚度_2 = Division(A=A_2, B=2)
neg_2 = Negative(Value=钢埋板厚度_2)
dom_2 = ConstructDomain(DomainStart=neg_2, DomainEnd=钢埋板厚度_2)
panel_3 = Panel(dom_2)

# ----
# 钢埋板肋板位置 1/4处
panel_4 = Panel("4")
division = Division(A=A, B=panel_4)

# ----
# 编号和截面尺寸分区
panel_5 = Panel("1")
split_2 = SplitList(List=split, Index=panel_5)  # -> flatten(ListA), flatten(ListB)

# ----
# 求出对应输入编号的钢结构截面尺寸
fsim = FindSimilarMember(Data=structure_number, Set=split_2.ListA)  # -> Hit, Index
item = ListItem(List=split_2.ListB, Index=fsim.Index, Wrap=True)

addition = Addition(A=neg_2, B=division)
addition_2 = Addition(A=钢埋板厚度_2, B=division)
dom_3 = ConstructDomain(DomainStart=addition, DomainEnd=addition_2)
panel_6 = Panel(split_2.ListB)
split_3 = TextSplit(Text=item, Separators="x")
split_4 = TextSplit(Text=split_3, Separators="Q")
item_2 = ListItem(List=split_4, Index="0", Wrap=True)  # -> flatten(Item)
subtraction = Subtraction(A=division, B=钢埋板厚度_2)
subtraction_2 = Subtraction(A=division, B=钢埋板厚度_2)
subtraction_3 = Subtraction(A=division, B=钢埋板厚度_2)
neg_3 = Negative(Value=钢埋板厚度_2)
neg_4 = Negative(Value=钢埋板厚度_2)
neg_5 = Negative(Value=钢埋板厚度_2)
subtraction_4 = Subtraction(A=division, B=钢埋板厚度_2)
addition_3 = Addition(A=subtraction, B=A_2)
addition_4 = Addition(A=subtraction_2, B=A_2)
subtraction_5 = Subtraction(A=neg_3, B=A_2)
subtraction_6 = Subtraction(A=neg_4, B="2")
subtraction_7 = Subtraction(A=division, B=钢埋板厚度_2)
addition_5 = Addition(A=subtraction_3, B="2")
subtraction_8 = Subtraction(A=neg_5, B="2")
neg_6 = Negative(Value=钢埋板厚度_2)
neg_7 = Negative(Value=钢埋板厚度_2)
工字钢_h = ListItem(List=item_2, Index=0, Wrap=True)
工字钢_b = ListItem(List=item_2, Index=1, Wrap=True)
工字钢_tf = ListItem(List=item_2, Index=3, Wrap=True)
工字钢_tw = ListItem(List=item_2, Index=2, Wrap=True)
pt = ConstructPoint(XCoordinate=neg_6, YCoordinate=subtraction_4, ZCoordinate=0)
pt_2 = ConstructPoint(XCoordinate=neg_7, YCoordinate=addition_3, ZCoordinate=0)
pt_3 = ConstructPoint(XCoordinate=subtraction_5, YCoordinate=addition_4, ZCoordinate=0)
pt_4 = ConstructPoint(XCoordinate=subtraction_6, YCoordinate=subtraction_7, ZCoordinate=0)
pt_5 = ConstructPoint(XCoordinate=subtraction_8, YCoordinate=addition_5, ZCoordinate=0)
subtraction_9 = Subtraction(A=工字钢_b, B=工字钢_tw)
division_2 = Division(A=subtraction_9, B="2")
merge = Merge(Data1=pt, Data2=pt_2, Data3=pt_3, Data4=pt_5, Data5=pt_4)
pline = PolyLine(Vertices=merge, Closed=True)
division_3 = Division(A=division_2, B="2")
subtraction_10 = Subtraction(A=division_3, B=A_2)
subtraction_11 = Subtraction(A=division_3, B=钢埋板厚度_2)
neg_8 = Negative(Value=division_3)
subtraction_12 = Subtraction(A=neg_8, B=subtraction_11)
addition_6 = Addition(A=subtraction_12, B=B)
dom_4 = ConstructDomain(DomainStart=addition_6, DomainEnd=subtraction_12)
dom_5 = ConstructDomain(DomainStart=addition, DomainEnd=addition_2)
钢肋板倒角_侧视图 = Rectangle(Plane=PlaneXY(0, 0, 0), XSize=dom_4, YSize=dom_5, Radius=0)  # -> Rectangle, Length
subtraction_13 = Subtraction(A=subtraction_10, B=subtraction_11)
subtraction_14 = Subtraction(A=neg_8, B=subtraction_11)
dom_6 = ConstructDomain(DomainStart=subtraction_13, DomainEnd=subtraction_14)
钢肋板_侧视图 = Rectangle(Plane=PlaneXY(0, 0, 0), XSize=dom_6, YSize=dom_3, Radius=0)  # -> Rectangle, Length
merge_2 = Merge(Data1=钢肋板_侧视图.Rectangle, Data2=pline, Data3=钢肋板倒角_侧视图.Rectangle)
xz = XZPlane(Origin=Point(0, 0, 0))
mirror = Mirror(Geometry=merge_2, Plane=xz)  # -> Geometry, Transform
钢埋板_侧视图 = Rectangle(Plane=PlaneXY(0, 0, 0), XSize=dom_2, YSize=dom, Radius=0)  # -> Rectangle, Length
division_4 = Division(A=工字钢_b, B=2)
侧视图 = Entwine(Branch00=钢埋板_侧视图.Rectangle, Branch01=merge_2, Branch02=mirror.Geometry, FlattenInputs=True)
R = ClusterOutput(division_4)
division_5 = Division(A=工字钢_h, B="2")
subtraction_15 = Subtraction(A=division_5, B=工字钢_tf)
addition_7 = Addition(A=subtraction_15, B=Slider(200, range=0..1000))
addition_8 = Addition(A=addition_7, B=division_2)
X = UnitX(Factor=addition_8)
move = Move(Geometry=侧视图, Motion=X)  # -> Geometry, Transform
split_tree = SplitTree(Data=move.Geometry, Masks=flatten("{0;0}"))  # -> Positive, Negative
dispatch = Dispatch(List=split_tree.Negative, DispatchPattern=[True, False])  # -> flatten(ListA), ListB
merge_3 = Merge(Data1=split_tree.Positive, Data2=dispatch.ListA)
entwine = Entwine(Branch00=merge_3, Branch01=dispatch.ListB, FlattenInputs=True)
flatten = FlattenTree(Tree=entwine, Path="{0}")
group = Group(Objects=flatten)
rotate = Rotate(Geometry=group, Angle=3.141592654, Plane=PlaneXY(0, 0, 0))  # -> Geometry, Transform
boxprop = BoxProperties(Box=rotate.Geometry)  # -> Center, Diagonal, Area, Volume, Degeneracy
bbox = BoundingBox(Content=rotate.Geometry, Plane=PlaneXY(0, 0, 0))  # -> Box, Box_2
debox = DeconstructBox(Box=bbox.Box)  # -> Plane, X, Y, Z
pdecon = Deconstruct(Point=boxprop.Center)  # -> XComponent, YComponent, ZComponent
dedomain = DeconstructDomain(Domain=debox.Y)  # -> Start, End
pt_6 = ConstructPoint(XCoordinate=pdecon.XComponent, YCoordinate=dedomain.Start, ZCoordinate=pdecon.ZComponent)
xy = XYPlane(Origin=Point(0, 0, 0))
concat = Concatenate(FragmentA="Embed", FragmentB=tag_text)
pl_origin = PlaneOrigin(Base=xy, Origin=pt_6)
orient = Orient(Geometry=rotate.Geometry, Source=pl_origin, Target=xy)  # -> Geometry, Transform
xy_2 = XYPlane(Origin=Point(0, 0, 0))
attributes = DefineObjectAttributes(Color=embed_color)
ungroup = Ungroup(Group=orient.Geometry)
block = DefineBlock(Geometry=ungroup, Attributes=attributes, BlockName=concat, BasePlane=PlaneXY(0, 0, 0))
deblock = DeconstructBlock(Block=block)  # -> Name, flatten(Plane), flatten(Geometry)
group_2 = Group(Objects=deblock.Geometry)
bbox_2 = BoundingBox(Content=group_2, Plane=PlaneXY(0, 0, 0))  # -> Box, Box_2
deplane = DeconstructPlane(Plane=deblock.Plane)  # -> Origin, XAxis, YAxis, ZAxis
area = Area(Geometry=bbox_2.Box)  # -> Area, Centroid
move2pt = MoveToPoint(Geometry=flatten(deplane.Origin), PointA=flatten(deplane.Origin), PointB=flatten(area.Centroid))  # -> Moved, Vector, Transform
pl = ConstructPlane(Origin=move2pt.Moved, XAxis=deplane.YAxis, YAxis=deplane.XAxis)  # -> graft(Plane)
deplane_2 = DeconstructPlane(Plane=pl)  # -> Origin, XAxis, YAxis, ZAxis
rotate_2 = Rotate(Geometry=pl, Angle="Pi", Plane=pl)  # -> Geometry, Transform
dedomain_2 = DeconstructDomain(Domain=dom)  # -> Start, End
multiplication = Multiplication(A=dedomain_2.Start, B=dedomain_2.Start)
amp = Amplitude(Vector=deplane_2.YAxis, Amplitude=multiplication)
move_2 = Move(Geometry=deplane_2.Origin, Motion=amp)  # -> Geometry, Transform
srf = Surface(bbox_2.Box)
crv = Curve(srf)
ln = Line(StartPoint=move_2.Geometry, EndPoint=deplane_2.Origin)
ccx = CurveCurve(CurveA=ln, CurveB=crv)  # -> Points, ParamsA, ParamsB
ln_2 = Line(StartPoint=deplane_2.Origin, EndPoint=ccx.Points)
move_3 = Move(Geometry=rotate_2.Geometry, Motion=ln_2)  # -> Geometry, Transform

ln_3 = Line(StartPoint=ccx.Points, EndPoint=deplane_2.Origin)
amp_2 = Amplitude(Vector=ln_3, Amplitude=text_offset)
move_4 = Move(Geometry=rotate_2.Geometry, Motion=amp_2)  # -> Geometry, Transform
text = DefineTextObject(Text=tag_text, Plane=move_4.Geometry, DimensionStyle=dimension_style, OutputType="Text")
group_3 = Group(Objects=[block, text])

entwine_2 = Entwine(Branch00=group_3, Branch01=move_3.Geometry, FlattenInputs=True)
project = Project(Geometry=G, Plane=xy_2)  # -> Geometry, Transform
R_2 = ClusterOutput(entwine_2)
G_2 = ClusterOutput(project.Geometry)
