# Grasshopper definition FacadeEmbed_JinQiao_PodiumNew.gh (Grasshopper 1.0.7)
# plug-ins: EleFront, TT Toolbox, Pufferfish, Hare, treesloth01

# ----
# 线段延长长度
number_slider = Slider(1001, range=0..10000)  # disabled

# ----
# remove duplicate curves
geo = Geometry()  # disabled
number_slider_2 = Slider(0.1, range=0..0.1)  # disabled
boundary = BoundarySurfaces(Edges=geo)  # disabled
area = Area(Geometry=boundary)  # -> Area, Centroid; disabled
cullduppoints = RemoveDuplicatePoints(InputPoints=area.Centroid, Tolerance=number_slider_2)  # -> OutputPoints, FirstPointIndexes; disabled
null = NullItem(Item=cullduppoints.FirstPointIndexes)  # -> NullFlags, InvalidFlags, Description; disabled
dispatch = Dispatch(List=boundary, DispatchPattern=null.NullFlags)  # -> ListA, ListB; disabled
geo_2 = Geometry(dispatch.ListA)  # disabled

# ----
# 调换阴阳角设定
toggle = BooleanToggle(False)  # disabled

# ----
# Step1.输入block names
# Step2:点击Update按钮
data = Data(["PX-GLAZ-F2$0$PX-GLAZ-F2$0$fin", "PX-GLAZ-F2$0$PX-GLAZ-F1$0$fin"])
panel = Panel(data)
# （1）导入埋件定位点
panel_2 = Panel("")
refblock = ReferenceBlockByName(BlockName=panel)

# ----
# Input Curves
# 
# Step1：选中其中一个curve,得到该图层所有curves
# Step2：点击Update按钮
crv = Curve(<curve referenced from the Rhino model>)

# ----
# (Block & Curve的形式)
# Input Blocks (Plane的Y轴向外)
# 
# Step1.输入Block所在图层
# Step2:点击Update按钮
data_2 = Data(["PX-GLAZ-F2$0$PX-GLAZ-F1$0$标准块", "PX-GLAZ-F2$0$PX-GLAZ-F2$0$标准块", "PX-GLAZ-F2$0$PX-GLAZ-F3$0$标准块"])

# ----
# （5）导入Default Embed
# 输入
# 
# 1.Embed的结构编号
# 2.Embed的Tag命名
# 需要出图的钢结构编号
panel_3 = Panel("GL3-3H")

# ----
# 埋件编号tag的Offset
number_slider_3 = Slider(190, range=0..1000)

# ----
# Embed Layer Color
swatch = ColourSwatch(SwatchColor=RGB(136, 235, 148))

# ----
# 钢结构截面列表
txt = Text(["GL2A-1\tHN 250x125x6x9\t\tQ235B\t热轧", "GL3-1\tHN 300x150x6.5x9\t\tQ235B\t热轧", "GL3-2\tH 300x100x8x10\t\tQ235B\t焊接H型", "GL3-3\tH 300x200x8x16\t\tQ355B\t焊接H型", "GL3-4\tHW 300x300x10x15\t\tQ355B\t热轧", "GL4-1\tHN 400x200x8x13\t\tQ355B\t热轧", "GL4-2\tH 400x200x10x16\t\tQ355B\t焊接H型", "GL4-3\tH 400x250x10x20\t\tQ355B\t焊接H型", "GL4-4\tH 400x350x16x35\t\tQ355B\t焊接H型", "GL4a-1\tH 450x200x9x14\t\tQ355B\t热轧", "GL5-1\tHN 500x200x10x16\t\tQ355B\t热轧", "GL5-2\tH 500x200x10x20\t\tQ355B\t焊接H型", "GL5-3\tH 500x300x14x20\t\tQ355B\t焊接H型", "GL5a-1\tH 550x250x10x25\t\tQ355B\t焊接H型", "GL5a-2\tH 550x300x14x25\t\tQ355B\t焊接H型", "GL6-1\tHN 600x200x11x17\t\tQ355B\t热轧", "GL6-2\tH 600x300x12x20\t\tQ355B\t焊接H型", "GL6-3\tH 600x350x12x25\t\tQ355B\t焊接H型", "GL6-4\tH 600x350x16x35\t\tQ355B\t焊接H型", "GL7-1\tHN 700x300x13x24\t\tQ355B\t热轧", "GL7-2\tH 700x350x14x30\t\tQ355B\t焊接H型", "GL7-3\tH 700x350x14x35\t\tQ355B\t焊接H型", "GL8-1\tHN 800x300x14x26\t\tQ355B\t热轧", "GL8-2\tH 800x300x20x40\t\tQ345GJB\t焊接H型", "GL9-1\tH 900x300x20x30\t\tQ355B\t焊接H型", "GL9-2\tH 900x400x20x40\t\tQ345GJB\t焊接H型", "GL10-1\tH 1000x400x20x30\t\tQ355B\t焊接H型", "GL10-2\tH 1000x500x20x30\t\tQ355B\t焊接H型", "GL10-3\tH 1000x500x20x35\t\tQ355B\t焊接H型", "GL10-4\tH 1000x400x20x40\t\tQ345GJB\t焊接H型", "GL10-5\tH 1000x500x20x40\t\tQ345GJB\t焊接H型", "GL10-6\t□ 1000x400x20x40\t\tQ345GJB\t焊接箱型", "GL12-1\tH 1200x400x25x50\t\tQ345GJB\t焊接H型"])

# ----
# 钢埋板长度（按需设定）
number_slider_4 = Slider(350, range=0..1000)

# ----
# 钢埋板厚度（按需设定）
number_slider_5 = Slider(16, range=0..100)

# ----
# 肋板倒角距离（按需设定）
number_slider_6 = Slider(30, range=0..100)

# ----
# Dimension Style
panel_4 = Panel("图例2-地上$0$XD100$0")

# ----
# block names
listblockd = ListBlockDocument()

# ----
# Input Blocks (Plane的Y轴向内)
# 
# Step1:输入Block所在图层
# Step2:点击Update按钮
data_3 = Data("PX-GLAZ-F2$0$T3T")

# ----
# 埋件编号tag
panel_5 = Panel("4-4")

# ----
# 输入
# 
# Embed的Tag命名
# 埋件编号
panel_6 = Panel("5-5")

# ----
# 长
panel_7 = Panel("-175 To 175")

# ----
# 宽
panel_8 = Panel("-125 To 125")

# ----
# Dimension Style
panel_9 = Panel("图例2-地上$0$XD100$0")

# ----
# Dimension Style
panel_10 = Panel("图例2-地上$0$XD100$0")

# ----
# (8) 撞到梁交点-Offset
number_slider_7 = Slider(450, range=0..1000)

# ----
# 埋件编号tag的Offset
number_slider_8 = Slider(353, range=0..1000)

# ----
# 埋件编号tag
panel_11 = Panel("6-6")

# ---- group: Input Beam Tags
panel_12 = Panel("text-def")

# ----
# 钢埋板长度（按需设定）
number_slider_9 = Slider(350, range=0..1000)

# ----
# 肋板倒角距离（按需设定）
number_slider_10 = Slider(30, range=0..100)

# ----
# Self Input Beam Tag Name
panel_13 = Panel("""1-1
2-2""")

# ---- group: 混凝土
# 板埋几何INPUT
list = ValueList({"C15": 0, "C20": 1, "C25": 2, "C30": 3, "C35": 4, "C40": 5}, selected="C35")

# ---- group: 钢筋牌号
list_2 = ValueList({"HPB300": 0, "HRB400": 1}, selected="HPB300")

# ---- group: 直径
list_3 = ValueList({"10": 0, "12": 1, "16": 2, "18": 3, "20": 4, "25": 5}, selected="12")

# ---- group: 锚筋间距
s_y = Slider(22, range=14..60, expression="X*5")
s_x = Slider(22, range=14..60, expression="X*5")

# ---- group: 列
list_4 = ValueList({"2X": 0, "3X": 1, "4X": 2}, selected="3X")

# ---- group: 行
# （7）生成底埋钢埋件
list_5 = ValueList({"2Y": 0, "3Y": 1, "4Y": 2}, selected="2Y")

# ---- group: Input Beam
crv_2 = Curve(<curve referenced from the Rhino model>)

# ----
# 钢埋板厚度（按需设定）
number_slider_11 = Slider(16, range=0..100)

# ----
# 埋件编号tag的Offset
number_slider_12 = Slider(300, range=0..1000)

# ----
# 导入下层建筑线
# 格式：Line-0-建筑
panel_14 = Panel("Line-0-建筑-Whole")
reflay = ReferenceByLayer(LayerName=panel_14)

# ----
# 导入上层建筑线+檐口线
# 格式：Line-1-
panel_15 = Panel("Line-1-檐口")
# （3）导入单体建筑的参考线
# 按照图层导入建筑、檐口线、特殊区域线
# 
# Step1:将不同类型的curve按照以下图层分类放入Rhino中
# Step2:依次点击每个Update按钮
panel_16 = Panel("Line-1-建筑-Whole")
reflay_2 = ReferenceByLayer(LayerName=panel_16)
reflay_3 = ReferenceByLayer(LayerName=panel_15)

# ----
# 钢结构截面列表
txt_2 = Text(["GL2A-1\tHN 250x125x6x9\t\tQ235B\t热轧", "GL3-1\tHN 300x150x6.5x9\t\tQ235B\t热轧", "GL3-2\tH 300x100x8x10\t\tQ235B\t焊接H型", "GL3-3\tH 300x200x8x16\t\tQ355B\t焊接H型", "GL3-4\tHW 300x300x10x15\t\tQ355B\t热轧", "GL4-1\tHN 400x200x8x13\t\tQ355B\t热轧", "GL4-2\tH 400x200x10x16\t\tQ355B\t焊接H型", "GL4-3\tH 400x250x10x20\t\tQ355B\t焊接H型", "GL4-4\tH 400x350x16x35\t\tQ355B\t焊接H型", "GL4a-1\tH 450x200x9x14\t\tQ355B\t热轧", "GL5-1\tHN 500x200x10x16\t\tQ355B\t热轧", "GL5-2\tH 500x200x10x20\t\tQ355B\t焊接H型", "GL5-3\tH 500x300x14x20\t\tQ355B\t焊接H型", "GL5a-1\tH 550x250x10x25\t\tQ355B\t焊接H型", "GL5a-2\tH 550x300x14x25\t\tQ355B\t焊接H型", "GL6-1\tHN 600x200x11x17\t\tQ355B\t热轧", "GL6-2\tH 600x300x12x20\t\tQ355B\t焊接H型", "GL6-3\tH 600x350x12x25\t\tQ355B\t焊接H型", "GL6-4\tH 600x350x16x35\t\tQ355B\t焊接H型", "GL7-1\tHN 700x300x13x24\t\tQ355B\t热轧", "GL7-2\tH 700x350x14x30\t\tQ355B\t焊接H型", "GL7-3\tH 700x350x14x35\t\tQ355B\t焊接H型", "GL8-1\tHN 800x300x14x26\t\tQ355B\t热轧", "GL8-2\tH 800x300x20x40\t\tQ345GJB\t焊接H型", "GL9-1\tH 900x300x20x30\t\tQ355B\t焊接H型", "GL9-2\tH 900x400x20x40\t\tQ345GJB\t焊接H型", "GL10-1\tH 1000x400x20x30\t\tQ355B\t焊接H型", "GL10-2\tH 1000x500x20x30\t\tQ355B\t焊接H型", "GL10-3\tH 1000x500x20x35\t\tQ355B\t焊接H型", "GL10-4\tH 1000x400x20x40\t\tQ345GJB\t焊接H型", "GL10-5\tH 1000x500x20x40\t\tQ345GJB\t焊接H型", "GL10-6\t□ 1000x400x20x40\t\tQ345GJB\t焊接箱型", "GL12-1\tH 1200x400x25x50\t\tQ345GJB\t焊接H型"])

# ----
# Dimension Style
panel_17 = Panel("图例2-地上$0$XD100$0")

# ----
# 5特殊区域线
# 上层建筑边线,
# 默认建筑提供上翻
# 如主结构提供示意则使用结构定位【该项目无】
# 如无则使用建筑边线向内50mm作为埋件定位
crv_3 = Curve(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)

# ---- group: 参考线起点
number_slider_13 = Slider(0.806, range=0..1)

# ---- group: Dimension Offset Input 2
number_slider_14 = Slider(1000, range=0..1000)

# ---- group: 移除重复位置点-容差
number_slider_15 = Slider(200, range=0..1000)

# ---- group: Dimension Offset Input 1
number_slider_16 = Slider(2000, range=0..10000)

# ---- group: 标注区域-单一轴网
标准范围_符合单一轴网方向 = Curve(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)

# ---- group: 轴网XY2个方向的线
crv_4 = Curve(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)
crv_5 = Curve(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)

# ---- group: 参考线: 符合轴网方向+囊括整个建筑
# (9)Bake Me!!
# 下层图纸-单一区域
crv_6 = Curve(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)

# ---- group: 移除重复位置点-容差
number_slider_17 = Slider(200, range=0..1000)

# ---- group: 参考线起点
number_slider_18 = Slider(0.548, range=0..1)

# ---- group: Dimension Offset Input 2
number_slider_19 = Slider(1000, range=0..1000)

# ---- group: Dimension Offset Input 1
number_slider_20 = Slider(2000, range=0..10000)

# ---- group: 标注区域-单一轴网
标准范围_符合单一轴网方向_2 = Curve(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)

# ---- group: 轴网XY2个方向的线
crv_7 = Curve(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)
crv_8 = Curve(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)

# ----
layer = ObjectLayer(Guid=crv)  # -> LayerIndex, LayerPathName
panel_18 = Panel(data_2)
panel_20 = Panel(layer.LayerPathName)
panel_21 = Panel(data_3)
refblock_2 = ReferenceBlockByName(BlockName=panel_18)
refblock_3 = ReferenceBlockByName(BlockName=panel_21)
reflay_4 = ReferenceByLayer(LayerName=panel_20)

# ---- group: 参考线: 符合轴网方向+囊括整个建筑
# (9)Bake Me!!
# 上层图纸-单一区域
crv_9 = Curve(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)

# ----
panel_22 = Panel(txt)

# ----
# （0）准备阶段
# 检测各个图层Block的Plane
panel_23 = Panel(listblockd)
deblock = DeconstructBlock(Block=refblock)  # -> Name, Plane, Geometry

# ---- group: Beam-Middle
crv_10 = Curve(flatten([<curve referenced from the Rhino model> x350]))

crv_11 = Curve(flatten([<curve referenced from the Rhino model> x349]))

# ---- group: Closed Outline Curve
crv_12 = Curve([<curve referenced from the Rhino model> x4])

# ----
# 生成下层定位平面
circle = Curve(<curve referenced from the Rhino model>)

# ----
# 生成上层定位平面
circle_2 = Curve(<curve referenced from the Rhino model>)

# ---- group: Closed Outline Curve
crv_13 = Curve([<curve referenced from the Rhino model> x3])

# ----
# Step3.检测plane是否存在+查看Plane的Y轴方向
pln = Plane(deblock.Plane)

deblock_2 = DeconstructBlock(Block=refblock_3)  # -> Name, Plane, Geometry
deblock_3 = DeconstructBlock(Block=refblock_2)  # -> Name, Plane, Geometry

# ----
# Step4.如果不存在则Blake geometry
# 并在rhino里面清理线段
geo_3 = Geometry(deblock.Geometry)

# ---- group: the Dimension Reference Curve
seam = Seam(Curve=reparameterize(crv_6), Seam=number_slider_13)

# ---- group: The Start Point of the Dimension Reference Curve
eval = EvaluateCurve(Curve=reparameterize(crv_6), Parameter=number_slider_13)  # -> Point, Tangent, Angle

# ---- group: Dimension Style
panel_24 = Panel("图例2-地上$0$XD100$0")

# ---- group: The Start Point of the Dimension Reference Curve
eval_2 = EvaluateCurve(Curve=reparameterize(crv_9), Parameter=number_slider_18)  # -> Point, Tangent, Angle

# ---- group: the Dimension Reference Curve
seam_2 = Seam(Curve=reparameterize(crv_9), Seam=number_slider_18)

# ---- group: Dimension Style
panel_25 = Panel("图例2-地上$0$XD100$0")

# ----
xy = XYPlane(Origin=Point(0, 0, 0))
xy_2 = XYPlane(Origin=Point(0, 0, 0))
xy_3 = XYPlane(Origin=Point(0, 0, 0))
xy_4 = XYPlane(Origin=Point(0, 0, 0))
xy_5 = XYPlane(Origin=Point(0, 0, 0))
xy_6 = XYPlane(Origin=Point(0, 0, 0))
project = Project(Geometry=reflay_2, Plane=xy_4)  # -> Geometry, Transform
project_2 = Project(Geometry=reflay_3, Plane=xy_5)  # -> Geometry, Transform
project_3 = Project(Geometry=reflay, Plane=xy_6)  # -> Geometry, Transform

crv_14 = Curve(project_2.Geometry)
crv_15 = Curve(project_3.Geometry)
crv_16 = Curve(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)
crv_17 = Curve(project.Geometry)

# ---- group: 制作上层定位平面 / Smoothed Curve-Site
crv_18 = Curve(crv_13)

# ----
project_4 = Project(Geometry=refblock_2, Plane=xy)  # -> Geometry, Transform
project_5 = Project(Geometry=refblock_3, Plane=xy_2)  # -> Geometry, Transform
project_6 = Project(Geometry=reflay_4, Plane=xy_3)  # -> Geometry, Transform

# ---- group: 制作上层定位平面 / Boundary Curve-Site
clscrv = CloseCurve(Curve=crv_13, CloseType=0, Bulge=0.5, Tolerance=0)  # -> Closed, R

# ---- group: 制作下层定位平面
layer_2 = ObjectLayer(Guid=circle)  # -> LayerIndex, LayerPathName
reflay_5 = ReferenceByLayer(LayerName=layer_2.LayerPathName)
movetoplane = MoveToPlane(Geometry=reflay_5, Plane=PlaneXY(0, 0, 0), Above=True, Below=True)  # -> Geometry, Transform
movetoplane_2 = MoveToPlane(Geometry=crv_10, Plane=PlaneXY(0, 0, 0), Above=True, Below=True)  # -> Geometry, Transform
area_2 = Area(Geometry=movetoplane.Geometry)  # -> Area, Centroid
pull = PullPoint(Point=area_2.Centroid, Geometry=movetoplane_2.Geometry, ClosestOnly=True)  # -> ClosestPoint, Distance
larger = LargerThan(FirstNumber=pull.Distance, SecondNumber="800")  # -> LargerThan, OrEqualTo
dispatch_2 = Dispatch(List=area_2.Centroid, DispatchPattern=larger.LargerThan)  # -> ListA, ListB

# ---- group: 制作下层定位平面 / Smoothed Curve-Site
crv_19 = Curve(crv_12)

# ---- group: 制作下层定位平面 / Boundary Curve-Site
clscrv_2 = CloseCurve(Curve=crv_12, CloseType=0, Bulge=0.5, Tolerance=0)  # -> Closed, R

# ----
cluster = Cluster_3(
    structure_number=panel_3,
    tag_text=panel_5,
    text_offset=number_slider_3,
    embed_color=swatch,
    T=txt,
    A=number_slider_4,
    A_2=number_slider_5,
    B=number_slider_6,
    dimension_style=panel_4)  # -> R, G_2, R_2
data_4 = Data(flatten(cluster.R_2))
item = ListItem(List=data_4, Index=0, Wrap=True)  # -> Item, Item1
merge = Merge(Data1=item.Item, Data2=item.Item1)

# ---- group: 制作上层定位平面
disc = Discontinuity(Curve=graft(crv_18), Level=1)  # -> Points, Parameters
crv_cp = CurveClosestPoint(Point=disc.Points, Curve=graft(crv_18))  # -> Point, Parameter, Distance
eval_3 = EvaluateCurve(Curve=graft(crv_18), Parameter=crv_cp.Parameter)  # -> flatten(Point), Tangent, flatten(Angle)
deg = Degrees(Radians=eval_3.Angle)
offset = OffsetCurve(Curve=clscrv.Closed, Distance=expr("-X", Slider(300, range=0..1000)), Corners=1)
larger_2 = LargerThan(FirstNumber=deg, SecondNumber=Slider(70, range=0..100))  # -> LargerThan, OrEqualTo
disc_2 = Discontinuity(Curve=offset, Level=1)  # -> flatten(Points), Parameters
dispatch_3 = Dispatch(List=deg, DispatchPattern=larger_2.LargerThan)  # -> ListA, ListB
dispatch_4 = Dispatch(List=eval_3.Point, DispatchPattern=larger_2.LargerThan)  # -> ListA, ListB
data_5 = Data(dispatch_4.ListA)
smaller = SmallerThan(FirstNumber=dispatch_3.ListA, SecondNumber=Slider(100, range=0..100))  # -> SmallerThan, OrEqualTo
dispatch_5 = Dispatch(List=data_5, DispatchPattern=smaller.SmallerThan)  # -> ListA, ListB
data_6 = Data(dispatch_5.ListA)
pull_2 = PullPoint(Point=data_6, Geometry=flatten(offset), ClosestOnly=True)  # -> ClosestPoint, Distance
testpoint = TestPoint(archPoint=pull_2.ClosestPoint, crvPoint=disc_2.Points)  # -> out, specialPt; inputs archPoint: list of Point3d, crvPoint: list of Point3d
# ---------- testpoint: C# ----------
    List<int> passIndex = new List<int>();

    for(int i = 0; i < archPoint.Count; i++){
      foreach(Point3d t in crvPoint){
        if(archPoint[i].X == t.X && archPoint[i].Y == t.Y && archPoint[i].Z == t.Z){
          Print("pass");
          passIndex.Add(i);}
      }
    }

    specialPt = passIndex;
# ---------- end testpoint ----------

# ---- group: 制作下层定位平面
disc_3 = Discontinuity(Curve=graft(crv_19), Level=1)  # -> Points, Parameters
crv_cp_2 = CurveClosestPoint(Point=disc_3.Points, Curve=graft(crv_19))  # -> Point, Parameter, Distance
eval_4 = EvaluateCurve(Curve=graft(crv_19), Parameter=crv_cp_2.Parameter)  # -> flatten(Point), Tangent, flatten(Angle)
deg_2 = Degrees(Radians=eval_4.Angle)
offset_2 = OffsetCurve(Curve=clscrv_2.Closed, Distance=expr("-X", Slider(300, range=0..1000)), Corners=1)
larger_3 = LargerThan(FirstNumber=deg_2, SecondNumber=Slider(70, range=0..100))  # -> LargerThan, OrEqualTo
disc_4 = Discontinuity(Curve=offset_2, Level=1)  # -> flatten(Points), Parameters
dispatch_6 = Dispatch(List=deg_2, DispatchPattern=larger_3.LargerThan)  # -> ListA, ListB
dispatch_7 = Dispatch(List=eval_4.Point, DispatchPattern=larger_3.LargerThan)  # -> ListA, ListB
data_7 = Data(dispatch_7.ListA)
smaller_2 = SmallerThan(FirstNumber=dispatch_6.ListA, SecondNumber=Slider(100, range=0..100))  # -> SmallerThan, OrEqualTo
dispatch_8 = Dispatch(List=data_7, DispatchPattern=smaller_2.SmallerThan)  # -> ListA, ListB
data_8 = Data(dispatch_8.ListA)
pull_3 = PullPoint(Point=data_8, Geometry=flatten(offset_2), ClosestOnly=True)  # -> ClosestPoint, Distance
testpoint_2 = TestPoint(archPoint=pull_3.ClosestPoint, crvPoint=disc_4.Points)  # -> out, specialPt; inputs archPoint: list of Point3d, crvPoint: list of Point3d; same code as testpoint

# ---- group: 制作下层定位平面 / 与梁中线距离小于800的点
pt = Point(dispatch_2.ListB)

# ---- group: 制作下层定位平面 / 定位点Offset450后二次筛选是否与梁有交点
pull_4 = PullPoint(Point=pt, Geometry=movetoplane_2.Geometry, ClosestOnly=True)  # -> ClosestPoint, Distance
end = EndPoints(Curve=crv_10)  # -> Start, End
merge_2 = Merge(Data1=end.Start, Data2=end.End)  # -> flatten(Result)
pull_5 = PullPoint(Point=pull_4.ClosestPoint, Geometry=merge_2, ClosestOnly=True)  # -> ClosestPoint, Distance
larger_4 = LargerThan(FirstNumber=pull_5.Distance, SecondNumber="1")  # -> LargerThan, OrEqualTo
dispatch_9 = Dispatch(List=pt, DispatchPattern=larger_4.LargerThan)  # -> ListA, ListB

# ----
钢埋板长度_2 = Division(A=number_slider_9, B=2)
neg = Negative(Value=钢埋板长度_2)
dom = ConstructDomain(DomainStart=neg, DomainEnd=钢埋板长度_2)
panel_26 = Panel(dom)

钢埋板厚度_2 = Division(A=number_slider_11, B=2)
neg_2 = Negative(Value=钢埋板厚度_2)
dom_2 = ConstructDomain(DomainStart=neg_2, DomainEnd=钢埋板厚度_2)
panel_27 = Panel(dom_2)

# ----
# 钢埋板肋板位置 1/4处
panel_28 = Panel("4")
division = Division(A=number_slider_9, B=panel_28)

# ----
# 列表文字以空格进行分割
panel_29 = Panel(" ")
split = TextSplit(Text=txt_2, Separators=panel_29)

# ----
# 编号和截面尺寸分区
panel_30 = Panel("1")
split_2 = SplitList(List=split, Index=panel_30)  # -> flatten(ListA), flatten(ListB)

# ---- group: 制作上层定位平面
# 阴角
cull_i = CullIndex(List=data_6, Indices=testpoint.specialPt, Wrap=True)

# 阳角
item_2 = ListItem(List=data_6, Index=testpoint.specialPt, Wrap=True)

# ---- group: 制作下层定位平面
# 阴角
cull_i_2 = CullIndex(List=data_8, Indices=testpoint_2.specialPt, Wrap=True)

# 阳角
item_3 = ListItem(List=data_8, Index=testpoint_2.specialPt, Wrap=True)

# ---- group: 制作上层定位平面
merge_3 = Merge(Data1=item_2, Data2=cull_i)  # -> flatten(Result)

# ---- group: 制作下层定位平面 / 定位点Offset450后二次筛选是否与梁有交点 / 与梁直接由交点
pt_2 = Point(dispatch_9.ListA)

# ---- group: 制作下层定位平面
merge_4 = Merge(Data1=item_3, Data2=cull_i_2)  # -> flatten(Result)

# ---- group: 制作上层定位平面
layer_3 = ObjectLayer(Guid=circle_2)  # -> LayerIndex, LayerPathName
reflay_6 = ReferenceByLayer(LayerName=layer_3.LayerPathName)
movetoplane_3 = MoveToPlane(Geometry=reflay_6, Plane=PlaneXY(0, 0, 0), Above=True, Below=True)  # -> Geometry, Transform
movetoplane_4 = MoveToPlane(Geometry=crv_11, Plane=PlaneXY(0, 0, 0), Above=True, Below=True)  # -> Geometry, Transform
area_3 = Area(Geometry=movetoplane_3.Geometry)  # -> Area, Centroid
pt_3 = Point(area_3.Centroid)

# ---- group: 制作下层定位平面 / 与梁距离大于800的点
pt_4 = Point(dispatch_2.ListA)

# ---- group: 制作下层定位平面 / 筛选阴阳角 / 阴阳角的点
pt_5 = Point(merge_4)

# ----
# 单体选型
list_6 = ValueList({"顶埋": 0, "侧埋": 1}, selected="顶埋")

# ---- group: F2 Arch Outline
crv_20 = Curve(crv_17)

# ---- group: 车道区域 / 檐口线Input
crv_21 = Curve(crv_14)

# ---- group: 檐口线Input
crv_22 = Curve(crv_14)

# ----
# 选要重塑的线段长度
number_slider_21 = Slider(1200, range=0..10000)

# ----
# 调整重塑线段的平滑度
number_slider_22 = Slider(11, range=0..11)

# ----
# 区分内外梁边线
# 1.根据F2建筑线制作轮廓线
explode = Explode(Curve=crv_20, Recursive=True)  # -> Segments, Vertices
len = Length(Curve=explode.Segments)
sort = SortList(Keys=len)  # -> Keys, ValuesA
larger_5 = LargerThan(FirstNumber=len, SecondNumber=number_slider_21)  # -> LargerThan, OrEqualTo
panel_31 = Panel(sort.Keys)
dispatch_10 = Dispatch(List=explode.Segments, DispatchPattern=larger_5.LargerThan)  # -> ListA, ListB
data_9 = Data(dispatch_10.ListA)
data_10 = Data(dispatch_10.ListB)
join = JoinCurves(Curves=data_10, Preserve=False)
disc_5 = Discontinuity(Curve=join, Level=1)  # -> Points, Parameters
nurbs = NurbsCurve(Vertices=disc_5.Points, Degree=number_slider_22, Periodic=False)  # -> flatten(Curve), Length, Domain
join_2 = JoinCurves(Curves=flatten([data_9, nurbs.Curve]), Preserve=False)
offset_3 = OffsetCurve(Curve=join_2, Distance=Slider(6859, range=0..10000), Corners=1)

# ---- group: F2 Archline - Smoothed
reb = RebuildCurve(Curve=offset_3, Count=Slider(17, range=0..100), Tangents=invert(False))

# ----
# InputCurve
crv_23 = Curve()

# ----
# Curve-框住要分析的建筑单体
# 如果要用自己导入Curve作为分析线，
# 请在InputCurve那里导入curve,
# 然后在上方的选型列表选择Input Curve。
# 
# 如果要用Grasshopper自动生成的Curve,
# 请在上方的选型列表选择Default Curve。
list_7 = ValueList({"Default Curve": 0, "Input Curve": 1}, selected="Default Curve")
filter = StreamFilter(Gate=list_7, Stream0=reb, Stream1=crv_23)

# ----
# 要连接的梁中线Offest值
# 要连接的梁中线curve
# 要连接的embed
# 埋件向外探索最远出的梁的距离
number_slider_23 = Slider(5000, range=0..10000)

# ---- group: 上层幕墙线-All
crv_24 = Curve(crv_13)

# ---- group: 下层幕墙线-All
crv_25 = Curve(crv_12)

# ---- group: 下层交点-除重 / 下层Arch Line
crv_26 = Curve(crv_15)

# ---- group: 下层交点-除重 / 上层 Arch Line
crv_27 = Curve(crv_17)

# ---- group: 下层交点-除重 / 容差
number_slider_24 = Slider(100, range=0..200)

# ----
data_11 = Data()
# 阴阳角
item_4 = ListItem(List=data_11, Index=0, Wrap=True)
item_5 = ListItem(List=data_11, Index="-1", Wrap=True)

# ----
# 是否有吊顶：
# 下层幕墙边线在结构边梁以内>350
# 
# （最外层结构线）
number_slider_25 = Slider(350, range=0..1000)

data_12 = Data()
item_6 = ListItem(List=data_12, Index=0, Wrap=True)
item_7 = ListItem(List=data_12, Index="-1", Wrap=True)
rotate = Rotate(Geometry=item_7, Angle="Pi", Plane=item_7)  # -> Geometry, Transform

# ---- group: 下层Arch Line
crv_28 = Curve(crv_15)

# ----
# 3.2下层建筑边线内侧300-600mm范围内
number_slider_26 = Slider(600, range=0..1000)
crv_29 = Curve(crv_28)
offset_4 = OffsetCurve(Curve=crv_29, Distance=expr("-x", Slider(300, range=0..1000)), Corners=1)
offset_5 = OffsetCurve(Curve=crv_29, Distance=expr("-x", number_slider_26), Corners=1)

# ----
# 3.1下层建筑边线外侧50-350mm范围内
number_slider_27 = Slider(350, range=0..1000)
crv_30 = Curve(crv_28)
offset_6 = OffsetCurve(Curve=crv_30, Distance=Slider(50, range=0..100), Corners=1)
offset_7 = OffsetCurve(Curve=crv_30, Distance=number_slider_27, Corners=1)

data_13 = Data()
data_14 = Data()
item_8 = ListItem(List=data_13, Index=0, Wrap=True)
item_9 = ListItem(List=data_13, Index="-1", Wrap=True)
item_10 = ListItem(List=data_14, Index=0, Wrap=True)
item_11 = ListItem(List=data_14, Index="-1", Wrap=True)
rotate_2 = Rotate(Geometry=item_9, Angle="Pi", Plane=item_9)  # -> Geometry, Transform

# ----
# 4下层建筑内侧到300到外侧50内
# 有钢结构
number_slider_28 = Slider(50, range=0..1000)
crv_31 = Curve(crv_28)
offset_8 = OffsetCurve(Curve=crv_31, Distance=expr("-x", Slider(300, range=0..1000)), Corners=1)
offset_9 = OffsetCurve(Curve=crv_31, Distance=number_slider_28, Corners=1)

# ----
# （3.1）导入轴线
crv_32 = Curve(<curve referenced from the Rhino model>)
layer_4 = ObjectLayer(Guid=crv_32)  # -> LayerIndex, LayerPathName
panel_32 = Panel(layer_4.LayerPathName)
reflay_7 = ReferenceByLayer(LayerName=panel_32)
xy_7 = XYPlane(Origin=Point(0, 0, 0))
project_7 = Project(Geometry=reflay_7, Plane=xy_7)  # -> Geometry, Transform

data_15 = Data(flatten(merge))
item_12 = ListItem(List=data_15, Index=0, Wrap=True)
item_13 = ListItem(List=data_15, Index="-1", Wrap=True)

# ----
# 求内部曲线转折点
crv_33 = Curve()  # disabled
number_slider_29 = Slider(300, range=0..1000)  # disabled
neg_3 = Negative(Value=number_slider_29)  # disabled
filter_2 = StreamFilter(Gate=toggle, Stream0=number_slider_29, Stream1=neg_3)  # disabled
number_slider_30 = Slider(60, range=0..100)  # disabled

ext = ExtendCurve(Curve=crv_33, Type=0, Start=number_slider, End=number_slider)  # disabled

# ----
# 第二层
# 
# Curves(location point)+ Smooth Curves(architecture line)
# 第二层-区分阴阳角
area_4 = Area(Geometry=geo_2)  # -> Area, Centroid; disabled
crv_34 = Curve(crv_33)  # disabled
pull_6 = PullPoint(Point=area_4.Centroid, Geometry=crv_34, ClosestOnly=True)  # -> ClosestPoint, Distance; disabled
number_slider_31 = Slider(200, range=0..1000)  # disabled
number_slider_32 = Slider(100, range=0..300)  # disabled

# ----
# 第二层-阴阳角
panel_33 = Panel("0.5 * Pi")  # disabled
toggle_2 = BooleanToggle(True)  # disabled
neg_4 = Negative(Value=panel_33)  # disabled
filter_3 = StreamFilter(Gate=toggle_2, Stream0=panel_33, Stream1=neg_4)  # disabled

# ----
# 第二层-大面定位
panel_34 = Panel("0.5 * Pi")  # disabled
toggle_3 = BooleanToggle(True)  # disabled
neg_5 = Negative(Value=panel_34)  # disabled
filter_4 = StreamFilter(Gate=toggle_3, Stream0=panel_34, Stream1=neg_5)  # disabled

number_slider_33 = Slider(300, range=0..1000)  # disabled
number_slider_34 = Slider(1.5, range=0..10)  # disabled

number_slider_35 = Slider(300, range=0..1000)  # disabled
number_slider_36 = Slider(1.5, range=0..10)  # disabled

number_slider_37 = Slider(300, range=0..1000)  # disabled
number_slider_38 = Slider(1.5, range=0..10)  # disabled

# ----
# 显示"False"时要选择线段延长
list_8 = ValueList({"线段不延长": 0, "线段延长": 1}, selected="线段延长")  # disabled

filter_5 = StreamFilter(Gate=list_8, Stream0=crv_33, Stream1=ext)  # disabled

disc_6 = Discontinuity(Curve=graft(filter_5), Level=1)  # -> Points, Parameters; disabled
crv_cp_3 = CurveClosestPoint(Point=disc_6.Points, Curve=graft(filter_5))  # -> Point, Parameter, Distance; disabled
eval_5 = EvaluateCurve(Curve=graft(filter_5), Parameter=crv_cp_3.Parameter)  # -> flatten(Point), Tangent, flatten(Angle); disabled
deg_3 = Degrees(Radians=eval_5.Angle)  # disabled
offset_10 = OffsetCurve(Curve=filter_5, Distance=expr("-X", filter_2), Corners=1)  # disabled
panel_35 = Panel(deg_3)  # disabled
larger_6 = LargerThan(FirstNumber=deg_3, SecondNumber=number_slider_30)  # -> LargerThan, OrEqualTo; disabled
disc_7 = Discontinuity(Curve=offset_10, Level=1)  # -> flatten(Points), Parameters; disabled
dispatch_11 = Dispatch(List=eval_5.Point, DispatchPattern=larger_6.LargerThan)  # -> ListA, ListB; disabled
end_2 = EndPoints(Curve=filter_5)  # -> Start, End; disabled
data_16 = Data(dispatch_11.ListA)  # disabled
pull_7 = PullPoint(Point=data_16, Geometry=flatten(offset_10), ClosestOnly=True)  # -> ClosestPoint, Distance; disabled
testpoint_3 = TestPoint(archPoint=pull_7.ClosestPoint, crvPoint=disc_7.Points)  # -> out, specialPt; inputs archPoint: list of Point3d, crvPoint: list of Point3d; disabled; same code as testpoint

# ----
# 阴角
item_14 = ListItem(List=data_16, Index=testpoint_3.specialPt, Wrap=True)  # disabled

# ----
# SmoothCurve-阴角&阳角
# 阳角
cull_i_3 = CullIndex(List=data_16, Indices=testpoint_3.specialPt, Wrap=True)  # disabled

dist = Distance(PointA=pull_6.ClosestPoint, PointB=data_16)  # disabled
sort_2 = SortList(Keys=dist)  # -> Keys, ValuesA; disabled
panel_36 = Panel(sort_2.Keys)  # disabled
smaller_3 = SmallerThan(FirstNumber=dist, SecondNumber=number_slider_31)  # -> SmallerThan, OrEqualTo; disabled
dispatch_12 = Dispatch(List=geo_2, DispatchPattern=smaller_3.SmallerThan)  # -> ListA, ListB; disabled
crv_35 = Curve(filter_5)  # disabled

data_17 = Data(dispatch_12.ListA)  # disabled
explode_2 = Explode(Curve=data_17, Recursive=True)  # -> Segments, Vertices; disabled
len_2 = Length(Curve=explode_2.Segments)  # disabled
sort_3 = SortList(Keys=reverse(len_2), ValuesA=explode_2.Segments)  # -> Keys, ValuesA; disabled
item_15 = ListItem(List=sort_3.ValuesA, Index=0, Wrap=True)  # -> flatten(Item); disabled
area_5 = Area(Geometry=data_17)  # -> Area, Centroid; disabled
midpt = CurveMiddle(Curve=item_15)  # disabled
move2pt = MoveToPoint(Geometry=item_15, PointA=midpt, PointB=area_5.Centroid)  # -> Moved, Vector, Transform; disabled
end_3 = EndPoints(Curve=move2pt.Moved)  # -> Start, End; disabled
ln = Line(StartPoint=end_3.Start, EndPoint=end_3.End)  # disabled
xy_8 = XYPlane(Origin=end_3.End)  # disabled
rotate_3 = Rotate(Geometry=ln, Angle=filter_3, Plane=xy_8)  # -> Geometry, Transform; disabled
pl = ConstructPlane(Origin=end_3.End, XAxis=rotate_3.Geometry, YAxis=ln)  # disabled

data_18 = Data(dispatch_12.ListB)  # disabled
explode_3 = Explode(Curve=data_18, Recursive=True)  # -> Segments, Vertices; disabled
len_3 = Length(Curve=explode_3.Segments)  # disabled
sort_4 = SortList(Keys=reverse(len_3), ValuesA=explode_3.Segments)  # -> Keys, ValuesA; disabled
item_16 = ListItem(List=sort_4.ValuesA, Index=0, Wrap=True)  # -> flatten(Item); disabled
area_6 = Area(Geometry=data_18)  # -> Area, Centroid; disabled
midpt_2 = CurveMiddle(Curve=item_16)  # disabled
move2pt_2 = MoveToPoint(Geometry=item_16, PointA=midpt_2, PointB=area_6.Centroid)  # -> Moved, Vector, Transform; disabled
end_4 = EndPoints(Curve=move2pt_2.Moved)  # -> Start, End; disabled
ln_2 = Line(StartPoint=end_4.Start, EndPoint=end_4.End)  # disabled
xy_9 = XYPlane(Origin=end_4.End)  # disabled
rotate_4 = Rotate(Geometry=ln_2, Angle=filter_4, Plane=xy_9)  # -> Geometry, Transform; disabled
pl_2 = ConstructPlane(Origin=end_4.End, XAxis=rotate_4.Geometry, YAxis=ln_2)  # disabled

data_19 = Data(flatten(pl_2))  # disabled
deplane = DeconstructPlane(Plane=data_19)  # -> Origin, XAxis, YAxis, ZAxis; disabled
amp = Amplitude(Vector=deplane.YAxis, Amplitude=number_slider_35)  # disabled
move = Move(Geometry=deplane.Origin, Motion=amp)  # -> Geometry, Transform; disabled
ln_3 = Line(StartPoint=deplane.Origin, EndPoint=move.Geometry)  # disabled
midpt_3 = CurveMiddle(Curve=ln_3)  # disabled
scale = Scale(Geometry=ln_3, Center=midpt_3, Factor=number_slider_36)  # -> Geometry, Transform; disabled
ccx = CurveCurve(CurveA=scale.Geometry, CurveB=crv_35)  # -> Points, ParamsA, ParamsB; disabled

dist_2 = Distance(PointA=graft(end_3.End), PointB=cull_i_3)  # disabled
sort_5 = SortList(Keys=dist_2)  # -> Keys, ValuesA; disabled
item_17 = ListItem(List=sort_5.Keys, Index=0, Wrap=True)  # disabled
smaller_4 = SmallerThan(FirstNumber=item_17, SecondNumber=number_slider_32)  # -> SmallerThan, OrEqualTo; disabled
flatten = FlattenTree(Tree=item_17, Path="{0}")  # disabled
dispatch_13 = Dispatch(List=graft(pl), DispatchPattern=smaller_4.SmallerThan)  # -> ListA, ListB; disabled
panel_37 = Panel(flatten)  # disabled
flatten_2 = FlattenTree(Tree=ccx.Points, Path="{0}")  # disabled
lng = ListLength(List=scale.Geometry)  # disabled
lng_2 = ListLength(List=flatten_2)  # disabled

data_20 = Data(flatten(dispatch_13.ListA))  # disabled
deplane_2 = DeconstructPlane(Plane=data_20)  # -> Origin, XAxis, YAxis, ZAxis; disabled
amp_2 = Amplitude(Vector=deplane_2.YAxis, Amplitude=number_slider_33)  # disabled
move_2 = Move(Geometry=deplane_2.Origin, Motion=amp_2)  # -> Geometry, Transform; disabled
ln_4 = Line(StartPoint=deplane_2.Origin, EndPoint=move_2.Geometry)  # disabled
midpt_4 = CurveMiddle(Curve=ln_4)  # disabled
scale_2 = Scale(Geometry=ln_4, Center=midpt_4, Factor=number_slider_34)  # -> Geometry, Transform; disabled
ccx_2 = CurveCurve(CurveA=scale_2.Geometry, CurveB=crv_35)  # -> Points, ParamsA, ParamsB; disabled

data_21 = Data(flatten(dispatch_13.ListB))  # disabled
deplane_3 = DeconstructPlane(Plane=data_21)  # -> Origin, XAxis, YAxis, ZAxis; disabled
amp_3 = Amplitude(Vector=deplane_3.YAxis, Amplitude=number_slider_37)  # disabled
move_3 = Move(Geometry=deplane_3.Origin, Motion=amp_3)  # -> Geometry, Transform; disabled
ln_5 = Line(StartPoint=deplane_3.Origin, EndPoint=move_3.Geometry)  # disabled
midpt_5 = CurveMiddle(Curve=ln_5)  # disabled
scale_3 = Scale(Geometry=ln_5, Center=midpt_5, Factor=number_slider_38)  # -> Geometry, Transform; disabled
ccx_3 = CurveCurve(CurveA=scale_3.Geometry, CurveB=crv_35)  # -> Points, ParamsA, ParamsB; disabled

equals = Equality(FirstNumber=lng, SecondNumber=lng_2)  # -> Equality, Inequality; disabled
panel_38 = Panel(equals.Equality)  # disabled

# ----
# InsideCurve-大面
move2pt_3 = MoveToPoint(Geometry=data_19, PointA=flatten(deplane.Origin), PointB=flatten(ccx.Points))  # -> Moved, Vector, Transform; disabled

# ----
# InsideCurve-阳角
move2pt_4 = MoveToPoint(Geometry=data_20, PointA=deplane_2.Origin, PointB=ccx_2.Points)  # -> Moved, Vector, Transform; disabled

# ----
# InsideCurve-阴角
move2pt_5 = MoveToPoint(Geometry=data_21, PointA=deplane_3.Origin, PointB=ccx_3.Points)  # -> Moved, Vector, Transform; disabled

# ----
# （4）导入结构线+生成对应的钢板焊埋件
list_9 = ValueList({"机动生成埋件Tags": 0, "手动输入埋件Tags": 1}, selected="机动生成埋件Tags")
panel_39 = Panel(txt_2)

# ----
# 1.1-掩口出侧埋遗漏
panel_40 = Panel("1.1-掩口出侧埋遗漏")
layer_5 = DefineLayer(Name=panel_40)
attributes = DefineObjectAttributes(Layer=layer_5)

data_22 = Data(merge_4)
swatch_2 = ColourSwatch(SwatchColor=RGB(140, 140, 140))

layer_6 = DefineLayer(Name="阴阳角定位-F1", Color=swatch_2)
attributes_2 = DefineObjectAttributes(Layer=layer_6, Color=swatch_2)

bake = BakeObjects(Geometry=data_22, Attributes=attributes_2, BakeName="阴阳角定位-F1", Bake=False)

swatch_3 = ColourSwatch(SwatchColor=RGB(255, 212, 0))

swatch_4 = ColourSwatch(SwatchColor=RGB(255, 242, 66))

swatch_5 = ColourSwatch(SwatchColor=RGB(180, 255, 66))

swatch_6 = ColourSwatch(SwatchColor=RGB(66, 255, 236))

swatch_7 = ColourSwatch(SwatchColor=RGB(66, 167, 255))

swatch_8 = ColourSwatch(SwatchColor=RGB(66, 98, 255))

swatch_9 = ColourSwatch(SwatchColor=RGB(255, 242, 66))

swatch_10 = ColourSwatch(SwatchColor=RGB(66, 255, 69))

layer_7 = DefineLayer(Name="Tag::1-1-02钢板焊埋件", Color=swatch_3)
layer_8 = DefineLayer(Name="Embed::1-1-02钢板焊埋件", Color=swatch_3)
entwine = Entwine(Branch00=layer_8, Branch01=layer_7, FlattenInputs=True)
attributes_3 = DefineObjectAttributes(Layer=entwine, Color=swatch_3)

layer_9 = DefineLayer(Name="Tag::2-1-03钢板焊埋件", Color=swatch_9)
layer_10 = DefineLayer(Name="Embed::2-1-03钢板焊埋件", Color=swatch_9)
entwine_2 = Entwine(Branch00=layer_10, Branch01=layer_9, FlattenInputs=True)
attributes_4 = DefineObjectAttributes(Layer=entwine_2, Color=swatch_9)

layer_11 = DefineLayer(Name="Tag::1-0-01钢板焊埋件", Color=swatch_4)
layer_12 = DefineLayer(Name="Embed::1-0-01钢板焊埋件", Color=swatch_4)
entwine_3 = Entwine(Branch00=layer_12, Branch01=layer_11, FlattenInputs=True)
attributes_5 = DefineObjectAttributes(Layer=entwine_3, Color=swatch_4)

layer_13 = DefineLayer(Name="Tag::3-1-03钢板焊埋件", Color=swatch_5)
layer_14 = DefineLayer(Name="Embed::3-1-03钢板焊埋件", Color=swatch_5)
entwine_4 = Entwine(Branch00=layer_14, Branch01=layer_13, FlattenInputs=True)
attributes_6 = DefineObjectAttributes(Layer=entwine_4, Color=swatch_5)

layer_15 = DefineLayer(Name="Tag::3-2-03钢板焊埋件", Color=swatch_10)
layer_16 = DefineLayer(Name="Embed::3-2-03钢板焊埋件", Color=swatch_10)
entwine_5 = Entwine(Branch00=layer_16, Branch01=layer_15, FlattenInputs=True)
attributes_7 = DefineObjectAttributes(Layer=entwine_5, Color=swatch_10)

layer_17 = DefineLayer(Name="Tag::4-1钢板焊底埋", Color=swatch_6)
layer_18 = DefineLayer(Name="Embed::4-1钢板焊底埋", Color=swatch_6)
entwine_6 = Entwine(Branch00=layer_18, Branch01=layer_17, FlattenInputs=True)
attributes_8 = DefineObjectAttributes(Layer=entwine_6, Color=swatch_6)

layer_19 = DefineLayer(Name="Tag::5-04板埋", Color=swatch_8)
layer_20 = DefineLayer(Name="Embed::5-04板埋", Color=swatch_8)
entwine_7 = Entwine(Branch00=layer_20, Branch01=layer_19, FlattenInputs=True)
attributes_9 = DefineObjectAttributes(Layer=entwine_7, Color=swatch_8)

layer_21 = DefineLayer(Name="Tag::4-0-03默认钢板焊", Color=swatch_7)
layer_22 = DefineLayer(Name="Embed::4-0-03默认钢板焊", Color=swatch_7)
entwine_8 = Entwine(Branch00=layer_22, Branch01=layer_21, FlattenInputs=True)
attributes_10 = DefineObjectAttributes(Layer=entwine_8, Color=swatch_7)

crv_36 = Curve(join_2)
panel_41 = Panel("""Dimension::Dim1
Dimension::Dim2
Dimension::Dim3
Dimension::Dim4""")
layer_23 = DefineLayer(Name=panel_41)  # -> graft(Layer)
attributes_11 = DefineObjectAttributes(Layer=layer_23)

# ----
# 生成底埋钢埋件
rectangle = Rectangle(Plane=PlaneXY(0, 0, 0), XSize=panel_7, YSize=panel_8, Radius=0)  # -> Rectangle, Length
rec = Rectangle(rectangle.Rectangle)
pln_2 = Plane(rectangle.Rectangle)

deplane_4 = DeconstructPlane(Plane=pln_2)  # -> Origin, XAxis, YAxis, ZAxis
dedomain = DeconstructDomain(Domain=panel_8)  # -> Start, End
amp_4 = Amplitude(Vector=deplane_4.YAxis, Amplitude=dedomain.End)
move_4 = Move(Geometry=deplane_4.Origin, Motion=amp_4)  # -> Geometry, Transform
ln_6 = Line(StartPoint=deplane_4.Origin, EndPoint=move_4.Geometry)
amp_5 = Amplitude(Vector=ln_6, Amplitude=Slider(190, range=0..1000))
move_5 = Move(Geometry=deplane_4.Origin, Motion=amp_5)  # -> Geometry, Transform

text = DefineTextObject(Text=panel_6, Plane=move_5.Geometry, DimensionStyle=panel_9, OutputType="Text")
group = Group(Objects=[rec, text])
merge_5 = Merge(Data1=group, Data2=pln_2)

data_23 = Data(merge_5)
item_18 = ListItem(List=data_23, Index="-1", Wrap=True)
item_19 = ListItem(List=data_23, Index=0, Wrap=True)

# ----
# 板埋：制作板埋三视图
max = Maximum(A=s_x, B=s_y)
filter_6 = StreamFilter(Gate=list, Stream0=7.2, Stream1=9.6, Stream2=11.9, Stream3=14.3, Stream4=16.7, Stream5=19.1)
filter_7 = StreamFilter(Gate=list_2, Stream0=270, Stream1=360)
filter_8 = StreamFilter(Gate=list_3, Stream0=10, Stream1=12, Stream2=16, Stream3=18, Stream4=20, Stream5=25)
filter_9 = StreamFilter(Gate=list, Stream0=0.91, Stream1=1.1, Stream2=1.27, Stream3=1.43, Stream4=1.57, Stream5=1.71)
filter_10 = StreamFilter(Gate=list_2, Stream0=0.16, Stream1=0.14)
addition = Addition(A=list_4, B=1)
addition_2 = Addition(A=list_5, B=1)
division_2 = Division(A=max, B=8)
t = Integer(division_2)
panel_42 = Panel(filter_9)
panel_43 = Panel(filter_6)
panel_44 = Panel(filter_10)
min = Minimum(A=filter_7, B=300)
panel_45 = Panel(min)
expression = Expression(A=filter_10, fy=filter_7, ft=filter_9, d=filter_8, Expression="(int((0.6*1.1*A*fy/ft*d)/5)+1)*5")

crv_37 = Curve(join_2)
panel_46 = Panel("""Dimension::Dim1
Dimension::Dim2
Dimension::Dim3
Dimension::Dim4""")
layer_24 = DefineLayer(Name=panel_46)  # -> graft(Layer)
attributes_12 = DefineObjectAttributes(Layer=layer_24)

layer_25 = ObjectLayer(Guid=crv_2)  # -> LayerIndex, LayerPathName
reflay_8 = ReferenceByLayer(LayerName=layer_25.LayerPathName)
reflay_9 = ReferenceByLayer(LayerName=panel_12)
rhatt = GetRhinoAttributes(Geometry=reflay_8)  # -> Name, Layer, Color
split_3 = TextSplit(Text=rhatt.Color, Separators=",")  # -> simplify(Result)
item_20 = ListItem(List=split_3, Index=0, Wrap=True)  # -> flatten(Item), flatten(Item1), flatten(Item2)
pt_6 = ConstructPoint(XCoordinate=item_20.Item, YCoordinate=item_20.Item1, ZCoordinate=item_20.Item2)
cullpt = CullDuplicates(Points=pt_6, Tolerance=0.1, CullMode=3)  # -> Points, Indices, Valence
pdecon = Deconstruct(Point=cullpt.Points)  # -> XComponent, YComponent, ZComponent
rgb = ColourRGB(Alpha=255, Red=pdecon.XComponent, Green=pdecon.YComponent, Blue=pdecon.ZComponent)
filtercolor = FilterByColor(Geometry=reflay_9, Color=rgb)  # -> simplify(Geometry)
detext = DeconstructText(TextObject=filtercolor)  # -> Text, Plane, Height, Justification
addition_3 = Addition(A=neg_2, B=division)
addition_4 = Addition(A=钢埋板厚度_2, B=division)
dom_3 = ConstructDomain(DomainStart=addition_3, DomainEnd=addition_4)
panel_47 = Panel(split_2.ListB)
钢埋板_侧视图 = Rectangle(Plane=PlaneXY(0, 0, 0), XSize=dom_2, YSize=dom, Radius=0)  # -> Rectangle, Length
xz = XZPlane(Origin=Point(0, 0, 0))
col = Colour(simplify(graft(rgb)))
attributes_13 = DefineObjectAttributes(Color=col)
xy_10 = XYPlane(Origin=Point(0, 0, 0))
dedomain_2 = DeconstructDomain(Domain=dom)  # -> Start, End
multiplication = Multiplication(A=dedomain_2.Start, B=dedomain_2.Start)

# ---- group: Beam
filtercolor_2 = FilterByColor(Geometry=reflay_8, Color=rgb)  # -> simplify(Geometry)

# ---- group: Text
item_21 = ListItem(List=detext.Text, Index=0, Wrap=True)

# ----
# 涉及到的梁编号
panel_48 = Panel(item_21)

# ---- group: Create Tags
tstat = TreeStatistics(Tree=detext.Text)  # -> Paths, Length, Count
series = Series(Start="1", Step=1, Count=tstat.Count)
concat = Concatenate(FragmentA=series, FragmentB="-")
concat_2 = Concatenate(FragmentA=concat, FragmentB=series)  # -> simplify(graft(Result))

# ----
filter_11 = StreamFilter(Gate=list_9, Stream0=concat_2, Stream1=simplify(graft(panel_13)))
panel_49 = Panel(filter_11)

crv_38 = Curve(filtercolor_2)
layer_26 = ObjectLayer(Guid=crv_38)  # -> LayerIndex, LayerPathName
panel_50 = Panel(layer_26.LayerPathName)
reflay_10 = ReferenceByLayer(LayerName=panel_50)
flatten_3 = FlattenTree(Tree=item_21, Path="{0}")
txt_3 = Text(item_21)
concat_3 = Concatenate(FragmentA="Embed", FragmentB=txt_3)
txt_4 = Text(filter_11)
project_8 = Project(Geometry=crv_38, Plane=xy_10)  # -> Geometry, Transform

# ----
# 求出对应输入编号的钢结构截面尺寸
fsim = FindSimilarMember(Data=flatten_3, Set=split_2.ListA)  # -> Hit, Index
item_22 = ListItem(List=split_2.ListB, Index=fsim.Index, Wrap=True)

# ----
# 要连接的梁中线curve
crv_39 = Curve(project_8.Geometry)

# ---- group: 制作下层定位平面 / 定位点Offset450后二次筛选是否与梁有交点
pt_7 = Point(dispatch_9.ListB)
num = Number(number_slider_7)
cir = Circle(Plane=pt_7, Radius=num)
movetoplane_5 = MoveToPlane(Geometry=crv_12, Plane=PlaneXY(0, 0, 0), Above=True, Below=True)  # -> Geometry, Transform
movetoplane_6 = MoveToPlane(Geometry=cir, Plane=PlaneXY(0, 0, 0), Above=True, Below=True)  # -> Geometry, Transform
ccx_4 = CurveCurve(CurveA=flatten(movetoplane_6.Geometry), CurveB=graft(movetoplane_5.Geometry))  # -> Points, ParamsA, ParamsB
pull_8 = PullPoint(Point=ccx_4.Points, Geometry=movetoplane_2.Geometry, ClosestOnly=True)  # -> ClosestPoint, Distance
pt_8 = Point(merge_2)
pull_9 = PullPoint(Point=pull_8.ClosestPoint, Geometry=pt_8, ClosestOnly=True)  # -> ClosestPoint, Distance
larger_7 = LargerThan(FirstNumber=pull_9.Distance, SecondNumber="1")  # -> LargerThan, OrEqualTo
dispatch_14 = Dispatch(List=ccx_4.Points, DispatchPattern=larger_7.LargerThan)  # -> ListA, ListB

# ---- group: 制作下层定位平面 / 定位点Offset450后二次筛选是否与梁有交点 / Offset450后与梁有交点
pt_9 = Point(dispatch_14.ListA)

# ---- group: 制作下层定位平面 / 定位点Offset450后二次筛选是否与梁有交点 (continued)
incurves = PointInCurves(Point=flatten(pt_9), Curves=cir)  # -> Relationship, Index, Point
cull_i_4 = CullIndex(List=pt_7, Indices=incurves.Index, Wrap=True)
cullduppoints_2 = RemoveDuplicatePoints(InputPoints=cull_i_4, Tolerance=0.001)  # -> OutputPoints, FirstPointIndexes
null_2 = NullItem(Item=cullduppoints_2.OutputPoints)  # -> NullFlags, InvalidFlags, Description
dispatch_15 = Dispatch(List=cull_i_4, DispatchPattern=null_2.InvalidFlags)  # -> ListA, ListB
merge_6 = Merge(Data1=pt_2, Data2=pt_9)

# ---- group: 制作下层定位平面 / Offset450后与梁没有交点
pt_10 = Point(dispatch_15.ListB)

# ---- group: 制作下层定位平面 / 定位平面-垂直于梁中线
pt_11 = Point(merge_6)

# ---- group: 制作下层定位平面 / 定位平面-幕墙线法线
merge_7 = Merge(Data1=pt_10, Data2=pt_4)  # -> flatten(Result)

# ----
# 板埋Modeling
multiplication_2 = Multiplication(A=s_x, B=addition)
multiplication_3 = Multiplication(A=s_y, B=addition_2)
recgrid = Rectangular(Plane=PlaneXY(0, 0, 0), SizeX=s_x, SizeY=s_y, ExtentX=addition, ExtentY=addition_2)  # -> Cells, Points
直径 = Text(filter_8)
division_3 = Division(A=multiplication_2, B=2)
division_4 = Division(A=multiplication_3, B=2)
vec = VectorXYZ(XComponent=expr("-x", division_3), YComponent=expr("-x", division_4), ZComponent=0)  # -> Vector, Length
move_6 = Move(Geometry=recgrid.Points, Motion=vec.Vector)  # -> Geometry, Transform
division_5 = Division(A=直径, B=2)
cyl = Cylinder(Base=move_6.Geometry, Radius=division_5, Length=expr("-x", expression))
X = UnitX(Factor=直径)
multiplication_4 = Multiplication(A=直径, B=6)
edges = BrepEdges(Brep=cyl)  # -> Naked, Interior, NonManifold
item_23 = ListItem(List=edges.Naked, Index=0, Wrap=True)
max_2 = Maximum(A=multiplication_4, B=70)
move_7 = Move(Geometry=item_23, Motion=X)  # -> Geometry, Transform
multiplication_5 = Multiplication(A=max_2, B=2)
addition_5 = Addition(A=multiplication_2, B=multiplication_5)
addition_6 = Addition(A=multiplication_3, B=multiplication_5)
division_6 = Division(A=t, B=2)
expression_2 = Expression(x=addition_6, Expression="Ceiling(x/10)*10/2")
expression_3 = Expression(x=addition_5, Expression="Ceiling(x/10)*10/2")
round = Round(Number=division_6)  # -> Nearest, Floor, Ceiling
multiplication_6 = Multiplication(A=round.Ceiling, B=2)
dom_4 = ConstructDomain(DomainStart=expr("-x", expression_2), DomainEnd=expression_2)
dom_5 = ConstructDomain(DomainStart=expr("-x", expression_3), DomainEnd=expression_3)
box = DomainBox(Base=PlaneXY(0, 0, 0), X=dom_5, Y=dom_4, Z=multiplication_6)
Z = UnitZ(Factor=expr("-x", multiplication_6))

multiplication_7 = Multiplication(A=直径, B=5)

Z_2 = UnitZ(Factor=multiplication_7)
extr = Extrude(Base=move_7.Geometry, Direction=Z_2)
cap = CapHoles(Brep=[extr, cyl])
merge_8 = Merge(Data1=cap, Data2=box)
flatten_4 = FlattenTree(Tree=merge_8, Path="{0}")
move_8 = Move(Geometry=flatten_4, Motion=Z)  # -> Geometry, Transform

split_4 = TextSplit(Text=item_22, Separators="x")
split_5 = TextSplit(Text=split_4, Separators="Q")
item_24 = ListItem(List=split_5, Index="0", Wrap=True)

shift = ShiftPaths(Data=item_24, Offset=-1)
subtraction = Subtraction(A=division, B=钢埋板厚度_2)
subtraction_2 = Subtraction(A=division, B=钢埋板厚度_2)
subtraction_3 = Subtraction(A=division, B=钢埋板厚度_2)
neg_6 = Negative(Value=钢埋板厚度_2)
neg_7 = Negative(Value=钢埋板厚度_2)
neg_8 = Negative(Value=钢埋板厚度_2)
subtraction_4 = Subtraction(A=division, B=钢埋板厚度_2)
addition_7 = Addition(A=subtraction, B=number_slider_11)
addition_8 = Addition(A=subtraction_2, B=number_slider_11)
subtraction_5 = Subtraction(A=neg_6, B=number_slider_11)
subtraction_6 = Subtraction(A=neg_7, B="2")
subtraction_7 = Subtraction(A=division, B=钢埋板厚度_2)
addition_9 = Addition(A=subtraction_3, B="2")
subtraction_8 = Subtraction(A=neg_8, B="2")
neg_9 = Negative(Value=钢埋板厚度_2)
neg_10 = Negative(Value=钢埋板厚度_2)
工字钢_h = ListItem(List=shift, Index=0, Wrap=True)
工字钢_b = ListItem(List=shift, Index=1, Wrap=True)
工字钢_tf = ListItem(List=shift, Index=3, Wrap=True)
工字钢_tw = ListItem(List=shift, Index=2, Wrap=True)
pt_12 = ConstructPoint(XCoordinate=neg_9, YCoordinate=subtraction_4, ZCoordinate=0)
pt_13 = ConstructPoint(XCoordinate=neg_10, YCoordinate=addition_7, ZCoordinate=0)
pt_14 = ConstructPoint(XCoordinate=subtraction_5, YCoordinate=addition_8, ZCoordinate=0)
pt_15 = ConstructPoint(XCoordinate=subtraction_6, YCoordinate=subtraction_7, ZCoordinate=0)
pt_16 = ConstructPoint(XCoordinate=subtraction_8, YCoordinate=addition_9, ZCoordinate=0)
subtraction_9 = Subtraction(A=工字钢_b, B=工字钢_tw)
merge_9 = Merge(Data1=pt_12, Data2=pt_13, Data3=pt_14, Data4=pt_16, Data5=pt_15)
division_7 = Division(A=subtraction_9, B="2")
pline = PolyLine(Vertices=merge_9, Closed=True)
division_8 = Division(A=division_7, B="2")
subtraction_10 = Subtraction(A=division_8, B=number_slider_11)
subtraction_11 = Subtraction(A=division_8, B=钢埋板厚度_2)
neg_11 = Negative(Value=division_8)
subtraction_12 = Subtraction(A=neg_11, B=subtraction_11)
addition_10 = Addition(A=subtraction_12, B=number_slider_10)
dom_6 = ConstructDomain(DomainStart=addition_10, DomainEnd=subtraction_12)
dom_7 = ConstructDomain(DomainStart=addition_3, DomainEnd=addition_4)
subtraction_13 = Subtraction(A=subtraction_10, B=subtraction_11)
subtraction_14 = Subtraction(A=neg_11, B=subtraction_11)
dom_8 = ConstructDomain(DomainStart=subtraction_13, DomainEnd=subtraction_14)

# ---- group: 制作上层定位平面 / 筛选阴阳角
pull_10 = PullPoint(Point=flatten(pt_3), Geometry=graft(merge_3), ClosestOnly=True)  # -> ClosestPoint, Distance
sort_6 = SortList(Keys=pull_10.Distance, ValuesA=flatten(pt_3))  # -> Keys, ValuesA
item_25 = ListItem(List=sort_6.Keys, Index=0, Wrap=True)  # -> Item, Item1
item_26 = ListItem(List=sort_6.ValuesA, Index=0, Wrap=True)  # -> Item, Item1
merge_10 = Merge(Data1=item_25.Item, Data2=item_25.Item1)
merge_11 = Merge(Data1=item_26.Item, Data2=item_26.Item1)
panel_51 = Panel(merge_10)
smaller_5 = SmallerThan(FirstNumber=merge_10, SecondNumber="100")  # -> SmallerThan, OrEqualTo
dispatch_16 = Dispatch(List=merge_11, DispatchPattern=smaller_5.SmallerThan)  # -> ListA, ListB
crv_40 = Curve(flatten(offset))

# ---- group: 制作上层定位平面 / 筛选阴阳角 / F1-阴阳角-点
data_24 = Data(dispatch_16.ListA)

# ---- group: F2阴阳角的点
# (9)Bake Me!!
# 埋件和阴阳角定位
pt_17 = Point(data_24)

# ---- group: 制作上层定位平面 / 筛选阴阳角 (continued)
check_same_points = CheckSamePoints(archPoint=flatten(pt_3), crvPoint=flatten(data_24))  # -> out, specialPt; inputs archPoint: list of Point3d, crvPoint: list of Point3d; same code as testpoint
cull_i_5 = CullIndex(List=flatten(pt_3), Indices=check_same_points.specialPt, Wrap=True)
pull_11 = PullPoint(Point=cull_i_5, Geometry=crv_40, ClosestOnly=True)  # -> ClosestPoint, Distance
ln_7 = Line(StartPoint=pull_11.ClosestPoint, EndPoint=cull_i_5)
rotate_5 = Rotate(Geometry=ln_7, Angle=1.570796327, Plane=cull_i_5)  # -> Geometry, Transform
pl_3 = ConstructPlane(Origin=cull_i_5, XAxis=rotate_5.Geometry, YAxis=ln_7)

# ---- group: 上层定位点Plane-去阴阳角
pln_3 = Plane(pl_3)

# ---- group: 上层定位平面-All
pln_4 = Plane(pln_3)

# ---- group: 制作下层定位平面
pull_12 = PullPoint(Point=pt_11, Geometry=movetoplane_2.Geometry, ClosestOnly=True)  # -> ClosestPoint, Distance
crv_41 = Curve(crv_12)
offset_11 = OffsetCurve(Curve=crv_41, Distance=Slider(500, range=0..1000), Corners=1)
pull_13 = PullPoint(Point=merge_7, Geometry=flatten(offset_11), ClosestOnly=True)  # -> ClosestPoint, Distance
pull_14 = PullPoint(Point=merge_7, Geometry=crv_41, ClosestOnly=True)  # -> ClosestPoint, Distance

# ---- group: 制作下层定位平面 / Y Axis Line-垂直梁中线
ln_8 = Line(StartPoint=pt_11, EndPoint=pull_12.ClosestPoint)

# ---- group: 制作下层定位平面 / Y Aixs Line-幕墙法线
ln_9 = Line(StartPoint=pull_14.ClosestPoint, EndPoint=pull_13.ClosestPoint)

# ---- group: 制作下层定位平面 (continued)
merge_12 = Merge(Data1=ln_8, Data2=ln_9)

# ---- group: 制作下层定位平面 / Y Axis Line-All
crv_42 = Curve(merge_12)

# ---- group: 制作下层定位平面 / 统一Y Axis向幕墙线外
end_5 = EndPoints(Curve=graft(crv_42))  # -> Start, End
movetoplane_7 = MoveToPlane(Geometry=crv_12, Plane=PlaneXY(0, 0, 0), Above=True, Below=True)  # -> Geometry, Transform
merge_13 = Merge(Data1=end_5.Start, Data2=end_5.End)
pull_15 = PullPoint(Point=merge_13, Geometry=movetoplane_7.Geometry, ClosestOnly=True)  # -> ClosestPoint, Distance
sort_7 = SortList(Keys=pull_15.Distance, ValuesA=merge_13)  # -> Keys, ValuesA
item_27 = ListItem(List=sort_7.ValuesA, Index="-1", Wrap=True)
item_28 = ListItem(List=sort_7.ValuesA, Index=0, Wrap=True)
pt_18 = Point(item_27)
pt_19 = Point(item_28)
ln_10 = Line(StartPoint=pt_19, EndPoint=pt_18)
rotate_6 = Rotate(Geometry=ln_10, Angle=1.570796327, Plane=pt_19)  # -> Geometry, Transform

# ---- group: 制作下层定位平面 / 统一Y Axis向幕墙线外 / F1-定位Plane-未筛选阴阳角
pl_4 = ConstructPlane(Origin=pt_19, XAxis=rotate_6.Geometry, YAxis=ln_10)  # -> flatten(Plane)

# ---- group: 制作下层定位平面 / 统一Y Axis向幕墙线外 (continued)
null_3 = NullItem(Item=pl_4)  # -> NullFlags, InvalidFlags, Description
dispatch_17 = Dispatch(List=pl_4, DispatchPattern=null_3.NullFlags)  # -> ListA, ListB

# ----
# 三视图
# hidden lines of top+pers view
# move to center
# 如果无法完整的生成埋件的三视图，
# 建议选择埋件的3D在Rhino中将
# Top/Perspective/Front/Right 试图缩放至合适大小后重新运行
panel_52 = Panel("""Top
Perspective
Front
Right""")
m2d_rhino = Make2DRhinoView(Name=panel_52, Clip=True)
number_slider_39 = Slider(1, range=0..10)
pt_20 = Point(Point(957.9296072, 367.7685097, 0))
pt_21 = Point("0,0,0")
recgrid_2 = Rectangular(
    Plane=pt_20,
    SizeX=Slider(12, range=1..20, expression="X*50"),
    SizeY=Slider(10, range=1..20, expression="X*50"),
    ExtentX=number_slider_39,
    ExtentY=number_slider_39)  # -> Cells, Points
flatten_5 = FlattenTree(Tree=recgrid_2.Points, Path="{0}")

# ----
# （6）生成板埋埋件
# 注意：
# 1.记得点一下Compute按钮
# 2.如果无法完整的生成埋件的三视图，
# 建议选择埋件的3D在Rhino中将
# Top/Perspective/Front/Right 试图缩放至合适大小后重新运行
make2d = Make2D(Geometry=move_8.Geometry, View=m2d_rhino, TangentEdges=False, TangentSeams=False, AutoComputeMake2D=False)  # -> VisibleCurves, VisibleIndex, VisibleType, HiddenCurves, HiddenIndex, HiddenType

bang = ExplodeTree(Data=make2d.VisibleCurves)  # -> Branch0, Branch1, Branch2, Branch3, Branch4, Branch5, Branch6, Branch7
divdist = DivideDistance(Curve=make2d.HiddenCurves, Distance=Slider(1, range=0..10))  # -> Points, Tangents, Parameters
graft = GraftTree(Tree=make2d.HiddenCurves, IncludeEmptyLists=True, IncludeNullItems=True)
shatter = Shatter(Curve=graft, Parameters=divdist.Parameters)
dispatch_18 = Dispatch(List=shatter, DispatchPattern=[True, False])  # -> ListA, ListB
crv_43 = Curve(dispatch_18.ListA)
pshift = ShiftPaths(Data=crv_43, Offset=-1)
pshift_2 = ShiftPaths(Data=pshift, Offset=-1)
bang_2 = ExplodeTree(Data=pshift_2)  # -> Branch0, Branch1, Branch2, Branch3, Branch4, Branch5, Branch6, Branch7
entwine_9 = Entwine(Branch00=bang_2.Branch0, Branch01=bang.Branch0, FlattenInputs=True)  # -> flatten(Result)
entwine_10 = Entwine(Branch00=bang_2.Branch1, Branch01=bang.Branch1, FlattenInputs=True)  # -> flatten(Result)
entwine_11 = Entwine(Branch00=entwine_9, Branch01=entwine_10, Branch02=bang.Branch2, Branch03=bang.Branch3, FlattenInputs=True)
group_2 = Group(Objects=entwine_11)
pshift_3 = ShiftPaths(Data=group_2, Offset=-1)
pshift_4 = ShiftPaths(Data=group_2, Offset=-1)
boxprop = BoxProperties(Box=pshift_3)  # -> Center, Diagonal, Area, Volume, Degeneracy
vec2pt = Vector2Pt(PointA=boxprop.Center, PointB=pt_21, Unitize=False)  # -> Vector, Length
move_9 = Move(Geometry=pshift_4, Motion=vec2pt.Vector)  # -> flatten(Geometry), Transform
orient = Orient(Geometry=flatten(move_9.Geometry), Source=PlaneXY(0, 0, 0), Target=flatten_5)  # -> Geometry, Transform
cull_i_6 = CullIndex(List=orient.Geometry, Indices="-1", Wrap=True)
split_6 = SplitList(List=cull_i_6, Index="4")  # -> ListA, ListB
geo_4 = Geometry(split_6.ListA)

# ---- group: 单体定Top/Side
item_29 = ListItem(List=geo_4, Index=Slider(0, range=0..10), Wrap=True)
item_30 = ListItem(List=geo_4, Index=2, Wrap=True)
cluster_2 = Cluster(G=item_29)
cluster_3 = Cluster(G=item_30)

# ----
钢肋板_侧视图 = Rectangle(Plane=PlaneXY(0, 0, 0), XSize=dom_8, YSize=dom_3, Radius=0)  # -> Rectangle, Length
tstat_2 = TreeStatistics(Tree=工字钢_h)  # -> Paths, Length, Count
钢肋板倒角_侧视图 = Rectangle(Plane=PlaneXY(0, 0, 0), XSize=dom_6, YSize=dom_7, Radius=0)  # -> Rectangle, Length
repeat = RepeatData(Data=pline, Length=tstat_2.Length)  # -> simplify(Data)
merge_14 = Merge(Data1=simplify(钢肋板_侧视图.Rectangle), Data2=simplify(repeat), Data3=simplify(钢肋板倒角_侧视图.Rectangle))
division_9 = Division(A=工字钢_h, B="2")
division_10 = Division(A=工字钢_b, B=2)
subtraction_15 = Subtraction(A=division_9, B=工字钢_tf)
repeat_2 = RepeatData(Data=钢埋板_侧视图.Rectangle, Length=tstat_2.Length)  # -> simplify(Data)
mirror = Mirror(Geometry=merge_14, Plane=xz)  # -> Geometry, Transform
addition_11 = Addition(A=subtraction_15, B=Slider(200, range=0..1000))
merge_15 = Merge(Data1=repeat_2, Data2=merge_14, Data3=mirror.Geometry)
addition_12 = Addition(A=addition_11, B=division_7)
X_2 = UnitX(Factor=addition_12)
move_10 = Move(Geometry=merge_15, Motion=X_2)  # -> Geometry, Transform

group_3 = Group(Objects=move_10.Geometry)
rotate_7 = Rotate(Geometry=group_3, Angle=3.141592654, Plane=PlaneXY(0, 0, 0))  # -> Geometry, Transform
boxprop_2 = BoxProperties(Box=rotate_7.Geometry)  # -> Center, Diagonal, Area, Volume, Degeneracy
bbox = BoundingBox(Content=rotate_7.Geometry, Plane=PlaneXY(0, 0, 0))  # -> Box, Box_2
debox = DeconstructBox(Box=bbox.Box)  # -> Plane, X, Y, Z
pdecon_2 = Deconstruct(Point=boxprop_2.Center)  # -> XComponent, YComponent, ZComponent
dedomain_3 = DeconstructDomain(Domain=debox.Y)  # -> Start, End
pt_22 = ConstructPoint(XCoordinate=pdecon_2.XComponent, YCoordinate=dedomain_3.Start, ZCoordinate=pdecon_2.ZComponent)
xy_11 = XYPlane(Origin=Point(0, 0, 0))
pl_origin = PlaneOrigin(Base=xy_11, Origin=pt_22)
orient_2 = Orient(Geometry=rotate_7.Geometry, Source=pl_origin, Target=xy_11)  # -> Geometry, Transform
ungroup = Ungroup(Group=orient_2.Geometry)  # -> simplify(Objects)

# ----
# 要连接的梁中线Offest值
num_2 = Number(simplify(division_10))

# ---- group: 制作下层定位平面 / 筛选阴阳角
pln_5 = Plane(dispatch_17.ListB)
pull_16 = PullPoint(Point=flatten(pln_5), Geometry=graft(pt_5), ClosestOnly=True)  # -> ClosestPoint, Distance
sort_8 = SortList(Keys=pull_16.Distance, ValuesA=flatten(pln_5))  # -> Keys, ValuesA
item_31 = ListItem(List=sort_8.Keys, Index=0, Wrap=True)  # -> Item, Item1
item_32 = ListItem(List=sort_8.ValuesA, Index=0, Wrap=True)  # -> Item, Item1
merge_16 = Merge(Data1=item_31.Item, Data2=item_31.Item1)
merge_17 = Merge(Data1=item_32.Item, Data2=item_32.Item1)
panel_53 = Panel(merge_16)
smaller_6 = SmallerThan(FirstNumber=merge_16, SecondNumber="100")  # -> SmallerThan, OrEqualTo
dispatch_19 = Dispatch(List=merge_17, DispatchPattern=smaller_6.SmallerThan)  # -> ListA, ListB
pln_6 = Plane(pln_5)
crv_44 = Curve(movetoplane_7.Geometry)
movetoplane_8 = MoveToPlane(Geometry=crv_44, Plane=PlaneXY(0, 0, 0), Above=True, Below=True)  # -> Geometry, Transform
clscrv_3 = CloseCurve(Curve=movetoplane_8.Geometry, CloseType=0, Bulge=0.5, Tolerance=0)  # -> Closed, R

# ---- group: 制作下层定位平面 / 筛选阴阳角 / F1-阴阳角-Plane
data_25 = Data(dispatch_19.ListA)

# ---- group: 制作下层定位平面 / 筛选阴阳角 (continued)
check_same_points_2 = CheckSamePoints(archPoint=flatten(pln_5), crvPoint=flatten(data_25))  # -> out, specialPt; inputs archPoint: list of Point3d, crvPoint: list of Point3d; same code as testpoint
cull_i_7 = CullIndex(List=flatten(pln_6), Indices=check_same_points_2.specialPt, Wrap=True)
deplane_5 = DeconstructPlane(Plane=cull_i_7)  # -> Origin, XAxis, YAxis, ZAxis
movetoplane_9 = MoveToPlane(Geometry=deplane_5.Origin, Plane=PlaneXY(0, 0, 0), Above=True, Below=True)  # -> Geometry, Transform
amp_6 = Amplitude(Vector=deplane_5.YAxis, Amplitude=Slider(300, range=0..1000))
move_11 = Move(Geometry=movetoplane_9.Geometry, Motion=amp_6)  # -> flatten(Geometry), Transform
incurves_2 = PointInCurves(Point=move_11.Geometry, Curves=clscrv_3.Closed)  # -> Relationship, Index, Point
equals_2 = Equality(FirstNumber=incurves_2.Relationship, SecondNumber="2")  # -> Equality, Inequality
dispatch_20 = Dispatch(List=flatten(cull_i_7), DispatchPattern=equals_2.Equality)  # -> ListA, ListB
data_26 = Data(dispatch_20.ListB)
data_27 = Data(dispatch_20.ListA)
deplane_6 = DeconstructPlane(Plane=data_27)  # -> Origin, XAxis, YAxis, ZAxis
rev = Reverse(Vector=deplane_6.YAxis)
pl_5 = ConstructPlane(Origin=deplane_6.Origin, XAxis=deplane_6.XAxis, YAxis=rev)
merge_18 = Merge(Data1=pl_5, Data2=data_26)

# ---- group: 下层定位点Plane-去阴阳角
pln_7 = Plane(merge_18)

# ---- group: 下层定位平面-All
pln_8 = Plane(pln_7)

# ---- group: 上层定位plane
pln_9 = Plane(pln_7)

# ----
block = DefineBlock(Geometry=ungroup, Attributes=attributes_13, BlockName=concat_3, BasePlane=PlaneXY(0, 0, 0))
deblock_4 = DeconstructBlock(Block=block)  # -> Name, Plane, Geometry
group_4 = Group(Objects=deblock_4.Geometry)
bbox_2 = BoundingBox(Content=group_4, Plane=PlaneXY(0, 0, 0))  # -> Box, Box_2
deplane_7 = DeconstructPlane(Plane=deblock_4.Plane)  # -> Origin, XAxis, YAxis, ZAxis
area_7 = Area(Geometry=bbox_2.Box)  # -> Area, Centroid
move2pt_6 = MoveToPoint(Geometry=deplane_7.Origin, PointA=deplane_7.Origin, PointB=area_7.Centroid)  # -> Moved, Vector, Transform
pl_6 = ConstructPlane(Origin=move2pt_6.Moved, XAxis=deplane_7.YAxis, YAxis=deplane_7.XAxis)
deplane_8 = DeconstructPlane(Plane=pl_6)  # -> Origin, XAxis, YAxis, ZAxis
rotate_8 = Rotate(Geometry=pl_6, Angle="Pi", Plane=pl_6)  # -> Geometry, Transform
amp_7 = Amplitude(Vector=deplane_8.YAxis, Amplitude=multiplication)
move_12 = Move(Geometry=deplane_8.Origin, Motion=amp_7)  # -> Geometry, Transform
srf = Surface(bbox_2.Box)
crv_45 = Curve(srf)
ln_11 = Line(StartPoint=move_12.Geometry, EndPoint=deplane_8.Origin)
ccx_5 = CurveCurve(CurveA=ln_11, CurveB=crv_45)  # -> Points, ParamsA, ParamsB
ln_12 = Line(StartPoint=deplane_8.Origin, EndPoint=ccx_5.Points)
move_13 = Move(Geometry=rotate_8.Geometry, Motion=ln_12)  # -> simplify(Geometry), Transform
amp_8 = Amplitude(Vector=ln_12, Amplitude=expr("-x", number_slider_12))
move_14 = Move(Geometry=move_13.Geometry, Motion=amp_8)  # -> Geometry, Transform

text_2 = DefineTextObject(Text=txt_4, Plane=simplify(move_14.Geometry), DimensionStyle=panel_17, OutputType="Text")
group_5 = Group(Objects=[block, text_2])

merge_19 = Merge(Data1=group_5, Data2=move_13.Geometry)

# ----
# 要连接的embed
data_28 = Data(merge_19)

# ----
# 测试Smooth Curve是否与每个Block相切
# remove duplicate blocks
# 测试Smooth Curve是否与每个Block相切
# remove duplicate blocks
data_29 = Data(data_28)
# 第一层
# 
# Curves(location point)+ Smooth Curves(architecture line)
# blocks + smooth curves
# blocks + special curves
# 阳角
# 阴角
# blocks + smooth curves
# blocks + special curves
# 转角点
# 第一层
# 
# Angular Curves(architecture line)
# 第一层
# 
# Special Curves(architecture line)
# 第一层
# 
# Angular Curves(architecture line)
item_33 = ListItem(List=data_29, Index=0, Wrap=True)
item_34 = ListItem(List=data_29, Index="-1", Wrap=True)

ungroup_2 = Ungroup(Group=cluster_3)
ungroup_3 = Ungroup(Group=cluster_2)

# ---- group: Top/Side
filter_12 = StreamFilter(Gate=list_6, Stream0=ungroup_3, Stream1=ungroup_2)

# ---- group: Block
attributes_14 = DefineObjectAttributes(Color=ColourSwatch(SwatchColor=RGB(255, 0, 0)))
block_2 = DefineBlock(Geometry=ungroup_3, Attributes=attributes_14, BlockName="Board Plate", BasePlane=PlaneXY(0, 0, 0))

# ----
deblock_5 = DeconstructBlock(Block=block_2)  # -> Name, flatten(Plane), flatten(Geometry)
boundary_2 = BoundarySurfaces(Edges=deblock_5.Geometry)
deplane_9 = DeconstructPlane(Plane=deblock_5.Plane)  # -> Origin, XAxis, YAxis, ZAxis
area_8 = Area(Geometry=boundary_2)  # -> Area, Centroid
move2pt_7 = MoveToPoint(Geometry=flatten(deplane_9.Origin), PointA=flatten(deplane_9.Origin), PointB=flatten(area_8.Centroid))  # -> Moved, Vector, Transform
pl_7 = ConstructPlane(Origin=move2pt_7.Moved, XAxis=deplane_9.XAxis, YAxis=deplane_9.YAxis)  # -> graft(Plane)

deplane_10 = DeconstructPlane(Plane=deblock_5.Plane)  # -> Origin, XAxis, YAxis, ZAxis
amp_9 = Amplitude(Vector=deplane_10.YAxis, Amplitude=number_slider_8)
move_15 = Move(Geometry=deplane_10.Origin, Motion=amp_9)  # -> Geometry, Transform

text_3 = DefineTextObject(Text=panel_11, Plane=move_15.Geometry, DimensionStyle=panel_10, OutputType="Text")
group_6 = Group(Objects=flatten([block_2, text_3]))
entwine_12 = Entwine(Branch00=group_6, Branch01=pl_7, FlattenInputs=True)

data_30 = Data(flatten(entwine_12))
item_35 = ListItem(List=data_30, Index=0, Wrap=True)
item_36 = ListItem(List=data_30, Index="-1", Wrap=True)

# ---- group: 车道区域
# 1.是否有檐口线-下层定位点
toggle_4 = BooleanToggle(True)
clean = CleanTree(RemoveNulls=True, RemoveInvalid=True, RemoveEmpty=toggle_4, Tree=pln_8)

# ---- group: 车道区域 / Input ???
deplane_11 = DeconstructPlane(Plane=clean)  # -> Origin, XAxis, YAxis, ZAxis

# ---- group: 车道区域 (continued)
incurve = PointInCurve(Point=deplane_11.Origin, Curve=crv_21)  # -> Relationship, Point
equals_3 = Equality(FirstNumber=incurve.Relationship, SecondNumber="2")  # -> Equality, Inequality
dispatch_21 = Dispatch(List=clean, DispatchPattern=equals_3.Equality)  # -> ListA, ListB

# Site - 有檐口线的定位点
pln_10 = Plane(dispatch_21.ListA)

# Site - 无檐口线的定位点
pln_11 = Plane(dispatch_21.ListB)

# ---- group: 车道区域 / 檐口线-Site
pln_12 = Plane(pln_10)

# ---- group: All-下层定位点
# 1.1有檐口线
pln_13 = Plane(pln_12)

# ----
# 1.0无檐口线初筛-下层定位点
pln_14 = Plane(pln_11)

deplane_12 = DeconstructPlane(Plane=pln_14)  # -> Origin, XAxis, YAxis, ZAxis
crv_46 = Curve(crv_25)
incurves_3 = PointInCurves(Point=deplane_12.Origin, Curves=flatten(crv_46))  # -> Relationship, Index, Point
equals_4 = Equality(FirstNumber=incurves_3.Relationship, SecondNumber="2")  # -> Equality, Inequality
dispatch_22 = Dispatch(List=pln_14, DispatchPattern=equals_4.Equality)  # -> ListA, ListB
data_31 = Data(dispatch_22.ListB)

pln_15 = Plane(dispatch_22.ListA)

# ---- group: 下层交点-除重
# 1.0无檐口线-下层定位点
pln_16 = Plane(pln_14)

# ----
# 阳角
# 阴角
# 阳角
# 阴角
pln_17 = Plane(pln_13)

# ----
# 1.是否有檐口线-上层定位点
toggle_5 = BooleanToggle(True)
clean_2 = CleanTree(RemoveNulls=True, RemoveInvalid=True, RemoveEmpty=toggle_5, Tree=pln_4)

# ---- group: Input ???
deplane_13 = DeconstructPlane(Plane=clean_2)  # -> Origin, XAxis, YAxis, ZAxis

# ----
incurve_2 = PointInCurve(Point=deplane_13.Origin, Curve=crv_22)  # -> Relationship, Point
equals_5 = Equality(FirstNumber=incurve_2.Relationship, SecondNumber="2")  # -> Equality, Inequality
dispatch_23 = Dispatch(List=clean_2, DispatchPattern=equals_5.Equality)  # -> ListA, ListB

# ----
# Site - 无檐口线的定位点
pln_18 = Plane(dispatch_23.ListB)

# ----
# 1.0无檐口线初筛-上层定位点
pln_19 = Plane(pln_18)

deplane_14 = DeconstructPlane(Plane=pln_19)  # -> Origin, XAxis, YAxis, ZAxis
crv_47 = Curve(crv_24)
incurves_4 = PointInCurves(Point=deplane_14.Origin, Curves=flatten(crv_47))  # -> Relationship, Index, Point
equals_6 = Equality(FirstNumber=incurves_4.Relationship, SecondNumber="2")  # -> Equality, Inequality
dispatch_24 = Dispatch(List=pln_19, DispatchPattern=equals_6.Equality)  # -> ListA, ListB
data_32 = Data(dispatch_24.ListB)

pln_20 = Plane(dispatch_24.ListA)

# ---- group: 下层交点-除重
# 1.0无檐口线-上层定位点
pln_21 = Plane(pln_19)

# ----
# 区分内外梁边线
# 2.根据是否相交判定内外梁(平行于建筑边线方向）
crv_48 = Curve(crv_39)
num_3 = Number(num_2)
crv_49 = Curve(filter)
offcrv = OffsetCurve(Curve=crv_48, Plane=PlaneXY(0, 0, 0), Distance=num_3, BothSides=expr("-x", num_3), Kinks=0, CapType="0")
midpt_6 = CurveMiddle(Curve=offcrv)
offcrv_2 = OffsetCurve(Curve=crv_48, Plane=PlaneXY(0, 0, 0), Distance=num_3, BothSides=expr("-x", num_3), Kinks=0, CapType="1")
crv_50 = Curve(offcrv)
item_37 = ListItem(List=midpt_6, Index=0, Wrap=True)
item_38 = ListItem(List=crv_50, Index=0, Wrap=True)
item_39 = ListItem(List=crv_50, Index="-1", Wrap=True)
graft_2 = GraftTree(Tree=crv_48, IncludeEmptyLists=True, IncludeNullItems=True)

# ---- group: 梁中线-中点
midpt_7 = CurveMiddle(Curve=crv_48)

# ---- group: Pull到轮廓线
pull_17 = PullPoint(Point=midpt_7, Geometry=crv_49, ClosestOnly=True)  # -> ClosestPoint, Distance

# ----
# 梁线闭合
shift_2 = ShiftPaths(Data=offcrv_2, Offset=-1)

# ---- group: 和某组梁边线相连
ln_13 = Line(StartPoint=item_37, EndPoint=graft(pull_17.ClosestPoint))

# ---- group: 有交点为内
ccx_6 = CurveCurve(CurveA=ln_13, CurveB=graft_2)  # -> Points, ParamsA, ParamsB

# ----
null_4 = NullItem(Item=ccx_6.Points)  # -> NullFlags, InvalidFlags, Description
dispatch_25 = Dispatch(List=item_38, DispatchPattern=null_4.InvalidFlags)  # -> ListA, ListB
dispatch_26 = Dispatch(List=item_39, DispatchPattern=null_4.InvalidFlags)  # -> ListA, ListB

# ----
# 梁边线-内
merge_20 = Merge(Data1=dispatch_25.ListB, Data2=dispatch_26.ListA)

# ----
# 梁边线-外
merge_21 = Merge(Data1=dispatch_25.ListA, Data2=dispatch_26.ListB)

# ---- group: 梁-外侧
crv_51 = Curve(merge_21)

# ----
crv_52 = Curve(shift_2)

# ---- group: 下层交点-除重 / 梁外侧
crv_53 = Curve(merge_21)

# ----
# 1.0
crv_54 = Curve(shift_2)

crv_55 = Curve(shift_2)

crv_56 = Curve(shift_2)

crv_57 = Curve(shift_2)

crv_58 = Curve(shift_2)

crv_59 = Curve(shift_2)

crv_60 = Curve(shift_2)

crv_61 = Curve(shift_2)

# ----
# 1.1 有檐口-整个site一起处理
pln_22 = Plane(pln_13)
deplane_15 = DeconstructPlane(Plane=pln_22)  # -> Origin, XAxis, YAxis, ZAxis
amp_10 = Amplitude(Vector=deplane_15.YAxis, Amplitude=number_slider_23)
# 檐口线的定位？？？
move_16 = Move(Geometry=deplane_15.Origin, Motion=amp_10)  # -> Geometry, Transform
ln_14 = Line(StartPoint=deplane_15.Origin, EndPoint=move_16.Geometry)
ccx_7 = CurveCurve(CurveA=graft(ln_14), CurveB=flatten(crv_51))  # -> Points, ParamsA, ParamsB
shift_3 = ShiftPaths(Data=ccx_7.Points, Offset=-1)
sort_9 = SortList(Keys=shift_3, ValuesA=shift_3)  # -> Keys, ValuesA
pull_18 = PullPoint(Point=sort_9.ValuesA, Geometry=graft(deplane_15.Origin), ClosestOnly=True)  # -> ClosestPoint, Distance
sort_10 = SortList(Keys=pull_18.Distance, ValuesA=sort_9.ValuesA)  # -> Keys, ValuesA
crv_62 = Curve(shift_2)

# ---- group: 最外侧的交点
item_40 = ListItem(List=sort_10.ValuesA, Index="-1", Wrap=True)

# ----
null_5 = NullItem(Item=flatten(item_40))  # -> NullFlags, InvalidFlags, Description
dispatch_27 = Dispatch(List=item_40, DispatchPattern=item_40)  # -> ListA, ListB
dispatch_28 = Dispatch(List=pln_22, DispatchPattern=null_5.InvalidFlags)  # -> ListA, ListB

# ---- group: 交点对应的初始Plane
data_33 = Data(dispatch_28.ListB)

# ---- group: 交点Point
data_34 = Data(dispatch_27.ListA)

# ----
# 按照梁分类定位点
pt_23 = Point(data_34)
incurves_5 = PointInCurves(Point=flatten(pt_23), Curves=crv_62)  # -> Relationship, Index, Point
equals_7 = Equality(FirstNumber=incurves_5.Relationship, SecondNumber="0")  # -> Equality, Inequality
dispatch_29 = Dispatch(List=flatten(pt_23), DispatchPattern=equals_7.Inequality)  # -> ListA, ListB

# ----
# 按照梁分类定位点
pt_24 = Point(data_34)
incurves_6 = PointInCurves(Point=flatten(pt_24), Curves=crv_62)  # -> Relationship, Index, Point
equals_8 = Equality(FirstNumber=incurves_6.Relationship, SecondNumber="0")  # -> Equality, Inequality
dispatch_30 = Dispatch(List=flatten(data_33), DispatchPattern=equals_8.Inequality)  # -> ListA, ListB

# ---- group: Plane-属于那个梁
data_35 = Data(dispatch_30.ListA)

# ---- group: 交点-属于哪个梁
data_36 = Data(dispatch_29.ListA)

# ----
move2pt_8 = MoveToPoint(Geometry=data_35, PointA=data_35, PointB=data_36)  # -> Moved, Vector, Transform
null_6 = NullItem(Item=move2pt_8.Moved)  # -> NullFlags, InvalidFlags, Description
dispatch_31 = Dispatch(List=move2pt_8.Moved, DispatchPattern=null_6.InvalidFlags)  # -> ListA, ListB

check_same_points_3 = CheckSamePoints(archPoint=pln_22, crvPoint=data_33)  # -> out, specialPt; inputs archPoint: list of Point3d, crvPoint: list of Point3d; same code as testpoint

# ---- group: 檐口-首次筛选的有效起始Plane
data_37 = Data(dispatch_31.ListB)

# ----
# 0无檐口线
# 与梁不相交
cull_i_8 = CullIndex(List=pln_22, Indices=check_same_points_3.specialPt, Wrap=True)

# ----
# 0 檐口出定位点
# 与结构无交点
pln_23 = Plane(cull_i_8)

# ----
# 0.Missing Point-二次筛选檐口处
# 埋件定位点Offset，没有找到和梁的交点
number_slider_40 = Slider(5000, range=0..10000)
deplane_16 = DeconstructPlane(Plane=pln_23)  # -> Origin, XAxis, YAxis, ZAxis
amp_11 = Amplitude(Vector=deplane_16.YAxis, Amplitude=number_slider_40)
move_17 = Move(Geometry=deplane_16.Origin, Motion=amp_11)  # -> Geometry, Transform
ln_15 = Line(StartPoint=move_17.Geometry, EndPoint=deplane_16.Origin)
amp_12 = Amplitude(Vector=deplane_16.XAxis, Amplitude=number_slider_7)
amp_13 = Amplitude(Vector=deplane_16.XAxis, Amplitude=expr("-x", number_slider_7))

# ---- group: 2条Offset的探针找交点
move_18 = Move(Geometry=ln_15, Motion=amp_12)  # -> Geometry, Transform
move_19 = Move(Geometry=ln_15, Motion=amp_13)  # -> Geometry, Transform

# ----
# 1.1 檐口处侧埋，钢板焊
# 02：钢板焊埋件[钢梁外侧]
# @钢边梁宽@钢边梁高
pln_24 = Plane(data_37)

# ---- group: 下层交点-除重
# 1.0 无檐口线+上下层幕墙边线连续
pln_25 = Plane(pln_21)
pln_26 = Plane(pln_16)
deplane_17 = DeconstructPlane(Plane=pln_25)  # -> Origin, XAxis, YAxis, ZAxis
deplane_18 = DeconstructPlane(Plane=pln_26)  # -> Origin, XAxis, YAxis, ZAxis
number_slider_41 = Slider(3584, range=0..10000)
number_slider_42 = Slider(3584, range=0..10000)
amp_14 = Amplitude(Vector=deplane_18.YAxis, Amplitude=expr("-x", number_slider_42))
amp_15 = Amplitude(Vector=deplane_18.YAxis, Amplitude=number_slider_42)
amp_16 = Amplitude(Vector=deplane_17.YAxis, Amplitude=expr("-x", number_slider_41))
amp_17 = Amplitude(Vector=deplane_17.YAxis, Amplitude=number_slider_41)
move_20 = Move(Geometry=deplane_18.Origin, Motion=amp_14)  # -> Geometry, Transform
move_21 = Move(Geometry=deplane_18.Origin, Motion=amp_15)  # -> Geometry, Transform
move_22 = Move(Geometry=deplane_17.Origin, Motion=amp_16)  # -> Geometry, Transform
move_23 = Move(Geometry=deplane_17.Origin, Motion=amp_17)  # -> Geometry, Transform
ln_16 = Line(StartPoint=move_22.Geometry, EndPoint=move_23.Geometry)
ln_17 = Line(StartPoint=move_20.Geometry, EndPoint=move_21.Geometry)
pt_25 = Point(deplane_17.Origin)
pln_27 = Plane(pln_26)
# 结构线是否分上下层？？？
number_slider_43 = Slider(2756, range=0..10000)

# ---- group: 下层交点-除重 / F1-交点
ccx_8 = CurveCurve(CurveA=ln_17, CurveB=crv_26)  # -> Points, ParamsA, ParamsB

# ---- group: 下层交点-除重 / F2-交点
ccx_9 = CurveCurve(CurveA=ln_16, CurveB=crv_27)  # -> Points, ParamsA, ParamsB

# ----
ccx_10 = CurveCurve(CurveA=graft(move_19.Geometry), CurveB=flatten(merge_21))  # -> Points, ParamsA, ParamsB
shift_4 = ShiftPaths(Data=ccx_10.Points, Offset=-1)
sort_11 = SortList(Keys=shift_4, ValuesA=shift_4)  # -> Keys, ValuesA
pull_19 = PullPoint(Point=sort_11.ValuesA, Geometry=graft(pln_23), ClosestOnly=True)  # -> ClosestPoint, Distance
sort_12 = SortList(Keys=pull_19.Distance, ValuesA=sort_11.ValuesA)  # -> Keys, ValuesA

# ---- group: 最远交点
item_41 = ListItem(List=sort_12.ValuesA, Index="-1", Wrap=True)

# ----
null_7 = NullItem(Item=flatten(item_41))  # -> NullFlags, InvalidFlags, Description
dispatch_32 = Dispatch(List=simplify(item_41), DispatchPattern=simplify(graft(null_7.InvalidFlags)))  # -> ListA, ListB
dispatch_33 = Dispatch(List=pln_23, DispatchPattern=null_7.InvalidFlags)  # -> ListA, ListB
pt_26 = Point(dispatch_32.ListB)
pln_28 = Plane(dispatch_33.ListB)

# ----
# 按照梁分类定位点
pln_29 = Plane(pln_28)
pt_27 = Point(pt_26)
incurves_7 = PointInCurves(Point=flatten(pt_27), Curves=crv_52)  # -> Relationship, Index, Point
equals_9 = Equality(FirstNumber=incurves_7.Relationship, SecondNumber="0")  # -> Equality, Inequality
dispatch_34 = Dispatch(List=flatten(pln_29), DispatchPattern=equals_9.Inequality)  # -> ListA, ListB
data_38 = Data(dispatch_34.ListA)

# ----
# 按照梁分类定位点
pt_28 = Point(pt_26)
incurves_8 = PointInCurves(Point=flatten(pt_28), Curves=crv_52)  # -> Relationship, Index, Point
equals_10 = Equality(FirstNumber=incurves_8.Relationship, SecondNumber="0")  # -> Equality, Inequality
dispatch_35 = Dispatch(List=flatten(pt_28), DispatchPattern=equals_10.Inequality)  # -> ListA, ListB
data_39 = Data(dispatch_35.ListA)

move2pt_9 = MoveToPoint(Geometry=data_38, PointA=data_38, PointB=data_39)  # -> Moved, Vector, Transform
null_8 = NullItem(Item=move2pt_9.Moved)  # -> NullFlags, InvalidFlags, Description
dispatch_36 = Dispatch(List=move2pt_9.Moved, DispatchPattern=null_8.InvalidFlags)  # -> ListA, ListB
pln_30 = Plane(dispatch_36.ListB)

ccx_11 = CurveCurve(CurveA=graft(move_18.Geometry), CurveB=flatten(merge_21))  # -> Points, ParamsA, ParamsB
shift_5 = ShiftPaths(Data=ccx_11.Points, Offset=-1)
sort_13 = SortList(Keys=shift_5, ValuesA=shift_5)  # -> Keys, ValuesA
pull_20 = PullPoint(Point=sort_13.ValuesA, Geometry=graft(pln_23), ClosestOnly=True)  # -> ClosestPoint, Distance
sort_14 = SortList(Keys=pull_20.Distance, ValuesA=sort_13.ValuesA)  # -> Keys, ValuesA

# ---- group: 最远交点
item_42 = ListItem(List=sort_14.ValuesA, Index="-1", Wrap=True)

# ----
null_9 = NullItem(Item=flatten(item_42))  # -> NullFlags, InvalidFlags, Description
dispatch_37 = Dispatch(List=simplify(item_42), DispatchPattern=simplify(graft(null_9.InvalidFlags)))  # -> ListA, ListB
dispatch_38 = Dispatch(List=pln_23, DispatchPattern=null_9.InvalidFlags)  # -> ListA, ListB
pln_31 = Plane(dispatch_38.ListB)
pt_29 = Point(dispatch_37.ListB)

# ----
# 按照梁分类定位点
pln_32 = Plane(pln_31)
pt_30 = Point(pt_29)
incurves_9 = PointInCurves(Point=flatten(pt_30), Curves=crv_52)  # -> Relationship, Index, Point
equals_11 = Equality(FirstNumber=incurves_9.Relationship, SecondNumber="0")  # -> Equality, Inequality
dispatch_39 = Dispatch(List=flatten(pln_32), DispatchPattern=equals_11.Inequality)  # -> ListA, ListB
data_40 = Data(dispatch_39.ListA)

# ----
# 按照梁分类定位点
pt_31 = Point(pt_29)
incurves_10 = PointInCurves(Point=flatten(pt_31), Curves=crv_52)  # -> Relationship, Index, Point
equals_12 = Equality(FirstNumber=incurves_10.Relationship, SecondNumber="0")  # -> Equality, Inequality
dispatch_40 = Dispatch(List=flatten(pt_31), DispatchPattern=equals_12.Inequality)  # -> ListA, ListB
data_41 = Data(dispatch_40.ListA)

move2pt_10 = MoveToPoint(Geometry=data_40, PointA=data_40, PointB=data_41)  # -> Moved, Vector, Transform
null_10 = NullItem(Item=move2pt_10.Moved)  # -> NullFlags, InvalidFlags, Description
dispatch_41 = Dispatch(List=move2pt_10.Moved, DispatchPattern=null_10.InvalidFlags)  # -> ListA, ListB
pln_33 = Plane(dispatch_41.ListB)

# ----
# 撞到梁交点
pln_34 = Plane(pln_33)
pln_35 = Plane(pln_30)

merge_22 = Merge(Data1=pln_24, Data2=pln_34, Data3=pln_35)
pln_36 = Plane(dispatch_38.ListA)
orient_3 = Orient(Geometry=item_33, Source=item_34, Target=merge_22)  # -> Geometry, Transform

data_42 = Data(orient_3.Geometry)
ungroup_4 = Ungroup(Group=data_42)
item_43 = ListItem(List=ungroup_4, Index=0, Wrap=True)  # -> flatten(Item)
item_44 = ListItem(List=ungroup_4, Index="-1", Wrap=True)  # -> flatten(Item)

entwine_13 = Entwine(Branch00=item_43, Branch01=item_44, FlattenInputs=True)
bake_2 = BakeObjects(Geometry=entwine_13, Attributes=attributes_3, BakeName="Embed::1-1-02钢板焊埋件", Bake=False)

# ----
# 未生成檐口线
pt_32 = Point(pln_36)

# ----
# （10）需人工排布
pt_33 = Point(pt_32)
bake_3 = BakeObjects(Geometry=pt_33, Attributes=attributes, BakeName=panel_40, Bake=False)

# ---- group: 下层交点-除重 (continued)
pull_21 = PullPoint(Point=ccx_9.Points, Geometry=deplane_17.Origin, ClosestOnly=True)  # -> ClosestPoint, Distance
pull_22 = PullPoint(Point=ccx_8.Points, Geometry=deplane_18.Origin, ClosestOnly=True)  # -> ClosestPoint, Distance
sort_15 = SortList(Keys=pull_22.Distance, ValuesA=ccx_8.Points)  # -> Keys, ValuesA
sort_16 = SortList(Keys=pull_21.Distance, ValuesA=ccx_9.Points)  # -> Keys, ValuesA
item_45 = ListItem(List=sort_15.ValuesA, Index=0, Wrap=True)  # -> flatten(Item)
item_46 = ListItem(List=sort_16.ValuesA, Index=0, Wrap=True)  # -> flatten(Item)
null_11 = NullItem(Item=item_45)  # -> NullFlags, InvalidFlags, Description
null_12 = NullItem(Item=item_46)  # -> NullFlags, InvalidFlags, Description
dispatch_42 = Dispatch(List=item_45, DispatchPattern=null_11.NullFlags)  # -> ListA, ListB
dispatch_43 = Dispatch(List=item_46, DispatchPattern=null_12.NullFlags)  # -> ListA, ListB

pt_34 = Point(dispatch_42.ListB)

# ---- group: 下层交点-除重 / 上层交点-除重
pt_35 = Point(dispatch_43.ListB)

# ---- group: 下层交点-除重 (continued)
pull_23 = PullPoint(Point=pt_34, Geometry=pt_35, ClosestOnly=True)  # -> ClosestPoint, Distance
sort_17 = SortList(Keys=pull_23.Distance, ValuesA=pull_23.ClosestPoint)  # -> Keys, ValuesA
panel_54 = Panel(sort_17.Keys)
larger_8 = LargerThan(FirstNumber=pull_23.Distance, SecondNumber=number_slider_24)  # -> LargerThan, OrEqualTo
dispatch_44 = Dispatch(List=pt_34, DispatchPattern=larger_8.LargerThan)  # -> ListA, ListB
pull_24 = PullPoint(Point=deplane_18.Origin, Geometry=graft(pt_34), ClosestOnly=True)  # -> ClosestPoint, Distance
sort_18 = SortList(Keys=pull_24.Distance, ValuesA=pln_27)  # -> Keys, ValuesA
item_47 = ListItem(List=sort_18.ValuesA, Index=0, Wrap=True)
check_same_points_4 = CheckSamePoints(archPoint=pln_27, crvPoint=flatten(item_47))  # -> out, specialPt; inputs archPoint: list of Point3d, crvPoint: list of Point3d; same code as testpoint
cull_i_9 = CullIndex(List=pln_27, Indices=check_same_points_4.specialPt, Wrap=True)

# ---- group: 下层交点-除重 / 2组交点距离大于容差-默认不同点
dispatch_45 = Dispatch(List=pull_23.ClosestPoint, DispatchPattern=larger_8.LargerThan)  # -> ListA, ListB

# ---- group: 下层交点-除重 / 大于容差算作新点
pt_36 = Point(dispatch_45.ListA)

# ---- group: 下层交点-除重 / 有效Plane-下层建筑线在该处连续
item_48 = ListItem(List=pln_27, Index=check_same_points_4.specialPt, Wrap=True)

# ----
# Rhino 文件中导入的块名
cull_i_10 = CullIndex(List=pln_27, Indices=check_same_points_4.specialPt, Wrap=True)
merge_23 = Merge(Data1=cull_i_10, Data2=pln_17)  # -> flatten(Result)

# ----
# 和下层楼板发生关系的定位点
pln_37 = Plane(merge_23)

# ---- group: 起始Plane
pln_38 = Plane(pln_37)

# ----
pln_39 = Plane(pln_38)
number_slider_44 = Slider(3584, range=0..10000)
deplane_19 = DeconstructPlane(Plane=pln_39)  # -> Origin, XAxis, YAxis, ZAxis
crv_63 = Curve(merge_21)
boundary_3 = BoundarySurfaces(Edges=[offset_5, offset_4])
scx = SurfaceCurve(Surface=boundary_3, Curve=crv_63)  # -> flatten(Curves), Points, UVPoints, Normals, Parameters, Tangents
amp_18 = Amplitude(Vector=deplane_19.YAxis, Amplitude=number_slider_44)
amp_19 = Amplitude(Vector=deplane_19.YAxis, Amplitude=expr("-x", number_slider_44))
move_24 = Move(Geometry=deplane_19.Origin, Motion=amp_19)  # -> Geometry, Transform
move_25 = Move(Geometry=deplane_19.Origin, Motion=amp_18)  # -> Geometry, Transform
ln_18 = Line(StartPoint=move_24.Geometry, EndPoint=move_25.Geometry)
ccx_12 = CurveCurve(CurveA=graft(ln_18), CurveB=scx.Curves)  # -> Points, ParamsA, ParamsB
shift_6 = ShiftPaths(Data=ccx_12.Points, Offset=-1)
pull_25 = PullPoint(Point=graft(pln_39), Geometry=shift_6, ClosestOnly=True)  # -> ClosestPoint, Distance
sort_19 = SortList(Keys=pull_25.Distance, ValuesA=pull_25.ClosestPoint)  # -> Keys, ValuesA
item_49 = ListItem(List=sort_19.ValuesA, Index=0, Wrap=True)
null_13 = NullItem(Item=item_49)  # -> NullFlags, simplify(InvalidFlags), Description
null_14 = NullItem(Item=sort_19.ValuesA)  # -> NullFlags, simplify(InvalidFlags), Description
dispatch_46 = Dispatch(List=simplify(graft(pln_39)), DispatchPattern=null_14.InvalidFlags)  # -> ListA, ListB
dispatch_47 = Dispatch(List=simplify(graft(item_49)), DispatchPattern=null_13.InvalidFlags)  # -> ListA, ListB
pln_40 = Plane(dispatch_46.ListB)
pln_41 = Plane(dispatch_46.ListA)
pt_37 = Point(dispatch_47.ListB)

# ----
# 可能的结构交点-大量
pln_42 = Plane(pln_41)

# ----
# 0 檐口出定位点
# 与结构无交点
pln_43 = Plane(flatten(pln_42))

# ---- group: 下层交点-除重 (continued)
pull_26 = PullPoint(Point=pt_36, Geometry=pt_25, ClosestOnly=True)  # -> ClosestPoint, Distance
check_same_points_5 = CheckSamePoints(archPoint=pt_25, crvPoint=flatten(pull_26.ClosestPoint))  # -> out, specialPt; inputs archPoint: list of Point3d, crvPoint: list of Point3d; same code as testpoint

# ---- group: 下层交点-除重 / 有效Plane-上层建筑线在该处连续
item_50 = ListItem(List=pln_21, Index=check_same_points_5.specialPt, Wrap=True)

# ---- group: 下层交点-除重 (continued)
merge_24 = Merge(Data1=item_48, Data2=item_50)
deplane_20 = DeconstructPlane(Plane=merge_24)  # -> Origin, XAxis, YAxis, ZAxis
amp_20 = Amplitude(Vector=deplane_20.YAxis, Amplitude=expr("-x", number_slider_43))
move_26 = Move(Geometry=deplane_20.Origin, Motion=amp_20)  # -> Geometry, Transform

# ---- group: 下层交点-除重 / 相内探索
ln_19 = Line(StartPoint=deplane_20.Origin, EndPoint=move_26.Geometry)

# ---- group: 下层交点-除重 (continued)
ccx_13 = CurveCurve(CurveA=graft(ln_19), CurveB=flatten(crv_53))  # -> Points, ParamsA, ParamsB
shift_7 = ShiftPaths(Data=ccx_13.Points, Offset=-1)
pull_27 = PullPoint(Point=deplane_20.Origin, Geometry=shift_7, ClosestOnly=True)  # -> ClosestPoint, Distance
sort_20 = SortList(Keys=pull_27.Distance, ValuesA=pull_27.ClosestPoint)  # -> Keys, ValuesA

# ---- group: 下层交点-除重 / 与梁最近交点
item_51 = ListItem(List=sort_20.ValuesA, Index=0, Wrap=True)

# ---- group: 下层交点-除重 (continued)
null_15 = NullItem(Item=flatten(item_51))  # -> NullFlags, InvalidFlags, Description
dispatch_48 = Dispatch(List=merge_24, DispatchPattern=null_15.InvalidFlags)  # -> ListA, ListB
dispatch_49 = Dispatch(List=flatten(item_51), DispatchPattern=null_15.InvalidFlags)  # -> ListA, ListB

# ---- group: 下层交点-除重 / 有效起始Plane
data_43 = Data(dispatch_48.ListB)

# ---- group: 下层交点-除重 / 去除Null的交点
data_44 = Data(dispatch_49.ListB)

# ---- group: 下层交点-除重 (continued)
flatten_6 = FlattenTree(Tree=data_44, Path="{0}")
move2pt_11 = MoveToPoint(Geometry=data_43, PointA=data_43, PointB=flatten(data_44))  # -> Moved, Vector, Transform
ln_20 = Line(StartPoint=data_43, EndPoint=flatten_6)
len_4 = Length(Curve=ln_20)
sort_21 = SortList(Keys=len_4)  # -> reverse(Keys), ValuesA

# ----
# 与梁无交点的定位点
pln_44 = Plane(dispatch_48.ListA)

# ----
# 1.0
number_slider_45 = Slider(50, range=0..100)
number = NumberGroups(Number=sort_21.Keys, Difference=number_slider_45)  # -> simplify(Groups), Indices
panel_55 = Panel(number.Groups)
tstat_3 = TreeStatistics(Tree=number.Groups)  # -> Paths, Length, Count
lng_3 = ListLength(List=tstat_3.Paths)
smaller_7 = SmallerThan(FirstNumber=lng_3, SecondNumber="2")  # -> SmallerThan, OrEqualTo
dispatch_50 = Dispatch(List=smaller_7.SmallerThan, DispatchPattern=[True, False])  # -> ListA, ListB
filter_13 = StreamFilter(Gate=dispatch_50.ListA, Stream0="-2", Stream1="-1")
item_52 = ListItem(List=tstat_3.Paths, Index=filter_13, Wrap=True)
branch = TreeBranch(Tree=number.Groups, Path=item_52, MaintainPaths=True)
sort_22 = SortList(Keys=branch)  # -> reverse(Keys), ValuesA
round_2 = Round(Number=sort_22.Keys)  # -> Nearest, Floor, Ceiling
item_53 = ListItem(List=round_2.Ceiling, Index=0, Wrap=True)

# ----
# 挑出反常点-交点距离起始点过远
list_10 = ValueList({"自己输入Value": 0, "GH Defaut Value": 1}, selected="GH Defaut Value")
panel_56 = Panel(item_53)
filter_14 = StreamFilter(Gate=list_10, Stream0=Slider(1000, range=0..10000), Stream1=panel_56)

larger_9 = LargerThan(FirstNumber=len_4, SecondNumber=filter_14)  # -> LargerThan, OrEqualTo
dispatch_51 = Dispatch(List=flatten_6, DispatchPattern=larger_9.LargerThan)  # -> ListA, ListB
dispatch_52 = Dispatch(List=data_43, DispatchPattern=larger_9.LargerThan)  # -> ListA, ListB
data_45 = Data(dispatch_52.ListB)
data_46 = Data(dispatch_51.ListB)

# ----
# 按照梁分类定位点
pt_38 = Point(data_46)
pln_45 = Plane(data_45)
incurves_11 = PointInCurves(Point=flatten(pt_38), Curves=crv_54)  # -> Relationship, Index, Point
equals_13 = Equality(FirstNumber=incurves_11.Relationship, SecondNumber="0")  # -> Equality, Inequality
dispatch_53 = Dispatch(List=flatten(pln_45), DispatchPattern=equals_13.Inequality)  # -> ListA, ListB
data_47 = Data(dispatch_53.ListA)

incurves_12 = PointInCurves(Point=flatten(pt_38), Curves=crv_54)  # -> Relationship, Index, Point
equals_14 = Equality(FirstNumber=incurves_12.Relationship, SecondNumber="0")  # -> Equality, Inequality
dispatch_54 = Dispatch(List=flatten(pt_38), DispatchPattern=equals_14.Inequality)  # -> ListA, ListB
data_48 = Data(dispatch_54.ListA)

move2pt_12 = MoveToPoint(Geometry=data_47, PointA=data_47, PointB=data_48)  # -> Moved, Vector, Transform
null_16 = NullItem(Item=move2pt_12.Moved)  # -> NullFlags, InvalidFlags, Description
dispatch_55 = Dispatch(List=move2pt_12.Moved, DispatchPattern=null_16.InvalidFlags)  # -> ListA, ListB
pln_46 = Plane(dispatch_55.ListB)
# ----
# 离梁过远的定位点
pln_47 = Plane(dispatch_52.ListA)

# ----
# 1.0无檐口线
# 与梁不相交
merge_25 = Merge(Data1=pln_44, Data2=pln_47)

# ----
# 0 檐口出定位点
# 与结构无交点
pln_48 = Plane(flatten(merge_25))

# ----
# 1.0.Missing Point
# 埋件定位点Offset，没有找到和梁的交点
number_slider_46 = Slider(5000, range=0..10000)
deplane_21 = DeconstructPlane(Plane=pln_48)  # -> Origin, XAxis, YAxis, ZAxis
amp_21 = Amplitude(Vector=deplane_21.YAxis, Amplitude=expr("-x", number_slider_46))
move_27 = Move(Geometry=deplane_21.Origin, Motion=amp_21)  # -> Geometry, Transform
ln_21 = Line(StartPoint=move_27.Geometry, EndPoint=deplane_21.Origin)
# 钢埋板高度，工字钢尺寸决定
crv_64 = Curve(crv_53)
amp_22 = Amplitude(Vector=deplane_21.XAxis, Amplitude=number_slider_7)
amp_23 = Amplitude(Vector=deplane_21.XAxis, Amplitude=expr("-x", number_slider_7))

# ---- group: 2组探索针
move_28 = Move(Geometry=ln_21, Motion=amp_23)  # -> Geometry, Transform
move_29 = Move(Geometry=ln_21, Motion=amp_22)  # -> Geometry, Transform

# ----
ccx_14 = CurveCurve(CurveA=graft(move_28.Geometry), CurveB=flatten(crv_64))  # -> Points, ParamsA, ParamsB
shift_8 = ShiftPaths(Data=ccx_14.Points, Offset=-1)
sort_23 = SortList(Keys=shift_8, ValuesA=shift_8)  # -> Keys, ValuesA
pull_28 = PullPoint(Point=sort_23.ValuesA, Geometry=graft(pln_48), ClosestOnly=True)  # -> ClosestPoint, Distance
sort_24 = SortList(Keys=pull_28.Distance, ValuesA=sort_23.ValuesA)  # -> Keys, ValuesA
item_54 = ListItem(List=sort_24.ValuesA, Index="0", Wrap=True)
null_17 = NullItem(Item=flatten(item_54))  # -> NullFlags, InvalidFlags, Description
dispatch_56 = Dispatch(List=simplify(item_54), DispatchPattern=simplify(graft(null_17.InvalidFlags)))  # -> ListA, ListB
dispatch_57 = Dispatch(List=pln_48, DispatchPattern=null_17.InvalidFlags)  # -> ListA, ListB
pln_49 = Plane(dispatch_57.ListB)
pt_39 = Point(dispatch_56.ListB)

ccx_15 = CurveCurve(CurveA=graft(move_29.Geometry), CurveB=flatten(crv_64))  # -> Points, ParamsA, ParamsB
shift_9 = ShiftPaths(Data=ccx_15.Points, Offset=-1)
sort_25 = SortList(Keys=shift_9, ValuesA=shift_9)  # -> Keys, ValuesA
pull_29 = PullPoint(Point=sort_25.ValuesA, Geometry=graft(pln_48), ClosestOnly=True)  # -> ClosestPoint, Distance
sort_26 = SortList(Keys=pull_29.Distance, ValuesA=sort_25.ValuesA)  # -> Keys, ValuesA
item_55 = ListItem(List=sort_26.ValuesA, Index="0", Wrap=True)
null_18 = NullItem(Item=flatten(item_55))  # -> NullFlags, InvalidFlags, Description
dispatch_58 = Dispatch(List=simplify(item_55), DispatchPattern=simplify(graft(null_18.InvalidFlags)))  # -> ListA, ListB
dispatch_59 = Dispatch(List=pln_48, DispatchPattern=null_18.InvalidFlags)  # -> ListA, ListB
pt_40 = Point(dispatch_58.ListB)
pln_50 = Plane(dispatch_59.ListB)

# ----
# 按照梁分类定位点
pln_51 = Plane(pln_50)
pt_41 = Point(pt_40)
incurves_13 = PointInCurves(Point=flatten(pt_41), Curves=crv_55)  # -> Relationship, Index, Point
equals_15 = Equality(FirstNumber=incurves_13.Relationship, SecondNumber="0")  # -> Equality, Inequality
dispatch_60 = Dispatch(List=flatten(pln_51), DispatchPattern=equals_15.Inequality)  # -> ListA, ListB
data_49 = Data(dispatch_60.ListA)

# ----
# 按照梁分类定位点
pln_52 = Plane(pln_49)
pt_42 = Point(pt_39)
incurves_14 = PointInCurves(Point=flatten(pt_42), Curves=crv_55)  # -> Relationship, Index, Point
equals_16 = Equality(FirstNumber=incurves_14.Relationship, SecondNumber="0")  # -> Equality, Inequality
dispatch_61 = Dispatch(List=flatten(pln_52), DispatchPattern=equals_16.Inequality)  # -> ListA, ListB
data_50 = Data(dispatch_61.ListA)

incurves_15 = PointInCurves(Point=flatten(pt_42), Curves=crv_55)  # -> Relationship, Index, Point
equals_17 = Equality(FirstNumber=incurves_15.Relationship, SecondNumber="0")  # -> Equality, Inequality
dispatch_62 = Dispatch(List=flatten(pt_42), DispatchPattern=equals_17.Inequality)  # -> ListA, ListB
data_51 = Data(dispatch_62.ListA)

incurves_16 = PointInCurves(Point=flatten(pt_41), Curves=crv_55)  # -> Relationship, Index, Point
equals_18 = Equality(FirstNumber=incurves_16.Relationship, SecondNumber="0")  # -> Equality, Inequality
dispatch_63 = Dispatch(List=flatten(pt_41), DispatchPattern=equals_18.Inequality)  # -> ListA, ListB
data_52 = Data(dispatch_63.ListA)

move2pt_13 = MoveToPoint(Geometry=data_49, PointA=data_49, PointB=data_52)  # -> Moved, Vector, Transform
null_19 = NullItem(Item=move2pt_13.Moved)  # -> NullFlags, InvalidFlags, Description
dispatch_64 = Dispatch(List=move2pt_13.Moved, DispatchPattern=null_19.InvalidFlags)  # -> ListA, ListB
pln_53 = Plane(dispatch_64.ListB)

move2pt_14 = MoveToPoint(Geometry=data_50, PointA=data_50, PointB=data_51)  # -> Moved, Vector, Transform
null_20 = NullItem(Item=move2pt_14.Moved)  # -> NullFlags, InvalidFlags, Description
dispatch_65 = Dispatch(List=move2pt_14.Moved, DispatchPattern=null_20.InvalidFlags)  # -> ListA, ListB
pln_54 = Plane(dispatch_65.ListB)

# ----
# 撞到梁交点
merge_26 = Merge(Data1=pln_53, Data2=pln_54)

# ----
# 1.0无檐口线+上下层幕墙边线连续
# 01：钢板焊埋件[钢梁外侧]
# @钢边梁宽@钢边梁高
pln_55 = Plane(pln_46)

merge_27 = Merge(Data1=pln_55, Data2=merge_26)
orient_4 = Orient(Geometry=item_4, Source=item_5, Target=merge_27)  # -> Geometry, Transform

data_53 = Data(orient_4.Geometry)
ungroup_5 = Ungroup(Group=data_53)
item_56 = ListItem(List=ungroup_5, Index=0, Wrap=True)  # -> flatten(Item)
item_57 = ListItem(List=ungroup_5, Index="-1", Wrap=True)  # -> flatten(Item)

entwine_14 = Entwine(Branch00=item_56, Branch01=item_57, FlattenInputs=True)
bake_4 = BakeObjects(Geometry=entwine_14, Attributes=attributes_5, BakeName="Embed::1-0-01钢板焊埋件", Bake=False)

# ----
# 2是否有吊顶
# 梁以内>350
deplane_22 = DeconstructPlane(Plane=pln_37)  # -> Origin, XAxis, YAxis, ZAxis
number_slider_47 = Slider(5000, range=0..10000)
amp_24 = Amplitude(Vector=deplane_22.YAxis, Amplitude=expr("-x", number_slider_47))
amp_25 = Amplitude(Vector=deplane_22.YAxis, Amplitude=number_slider_47)
move_30 = Move(Geometry=deplane_22.Origin, Motion=amp_25)  # -> Geometry, Transform
move_31 = Move(Geometry=deplane_22.Origin, Motion=amp_24)  # -> Geometry, Transform
ln_22 = Line(StartPoint=move_30.Geometry, EndPoint=move_31.Geometry)
crv_65 = Curve(crv_15)
crv_66 = Curve(merge_20)

# ---- group: 和下层建筑的交点
ccx_16 = CurveCurve(CurveA=ln_22, CurveB=crv_65)  # -> Points, ParamsA, ParamsB

# ----
null_21 = NullItem(Item=ccx_16.Points)  # -> NullFlags, InvalidFlags, Description
dispatch_66 = Dispatch(List=simplify(ccx_16.Points), DispatchPattern=simplify(null_21.NullFlags))  # -> ListA, ListB
dispatch_67 = Dispatch(List=simplify(graft(pln_37)), DispatchPattern=simplify(null_21.NullFlags))  # -> ListA, ListB
pt_43 = Point(dispatch_66.ListB)
pln_56 = Plane(flatten(dispatch_67.ListB))
pt_44 = Point(pln_56)
pull_30 = PullPoint(Point=flatten(pt_44), Geometry=flatten(pt_43), ClosestOnly=True)  # -> ClosestPoint, Distance
ln_23 = Line(StartPoint=pln_56, EndPoint=pull_30.ClosestPoint)

# ----
# 定位点Project到下层建筑线
move2pt_15 = MoveToPoint(Geometry=pln_56, PointA=pln_56, PointB=pull_30.ClosestPoint)  # -> Moved, Vector, Transform

# ----
# 可能的点-离结构很远
pln_57 = Plane(dispatch_67.ListA)

deplane_23 = DeconstructPlane(Plane=move2pt_15.Moved)  # -> Origin, XAxis, YAxis, ZAxis
amp_26 = Amplitude(Vector=deplane_23.YAxis, Amplitude=Slider(5000, range=0..10000))
move_32 = Move(Geometry=deplane_23.Origin, Motion=amp_26)  # -> Geometry, Transform
ln_24 = Line(StartPoint=move_32.Geometry, EndPoint=deplane_23.Origin)

# ---- group: 和内测梁交点
ccx_17 = CurveCurve(CurveA=graft(ln_24), CurveB=flatten(crv_66))  # -> simplify(Points), ParamsA, ParamsB

# ----
shift_10 = ShiftPaths(Data=ccx_17.Points, Offset=-1)
null_22 = NullItem(Item=shift_10)  # -> NullFlags, InvalidFlags, Description
dispatch_68 = Dispatch(List=simplify(graft(move2pt_15.Moved)), DispatchPattern=null_22.NullFlags)  # -> ListA, ListB
dispatch_69 = Dispatch(List=simplify(graft(ln_24)), DispatchPattern=null_22.NullFlags)  # -> ListA, ListB
pln_58 = Plane(dispatch_68.ListA)
crv_67 = Curve(dispatch_69.ListB)
pln_59 = Plane(dispatch_68.ListB)
ccx_18 = CurveCurve(CurveA=graft(crv_67), CurveB=flatten(crv_66))  # -> Points, ParamsA, ParamsB
shift_11 = ShiftPaths(Data=simplify(ccx_18.Points), Offset=-1)
pull_31 = PullPoint(Point=pln_59, Geometry=shift_11, ClosestOnly=True)  # -> ClosestPoint, Distance
sort_27 = SortList(Keys=pull_31.Distance, ValuesA=pull_31.ClosestPoint)  # -> Keys, ValuesA

# ---- group: 交点对应的起始定位点
item_58 = ListItem(List=sort_27.ValuesA, Index=0, Wrap=True)

# ----
ln_25 = Line(StartPoint=pln_59, EndPoint=item_58)
len_5 = Length(Curve=ln_25)
larger_10 = LargerThan(FirstNumber=len_5, SecondNumber=number_slider_25)  # -> LargerThan, OrEqualTo
panel_57 = Panel(len_5)
dispatch_70 = Dispatch(List=item_58, DispatchPattern=larger_10.LargerThan)  # -> ListA, ListB
dispatch_71 = Dispatch(List=pln_59, DispatchPattern=larger_10.LargerThan)  # -> ListA, ListB
pln_60 = Plane(dispatch_71.ListB)

# ---- group: 起始点
pt_45 = Point(dispatch_70.ListA)

# ---- group: 最终Plane
pln_61 = Plane(dispatch_71.ListA)

# ---- group: 分类后的Plane
# 按照梁分类定位点
pln_62 = Plane(pln_61)
pt_46 = Point(pt_45)
incurves_17 = PointInCurves(Point=flatten(pt_46), Curves=crv_56)  # -> Relationship, Index, Point
equals_19 = Equality(FirstNumber=incurves_17.Relationship, SecondNumber="0")  # -> Equality, Inequality
dispatch_72 = Dispatch(List=flatten(pln_62), DispatchPattern=equals_19.Inequality)  # -> ListA, ListB
data_54 = Data(dispatch_72.ListA)

incurves_18 = PointInCurves(Point=flatten(pt_46), Curves=crv_56)  # -> Relationship, Index, Point
# SmoothCurve-阴角
# SmoothCurve-阳角
# SmoothCurve-阴角
# SmoothCurve-正常
# Angular Curve - All
# Special Curve(with location)- All
# Curve for this project only - All
panel_58 = Panel("0")
equals_20 = Equality(FirstNumber=incurves_18.Relationship, SecondNumber=panel_58)  # -> Equality, Inequality
dispatch_73 = Dispatch(List=flatten(pt_46), DispatchPattern=equals_20.Inequality)  # -> ListA, ListB
data_55 = Data(dispatch_73.ListA)

move2pt_16 = MoveToPoint(Geometry=data_54, PointA=data_54, PointB=data_55)  # -> Moved, Vector, Transform
null_23 = NullItem(Item=move2pt_16.Moved)  # -> NullFlags, InvalidFlags, Description
dispatch_74 = Dispatch(List=move2pt_16.Moved, DispatchPattern=null_23.InvalidFlags)  # -> ListA, ListB

pln_63 = Plane(dispatch_74.ListB)

# ----
# 可能的结构交点-大量
pln_64 = Plane(pln_58)

# ----
# 可能的结构交点
pln_65 = Plane(pln_60)

# ----
# 这里如果跑红也不要紧，
# 说明单体没有出现相撞的情况
# 2.1 梁以内>350
# 
# 侧埋，钢板焊
# 03：钢板焊埋件[钢梁内侧]
# @钢边梁宽@钢边梁高
pln_66 = Plane(pln_63)

# ----
# 2.1 Missing Point
# 埋件定位点Offset，没有找到和梁的交点
merge_28 = Merge(Data1=pln_57, Data2=pln_65, Data3=pln_64)
crv_68 = Curve(crv_66)

# ----
# 0 檐口出定位点
# 与结构无交点
pln_67 = Plane(flatten(merge_28))

deplane_24 = DeconstructPlane(Plane=pln_67)  # -> Origin, XAxis, YAxis, ZAxis
amp_27 = Amplitude(Vector=deplane_24.YAxis, Amplitude=Slider(5000, range=0..10000))
move_33 = Move(Geometry=deplane_24.Origin, Motion=amp_27)  # -> Geometry, Transform
ln_26 = Line(StartPoint=move_33.Geometry, EndPoint=deplane_24.Origin)
amp_28 = Amplitude(Vector=deplane_24.XAxis, Amplitude=number_slider_7)
amp_29 = Amplitude(Vector=deplane_24.XAxis, Amplitude=expr("-x", number_slider_7))
move_34 = Move(Geometry=ln_26, Motion=amp_28)  # -> Geometry, Transform
move_35 = Move(Geometry=ln_26, Motion=amp_29)  # -> Geometry, Transform

ccx_19 = CurveCurve(CurveA=graft(move_34.Geometry), CurveB=flatten(crv_68))  # -> Points, ParamsA, ParamsB
shift_12 = ShiftPaths(Data=ccx_19.Points, Offset=-1)
sort_28 = SortList(Keys=shift_12, ValuesA=shift_12)  # -> Keys, ValuesA
pull_32 = PullPoint(Point=sort_28.ValuesA, Geometry=graft(pln_67), ClosestOnly=True)  # -> ClosestPoint, Distance
sort_29 = SortList(Keys=pull_32.Distance, ValuesA=sort_28.ValuesA)  # -> Keys, ValuesA
item_59 = ListItem(List=sort_29.ValuesA, Index="-1", Wrap=True)
null_24 = NullItem(Item=flatten(item_59))  # -> NullFlags, InvalidFlags, Description
end_6 = EndPoints(Curve=move_34.Geometry)  # -> Start, End
dispatch_75 = Dispatch(List=graft(pln_67), DispatchPattern=graft(null_24.InvalidFlags))  # -> ListA, ListB
dispatch_76 = Dispatch(List=simplify(item_59), DispatchPattern=simplify(graft(null_24.InvalidFlags)))  # -> ListA, ListB
pt_47 = Point(dispatch_76.ListB)
pln_68 = Plane(dispatch_75.ListB)
dispatch_77 = Dispatch(List=simplify(graft(end_6.End)), DispatchPattern=simplify(graft(null_24.InvalidFlags)))  # -> ListA, ListB
pt_48 = Point(dispatch_77.ListB)
ln_27 = Line(StartPoint=pt_48, EndPoint=pt_47)
len_6 = Length(Curve=ln_27)
larger_11 = LargerThan(FirstNumber=len_6, SecondNumber=Slider(350, range=0..1000))  # -> LargerThan, OrEqualTo
dispatch_78 = Dispatch(List=pln_68, DispatchPattern=larger_11.LargerThan)  # -> ListA, ListB
dispatch_79 = Dispatch(List=pt_48, DispatchPattern=larger_11.LargerThan)  # -> ListA, ListB
pln_69 = Plane(dispatch_78.ListA)
pt_49 = Point(dispatch_79.ListA)

ccx_20 = CurveCurve(CurveA=graft(move_35.Geometry), CurveB=flatten(crv_68))  # -> Points, ParamsA, ParamsB
shift_13 = ShiftPaths(Data=ccx_20.Points, Offset=-1)
sort_30 = SortList(Keys=shift_13, ValuesA=shift_13)  # -> Keys, ValuesA
pull_33 = PullPoint(Point=sort_30.ValuesA, Geometry=graft(pln_67), ClosestOnly=True)  # -> ClosestPoint, Distance
sort_31 = SortList(Keys=pull_33.Distance, ValuesA=sort_30.ValuesA)  # -> Keys, ValuesA
item_60 = ListItem(List=sort_31.ValuesA, Index="-1", Wrap=True)
null_25 = NullItem(Item=flatten(item_60))  # -> NullFlags, InvalidFlags, Description
end_7 = EndPoints(Curve=move_35.Geometry)  # -> Start, End
dispatch_80 = Dispatch(List=simplify(item_60), DispatchPattern=simplify(graft(null_25.InvalidFlags)))  # -> ListA, ListB
dispatch_81 = Dispatch(List=graft(pln_67), DispatchPattern=flatten(null_25.InvalidFlags))  # -> ListA, ListB
dispatch_82 = Dispatch(List=simplify(graft(end_7.End)), DispatchPattern=simplify(graft(null_25.InvalidFlags)))  # -> ListA, ListB
pln_70 = Plane(dispatch_81.ListB)
pt_50 = Point(dispatch_80.ListB)
pt_51 = Point(dispatch_82.ListB)
ln_28 = Line(StartPoint=pt_51, EndPoint=pt_47)
len_7 = Length(Curve=ln_28)
larger_12 = LargerThan(FirstNumber=len_7, SecondNumber=Slider(350, range=0..1000))  # -> LargerThan, OrEqualTo
dispatch_83 = Dispatch(List=pln_70, DispatchPattern=larger_12.LargerThan)  # -> ListA, ListB
dispatch_84 = Dispatch(List=pt_51, DispatchPattern=larger_12.LargerThan)  # -> ListA, ListB
pln_71 = Plane(dispatch_83.ListA)
pt_52 = Point(dispatch_84.ListA)

# ----
# 按照梁分类定位点
pln_72 = Plane(pln_69)
pt_53 = Point(pt_49)
incurves_19 = PointInCurves(Point=flatten(pt_53), Curves=crv_57)  # -> Relationship, Index, Point
equals_21 = Equality(FirstNumber=incurves_19.Relationship, SecondNumber="0")  # -> Equality, Inequality
dispatch_85 = Dispatch(List=flatten(pln_72), DispatchPattern=equals_21.Inequality)  # -> ListA, ListB
data_56 = Data(dispatch_85.ListA)

# ----
# 按照梁分类定位点
pln_73 = Plane(pln_71)
pt_54 = Point(pt_52)
incurves_20 = PointInCurves(Point=flatten(pt_54), Curves=crv_57)  # -> Relationship, Index, Point
equals_22 = Equality(FirstNumber=incurves_20.Relationship, SecondNumber="0")  # -> Equality, Inequality
dispatch_86 = Dispatch(List=flatten(pln_73), DispatchPattern=equals_22.Inequality)  # -> ListA, ListB
data_57 = Data(dispatch_86.ListA)

incurves_21 = PointInCurves(Point=flatten(pt_54), Curves=crv_57)  # -> Relationship, Index, Point
equals_23 = Equality(FirstNumber=incurves_21.Relationship, SecondNumber="0")  # -> Equality, Inequality
dispatch_87 = Dispatch(List=flatten(pt_54), DispatchPattern=equals_23.Inequality)  # -> ListA, ListB
data_58 = Data(dispatch_87.ListA)

incurves_22 = PointInCurves(Point=flatten(pt_53), Curves=crv_57)  # -> Relationship, Index, Point
equals_24 = Equality(FirstNumber=incurves_22.Relationship, SecondNumber="0")  # -> Equality, Inequality
dispatch_88 = Dispatch(List=flatten(pt_53), DispatchPattern=equals_24.Inequality)  # -> ListA, ListB
data_59 = Data(dispatch_88.ListA)

move2pt_17 = MoveToPoint(Geometry=data_56, PointA=data_56, PointB=data_59)  # -> Moved, Vector, Transform
null_26 = NullItem(Item=move2pt_17.Moved)  # -> NullFlags, InvalidFlags, Description
dispatch_89 = Dispatch(List=move2pt_17.Moved, DispatchPattern=null_26.InvalidFlags)  # -> ListA, ListB

move2pt_18 = MoveToPoint(Geometry=data_57, PointA=data_57, PointB=data_58)  # -> Moved, Vector, Transform
null_27 = NullItem(Item=move2pt_18.Moved)  # -> NullFlags, InvalidFlags, Description
dispatch_90 = Dispatch(List=move2pt_18.Moved, DispatchPattern=null_27.InvalidFlags)  # -> ListA, ListB
pln_74 = Plane(dispatch_90.ListB)

# ---- group: 2次筛选所得
pln_75 = Plane(dispatch_89.ListB)

# ----
# 撞到梁交点
merge_29 = Merge(Data1=pln_75, Data2=pln_74)

merge_30 = Merge(Data1=pln_66, Data2=merge_29)
orient_5 = Orient(Geometry=item_6, Source=rotate.Geometry, Target=merge_30)  # -> Geometry, Transform

data_60 = Data(orient_5.Geometry)
ungroup_6 = Ungroup(Group=data_60)
item_61 = ListItem(List=ungroup_6, Index=0, Wrap=True)  # -> flatten(Item)
item_62 = ListItem(List=ungroup_6, Index="-1", Wrap=True)  # -> flatten(Item)

entwine_15 = Entwine(Branch00=item_61, Branch01=item_62, FlattenInputs=True)
bake_5 = BakeObjects(Geometry=entwine_15, Attributes=attributes_4, BakeName="Embed::2-1-03钢板焊埋件", Bake=False)

number_slider_48 = Slider(3584, range=0..10000)
deplane_25 = DeconstructPlane(Plane=pln_38)  # -> Origin, XAxis, YAxis, ZAxis
amp_30 = Amplitude(Vector=deplane_25.YAxis, Amplitude=number_slider_48)
amp_31 = Amplitude(Vector=deplane_25.YAxis, Amplitude=expr("-x", number_slider_48))
boundary_4 = BoundarySurfaces(Edges=[offset_6, offset_7])
crv_69 = Curve(merge_20)
move_36 = Move(Geometry=deplane_25.Origin, Motion=amp_31)  # -> Geometry, Transform
move_37 = Move(Geometry=deplane_25.Origin, Motion=amp_30)  # -> Geometry, Transform
ln_29 = Line(StartPoint=move_36.Geometry, EndPoint=move_37.Geometry)

# ---- group: 50-350建筑结构交点
scx_2 = SurfaceCurve(Surface=boundary_4, Curve=crv_69)  # -> flatten(Curves), Points, UVPoints, Normals, Parameters, Tangents

# ---- group: 该区间的定位点
ccx_21 = CurveCurve(CurveA=graft(ln_29), CurveB=scx_2.Curves)  # -> Points, ParamsA, ParamsB

# ----
shift_14 = ShiftPaths(Data=ccx_21.Points, Offset=-1)
pull_34 = PullPoint(Point=graft(pln_38), Geometry=shift_14, ClosestOnly=True)  # -> ClosestPoint, Distance
sort_32 = SortList(Keys=pull_34.Distance, ValuesA=pull_34.ClosestPoint)  # -> Keys, ValuesA
null_28 = NullItem(Item=sort_32.ValuesA)  # -> NullFlags, simplify(InvalidFlags), Description
item_63 = ListItem(List=sort_32.ValuesA, Index=0, Wrap=True)
dispatch_91 = Dispatch(List=simplify(graft(pln_38)), DispatchPattern=null_28.InvalidFlags)  # -> ListA, ListB
dispatch_92 = Dispatch(List=simplify(graft(item_63)), DispatchPattern=null_28.InvalidFlags)  # -> ListA, ListB
pln_76 = Plane(dispatch_91.ListB)
pln_77 = Plane(dispatch_91.ListA)
pt_55 = Point(dispatch_92.ListB)

# ----
# 可能的结构交点-大量
pln_78 = Plane(pln_77)

# ----
# 0 檐口出定位点
# 与结构无交点
pln_79 = Plane(flatten(pln_78))

crv_70 = Curve(shift_2)

# ----
# 按照梁分类定位点
pt_56 = Point(pt_55)
pln_80 = Plane(pln_76)
incurves_23 = PointInCurves(Point=flatten(pt_56), Curves=crv_70)  # -> Relationship, Index, Point
equals_25 = Equality(FirstNumber=incurves_23.Relationship, SecondNumber="0")  # -> Equality, Inequality
dispatch_93 = Dispatch(List=flatten(pln_80), DispatchPattern=equals_25.Inequality)  # -> ListA, ListB
data_61 = Data(dispatch_93.ListA)

incurves_24 = PointInCurves(Point=flatten(pt_56), Curves=crv_70)  # -> Relationship, Index, Point
equals_26 = Equality(FirstNumber=incurves_24.Relationship, SecondNumber="0")  # -> Equality, Inequality
dispatch_94 = Dispatch(List=flatten(pt_56), DispatchPattern=equals_26.Inequality)  # -> ListA, ListB
data_62 = Data(dispatch_94.ListA)

move2pt_19 = MoveToPoint(Geometry=data_61, PointA=data_61, PointB=data_62)  # -> Moved, Vector, Transform
null_29 = NullItem(Item=move2pt_19.Moved)  # -> NullFlags, InvalidFlags, Description
dispatch_95 = Dispatch(List=move2pt_19.Moved, DispatchPattern=null_29.InvalidFlags)  # -> ListA, ListB
pln_81 = Plane(dispatch_95.ListB)

# ----
# 3.1
# 下层建筑边线外侧50-350mm
# 03：钢板焊埋件[钢梁内侧]
# @钢边梁宽@钢边梁高
pln_82 = Plane(pln_81)

crv_71 = Curve(shift_2)

# ----
# 按照梁分类定位点
pt_57 = Point(pt_37)
pln_83 = Plane(pln_40)
incurves_25 = PointInCurves(Point=flatten(pt_57), Curves=crv_71)  # -> Relationship, Index, Point
equals_27 = Equality(FirstNumber=incurves_25.Relationship, SecondNumber="0")  # -> Equality, Inequality
dispatch_96 = Dispatch(List=flatten(pln_83), DispatchPattern=equals_27.Inequality)  # -> ListA, ListB
data_63 = Data(dispatch_96.ListA)

incurves_26 = PointInCurves(Point=flatten(pt_57), Curves=crv_71)  # -> Relationship, Index, Point
equals_28 = Equality(FirstNumber=incurves_26.Relationship, SecondNumber="0")  # -> Equality, Inequality
dispatch_97 = Dispatch(List=flatten(pt_57), DispatchPattern=equals_28.Inequality)  # -> ListA, ListB
data_64 = Data(dispatch_97.ListA)

move2pt_20 = MoveToPoint(Geometry=data_63, PointA=data_63, PointB=data_64)  # -> Moved, Vector, Transform
null_30 = NullItem(Item=move2pt_20.Moved)  # -> NullFlags, InvalidFlags, Description
dispatch_98 = Dispatch(List=move2pt_20.Moved, DispatchPattern=null_30.InvalidFlags)  # -> ListA, ListB
pln_84 = Plane(dispatch_98.ListB)

# ----
# 3.2
# 下层建筑边线内侧300-600mm范围
# 03：钢板焊埋件[钢梁外侧]
# @钢边梁宽@钢边梁高
pln_85 = Plane(pln_84)

# ----
# 3.1 Missing Point
# 埋件定位点Offset，没有找到和梁的交点
number_slider_49 = Slider(5000, range=0..10000)
deplane_26 = DeconstructPlane(Plane=pln_79)  # -> Origin, XAxis, YAxis, ZAxis
amp_32 = Amplitude(Vector=deplane_26.YAxis, Amplitude=number_slider_49)
crv_72 = Curve(scx_2.Curves)
move_38 = Move(Geometry=deplane_26.Origin, Motion=amp_32)  # -> Geometry, Transform
ln_30 = Line(StartPoint=move_38.Geometry, EndPoint=deplane_26.Origin)
amp_33 = Amplitude(Vector=deplane_26.XAxis, Amplitude=expr("-x", number_slider_7))
amp_34 = Amplitude(Vector=deplane_26.XAxis, Amplitude=number_slider_7)
move_39 = Move(Geometry=ln_30, Motion=amp_34)  # -> Geometry, Transform
move_40 = Move(Geometry=ln_30, Motion=amp_33)  # -> Geometry, Transform
pln_86 = Plane(pln_77)

ccx_22 = CurveCurve(CurveA=graft(move_40.Geometry), CurveB=flatten(crv_72))  # -> Points, ParamsA, ParamsB
shift_15 = ShiftPaths(Data=ccx_22.Points, Offset=-1)
sort_33 = SortList(Keys=shift_15, ValuesA=shift_15)  # -> Keys, ValuesA
pull_35 = PullPoint(Point=sort_33.ValuesA, Geometry=graft(pln_79), ClosestOnly=True)  # -> ClosestPoint, Distance
sort_34 = SortList(Keys=pull_35.Distance, ValuesA=sort_33.ValuesA)  # -> Keys, ValuesA
item_64 = ListItem(List=sort_34.ValuesA, Index="-1", Wrap=True)
null_31 = NullItem(Item=flatten(item_64))  # -> NullFlags, InvalidFlags, Description
dispatch_99 = Dispatch(List=flatten(item_64), DispatchPattern=null_31.InvalidFlags)  # -> ListA, ListB
dispatch_100 = Dispatch(List=pln_79, DispatchPattern=null_31.InvalidFlags)  # -> ListA, ListB
pt_58 = Point(dispatch_99.ListB)
pln_87 = Plane(dispatch_100.ListB)

ccx_23 = CurveCurve(CurveA=graft(move_39.Geometry), CurveB=flatten(crv_72))  # -> Points, ParamsA, ParamsB
shift_16 = ShiftPaths(Data=ccx_23.Points, Offset=-1)
sort_35 = SortList(Keys=shift_16, ValuesA=shift_16)  # -> Keys, ValuesA
pull_36 = PullPoint(Point=sort_35.ValuesA, Geometry=graft(pln_79), ClosestOnly=True)  # -> ClosestPoint, Distance
sort_36 = SortList(Keys=pull_36.Distance, ValuesA=sort_35.ValuesA)  # -> Keys, ValuesA
item_65 = ListItem(List=sort_36.ValuesA, Index="-1", Wrap=True)
null_32 = NullItem(Item=flatten(item_65))  # -> NullFlags, InvalidFlags, Description
dispatch_101 = Dispatch(List=flatten(item_65), DispatchPattern=null_32.InvalidFlags)  # -> ListA, ListB
dispatch_102 = Dispatch(List=pln_79, DispatchPattern=null_32.InvalidFlags)  # -> ListA, ListB
pln_88 = Plane(dispatch_102.ListB)
pt_59 = Point(dispatch_101.ListB)

merge_31 = Merge(Data1=pln_88, Data2=pln_87)  # -> flatten(Result)
check_same_points_6 = CheckSamePoints(archPoint=flatten(pln_86), crvPoint=merge_31)  # -> out, specialPt; inputs archPoint: list of Point3d, crvPoint: list of Point3d; same code as testpoint

# ----
# pass
cull_i_11 = CullIndex(List=flatten(pln_86), Indices=check_same_points_6.specialPt, Wrap=True)

# ----
# 按照梁分类定位点
pln_89 = Plane(pln_88)
pt_60 = Point(pt_59)
incurves_27 = PointInCurves(Point=flatten(pt_60), Curves=crv_58)  # -> Relationship, Index, Point
equals_29 = Equality(FirstNumber=incurves_27.Relationship, SecondNumber="0")  # -> Equality, Inequality
dispatch_103 = Dispatch(List=flatten(pln_89), DispatchPattern=equals_29.Inequality)  # -> ListA, ListB
data_65 = Data(dispatch_103.ListA)

# ----
# 按照梁分类定位点
pln_90 = Plane(pln_87)
pt_61 = Point(pt_58)
incurves_28 = PointInCurves(Point=flatten(pt_61), Curves=crv_58)  # -> Relationship, Index, Point
equals_30 = Equality(FirstNumber=incurves_28.Relationship, SecondNumber="0")  # -> Equality, Inequality
dispatch_104 = Dispatch(List=flatten(pln_90), DispatchPattern=equals_30.Inequality)  # -> ListA, ListB
data_66 = Data(dispatch_104.ListA)

incurves_29 = PointInCurves(Point=flatten(pt_61), Curves=crv_58)  # -> Relationship, Index, Point
equals_31 = Equality(FirstNumber=incurves_29.Relationship, SecondNumber="0")  # -> Equality, Inequality
dispatch_105 = Dispatch(List=flatten(pt_61), DispatchPattern=equals_31.Inequality)  # -> ListA, ListB
data_67 = Data(dispatch_105.ListA)

incurves_30 = PointInCurves(Point=flatten(pt_60), Curves=crv_58)  # -> Relationship, Index, Point
equals_32 = Equality(FirstNumber=incurves_30.Relationship, SecondNumber="0")  # -> Equality, Inequality
dispatch_106 = Dispatch(List=flatten(pt_60), DispatchPattern=equals_32.Inequality)  # -> ListA, ListB
data_68 = Data(dispatch_106.ListA)

move2pt_21 = MoveToPoint(Geometry=data_65, PointA=data_65, PointB=data_68)  # -> Moved, Vector, Transform
null_33 = NullItem(Item=move2pt_21.Moved)  # -> NullFlags, InvalidFlags, Description
dispatch_107 = Dispatch(List=move2pt_21.Moved, DispatchPattern=null_33.InvalidFlags)  # -> ListA, ListB
pln_91 = Plane(dispatch_107.ListB)

move2pt_22 = MoveToPoint(Geometry=data_66, PointA=data_66, PointB=data_67)  # -> Moved, Vector, Transform
null_34 = NullItem(Item=move2pt_22.Moved)  # -> NullFlags, InvalidFlags, Description
dispatch_108 = Dispatch(List=move2pt_22.Moved, DispatchPattern=null_34.InvalidFlags)  # -> ListA, ListB
pln_92 = Plane(dispatch_108.ListB)

# ----
# 撞到梁交点
merge_32 = Merge(Data1=pln_91, Data2=pln_92)

merge_33 = Merge(Data1=pln_82, Data2=merge_32)
orient_6 = Orient(Geometry=item_8, Source=rotate_2.Geometry, Target=merge_33)  # -> Geometry, Transform

data_69 = Data(orient_6.Geometry)
ungroup_7 = Ungroup(Group=data_69)
item_66 = ListItem(List=ungroup_7, Index=0, Wrap=True)  # -> flatten(Item)
item_67 = ListItem(List=ungroup_7, Index="-1", Wrap=True)  # -> flatten(Item)

entwine_16 = Entwine(Branch00=item_66, Branch01=item_67, FlattenInputs=True)
bake_6 = BakeObjects(Geometry=entwine_16, Attributes=attributes_6, BakeName="Embed::3-1-03钢板焊埋件", Bake=False)

# ----
# 3.2  Missing Point
# 埋件定位点Offset，没有找到和梁的交点
number_slider_50 = Slider(5000, range=0..10000)
crv_73 = Curve(scx.Curves)
deplane_27 = DeconstructPlane(Plane=pln_43)  # -> Origin, XAxis, YAxis, ZAxis
amp_35 = Amplitude(Vector=deplane_27.YAxis, Amplitude=number_slider_50)
move_41 = Move(Geometry=deplane_27.Origin, Motion=amp_35)  # -> Geometry, Transform
ln_31 = Line(StartPoint=move_41.Geometry, EndPoint=deplane_27.Origin)
amp_36 = Amplitude(Vector=deplane_27.XAxis, Amplitude=number_slider_7)
amp_37 = Amplitude(Vector=deplane_27.XAxis, Amplitude=expr("-x", number_slider_7))
move_42 = Move(Geometry=ln_31, Motion=amp_36)  # -> Geometry, Transform
move_43 = Move(Geometry=ln_31, Motion=amp_37)  # -> Geometry, Transform
pln_93 = Plane(pln_41)

ccx_24 = CurveCurve(CurveA=graft(move_43.Geometry), CurveB=flatten(crv_73))  # -> Points, ParamsA, ParamsB
shift_17 = ShiftPaths(Data=ccx_24.Points, Offset=-1)
sort_37 = SortList(Keys=shift_17, ValuesA=shift_17)  # -> Keys, ValuesA
pull_37 = PullPoint(Point=sort_37.ValuesA, Geometry=graft(pln_43), ClosestOnly=True)  # -> ClosestPoint, Distance
sort_38 = SortList(Keys=pull_37.Distance, ValuesA=sort_37.ValuesA)  # -> Keys, ValuesA
item_68 = ListItem(List=sort_38.ValuesA, Index="-1", Wrap=True)
null_35 = NullItem(Item=flatten(item_68))  # -> NullFlags, InvalidFlags, Description
dispatch_109 = Dispatch(List=flatten(item_68), DispatchPattern=null_35.InvalidFlags)  # -> ListA, ListB
dispatch_110 = Dispatch(List=pln_43, DispatchPattern=null_35.InvalidFlags)  # -> ListA, ListB
pt_62 = Point(dispatch_109.ListB)
pln_94 = Plane(dispatch_110.ListB)

ccx_25 = CurveCurve(CurveA=graft(move_42.Geometry), CurveB=flatten(crv_73))  # -> Points, ParamsA, ParamsB
shift_18 = ShiftPaths(Data=ccx_25.Points, Offset=-1)
sort_39 = SortList(Keys=shift_18, ValuesA=shift_18)  # -> Keys, ValuesA
pull_38 = PullPoint(Point=sort_39.ValuesA, Geometry=graft(pln_43), ClosestOnly=True)  # -> ClosestPoint, Distance
sort_40 = SortList(Keys=pull_38.Distance, ValuesA=sort_39.ValuesA)  # -> Keys, ValuesA
item_69 = ListItem(List=sort_40.ValuesA, Index="-1", Wrap=True)
null_36 = NullItem(Item=flatten(item_69))  # -> NullFlags, InvalidFlags, Description
dispatch_111 = Dispatch(List=flatten(item_69), DispatchPattern=null_36.InvalidFlags)  # -> ListA, ListB
dispatch_112 = Dispatch(List=pln_43, DispatchPattern=null_36.InvalidFlags)  # -> ListA, ListB
pln_95 = Plane(dispatch_112.ListB)
pt_63 = Point(dispatch_111.ListB)

merge_34 = Merge(Data1=pln_95, Data2=pln_94)  # -> flatten(Result)
check_same_points_7 = CheckSamePoints(archPoint=flatten(pln_93), crvPoint=merge_34)  # -> out, specialPt; inputs archPoint: list of Point3d, crvPoint: list of Point3d; same code as testpoint

# ----
# pass
cull_i_12 = CullIndex(List=flatten(pln_93), Indices=check_same_points_7.specialPt, Wrap=True)

# ----
# 按照梁分类定位点
pln_96 = Plane(pln_95)
pt_64 = Point(pt_63)
incurves_31 = PointInCurves(Point=flatten(pt_64), Curves=crv_59)  # -> Relationship, Index, Point
equals_33 = Equality(FirstNumber=incurves_31.Relationship, SecondNumber="0")  # -> Equality, Inequality
dispatch_113 = Dispatch(List=flatten(pln_96), DispatchPattern=equals_33.Inequality)  # -> ListA, ListB
data_70 = Data(dispatch_113.ListA)

# ----
# 按照梁分类定位点
pln_97 = Plane(pln_94)
pt_65 = Point(pt_62)
incurves_32 = PointInCurves(Point=flatten(pt_65), Curves=crv_59)  # -> Relationship, Index, Point
equals_34 = Equality(FirstNumber=incurves_32.Relationship, SecondNumber="0")  # -> Equality, Inequality
dispatch_114 = Dispatch(List=flatten(pln_97), DispatchPattern=equals_34.Inequality)  # -> ListA, ListB
data_71 = Data(dispatch_114.ListA)

incurves_33 = PointInCurves(Point=flatten(pt_65), Curves=crv_59)  # -> Relationship, Index, Point
equals_35 = Equality(FirstNumber=incurves_33.Relationship, SecondNumber="0")  # -> Equality, Inequality
dispatch_115 = Dispatch(List=flatten(pt_65), DispatchPattern=equals_35.Inequality)  # -> ListA, ListB
data_72 = Data(dispatch_115.ListA)

incurves_34 = PointInCurves(Point=flatten(pt_64), Curves=crv_59)  # -> Relationship, Index, Point
equals_36 = Equality(FirstNumber=incurves_34.Relationship, SecondNumber="0")  # -> Equality, Inequality
dispatch_116 = Dispatch(List=flatten(pt_64), DispatchPattern=equals_36.Inequality)  # -> ListA, ListB
data_73 = Data(dispatch_116.ListA)

move2pt_23 = MoveToPoint(Geometry=data_70, PointA=data_70, PointB=data_73)  # -> Moved, Vector, Transform
null_37 = NullItem(Item=move2pt_23.Moved)  # -> NullFlags, InvalidFlags, Description
dispatch_117 = Dispatch(List=move2pt_23.Moved, DispatchPattern=null_37.InvalidFlags)  # -> ListA, ListB
pln_98 = Plane(dispatch_117.ListB)

move2pt_24 = MoveToPoint(Geometry=data_71, PointA=data_71, PointB=data_72)  # -> Moved, Vector, Transform
null_38 = NullItem(Item=move2pt_24.Moved)  # -> NullFlags, InvalidFlags, Description
dispatch_118 = Dispatch(List=move2pt_24.Moved, DispatchPattern=null_38.InvalidFlags)  # -> ListA, ListB
pln_99 = Plane(dispatch_118.ListB)

# ----
# 撞到梁交点
merge_35 = Merge(Data1=pln_98, Data2=pln_99)

pln_100 = Plane(cull_i_11)
pln_101 = Plane(cull_i_12)

# ----
# 3.1下层建筑内侧到300到外侧50内是否有钢结构
deplane_28 = DeconstructPlane(Plane=pln_100)  # -> Origin, XAxis, YAxis, ZAxis
deplane_29 = DeconstructPlane(Plane=pln_101)  # -> Origin, XAxis, YAxis, ZAxis
check_same_points_8 = CheckSamePoints(archPoint=deplane_29.Origin, crvPoint=deplane_28.Origin)  # -> out, specialPt; inputs archPoint: list of Point3d, crvPoint: list of Point3d; same code as testpoint

merge_36 = Merge(Data1=pln_85, Data2=merge_35)
orient_7 = Orient(Geometry=item_10, Source=item_11, Target=merge_36)  # -> Geometry, Transform

data_74 = Data(orient_7.Geometry)
ungroup_8 = Ungroup(Group=data_74)
item_70 = ListItem(List=ungroup_8, Index=0, Wrap=True)  # -> flatten(Item)
item_71 = ListItem(List=ungroup_8, Index="-1", Wrap=True)  # -> flatten(Item)

entwine_17 = Entwine(Branch00=item_70, Branch01=item_71, FlattenInputs=True)
bake_7 = BakeObjects(Geometry=entwine_17, Attributes=attributes_7, BakeName="Embed::3-2-03钢板焊埋件", Bake=False)

# ----
# 同时满足N
item_72 = ListItem(List=pln_101, Index=check_same_points_8.specialPt, Wrap=True)

pln_102 = Plane(item_72)
flatten_7 = FlattenTree(Tree=crv_48, Path="{0}")
number_slider_51 = Slider(3584, range=0..10000)
deplane_30 = DeconstructPlane(Plane=pln_102)  # -> Origin, XAxis, YAxis, ZAxis
boundary_5 = BoundarySurfaces(Edges=[offset_9, offset_8])
crv_74 = Curve(flatten_7)
amp_38 = Amplitude(Vector=deplane_30.YAxis, Amplitude=number_slider_51)
amp_39 = Amplitude(Vector=deplane_30.YAxis, Amplitude=expr("-x", number_slider_51))
scx_3 = SurfaceCurve(Surface=boundary_5, Curve=crv_74)  # -> flatten(Curves), Points, UVPoints, Normals, Parameters, Tangents
move_44 = Move(Geometry=deplane_30.Origin, Motion=amp_39)  # -> Geometry, Transform
move_45 = Move(Geometry=deplane_30.Origin, Motion=amp_38)  # -> Geometry, Transform
ln_32 = Line(StartPoint=move_44.Geometry, EndPoint=move_45.Geometry)
ccx_26 = CurveCurve(CurveA=graft(ln_32), CurveB=scx_3.Curves)  # -> Points, ParamsA, ParamsB
shift_19 = ShiftPaths(Data=ccx_26.Points, Offset=-1)
pull_39 = PullPoint(Point=graft(pln_102), Geometry=shift_19, ClosestOnly=True)  # -> ClosestPoint, Distance
sort_41 = SortList(Keys=pull_39.Distance, ValuesA=pull_39.ClosestPoint)  # -> Keys, ValuesA
item_73 = ListItem(List=sort_41.ValuesA, Index=0, Wrap=True)
null_39 = NullItem(Item=sort_41.ValuesA)  # -> NullFlags, simplify(InvalidFlags), Description
dispatch_119 = Dispatch(List=simplify(graft(pln_102)), DispatchPattern=null_39.InvalidFlags)  # -> ListA, ListB
pln_103 = Plane(dispatch_119.ListB)
pln_104 = Plane(dispatch_119.ListA)

dispatch_120 = Dispatch(List=simplify(graft(item_73)), DispatchPattern=null_39.InvalidFlags)  # -> ListA, ListB
pt_66 = Point(dispatch_120.ListB)

# ----
# 按照梁分类定位点
pt_67 = Point(pt_66)
pln_105 = Plane(pln_103)
incurves_35 = PointInCurves(Point=flatten(pt_67), Curves=crv_60)  # -> Relationship, Index, Point
equals_37 = Equality(FirstNumber=incurves_35.Relationship, SecondNumber="0")  # -> Equality, Inequality
dispatch_121 = Dispatch(List=flatten(pln_105), DispatchPattern=equals_37.Inequality)  # -> ListA, ListB
data_75 = Data(dispatch_121.ListA)

incurves_36 = PointInCurves(Point=flatten(pt_67), Curves=crv_60)  # -> Relationship, Index, Point
equals_38 = Equality(FirstNumber=incurves_36.Relationship, SecondNumber="0")  # -> Equality, Inequality
dispatch_122 = Dispatch(List=flatten(pt_67), DispatchPattern=equals_38.Inequality)  # -> ListA, ListB
data_76 = Data(dispatch_122.ListA)

move2pt_25 = MoveToPoint(Geometry=data_75, PointA=data_75, PointB=data_76)  # -> Moved, Vector, Transform
null_40 = NullItem(Item=move2pt_25.Moved)  # -> NullFlags, InvalidFlags, Description
dispatch_123 = Dispatch(List=move2pt_25.Moved, DispatchPattern=null_40.InvalidFlags)  # -> ListA, ListB
pln_106 = Plane(dispatch_123.ListB)

# ----
# 可能的结构交点-大量
pln_107 = Plane(pln_104)

# ----
# 0 檐口出定位点
# 与结构无交点
pln_108 = Plane(flatten(pln_107))

# ----
# 4.1下层建筑内侧300到外侧50内
# 03底埋，钢板焊
pln_109 = Plane(pln_106)

# ----
# 4 Missing Point
# 埋件定位点Offset，没有找到和梁的交点
number_slider_52 = Slider(5000, range=0..10000)
deplane_31 = DeconstructPlane(Plane=pln_108)  # -> Origin, XAxis, YAxis, ZAxis
crv_75 = Curve(scx_3.Curves)
amp_40 = Amplitude(Vector=deplane_31.YAxis, Amplitude=number_slider_52)
move_46 = Move(Geometry=deplane_31.Origin, Motion=amp_40)  # -> Geometry, Transform
ln_33 = Line(StartPoint=move_46.Geometry, EndPoint=deplane_31.Origin)
amp_41 = Amplitude(Vector=deplane_31.XAxis, Amplitude=number_slider_7)
amp_42 = Amplitude(Vector=deplane_31.XAxis, Amplitude=expr("-x", number_slider_7))
move_47 = Move(Geometry=ln_33, Motion=amp_41)  # -> Geometry, Transform
move_48 = Move(Geometry=ln_33, Motion=amp_42)  # -> Geometry, Transform
pln_110 = Plane(pln_108)

ccx_27 = CurveCurve(CurveA=graft(move_48.Geometry), CurveB=flatten(crv_75))  # -> Points, ParamsA, ParamsB
shift_20 = ShiftPaths(Data=ccx_27.Points, Offset=-1)
sort_42 = SortList(Keys=shift_20, ValuesA=shift_20)  # -> Keys, ValuesA
pull_40 = PullPoint(Point=sort_42.ValuesA, Geometry=graft(pln_108), ClosestOnly=True)  # -> ClosestPoint, Distance
sort_43 = SortList(Keys=pull_40.Distance, ValuesA=sort_42.ValuesA)  # -> Keys, ValuesA
item_74 = ListItem(List=sort_43.ValuesA, Index="-1", Wrap=True)
null_41 = NullItem(Item=flatten(item_74))  # -> NullFlags, InvalidFlags, Description
dispatch_124 = Dispatch(List=flatten(item_74), DispatchPattern=null_41.InvalidFlags)  # -> ListA, ListB
dispatch_125 = Dispatch(List=pln_108, DispatchPattern=null_41.InvalidFlags)  # -> ListA, ListB
pln_111 = Plane(dispatch_125.ListB)
pt_68 = Point(dispatch_124.ListB)

ccx_28 = CurveCurve(CurveA=graft(move_47.Geometry), CurveB=flatten(crv_75))  # -> Points, ParamsA, ParamsB
shift_21 = ShiftPaths(Data=ccx_28.Points, Offset=-1)
sort_44 = SortList(Keys=shift_21, ValuesA=shift_21)  # -> Keys, ValuesA
pull_41 = PullPoint(Point=sort_44.ValuesA, Geometry=graft(pln_108), ClosestOnly=True)  # -> ClosestPoint, Distance
sort_45 = SortList(Keys=pull_41.Distance, ValuesA=sort_44.ValuesA)  # -> Keys, ValuesA
item_75 = ListItem(List=sort_45.ValuesA, Index="-1", Wrap=True)
null_42 = NullItem(Item=flatten(item_75))  # -> NullFlags, InvalidFlags, Description
dispatch_126 = Dispatch(List=pln_108, DispatchPattern=null_42.InvalidFlags)  # -> ListA, ListB
dispatch_127 = Dispatch(List=flatten(item_75), DispatchPattern=null_42.InvalidFlags)  # -> ListA, ListB
pt_69 = Point(dispatch_127.ListB)
pln_112 = Plane(dispatch_126.ListB)

merge_37 = Merge(Data1=pln_112, Data2=pln_111)  # -> flatten(Result)
check_same_points_9 = CheckSamePoints(archPoint=flatten(pln_110), crvPoint=merge_37)  # -> out, specialPt; inputs archPoint: list of Point3d, crvPoint: list of Point3d; same code as testpoint

# ----
# pass
cull_i_13 = CullIndex(List=flatten(pln_110), Indices=check_same_points_9.specialPt, Wrap=True)  # -> simplify(graft(List))

# ----
# 按照梁分类定位点
pln_113 = Plane(pln_112)
pt_70 = Point(pt_69)
incurves_37 = PointInCurves(Point=flatten(pt_70), Curves=crv_61)  # -> Relationship, Index, Point
equals_39 = Equality(FirstNumber=incurves_37.Relationship, SecondNumber="0")  # -> Equality, Inequality
dispatch_128 = Dispatch(List=flatten(pln_113), DispatchPattern=equals_39.Inequality)  # -> ListA, ListB
data_77 = Data(dispatch_128.ListA)

# ----
# 按照梁分类定位点
pln_114 = Plane(pln_111)
pt_71 = Point(pt_68)
incurves_38 = PointInCurves(Point=flatten(pt_71), Curves=crv_61)  # -> Relationship, Index, Point
equals_40 = Equality(FirstNumber=incurves_38.Relationship, SecondNumber="0")  # -> Equality, Inequality
dispatch_129 = Dispatch(List=flatten(pln_114), DispatchPattern=equals_40.Inequality)  # -> ListA, ListB
data_78 = Data(dispatch_129.ListA)

incurves_39 = PointInCurves(Point=flatten(pt_71), Curves=crv_61)  # -> Relationship, Index, Point
equals_41 = Equality(FirstNumber=incurves_39.Relationship, SecondNumber="0")  # -> Equality, Inequality
dispatch_130 = Dispatch(List=flatten(pt_71), DispatchPattern=equals_41.Inequality)  # -> ListA, ListB
data_79 = Data(dispatch_130.ListA)

incurves_40 = PointInCurves(Point=flatten(pt_70), Curves=crv_61)  # -> Relationship, Index, Point
equals_42 = Equality(FirstNumber=incurves_40.Relationship, SecondNumber="0")  # -> Equality, Inequality
dispatch_131 = Dispatch(List=flatten(pt_70), DispatchPattern=equals_42.Inequality)  # -> ListA, ListB
data_80 = Data(dispatch_131.ListA)

move2pt_26 = MoveToPoint(Geometry=data_77, PointA=data_77, PointB=data_80)  # -> Moved, Vector, Transform
null_43 = NullItem(Item=move2pt_26.Moved)  # -> NullFlags, InvalidFlags, Description
dispatch_132 = Dispatch(List=move2pt_26.Moved, DispatchPattern=null_43.InvalidFlags)  # -> ListA, ListB
pln_115 = Plane(dispatch_132.ListB)

move2pt_27 = MoveToPoint(Geometry=data_78, PointA=data_78, PointB=data_79)  # -> Moved, Vector, Transform
null_44 = NullItem(Item=move2pt_27.Moved)  # -> NullFlags, InvalidFlags, Description
dispatch_133 = Dispatch(List=move2pt_27.Moved, DispatchPattern=null_44.InvalidFlags)  # -> ListA, ListB
pln_116 = Plane(dispatch_133.ListB)

# ----
# 撞到梁交点
merge_38 = Merge(Data1=pln_115, Data2=pln_116)

merge_39 = Merge(Data1=flatten(pln_109), Data2=flatten(merge_38))
orient_8 = Orient(Geometry=item_19, Source=item_18, Target=merge_39)  # -> Geometry, Transform

data_81 = Data(orient_8.Geometry)
ungroup_9 = Ungroup(Group=data_81)
item_76 = ListItem(List=ungroup_9, Index=0, Wrap=True)  # -> flatten(Item)
item_77 = ListItem(List=ungroup_9, Index="-1", Wrap=True)  # -> flatten(Item)

entwine_18 = Entwine(Branch00=item_76, Branch01=item_77, FlattenInputs=True)
bake_8 = BakeObjects(Geometry=entwine_18, Attributes=attributes_8, BakeName="Embed::4-1钢板焊底埋", Bake=False)

# ----
# 5 上层建筑边线,
# 默认建筑提供上翻，如主结构提供示意则使用结构定位【该项目无】，
# 如无则使用建筑边线向内50mm作为埋件定位
# 筛选区域用什么input？？？
movetoplane_10 = MoveToPlane(Geometry=crv_3, Plane=PlaneXY(0, 0, 0), Above=True, Below=True)  # -> Geometry, Transform
movetoplane_11 = MoveToPlane(Geometry=pln_9, Plane=PlaneXY(0, 0, 0), Above=True, Below=True)  # -> Geometry, Transform
crv_76 = Curve(crv_17)
incurves_41 = PointInCurves(Point=movetoplane_11.Geometry, Curves=flatten(movetoplane_10.Geometry))  # -> Relationship, Index, Point
equals_43 = Equality(FirstNumber=incurves_41.Relationship, SecondNumber="2")  # -> Equality, Inequality
dispatch_134 = Dispatch(List=pln_9, DispatchPattern=equals_43.Equality)  # -> ListA, ListB
number_slider_53 = Slider(3584, range=0..10000)

# ---- group: Plane二次筛选
pln_117 = Plane(dispatch_134.ListA)

# ----
# 4.0下层建筑内侧到300到外侧50内
# 无钢结构
# 要求主体结构提供钢结构梁，默认位置为建筑边线向内300mm
number_slider_54 = Slider(300, range=0..1000)
crv_77 = Curve(crv_28)
pln_118 = Plane(cull_i_13)
offset_12 = OffsetCurve(Curve=crv_77, Distance=expr("-x", number_slider_54), Corners=1)
pull_42 = PullPoint(Point=pln_118, Geometry=offset_12, ClosestOnly=True)  # -> ClosestPoint, Distance
sort_46 = SortList(Keys=pull_42.Distance)  # -> Keys, ValuesA
larger_13 = LargerThan(FirstNumber=pull_42.Distance, SecondNumber=Slider(400, range=0..1000))  # -> LargerThan, OrEqualTo
panel_59 = Panel(sort_46.Keys)
number_slider_55 = Slider(3584, range=0..10000)

# ---- group: 删除反常线
dispatch_135 = Dispatch(List=pln_118, DispatchPattern=larger_13.LargerThan)  # -> ListA, ListB

# ----
pln_119 = Plane(flatten(dispatch_135.ListB))
deplane_32 = DeconstructPlane(Plane=pln_119)  # -> Origin, XAxis, YAxis, ZAxis
amp_43 = Amplitude(Vector=deplane_32.YAxis, Amplitude=number_slider_55)
amp_44 = Amplitude(Vector=deplane_32.YAxis, Amplitude=expr("-x", number_slider_55))
move_49 = Move(Geometry=deplane_32.Origin, Motion=amp_44)  # -> Geometry, Transform
move_50 = Move(Geometry=deplane_32.Origin, Motion=amp_43)  # -> Geometry, Transform
ln_34 = Line(StartPoint=move_49.Geometry, EndPoint=move_50.Geometry)
ccx_29 = CurveCurve(CurveA=ln_34, CurveB=offset_12)  # -> Points, ParamsA, ParamsB
flatten_8 = FlattenTree(Tree=ccx_29.Points, Path="{0}")
null_45 = NullItem(Item=simplify(ccx_29.Points))  # -> NullFlags, InvalidFlags, Description
dispatch_136 = Dispatch(List=simplify(graft(pln_119)), DispatchPattern=null_45.NullFlags)  # -> ListA, ListB

# ---- group: 有效点
pull_43 = PullPoint(Point=deplane_32.Origin, Geometry=flatten_8, ClosestOnly=True)  # -> ClosestPoint, Distance

# ----
# 可能的双点
pln_120 = Plane(dispatch_136.ListA)

# ----
# 离结构太远
pln_121 = Plane(dispatch_135.ListA)

merge_40 = Merge(Data1=pln_121, Data2=pln_120)

# ----
# 0 檐口出定位点
# 与结构无交点
pln_122 = Plane(flatten(merge_40))

# ----
# 4.0 默认位置为建筑边线向内300mm
# 侧埋，钢板焊
# 03：钢板焊埋件[钢梁外侧]@钢边梁宽@钢边梁高
move2pt_28 = MoveToPoint(Geometry=pln_119, PointA=deplane_32.Origin, PointB=pull_43.ClosestPoint)  # -> Moved, Vector, Transform

deplane_33 = DeconstructPlane(Plane=pln_117)  # -> Origin, XAxis, YAxis, ZAxis
amp_45 = Amplitude(Vector=deplane_33.YAxis, Amplitude=number_slider_53)
amp_46 = Amplitude(Vector=deplane_33.YAxis, Amplitude=expr("-x", number_slider_53))
move_51 = Move(Geometry=deplane_33.Origin, Motion=amp_46)  # -> Geometry, Transform
move_52 = Move(Geometry=deplane_33.Origin, Motion=amp_45)  # -> Geometry, Transform
ln_35 = Line(StartPoint=move_51.Geometry, EndPoint=move_52.Geometry)

offset_13 = OffsetCurve(Curve=crv_76, Distance=expr("-x", Slider(50, range=0..100)), Corners=1)
ccx_30 = CurveCurve(CurveA=ln_35, CurveB=offset_13)  # -> simplify(Points), ParamsA, ParamsB

ln_36 = Line(StartPoint=ccx_30.Points, EndPoint=simplify(graft(pln_117)))
len_8 = Length(Curve=ln_36)
null_46 = NullItem(Item=ccx_30.Points)  # -> NullFlags, InvalidFlags, Description
sort_47 = SortList(Keys=len_8, ValuesA=simplify(ccx_30.Points))  # -> Keys, ValuesA
dispatch_137 = Dispatch(List=simplify(graft(pln_117)), DispatchPattern=null_46.NullFlags)  # -> ListA, ListB
item_78 = ListItem(List=sort_47.ValuesA, Index=0, Wrap=True)

# ----
# 可能的双点
pln_123 = Plane(dispatch_137.ListA)

# ----
# 0 檐口出定位点
# 与结构无交点
pln_124 = Plane(flatten(pln_123))

# ----
# 5 上层建筑边线,
# 默认建筑提供上翻
# 04：板埋埋件[混凝土楼板上侧]
# @板埋参数xn
move2pt_29 = MoveToPoint(Geometry=simplify(graft(pln_117)), PointA=simplify(graft(pln_117)), PointB=item_78)  # -> flatten(Moved), Vector, Transform

# ----
# 5  Missing Point
# 埋件定位点Offset，没有找到和梁的交点
number_slider_56 = Slider(5000, range=0..10000)
deplane_34 = DeconstructPlane(Plane=pln_124)  # -> Origin, XAxis, YAxis, ZAxis
crv_78 = Curve(crv_76)
amp_47 = Amplitude(Vector=deplane_34.YAxis, Amplitude=number_slider_56)
move_53 = Move(Geometry=deplane_34.Origin, Motion=amp_47)  # -> Geometry, Transform
ln_37 = Line(StartPoint=move_53.Geometry, EndPoint=deplane_34.Origin)
amp_48 = Amplitude(Vector=deplane_34.XAxis, Amplitude=number_slider_7)
amp_49 = Amplitude(Vector=deplane_34.XAxis, Amplitude=expr("-x", number_slider_7))
move_54 = Move(Geometry=ln_37, Motion=amp_48)  # -> Geometry, Transform
move_55 = Move(Geometry=ln_37, Motion=amp_49)  # -> Geometry, Transform
pln_125 = Plane(pln_124)

ccx_31 = CurveCurve(CurveA=graft(move_55.Geometry), CurveB=flatten(crv_78))  # -> Points, ParamsA, ParamsB
shift_22 = ShiftPaths(Data=ccx_31.Points, Offset=-1)
sort_48 = SortList(Keys=shift_22, ValuesA=shift_22)  # -> Keys, ValuesA
pull_44 = PullPoint(Point=sort_48.ValuesA, Geometry=graft(pln_124), ClosestOnly=True)  # -> ClosestPoint, Distance
sort_49 = SortList(Keys=pull_44.Distance, ValuesA=sort_48.ValuesA)  # -> Keys, ValuesA
item_79 = ListItem(List=sort_49.ValuesA, Index="-1", Wrap=True)
null_47 = NullItem(Item=flatten(item_79))  # -> NullFlags, InvalidFlags, Description
dispatch_138 = Dispatch(List=simplify(item_79), DispatchPattern=simplify(graft(null_47.InvalidFlags)))  # -> ListA, ListB
dispatch_139 = Dispatch(List=pln_124, DispatchPattern=null_47.InvalidFlags)  # -> ListA, ListB
pln_126 = Plane(dispatch_139.ListB)
pt_72 = Point(dispatch_138.ListB)

ccx_32 = CurveCurve(CurveA=graft(move_54.Geometry), CurveB=flatten(crv_78))  # -> Points, ParamsA, ParamsB
shift_23 = ShiftPaths(Data=ccx_32.Points, Offset=-1)
sort_50 = SortList(Keys=shift_23, ValuesA=shift_23)  # -> Keys, ValuesA
pull_45 = PullPoint(Point=sort_50.ValuesA, Geometry=graft(pln_124), ClosestOnly=True)  # -> ClosestPoint, Distance
sort_51 = SortList(Keys=pull_45.Distance, ValuesA=sort_50.ValuesA)  # -> Keys, ValuesA
item_80 = ListItem(List=sort_51.ValuesA, Index="-1", Wrap=True)
null_48 = NullItem(Item=flatten(item_80))  # -> NullFlags, InvalidFlags, Description
dispatch_140 = Dispatch(List=simplify(item_80), DispatchPattern=simplify(graft(null_48.InvalidFlags)))  # -> ListA, ListB
dispatch_141 = Dispatch(List=pln_124, DispatchPattern=null_48.InvalidFlags)  # -> ListA, ListB
pln_127 = Plane(dispatch_141.ListB)
pt_73 = Point(dispatch_140.ListB)

merge_41 = Merge(Data1=pln_127, Data2=pln_126)  # -> flatten(Result)
check_same_points_10 = CheckSamePoints(archPoint=flatten(pln_125), crvPoint=merge_41)  # -> out, specialPt; inputs archPoint: list of Point3d, crvPoint: list of Point3d; same code as testpoint

# ----
# 撞到结构
move2pt_30 = MoveToPoint(Geometry=flatten(pln_127), PointA=flatten(pln_127), PointB=flatten(pt_73))  # -> Moved, Vector, Transform
move2pt_31 = MoveToPoint(Geometry=flatten(pln_126), PointA=flatten(pln_126), PointB=flatten(pt_72))  # -> Moved, Vector, Transform

# ----
# pass
cull_i_14 = CullIndex(List=flatten(pln_125), Indices=check_same_points_10.specialPt, Wrap=True)  # -> simplify(graft(List))

# ----
# 撞到梁交点
merge_42 = Merge(Data1=move2pt_30.Moved, Data2=move2pt_31.Moved)

merge_43 = Merge(Data1=move2pt_29.Moved, Data2=merge_42)

# ---- group: All Location Point
merge_44 = Merge(Data1=merge_22, Data2=merge_27, Data3=merge_43)

# ----
orient_9 = Orient(Geometry=item_35, Source=item_36, Target=merge_43)  # -> Geometry, Transform

data_82 = Data(orient_9.Geometry)
ungroup_10 = Ungroup(Group=data_82)
item_81 = ListItem(List=ungroup_10, Index=0, Wrap=True)  # -> flatten(Item)
item_82 = ListItem(List=ungroup_10, Index="-1", Wrap=True)  # -> flatten(Item)

entwine_19 = Entwine(Branch00=item_81, Branch01=item_82, FlattenInputs=True)
bake_9 = BakeObjects(Geometry=entwine_19, Attributes=attributes_9, BakeName="Embed::5-04板埋", Bake=False)

null_49 = NullItem(Item=merge_44)  # -> NullFlags, InvalidFlags, Description
dispatch_142 = Dispatch(List=merge_44, DispatchPattern=null_49.InvalidFlags)  # -> ListA, ListB

# ---- group: 下层图纸-标注定位点
pt_74 = Point(dispatch_142.ListB)

# ----
cluster_4 = Cluster_2(
    outline_curve=标准范围_符合单一轴网方向_2,
    dim_offset_1=number_slider_20,
    dim_offset_2=number_slider_19,
    axis_direction_crv1=crv_7,
    axis_direction_crv2=crv_8,
    f2_arch_outline=crv_37,
    location_point=pt_74,
    dim_style=panel_25,
    directed_outline=seam_2,
    移除重复位置点_容差=number_slider_17)  # -> D_3, D_4, D, D_2
dimension1 = Data(cluster_4.D_3)

# ---- group: Dimension2
data_83 = Data(cluster_4.D_4)

# ---- group: Dimension4
data_84 = Data(cluster_4.D_2)

# ---- group: Dimension3
data_85 = Data(cluster_4.D)

# ----
entwine_20 = Entwine(Branch00=dimension1, Branch01=data_83, Branch02=data_85, Branch03=data_84, FlattenInputs=True)

# ---- group: Refrash Data
# 将所有Input都输入完后要Refresh data
dam = DataDam(DataA=entwine_20, BufferDelay=10000000, BufferMode=0)

# ----
dedim = DeconstructDimension(DimensionObject=dam)  # -> Value, Text, Plane, Points, Style
shift_24 = ShiftPaths(Data=dedim.Text, Offset=-1)
smaller_8 = SmallerThan(FirstNumber=shift_24, SecondNumber=Slider(1, range=0..10))  # -> SmallerThan, OrEqualTo
dispatch_143 = Dispatch(List=dam, DispatchPattern=smaller_8.SmallerThan)  # -> ListA, ListB

# ---- group: Bake Me
bake_10 = BakeObjects(Geometry=dispatch_143.ListB, Attributes=attributes_12, Bake=False)

# ----
data_86 = Data(dispatch_143.ListB)

# ----
# 4.0  Missing Point
# 埋件定位点Offset，没有找到和梁的交点
number_slider_57 = Slider(5000, range=0..10000)
deplane_35 = DeconstructPlane(Plane=pln_122)  # -> Origin, XAxis, YAxis, ZAxis
crv_79 = Curve(scx_3.Curves)
amp_50 = Amplitude(Vector=deplane_35.YAxis, Amplitude=number_slider_57)
move_56 = Move(Geometry=deplane_35.Origin, Motion=amp_50)  # -> Geometry, Transform
ln_38 = Line(StartPoint=move_56.Geometry, EndPoint=deplane_35.Origin)
amp_51 = Amplitude(Vector=deplane_35.XAxis, Amplitude=number_slider_7)
amp_52 = Amplitude(Vector=deplane_35.XAxis, Amplitude=expr("-x", number_slider_7))
move_57 = Move(Geometry=ln_38, Motion=amp_51)  # -> Geometry, Transform
move_58 = Move(Geometry=ln_38, Motion=amp_52)  # -> Geometry, Transform
pln_128 = Plane(pln_122)

ccx_33 = CurveCurve(CurveA=graft(move_58.Geometry), CurveB=flatten(crv_79))  # -> Points, ParamsA, ParamsB
shift_25 = ShiftPaths(Data=ccx_33.Points, Offset=-1)
sort_52 = SortList(Keys=shift_25, ValuesA=shift_25)  # -> Keys, ValuesA
pull_46 = PullPoint(Point=sort_52.ValuesA, Geometry=graft(pln_122), ClosestOnly=True)  # -> ClosestPoint, Distance
sort_53 = SortList(Keys=pull_46.Distance, ValuesA=sort_52.ValuesA)  # -> Keys, ValuesA
item_83 = ListItem(List=sort_53.ValuesA, Index="-1", Wrap=True)
null_50 = NullItem(Item=flatten(item_83))  # -> NullFlags, InvalidFlags, Description
dispatch_144 = Dispatch(List=simplify(item_83), DispatchPattern=simplify(graft(null_50.InvalidFlags)))  # -> ListA, ListB
dispatch_145 = Dispatch(List=pln_122, DispatchPattern=null_50.InvalidFlags)  # -> ListA, ListB
pln_129 = Plane(dispatch_145.ListB)
pt_75 = Point(dispatch_144.ListB)

ccx_34 = CurveCurve(CurveA=graft(move_57.Geometry), CurveB=flatten(crv_79))  # -> Points, ParamsA, ParamsB
shift_26 = ShiftPaths(Data=ccx_34.Points, Offset=-1)
sort_54 = SortList(Keys=shift_26, ValuesA=shift_26)  # -> Keys, ValuesA
pull_47 = PullPoint(Point=sort_54.ValuesA, Geometry=graft(pln_122), ClosestOnly=True)  # -> ClosestPoint, Distance
sort_55 = SortList(Keys=pull_47.Distance, ValuesA=sort_54.ValuesA)  # -> Keys, ValuesA
item_84 = ListItem(List=sort_55.ValuesA, Index="-1", Wrap=True)
null_51 = NullItem(Item=flatten(item_84))  # -> NullFlags, InvalidFlags, Description
dispatch_146 = Dispatch(List=simplify(item_84), DispatchPattern=simplify(graft(null_51.InvalidFlags)))  # -> ListA, ListB
dispatch_147 = Dispatch(List=pln_122, DispatchPattern=null_51.InvalidFlags)  # -> ListA, ListB
pln_130 = Plane(dispatch_147.ListB)
pt_76 = Point(dispatch_146.ListB)

merge_45 = Merge(Data1=pln_130, Data2=pln_129)  # -> flatten(Result)
check_same_points_11 = CheckSamePoints(archPoint=flatten(pln_128), crvPoint=merge_45)  # -> out, specialPt; inputs archPoint: list of Point3d, crvPoint: list of Point3d; same code as testpoint

# ----
# 撞到结构
move2pt_32 = MoveToPoint(Geometry=flatten(pln_130), PointA=flatten(pln_130), PointB=flatten(pt_76))  # -> Moved, Vector, Transform
move2pt_33 = MoveToPoint(Geometry=flatten(pln_129), PointA=flatten(pln_129), PointB=flatten(pt_75))  # -> Moved, Vector, Transform

# ----
# pass
cull_i_15 = CullIndex(List=flatten(pln_128), Indices=check_same_points_11.specialPt, Wrap=True)  # -> simplify(graft(List))

# ----
# 撞到梁交点
merge_46 = Merge(Data1=move2pt_32.Moved, Data2=move2pt_33.Moved)

merge_47 = Merge(Data1=move2pt_28.Moved, Data2=merge_46)

# ---- group: All Location Point
merge_48 = Merge(Data1=merge_30, Data2=merge_33, Data3=merge_36, Data4=merge_39, Data5=merge_47)

# ----
orient_10 = Orient(Geometry=item_12, Source=item_13, Target=merge_47)  # -> Geometry, Transform

data_87 = Data(orient_10.Geometry)
ungroup_11 = Ungroup(Group=data_87)
item_85 = ListItem(List=ungroup_11, Index=0, Wrap=True)  # -> flatten(Item)
item_86 = ListItem(List=ungroup_11, Index="-1", Wrap=True)  # -> flatten(Item)

entwine_21 = Entwine(Branch00=item_85, Branch01=item_86, FlattenInputs=True)
bake_11 = BakeObjects(Geometry=entwine_21, Attributes=attributes_10, BakeName="Embed::4-0-03默认钢板焊", Bake=False)

null_52 = NullItem(Item=merge_48)  # -> NullFlags, InvalidFlags, Description
dispatch_148 = Dispatch(List=merge_48, DispatchPattern=null_52.InvalidFlags)  # -> ListA, ListB

# ---- group: 下层图纸-标注定位点
pt_77 = Point(dispatch_148.ListB)

# ----
cluster_5 = Cluster_2(
    outline_curve=标准范围_符合单一轴网方向,
    dim_offset_1=number_slider_16,
    dim_offset_2=number_slider_14,
    axis_direction_crv1=crv_4,
    axis_direction_crv2=crv_5,
    f2_arch_outline=crv_36,
    location_point=pt_77,
    dim_style=panel_24,
    directed_outline=seam,
    移除重复位置点_容差=number_slider_15)  # -> D_3, D_4, D, D_2
dimension1_2 = Data(cluster_5.D_3)

# ---- group: Dimension2
data_88 = Data(cluster_5.D_4)

# ---- group: Dimension4
data_89 = Data(cluster_5.D_2)

# ---- group: Dimension3
data_90 = Data(cluster_5.D)

# ----
entwine_22 = Entwine(Branch00=dimension1_2, Branch01=data_88, Branch02=data_90, Branch03=data_89, FlattenInputs=True)

# ---- group: Refrash Data
# 将所有Input都输入完后要Refresh data
dam_2 = DataDam(DataA=entwine_22, BufferDelay=10000000, BufferMode=0)

# ----
dedim_2 = DeconstructDimension(DimensionObject=dam_2)  # -> Value, Text, Plane, Points, Style
shift_27 = ShiftPaths(Data=dedim_2.Text, Offset=-1)
smaller_9 = SmallerThan(FirstNumber=shift_27, SecondNumber=Slider(1, range=0..10))  # -> SmallerThan, OrEqualTo
dispatch_149 = Dispatch(List=dam_2, DispatchPattern=smaller_9.SmallerThan)  # -> ListA, ListB

# ---- group: Bake Me
bake_12 = BakeObjects(Geometry=dispatch_149.ListB, Attributes=attributes_11, Bake=False)

# ----
data_91 = Data(dispatch_149.ListB)

crv_80 = Curve(project_7.Geometry)
crv_81 = Curve([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])
merge_49 = Merge(Data1=crv_80, Data2=crv_81)  # -> flatten(Result)

# ----
# curve
crv_82 = Curve(merge_49)

angle = Angle(VectorA=crv_82, VectorB="1,0,0")  # -> Angle, Reflex
deg_4 = Degrees(Radians=angle.Angle)
number_2 = NumberGroups(Number=deg_4, Difference="0.2")  # -> Groups, Indices
item_87 = ListItem(List=crv_82, Index=number_2.Indices, Wrap=True)  # -> simplify(Item)
panel_60 = Panel(number_2.Groups)
item_88 = ListItem(List=item_87, Index=0, Wrap=True)  # -> flatten(Item)
item_89 = ListItem(List=item_87, Index=0, Wrap=True)
bang_3 = ExplodeTree(Data=item_87)  # -> Branch0, Branch1, Branch2, Branch3, Branch4, Branch5
crv_83 = Curve(bang_3.Branch0)
crv_84 = Curve(bang_3.Branch1)
crv_85 = Curve(bang_3.Branch2)
crv_86 = Curve(bang_3.Branch3)
angle_2 = Angle(VectorA=item_89, VectorB=item_88)  # -> Angle, Reflex
deg_5 = Degrees(Radians=angle_2.Angle)
round_3 = Round(Number=deg_5, DecimalPlace="0")  # -> Nearest, Floor, Ceiling
equals_44 = Equality(FirstNumber=round_3.Nearest, SecondNumber="90")  # -> Equality, Inequality
panel_61 = Panel(round_3.Nearest)
dispatch_150 = Dispatch(List=item_88, DispatchPattern=equals_44.Equality)  # -> ListA, ListB
crv_87 = Curve(flatten(dispatch_150.ListA))
index = ItemIndex(List=item_88, Item=crv_87)
concat_4 = Concatenate(FragmentA="{", FragmentB=index)
concat_5 = Concatenate(FragmentA=concat_4, FragmentB="}")
tstat_4 = TreeStatistics(Tree=item_87)  # -> Paths, Length, Count
item_90 = ListItem(List=tstat_4.Paths, Index=0, Wrap=True)  # -> Item, Item1
item_91 = ListItem(List=concat_5, Index=0, Wrap=True)
# Sort Text
branch_2 = TreeBranch(Tree=item_87, Path=item_90.Item, MaintainPaths=True)
branch_3 = TreeBranch(Tree=item_87, Path=item_91, MaintainPaths=True)

# ==== cluster Cluster
G = ClusterInput()
rotate = Rotate(Geometry=G, Angle=3.141592654, Plane=PlaneXY(0, 0, 0))  # -> Geometry, Transform
boxprop = BoxProperties(Box=rotate.Geometry)  # -> Center, Diagonal, Area, Volume, Degeneracy
bbox = BoundingBox(Content=rotate.Geometry, Plane=PlaneXY(0, 0, 0))  # -> Box, Box_2
debox = DeconstructBox(Box=bbox.Box)  # -> Plane, X, Y, Z
pdecon = Deconstruct(Point=boxprop.Center)  # -> XComponent, YComponent, ZComponent
dedomain = DeconstructDomain(Domain=debox.Y)  # -> Start, End
pt = ConstructPoint(XCoordinate=pdecon.XComponent, YCoordinate=dedomain.Start, ZCoordinate=pdecon.ZComponent)
xy = XYPlane(Origin=Point(0, 0, 0))
pl_origin = PlaneOrigin(Base=xy, Origin=pt)
orient = Orient(Geometry=rotate.Geometry, Source=pl_origin, Target=xy)  # -> Geometry, Transform
G_2 = ClusterOutput(orient.Geometry)

# ==== cluster Cluster_2
f2_arch_outline = ClusterInput()
directed_outline = ClusterInput()
location_point = ClusterInput()
移除重复位置点_容差 = ClusterInput()
dim_offset_1 = ClusterInput()
dim_offset_2 = ClusterInput()
axis_direction_crv1 = ClusterInput()
axis_direction_crv2 = ClusterInput()
dim_style = ClusterInput()
outline_curve = ClusterInput()
pt = Point(location_point)
merge = Merge(Data1=axis_direction_crv1, Data2=axis_direction_crv2)
crv = Curve(f2_arch_outline)
number_slider = Slider(61, range=0..100)

incurve = PointInCurve(Point=flatten(pt), Curve=outline_curve)  # -> Relationship, Point
equals = Equality(FirstNumber=incurve.Relationship, SecondNumber="0")  # -> Equality, Inequality
dispatch = Dispatch(List=flatten(pt), DispatchPattern=equals.Inequality)  # -> ListA, ListB
pt_2 = Point(dispatch.ListA)
crv_cp = CurveClosestPoint(Point=pt_2, Curve=directed_outline)  # -> Point, Parameter, Distance
sort = SortList(Keys=crv_cp.Parameter, ValuesA=pt_2)  # -> Keys, ValuesA
pt_3 = Point(sort.ValuesA)
item = ListItem(List=merge, Index=0, Wrap=True)  # -> Item, Item1

# ----
# remove重复定位点生成的2个点
pt_4 = Point(pt_3)
shift = ShiftList(List=pt_4, Shift=1, Wrap=invert(True))
pt_5 = Point(pt_3)
pt_6 = Point(shift)
dist = Distance(PointA=pt_5, PointB=pt_6)
larger = LargerThan(FirstNumber=dist, SecondNumber=移除重复位置点_容差)  # -> LargerThan, OrEqualTo
dispatch_2 = Dispatch(List=pt_5, DispatchPattern=larger.LargerThan)  # -> ListA, ListB
pt_7 = Point(dispatch_2.ListA)
pt_8 = Point(dispatch_2.ListB)

dispatch_3 = Dispatch(List=pt_7, DispatchPattern=[True, False])  # -> ListA, ListB
pt_9 = Point(dispatch_3.ListB)
pt_10 = Point(dispatch_3.ListA)
pl = ConstructPlane(Origin=pt_10, XAxis=item.Item1, YAxis=item.Item)
pl_2 = ConstructPlane(Origin=pt_10, XAxis=item.Item, YAxis=item.Item1)

item_2 = ListItem(List=pt_7, Index=number_slider, Wrap=True)
shift_2 = ShiftList(List=pt_7, Shift=1, Wrap=invert(True))
item_3 = ListItem(List=shift_2, Index=number_slider, Wrap=True)

dispatch_4 = Dispatch(List=shift_2, DispatchPattern=[True, False])  # -> ListA, ListB
item_4 = ListItem(List=merge, Index=0, Wrap=True)  # -> Item, Item1
pt_11 = Point(dispatch_4.ListB)
pt_12 = Point(dispatch_4.ListA)
pl_3 = ConstructPlane(Origin=pt_12, XAxis=item_4.Item1, YAxis=item_4.Item)
pl_4 = ConstructPlane(Origin=pt_12, XAxis=item_4.Item, YAxis=item_4.Item1)

ln = Line(StartPoint=pt_10, EndPoint=pt_9)
ln_2 = Line(StartPoint=pt_12, EndPoint=pt_11)

crv_2 = Curve(crv)
deplane = DeconstructPlane(Plane=pl_3)  # -> Origin, XAxis, YAxis, ZAxis
amp = Amplitude(Vector=deplane.YAxis, Amplitude=Slider(3000, range=0..10000))
move = Move(Geometry=deplane.Origin, Motion=amp)  # -> Geometry, Transform
clscrv = CloseCurve(Curve=crv_2, CloseType=0, Bulge=0.5, Tolerance=0)  # -> Closed, R
pt_13 = Point(move.Geometry)
incurve_2 = PointInCurve(Point=pt_13, Curve=clscrv.Closed)  # -> Relationship, Point
equals_2 = Equality(FirstNumber=incurve_2.Relationship, SecondNumber="2")  # -> Equality, Inequality
lng = ListLength(List=equals_2.Equality)
lng_2 = ListLength(List=equals_2.Equality)
neg = Negative(Value=dim_offset_1)
repeat = RepeatData(Data=graft(neg), Length=lng)
repeat_2 = RepeatData(Data=graft(dim_offset_1), Length=lng_2)
panel = Panel(equals_2.Equality)
dispatch_5 = Dispatch(List=graft(repeat_2), DispatchPattern=graft(equals_2.Equality))  # -> ListA, ListB
dispatch_6 = Dispatch(List=graft(repeat), DispatchPattern=graft(equals_2.Equality))  # -> ListA, ListB
merge_2 = Merge(Data1=dispatch_5.ListA, Data2=dispatch_6.ListB)  # -> flatten(Result)

crv_3 = Curve(crv)
deplane_2 = DeconstructPlane(Plane=pl_4)  # -> Origin, XAxis, YAxis, ZAxis
amp_2 = Amplitude(Vector=deplane_2.YAxis, Amplitude=Slider(3000, range=0..10000))
move_2 = Move(Geometry=deplane_2.Origin, Motion=amp_2)  # -> Geometry, Transform
clscrv_2 = CloseCurve(Curve=crv_3, CloseType=0, Bulge=0.5, Tolerance=0)  # -> Closed, R
pt_14 = Point(move_2.Geometry)
incurve_3 = PointInCurve(Point=pt_14, Curve=clscrv_2.Closed)  # -> Relationship, Point
equals_3 = Equality(FirstNumber=incurve_3.Relationship, SecondNumber="2")  # -> Equality, Inequality
lng_3 = ListLength(List=equals_3.Equality)
neg_2 = Negative(Value=dim_offset_1)
lng_4 = ListLength(List=equals_3.Equality)
repeat_3 = RepeatData(Data=graft(neg_2), Length=lng_4)
repeat_4 = RepeatData(Data=graft(dim_offset_1), Length=lng_3)
panel_2 = Panel(equals_3.Equality)
dispatch_7 = Dispatch(List=graft(repeat_4), DispatchPattern=graft(equals_3.Equality))  # -> ListA, ListB
dispatch_8 = Dispatch(List=graft(repeat_3), DispatchPattern=graft(equals_3.Equality))  # -> ListA, ListB
merge_3 = Merge(Data1=dispatch_7.ListA, Data2=dispatch_8.ListB)  # -> flatten(Result)

crv_4 = Curve(crv)
deplane_3 = DeconstructPlane(Plane=pl)  # -> Origin, XAxis, YAxis, ZAxis
amp_3 = Amplitude(Vector=deplane_3.YAxis, Amplitude=Slider(3000, range=0..10000))
move_3 = Move(Geometry=deplane_3.Origin, Motion=amp_3)  # -> Geometry, Transform
clscrv_3 = CloseCurve(Curve=crv_4, CloseType=0, Bulge=0.5, Tolerance=0)  # -> Closed, R
pt_15 = Point(move_3.Geometry)
incurve_4 = PointInCurve(Point=pt_15, Curve=clscrv_3.Closed)  # -> Relationship, Point
equals_4 = Equality(FirstNumber=incurve_4.Relationship, SecondNumber="2")  # -> Equality, Inequality
lng_5 = ListLength(List=equals_4.Equality)
neg_3 = Negative(Value=dim_offset_2)
lng_6 = ListLength(List=equals_4.Equality)
repeat_5 = RepeatData(Data=graft(neg_3), Length=lng_6)
repeat_6 = RepeatData(Data=graft(dim_offset_2), Length=lng_5)
panel_3 = Panel(equals_4.Equality)
dispatch_9 = Dispatch(List=graft(repeat_6), DispatchPattern=graft(equals_4.Equality))  # -> ListA, ListB
dispatch_10 = Dispatch(List=graft(repeat_5), DispatchPattern=graft(equals_4.Equality))  # -> ListA, ListB
merge_4 = Merge(Data1=dispatch_9.ListA, Data2=dispatch_10.ListB)  # -> flatten(Result)

crv_5 = Curve(crv)
deplane_4 = DeconstructPlane(Plane=pl_2)  # -> Origin, XAxis, YAxis, ZAxis
amp_4 = Amplitude(Vector=deplane_4.YAxis, Amplitude=Slider(3000, range=0..10000))
move_4 = Move(Geometry=deplane_4.Origin, Motion=amp_4)  # -> Geometry, Transform
clscrv_4 = CloseCurve(Curve=crv_5, CloseType=0, Bulge=0.5, Tolerance=0)  # -> Closed, R
pt_16 = Point(move_4.Geometry)
incurve_5 = PointInCurve(Point=pt_16, Curve=clscrv_4.Closed)  # -> Relationship, Point
equals_5 = Equality(FirstNumber=incurve_5.Relationship, SecondNumber="2")  # -> Equality, Inequality
lng_7 = ListLength(List=equals_5.Equality)
neg_4 = Negative(Value=dim_offset_2)
lng_8 = ListLength(List=equals_5.Equality)
repeat_7 = RepeatData(Data=graft(neg_4), Length=lng_8)
repeat_8 = RepeatData(Data=graft(dim_offset_2), Length=lng_7)
panel_4 = Panel(equals_5.Equality)
dispatch_11 = Dispatch(List=graft(repeat_8), DispatchPattern=graft(equals_5.Equality))  # -> ListA, ListB
dispatch_12 = Dispatch(List=graft(repeat_7), DispatchPattern=graft(equals_5.Equality))  # -> ListA, ListB
merge_5 = Merge(Data1=dispatch_11.ListA, Data2=dispatch_12.ListB)  # -> flatten(Result)

lineardim = DefineLinearDimension(
    Point1=simplify(pt_12),
    Point2=simplify(pt_11),
    DimensionPlane=simplify(pl_3),
    Offset=expr("-x", merge_2),
    DimensionStyle=dim_style)
lineardim_2 = DefineLinearDimension(
    Point1=simplify(pt_12),
    Point2=simplify(pt_11),
    DimensionPlane=simplify(pl_4),
    Offset=expr("-x", merge_3),
    DimensionStyle=dim_style)
lineardim_3 = DefineLinearDimension(
    Point1=simplify(pt_10),
    Point2=simplify(pt_9),
    DimensionPlane=simplify(pl),
    Offset=expr("-x", merge_4),
    DimensionStyle=dim_style)
lineardim_4 = DefineLinearDimension(
    Point1=simplify(pt_10),
    Point2=simplify(pt_9),
    DimensionPlane=simplify(pl_2),
    Offset=expr("-x", merge_5),
    DimensionStyle=dim_style)
D = ClusterOutput(lineardim)
D_2 = ClusterOutput(lineardim_2)
D_3 = ClusterOutput(lineardim_3)
D_4 = ClusterOutput(lineardim_4)

# ==== cluster Cluster_3
structure_number = ClusterInput()
tag_text = ClusterInput()
text_offset = ClusterInput()
embed_color = ClusterInput()
T = ClusterInput()
G = ClusterInput()
A = ClusterInput()
A_2 = ClusterInput()
B = ClusterInput()
dimension_style = ClusterInput()

# ----
# 列表文字以空格进行分割
panel = Panel(" ")
split = TextSplit(Text=T, Separators=panel)

钢埋板长度_2 = Division(A=A, B=2)
neg = Negative(Value=钢埋板长度_2)
dom = ConstructDomain(DomainStart=neg, DomainEnd=钢埋板长度_2)
panel_2 = Panel(dom)

钢埋板厚度_2 = Division(A=A_2, B=2)
neg_2 = Negative(Value=钢埋板厚度_2)
dom_2 = ConstructDomain(DomainStart=neg_2, DomainEnd=钢埋板厚度_2)
panel_3 = Panel(dom_2)

# ----
# 钢埋板肋板位置 1/4处
panel_4 = Panel("4")
division = Division(A=A, B=panel_4)

# ----
# 编号和截面尺寸分区
panel_5 = Panel("1")
split_2 = SplitList(List=split, Index=panel_5)  # -> flatten(ListA), flatten(ListB)

# ----
# 求出对应输入编号的钢结构截面尺寸
fsim = FindSimilarMember(Data=structure_number, Set=split_2.ListA)  # -> Hit, Index
item = ListItem(List=split_2.ListB, Index=fsim.Index, Wrap=True)

addition = Addition(A=neg_2, B=division)
addition_2 = Addition(A=钢埋板厚度_2, B=division)
dom_3 = ConstructDomain(DomainStart=addition, DomainEnd=addition_2)
panel_6 = Panel(split_2.ListB)
split_3 = TextSplit(Text=item, Separators="x")
split_4 = TextSplit(Text=split_3, Separators="Q")
item_2 = ListItem(List=split_4, Index="0", Wrap=True)  # -> flatten(Item)
subtraction = Subtraction(A=division, B=钢埋板厚度_2)
subtraction_2 = Subtraction(A=division, B=钢埋板厚度_2)
subtraction_3 = Subtraction(A=division, B=钢埋板厚度_2)
neg_3 = Negative(Value=钢埋板厚度_2)
neg_4 = Negative(Value=钢埋板厚度_2)
neg_5 = Negative(Value=钢埋板厚度_2)
subtraction_4 = Subtraction(A=division, B=钢埋板厚度_2)
addition_3 = Addition(A=subtraction, B=A_2)
addition_4 = Addition(A=subtraction_2, B=A_2)
subtraction_5 = Subtraction(A=neg_3, B=A_2)
subtraction_6 = Subtraction(A=neg_4, B="2")
subtraction_7 = Subtraction(A=division, B=钢埋板厚度_2)
addition_5 = Addition(A=subtraction_3, B="2")
subtraction_8 = Subtraction(A=neg_5, B="2")
neg_6 = Negative(Value=钢埋板厚度_2)
neg_7 = Negative(Value=钢埋板厚度_2)
工字钢_h = ListItem(List=item_2, Index=0, Wrap=True)
工字钢_b = ListItem(List=item_2, Index=1, Wrap=True)
工字钢_tf = ListItem(List=item_2, Index=3, Wrap=True)
工字钢_tw = ListItem(List=item_2, Index=2, Wrap=True)
pt = ConstructPoint(XCoordinate=neg_6, YCoordinate=subtraction_4, ZCoordinate=0)
pt_2 = ConstructPoint(XCoordinate=neg_7, YCoordinate=addition_3, ZCoordinate=0)
pt_3 = ConstructPoint(XCoordinate=subtraction_5, YCoordinate=addition_4, ZCoordinate=0)
pt_4 = ConstructPoint(XCoordinate=subtraction_6, YCoordinate=subtraction_7, ZCoordinate=0)
pt_5 = ConstructPoint(XCoordinate=subtraction_8, YCoordinate=addition_5, ZCoordinate=0)
subtraction_9 = Subtraction(A=工字钢_b, B=工字钢_tw)
division_2 = Division(A=subtraction_9, B="2")
merge = Merge(Data1=pt, Data2=pt_2, Data3=pt_3, Data4=pt_5, Data5=pt_4)
pline = PolyLine(Vertices=merge, Closed=True)
division_3 = Division(A=division_2, B="2")
subtraction_10 = Subtraction(A=division_3, B=A_2)
subtraction_11 = Subtraction(A=division_3, B=钢埋板厚度_2)
neg_8 = Negative(Value=division_3)
subtraction_12 = Subtraction(A=neg_8, B=subtraction_11)
addition_6 = Addition(A=subtraction_12, B=B)
dom_4 = ConstructDomain(DomainStart=addition_6, DomainEnd=subtraction_12)
dom_5 = ConstructDomain(DomainStart=addition, DomainEnd=addition_2)
钢肋板倒角_侧视图 = Rectangle(Plane=PlaneXY(0, 0, 0), XSize=dom_4, YSize=dom_5, Radius=0)  # -> Rectangle, Length
subtraction_13 = Subtraction(A=subtraction_10, B=subtraction_11)
subtraction_14 = Subtraction(A=neg_8, B=subtraction_11)
dom_6 = ConstructDomain(DomainStart=subtraction_13, DomainEnd=subtraction_14)
钢肋板_侧视图 = Rectangle(Plane=PlaneXY(0, 0, 0), XSize=dom_6, YSize=dom_3, Radius=0)  # -> Rectangle, Length
merge_2 = Merge(Data1=钢肋板_侧视图.Rectangle, Data2=pline, Data3=钢肋板倒角_侧视图.Rectangle)
xz = XZPlane(Origin=Point(0, 0, 0))
mirror = Mirror(Geometry=merge_2, Plane=xz)  # -> Geometry, Transform
钢埋板_侧视图 = Rectangle(Plane=PlaneXY(0, 0, 0), XSize=dom_2, YSize=dom, Radius=0)  # -> Rectangle, Length
division_4 = Division(A=工字钢_b, B=2)
侧视图 = Entwine(Branch00=钢埋板_侧视图.Rectangle, Branch01=merge_2, Branch02=mirror.Geometry, FlattenInputs=True)
R = ClusterOutput(division_4)
division_5 = Division(A=工字钢_h, B="2")
subtraction_15 = Subtraction(A=division_5, B=工字钢_tf)
addition_7 = Addition(A=subtraction_15, B=Slider(200, range=0..1000))
addition_8 = Addition(A=addition_7, B=division_2)
X = UnitX(Factor=addition_8)
move = Move(Geometry=侧视图, Motion=X)  # -> Geometry, Transform
split_tree = SplitTree(Data=move.Geometry, Masks=flatten("{0;0}"))  # -> Positive, Negative
dispatch = Dispatch(List=split_tree.Negative, DispatchPattern=[True, False])  # -> flatten(ListA), ListB
merge_3 = Merge(Data1=split_tree.Positive, Data2=dispatch.ListA)
entwine = Entwine(Branch00=merge_3, Branch01=dispatch.ListB, FlattenInputs=True)
flatten = FlattenTree(Tree=entwine, Path="{0}")
group = Group(Objects=flatten)
rotate = Rotate(Geometry=group, Angle=3.141592654, Plane=PlaneXY(0, 0, 0))  # -> Geometry, Transform
boxprop = BoxProperties(Box=rotate.Geometry)  # -> Center, Diagonal, Area, Volume, Degeneracy
bbox = BoundingBox(Content=rotate.Geometry, Plane=PlaneXY(0, 0, 0))  # -> Box, Box_2
debox = DeconstructBox(Box=bbox.Box)  # -> Plane, X, Y, Z
pdecon = Deconstruct(Point=boxprop.Center)  # -> XComponent, YComponent, ZComponent
dedomain = DeconstructDomain(Domain=debox.Y)  # -> Start, End
pt_6 = ConstructPoint(XCoordinate=pdecon.XComponent, YCoordinate=dedomain.Start, ZCoordinate=pdecon.ZComponent)
xy = XYPlane(Origin=Point(0, 0, 0))
concat = Concatenate(FragmentA="Embed", FragmentB=tag_text)
pl_origin = PlaneOrigin(Base=xy, Origin=pt_6)
orient = Orient(Geometry=rotate.Geometry, Source=pl_origin, Target=xy)  # -> Geometry, Transform
xy_2 = XYPlane(Origin=Point(0, 0, 0))
attributes = DefineObjectAttributes(Color=embed_color)
ungroup = Ungroup(Group=orient.Geometry)
block = DefineBlock(Geometry=ungroup, Attributes=attributes, BlockName=concat, BasePlane=PlaneXY(0, 0, 0))
deblock = DeconstructBlock(Block=block)  # -> Name, flatten(Plane), flatten(Geometry)
group_2 = Group(Objects=deblock.Geometry)
bbox_2 = BoundingBox(Content=group_2, Plane=PlaneXY(0, 0, 0))  # -> Box, Box_2
deplane = DeconstructPlane(Plane=deblock.Plane)  # -> Origin, XAxis, YAxis, ZAxis
area = Area(Geometry=bbox_2.Box)  # -> Area, Centroid
move2pt = MoveToPoint(Geometry=flatten(deplane.Origin), PointA=flatten(deplane.Origin), PointB=flatten(area.Centroid))  # -> Moved, Vector, Transform
pl = ConstructPlane(Origin=move2pt.Moved, XAxis=deplane.YAxis, YAxis=deplane.XAxis)  # -> graft(Plane)
deplane_2 = DeconstructPlane(Plane=pl)  # -> Origin, XAxis, YAxis, ZAxis
rotate_2 = Rotate(Geometry=pl, Angle="Pi", Plane=pl)  # -> Geometry, Transform
dedomain_2 = DeconstructDomain(Domain=dom)  # -> Start, End
multiplication = Multiplication(A=dedomain_2.Start, B=dedomain_2.Start)
amp = Amplitude(Vector=deplane_2.YAxis, Amplitude=multiplication)
move_2 = Move(Geometry=deplane_2.Origin, Motion=amp)  # -> Geometry, Transform
srf = Surface(bbox_2.Box)
crv = Curve(srf)
ln = Line(StartPoint=move_2.Geometry, EndPoint=deplane_2.Origin)
ccx = CurveCurve(CurveA=ln, CurveB=crv)  # -> Points, ParamsA, ParamsB
ln_2 = Line(StartPoint=deplane_2.Origin, EndPoint=ccx.Points)
move_3 = Move(Geometry=rotate_2.Geometry, Motion=ln_2)  # -> Geometry, Transform

ln_3 = Line(StartPoint=ccx.Points, EndPoint=deplane_2.Origin)
amp_2 = Amplitude(Vector=ln_3, Amplitude=text_offset)
move_4 = Move(Geometry=rotate_2.Geometry, Motion=amp_2)  # -> Geometry, Transform
text = DefineTextObject(Text=tag_text, Plane=move_4.Geometry, DimensionStyle=dimension_style, OutputType="Text")
group_3 = Group(Objects=[block, text])

entwine_2 = Entwine(Branch00=group_3, Branch01=move_3.Geometry, FlattenInputs=True)
project = Project(Geometry=G, Plane=xy_2)  # -> Geometry, Transform
R_2 = ClusterOutput(entwine_2)
G_2 = ClusterOutput(project.Geometry)
